# Grasshopper definition Multi-Agent Assembly Algorithm.gh (Grasshopper 1.0.7)
# plug-ins: Heteroptera, ABxM.Grasshopper

# ----
# User Input
# agent count
# home count
number_slider = Slider(5, range=0..10)
ihomecount = Slider(3, range=1..4)

# ----
# To Run
trigger = Trigger(Interval=100, TimerInterval=100, Target=solver)  # disabled
toggle = BooleanToggle(True)

# ----
# Pre-set Parameter
# (keep them as they are for now)
number_slider_2 = Slider(1, range=1..100)
center = Center(Geometric=[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])  # -> Center, Dimension
structural_resolution = Panel("1")

# ----
# Multi-Agents, Multi-HomeBases
panel = Panel("")

# ----
# Pre-processing Geometry
ghpython_script = GhPythonScript(x=center.Center)  # -> out, a; inputs x: list of Point3d
# ---------- ghpython_script: Python ----------
import Rhino.Geometry as rg


for i in range(len(x)):
    x[i].Z = int(x[i].Z)
    
    
a = x
# ---------- end ghpython_script ----------
radians = Radians(Degrees=Slider(46, range=1..360))
convex_hull = ConvexHull(Points=ghpython_script.a, Plane=PlaneXY(0, 0, 0))  # -> Hull, HullZ, Indices
structural_resolution_2 = Number(structural_resolution)
pre_processing = CSharpScript(
    iDesignGeo=ghpython_script.a,
    iUnitLen=structural_resolution_2,
    iLayerHeight=number_slider_2,
    iArea=Slider(1, range=1..100),
    iAngle=radians,
    iHull=convex_hull.Hull)  # -> out, oStartPos, oWaitingPos, oAllCloud, oDesignGeo, oPByLayer, oSupports, oRaft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; inputs iDesignGeo: list of Point3d, iStartPos: Point3d, iUnitLen: Double, iLayerHeight: Double, iArea: Double, iAngle: Double, iHull: Curve
# ---------- pre_processing: C# usings ----------
using Rhino.Collections;
using System.Linq;
# ---------- pre_processing: C# ----------
    // remove duplicate points
    List<Point3d> uniquePts = RemoveDuplicatePoints(iDesignGeo);
    oDesignGeo = uniquePts;

    // group points by layer
    List<PointCloud> pointCloudByLayer = GroupPointsByLayer(uniquePts, iLayerHeight);
    oPByLayer = pointCloudByLayer;

    List<Point3d> pointsByLayer = new List<Point3d>();
    foreach (PointCloud pointCloud in pointCloudByLayer)
    {
      List<Point3d> pointList = pointCloud.GetPoints().ToList();
      pointsByLayer.AddRange(pointList);
    }



    // get basement
    List<Point3d> basePoints = pointCloudByLayer[0].GetPoints().ToList();
    basePoints = GetBase(iUnitLen, basePoints, iHull);
    oRaft = basePoints;

    // generate support
    var supportResults = GenerateSupport(iStartPos, iDesignGeo, pointCloudByLayer, iAngle, iLayerHeight, iArea, iUnitLen, basePoints);
    PointCloud allSupporPts = supportResults.Item1;
    Dictionary<Point3d, Point3d> bindP = supportResults.Item2;
    Dictionary<Point3d, List<Point3d>> bindL = supportResults.Item3;
    Dictionary<Point3d, Point3d> pToSp = supportResults.Item4;
    Dictionary<Point3d, List<Point3d>> spToP = supportResults.Item5;
    Dictionary<Point3d, List<Point3d>> spDic = supportResults.Item6;

    List<Point3d> supportPts = allSupporPts.GetPoints().ToList();
    oSupports = supportPts;
    oPToSp = pToSp;
    oSpToP = spToP;
    oSpDic = spDic;
    oBindP = bindP;
    oBindL = bindL;

    List<Point3d> allPts = new List<Point3d>();
    allPts.AddRange(iDesignGeo);
    allPts.AddRange(supportPts);
    allPts.AddRange(basePoints);
    oAllCloud = allPts;

    // DEBUGGING MESSAGE IN OUT
    foreach (var kvp1 in bindP)
    {
      Point3d ptA = kvp1.Key;
      Point3d ptB = kvp1.Value;
      Print("the point = " + allPts.IndexOf(ptA) + " needs the point = " + allPts.IndexOf(ptB) + " to be built first");
    }

    foreach (var kvp2 in bindL)
    {
      Point3d ptA = kvp2.Key;
      List<Point3d> ptB = kvp2.Value;
      List<int> ptBIndices = new List<int>();
      foreach (Point3d pt in ptB)
      {
        ptBIndices.Add(allPts.IndexOf(pt));
      }
      Print("the point = " + allPts.IndexOf(ptA) + " is the prerequisite to point list = [" + string.Join(",", ptBIndices) + "]");
    }
# ---------- pre_processing: C# additional code ----------
  public List<Point3d> RemoveDuplicatePoints(List<Point3d> points)
  {
    HashSet<Point3d> uniquePoints = new HashSet<Point3d>();
    foreach (Point3d pt in points)
    {
      if (!uniquePoints.Contains(pt))
      {
        uniquePoints.Add(pt);
      }
    }
    List<Point3d> finalPoints = new List<Point3d>(uniquePoints);

    return finalPoints;
  }

  public List<PointCloud> GroupPointsByLayer(List<Point3d> points, double layerHeight)
  {

    Dictionary<int, PointCloud> pointsByLayer = new Dictionary<int, PointCloud>();
    foreach (Point3d pt in points)
    {
      //int layerIndex = (int)Math.Floor(pt.Z / layerHeight);
      int layerIndex = (int)Math.Floor((pt.Z + Double.Epsilon) / layerHeight);

      if (!pointsByLayer.ContainsKey(layerIndex))
      {
        pointsByLayer[layerIndex] = new PointCloud();
      }
      pointsByLayer[layerIndex].Add(pt);
    }

    // sort dictionary by key
    List<int> layerIndices = pointsByLayer.Keys.ToList();
    layerIndices.Sort();

    List<PointCloud> pointsGroupByLayer = new List<PointCloud>();
    foreach (int layerIndex in layerIndices)
    {
      PointCloud thisLayer = pointsByLayer[layerIndex];
      pointsGroupByLayer.Add(thisLayer);

    }

    return pointsGroupByLayer;
  }

  public List<Point3d> GetBase(double unitLen, List<Point3d> pointList, Curve hull)
  {
    // get the first and last point of the boundary projection on the ground
    BoundingBox hullBox = hull.GetBoundingBox(Plane.WorldXY);
    Point3d firstPoint = hullBox.Min;
    Point3d lastPoint = hullBox.Max;
    double minX = firstPoint.X;
    double minY = firstPoint.Y;
    double maxX = lastPoint.X;
    double maxY = lastPoint.Y;
    // avoid mixing world coordinate with index
    int iStart = (int)Math.Floor(minX / unitLen);
    int iEnd = (int)Math.Floor((maxX) / unitLen);
    int jStart = (int)Math.Floor(minY / unitLen);
    int jEnd = (int)Math.Floor((maxY) / unitLen);


    // generate the grid points within the boundary projection
    // extract base points from the grid points
    List<Point3d> basePoints = new List<Point3d>();
    for (int i = iStart; i <= iEnd; i++)
    {
      for (int j = jStart; j <= jEnd; j++)
      {
        Point3d point = new Point3d(i * unitLen, j * unitLen, 0);

        bool isAlreadyExisting = pointList.Any(p => p.DistanceTo(point) < 1e-6);
        if (isAlreadyExisting) continue;

        PointContainment isWithinHull = hull.Contains(point, Plane.WorldXY, 0.1);
        if (isWithinHull == PointContainment.Outside || isWithinHull == PointContainment.Unset) continue;
        if (isWithinHull == PointContainment.Outside || isWithinHull == PointContainment.Unset) continue;

        basePoints.Add(point);
      }
    }

    return basePoints;
  }


  public Tuple<PointCloud, Dictionary<Point3d, Point3d>, Dictionary<Point3d, List<Point3d>>, Dictionary<Point3d, Point3d>, Dictionary<Point3d, List<Point3d>>, Dictionary<Point3d, List<Point3d>>> GenerateSupport(Point3d startPos, List<Point3d> designGeo, List<PointCloud> pointCloudByLayer, double iAngle, double layerHeight, double iArea, double unitLen, List<Point3d> basement)
  {
    // build necessary dictionaries
    Dictionary<Point3d, Point3d> bindP = new Dictionary<Point3d, Point3d>(); // bindP{A, B}-> B needs to be built before A
    Dictionary<Point3d, List<Point3d>> bindL = new Dictionary<Point3d, List<Point3d>>();
    Dictionary<Point3d, Point3d> pToSp = new Dictionary<Point3d, Point3d>(); // dictionary{A, B}-> pointA needs support pointB
    Dictionary<Point3d, List<Point3d>> spToP = new Dictionary<Point3d, List<Point3d>>();
    Dictionary<Point3d, List<Point3d>> spDic = new Dictionary<Point3d, List<Point3d>>();
    PointCloud allSupportPts = new PointCloud();

    // loop through points, detect who need support: no point underneath and overhang angle > iAngle (usually 45degree)
    for (int i = 1; i < pointCloudByLayer.Count; i++)
    {
      List<Point3d> pointListThisFloor = pointCloudByLayer[i].GetPoints().ToList();
      if (pointCloudByLayer[i - 1].Count == 0) continue; // defensive code
      List<Point3d> pointListLowerFloor = pointCloudByLayer[i - 1].GetPoints().ToList();
      Point3dList pointsWithSupports = new Point3dList();

      foreach (Point3d pt in pointListThisFloor)
      {
        // found a closest point in the lower layer
        Point3d ptOnLowerFloor = new Point3d(pt.X, pt.Y, pt.Z - layerHeight);  // projected point on the lower floor
        Point3d closestPt = new Point3d();
        // this line is not good, because you Only consider support/binding if there is a point exactly below -- bool isClosestFound = pointListLowerFloor.Any(pt => pt.DistanceTo(ptOnLowerFloor) < 1e-6);
        // however, in real slicing, A point can be supported by an offset point, and Support decision depends on distance + angle, not exact XY match
        // instead, you should always find the closest lower-layer point, even if offset.
        var closestPtSearchResult = FindClosestPoint(pt, pointListLowerFloor);
        bool isClosestFound = closestPtSearchResult.Item1;
        bool needSupport = false;
        bool shouldBind = false;

        // decide if a support is NEEDED or if it should be binded
        if (isClosestFound)
        {
          double offsetDist = 0.1;
          closestPt = closestPtSearchResult.Item2;
          double dist = closestPt.DistanceTo(ptOnLowerFloor);
          // calculate overhang angle
          double overhangAngle = CalculateOverhangAngle(pt, closestPt);

          if (dist > offsetDist && overhangAngle > iAngle) needSupport = true;
          if (dist <= offsetDist) shouldBind = true;
        }

        // decide if a support SHOULD be built --if shared, no need to build, otherwise, build it
        if (needSupport)
        {
          // check if there's supports this pt can share
          bool isSharedSupportAvailable = false;
          Point3d closestPtWithSupport = new Point3d(); // find the closest point on the same layer, which has support already

          if (pointsWithSupports.Count != 0)
          {
            int closestIndex = pointsWithSupports.ClosestIndex(pt);
            if (closestIndex < 0) // defensive code
            {
              isSharedSupportAvailable = false;
            }
            else
            {
              closestPtWithSupport = pointsWithSupports[closestIndex];
              double dist = pt.DistanceTo(closestPtWithSupport); // distance from pt to the closest point with supports already
              if (dist <= iArea)
              {
                isSharedSupportAvailable = true;
              }
            }
          }

          // if shared support available, record it to pToSp and spToP; otherwise, build a support
          if (isSharedSupportAvailable)
          {
            Point3d sharedSupportPt = pToSp[closestPtWithSupport];
            pToSp[pt] = sharedSupportPt; // shared support

            if (!spToP.ContainsKey(sharedSupportPt))
            {
              spToP[sharedSupportPt] = new List<Point3d>();
              spToP[sharedSupportPt].Add(closestPtWithSupport);
            }
            spToP[sharedSupportPt].Add(pt);
          }
          else // otherwise, build a support and grow a support column from the support top
          {
            pointsWithSupports.Add(pt);
            pToSp.Add(pt, ptOnLowerFloor);
            if (!spToP.ContainsKey(ptOnLowerFloor))
            {
              spToP[ptOnLowerFloor] = new List<Point3d>();
            }
            spToP[ptOnLowerFloor].Add(pt);

            // build support column downwards
            List<Point3d> supportCol = GrowSupportColDownwards(pt, basement, designGeo, layerHeight, i);

            // add the support column to spDic
            if (supportCol.Count == 0) // defensive code
            {
              continue; // No valid support column can be built → skip this support
            }
            Point3d supportTop = supportCol[0];
            if (!spDic.ContainsKey(supportTop))
            {
              spDic[supportTop] = new List<Point3d>();
            }
            spDic[supportTop] = supportCol;
            allSupportPts.AddRange(supportCol); //PointCloud.AddRange(list of point3d)--> still result in flat pointcloud
          }
        }

        // if no support is needed and should be bound:
        if (shouldBind)
        {
          // if (!isClosestFound) continue; redundant check--if shouldBind is true, isClosestFound is true already
          if (closestPt == startPos) continue; // do not include startPos, because startPos does not need to build

          bindP.Add(pt, closestPt); // then find the structural point underneath, add to bindP and bindL
          if (!bindL.ContainsKey(closestPt))
          {
            bindL[closestPt] = new List<Point3d>(); // must intialize it before adding an item to the list
          }
          bindL[closestPt].Add(pt);
        }

      }
    }
    return Tuple.Create(allSupportPts, bindP, bindL, pToSp, spToP, spDic);

  }

  public Tuple<bool, Point3d> FindClosestPoint(Point3d testPoint, List<Point3d> pointList)
  {
    double minDist = double.MaxValue;
    bool success = false;
    Point3d closestPt = new Point3d();
    List<Point3d> closestPoints = new List<Point3d>();
    foreach (Point3d p in pointList)
    {
      double dist = p.DistanceTo(testPoint);
      if (dist < minDist)
      {
        minDist = dist;
        closestPoints.Clear(); // to replace previous points, you need to first clear the list
        closestPoints.Add(p);
      }
      else if (Math.Abs(dist - minDist) < 1e-10) // use tolerance
      {
        closestPoints.Add(p);
      }
    }

    if (closestPoints.Count == 0)
    {
      success = false;
    }
    else
    {
      success = true;
      closestPt = closestPoints[0];
    }
    return Tuple.Create(success, closestPt); // C# tuple is <>, accessing Tuple using Tuple.Item1
  }

  public double CalculateOverhangAngle(Point3d pt, Point3d closestPt)
  {
    // pt is the point on the higher layer, closestPt is the closest point to the pt projected in the lower layer point list
    Point3d tempPt = new Point3d(pt.X, pt.Y, closestPt.Z);
    Vector3d horizontalVect = tempPt - closestPt;
    Vector3d closestPtToPt = pt - closestPt;
    double overhangAngle = 0;
    if (!horizontalVect.IsZero)
    {
      overhangAngle = Math.PI * 0.5 - Vector3d.VectorAngle(horizontalVect, closestPtToPt);
    }
    return overhangAngle;
  }

  public List<Point3d> GrowSupportColDownwards(Point3d point, List<Point3d> basement, List<Point3d> iDesignGeo, double layerHeight, int currentLayerIndex)
  {
    List<Point3d> supportColumn = new List<Point3d>();
    var basementResult = FindClosestPoint(point, basement);
    if (!basementResult.Item1) return new List<Point3d>();  // Return empty list;
    Point3d closestPtonBase = basementResult.Item2;

    for (int j = currentLayerIndex - 1; j >= 0; j--)
    {
      Point3d supportP = new Point3d(point.X, point.Y, layerHeight * j);
      // check if the supportP is gonna collide with the existing geo, if no, then grow it.
      bool collideGeo = iDesignGeo.Any(p => p.DistanceTo(supportP) < 1e-6);
      bool onBase = basement.Any(p => p.DistanceTo(supportP) < 1e-6);

      if ((!collideGeo) && (!onBase))
      {
        supportColumn.Add(supportP);
      }
      else break;

    }

    return supportColumn;
  }






  // BUILD ADJACENCY MAP
  // Build RTree ONCE for all neighbor searches
  public RTree CreateNewRTree(List<Point3d> pts)
  {
    RTree rTree = new RTree();
    for (int i = 0; i < pts.Count; i++)
    {
      rTree.Insert(pts[i], i);
    }
    return rTree;
  }


  // find neighbors for a particular point
  public List<int> FindNeighbors(int pointIndex, RTree rTree, List<Point3d> allCloud, double structuralResolution)
  {
    Point3d needlePt = allCloud[pointIndex];
    List<int> myNeighborIndices = new List<int>();
    Sphere boundingBox = new Sphere(needlePt, structuralResolution);
    rTree.Search(boundingBox, (sender, args) =>
      {
        if (args.Id != pointIndex) // Don't include self as neighbor
          myNeighborIndices.Add(args.Id);
      });

    return myNeighborIndices;
  }


  //------------------------------------------SUPPORTING CLASS FOR HOMEBASE-----------------------------------

  public class HomeBaseData
  {
    // static state data
    public Point3d HomeBasePt; // the list of these home base points
    public Point3d MaterialPickUpPt; // the list of the material pick up locations for each home base
    public Vector3d MaterialPickUpDir; // the list of the material pick up directions at each home base
    public Point3d FirstWaitingSpot; // the waiting line for agents who exit the field, [0] = first waiting spot, [1] = second, etc.
    public Vector3d WaitingDir;

    // dynamic state -chagnes as agents arrive/leave
    public int OccupyingAgentId; // -1 if the home base is free
    public Queue<int> WaitingQueue; // agent IDs waiting in line, in order
    public HomeBaseData(Point3d homeBasePt, Point3d materialPickUpPt, Vector3d materialPickUpDir, Point3d firstWaitingSpot, Vector3d waitingDir)
    {
      this.HomeBasePt = homeBasePt;
      this.MaterialPickUpPt = materialPickUpPt;
      this.MaterialPickUpDir = materialPickUpDir;
      this.FirstWaitingSpot = firstWaitingSpot;
      this.WaitingDir = waitingDir;
      this.OccupyingAgentId = -1;
      this.WaitingQueue = new Queue<int>();
    }

    public bool IsOccupied()
    {
      if (OccupyingAgentId != -1)
      {
        return true;
      }
      else
      {
        return false;
      }
    }

    public Point3d GetWaitingSpotFor(int agentID)
    {
      // returns which physical spot this agent should stand at
      int waitingLineIndex = 0;
      for (int i = 0; i < WaitingQueue.Count; i++)
      {
        int id = WaitingQueue.ElementAt(i);
        if (id == agentID)
        {
          Point3d waitingSpot = HomeBasePt + WaitingDir * (i + 1);
          return waitingSpot;
        }
        waitingLineIndex++;
        if (waitingLineIndex >= WaitingQueue.Count) break;
      }
      // overflow to last spot
      Point3d lastAvailbleSpot = HomeBasePt + WaitingDir * (WaitingQueue.Count + 1);
      return lastAvailbleSpot;
    }
  }
# ---------- end pre_processing ----------
geo = Geometry(pre_processing.oAllCloud)
selecthomes = CSharpScript(
    iDesignGeo=pre_processing.oDesignGeo,
    iRaft=pre_processing.oRaft,
    ihomeCount=ihomecount,
    iStructuralResolution=structural_resolution_2)  # -> out, oSelectedHomeBases, oSelectedMaterialPickBases, oSelectedMaterialPickUpDir, oSelectedFirstWaitingSpot, oSelectedWaitingDir, oAllHomeBases, oAllMaterialPickUpBases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; inputs iDesignGeo: list of Point3d, iRaft: list of Point3d, ihomeCount: Int32, iStructuralResolution: Double
# ---------- selecthomes: C# usings ----------
using System.Linq;
# ---------- selecthomes: C# ----------
    List<Point3d> allPtsOnGround = FilterOutPointsOnGround(iDesignGeo, iRaft);
    Dictionary<Point3d, HomeBaseData> homeBaseDic = GenerateHomeBases(allPtsOnGround, iStructuralResolution);
    Print("avaialbel home bases = " + homeBaseDic.Count);

    List<Point3d> homeBases = new List<Point3d>();
    List<Point3d> materialBases = new List<Point3d>();
    List<Vector3d> materialDir = new List<Vector3d>();
    List<Point3d> waitingLines = new List<Point3d>();
    List<Vector3d> waitingDir = new List<Vector3d>();
    foreach (var kvp in homeBaseDic)
    {
      Point3d homeBase = kvp.Key;
      HomeBaseData homeData = kvp.Value;
      homeBases.Add(homeBase);
      materialBases.Add(homeData.MaterialPickUpPt);
      materialDir.Add(homeData.MaterialPickUpDir);
      waitingLines.Add(homeData.FirstWaitingSpot);
      waitingDir.Add(homeData.WaitingDir);
      Print("home base = " + homeBase + ", material base = " + homeData.MaterialPickUpPt + ", material dir = " + homeData.MaterialPickUpDir + ", first waiting spot = " + homeData.FirstWaitingSpot + ", waiting dir = " + homeData.WaitingDir);
      Print("occupied by agentID = " + homeData.OccupyingAgentId + ", waiting queue = " + homeData.WaitingQueue.Count);
    }
    oAllHomeBases = homeBases;
    oAllMaterialPickUpBases = materialBases;
    oAllMaterialPickDirs = materialDir;
    oAllWaitingBases = waitingLines;
    oAllEnterTheFieldDirs = waitingDir;


    HashSet<int> randomIndices = new HashSet<int>();
    int counter = 0;
    if (ihomeCount < homeBases.Count)
    {
      while (counter < ihomeCount)
      {
        int randomIndex = random.Next(0, homeBases.Count);
        if (randomIndices.Contains(randomIndex)) continue;
        randomIndices.Add(randomIndex);
        Print("the index = " + randomIndex + " is added to randomIndices");
        counter++;
      }

    }
    else
    {
      while (counter < homeBases.Count)
      {
        int randomIndex = random.Next(0, homeBases.Count);
        if (randomIndices.Contains(randomIndex)) continue;
        randomIndices.Add(randomIndex);
        Print("the index = " + randomIndex + " is added to randomIndices");
        counter++;
      }
    }

    Print("the randomIndices Count = " + randomIndices.Count);
    Print("the randomIndices at index = " + randomIndices.ElementAt(0));

    List<Point3d> selectedHomeBases = new List<Point3d>();
    List<Point3d> selectedMaterialPickUpBases = new List<Point3d>(); // the position where material shall be stored corresponding to different home index
    List<Point3d> selectedFirstWaitingSpots = new List<Point3d>(); // the first waiting spot in waiting line of the cooresponding home index when agent is outside the field
    List<Vector3d> selectedMaterialPickUpDir = new List<Vector3d>(); // the dir when agent is to pick up a new material at the material pick up base
    List<Vector3d> selectedWaitingDir = new List<Vector3d>(); // the waiting dir when agent is outside the field
    for (int i = 0; i < randomIndices.Count; i++)
    {
      int index = randomIndices.ElementAt(i);
      Point3d homePt = homeBases[index];
      Point3d materialPickUpPt = materialBases[index];
      Vector3d materialPickUpDir = materialDir[index];
      Point3d firstWaitingPt = waitingLines[index];
      Vector3d waitingOrientation = waitingDir[index];
      selectedHomeBases.Add(homePt);
      selectedMaterialPickUpBases.Add(materialPickUpPt);
      selectedMaterialPickUpDir.Add(materialPickUpDir);
      selectedFirstWaitingSpots.Add(firstWaitingPt);
      selectedWaitingDir.Add(waitingOrientation);
    }
    oSelectedHomeBases = selectedHomeBases;
    oSelectedMaterialPickBases = selectedMaterialPickUpBases;
    oSelectedMaterialPickUpDir = selectedMaterialPickUpDir;
    oSelectedWaitingDir = selectedWaitingDir;
    oSelectedFirstWaitingSpot = selectedFirstWaitingSpots;
# ---------- selecthomes: C# additional code ----------
  Random random = new Random(30);



  private List<Point3d> FilterOutPointsOnGround(List<Point3d> designGeo, List<Point3d> raftPts)
  {
    List<Point3d> designWithRaft = new List<Point3d>();
    designWithRaft.AddRange(designGeo);
    designWithRaft.AddRange(raftPts);

    List<Point3d> orderedPtsByZ = new List<Point3d>();
    orderedPtsByZ = designWithRaft.OrderBy(pt => pt.Z).ToList();
    RhinoApp.WriteLine("the total number of points (designWithRaft " + orderedPtsByZ.Count);

    double smallestZ = double.MinValue;
    if (orderedPtsByZ != null && orderedPtsByZ.Count > 0)
    {
      smallestZ = orderedPtsByZ[0].Z;
    }
    else
    {
      return new List<Point3d>();
    }

    List<Point3d> baseDesignPts = new List<Point3d>();
    foreach (Point3d pt in designWithRaft)
    {
      double thisZ = pt.Z;
      double diff = Math.Abs(smallestZ - thisZ);
      if (diff < 0.1)
      {
        baseDesignPts.Add(pt);
      }
    }

    if (baseDesignPts == null || baseDesignPts.Count == 0) { return new List<Point3d>(); }

    return baseDesignPts;
  }


  private Dictionary<Point3d, HomeBaseData> GenerateHomeBases(List<Point3d> allPtsOnGround, double structuralResolution)
  {

    Dictionary<Point3d, HomeBaseData> selectedHomeBase = new Dictionary<Point3d, HomeBaseData>();

    Print("Running GenerateHomeBase()...The number of base points to be considered for home bases are " + allPtsOnGround.Count);

    List<Point3d> baseDesignPts = allPtsOnGround;

    // find the neighbors of each base design pt
    Dictionary<int, List<int>> adjacencyMap = new Dictionary<int, List<int>>();
    RTree rTree = CreateNewRTreeFromPoints(baseDesignPts);
    for (int i = 0; i < baseDesignPts.Count; i++)
    {
      Point3d point = baseDesignPts[i];
      List<int> myNeighbors = FindNeighborsInPointList(i, rTree, baseDesignPts, structuralResolution);
      adjacencyMap[i] = myNeighbors;
    }

    // filter the ones who has no more than 2 neighbors, so that only pick the ones who can have space for material storage and waiting area
    adjacencyMap = adjacencyMap.Where(kvp => kvp.Value.Count <= 2).ToDictionary(kvp => kvp.Key, kvp => kvp.Value);
    foreach (var kvp in adjacencyMap)
    {
      int pointIndex = kvp.Key;
      Point3d homePt = baseDesignPts[pointIndex];
      List<int> neighborIndices = kvp.Value;
      Print("adjacencyMap DEBUG:");
      Print("for home index = " + pointIndex + ": has neighbor indices = [" + string.Join(", ", neighborIndices) + "]");
      // skip it has more than 2 neighbors, it means it does not have 2 other areas for material pick and waiting line
      if (neighborIndices.Count > 2) continue;

      Point3d neighborA = homePt + Vector3d.XAxis;
      Point3d neighborB = homePt - Vector3d.XAxis;
      Point3d neighborC = homePt + Vector3d.YAxis;
      Point3d neighborD = homePt - Vector3d.YAxis;
      List<Point3d> allNeighbors = new List<Point3d> { neighborA, neighborB, neighborC, neighborD }; // including neighbor pt that are not in the intput point list

      List<Point3d> realNeighbors = new List<Point3d>();
      foreach (int i in neighborIndices)
      {
        Point3d neighborPt = baseDesignPts[i];
        realNeighbors.Add(neighborPt);
      }

      List<Point3d> areasForMaterialAndWaiting = new List<Point3d>();
      foreach (Point3d candidate in allNeighbors)
      {
        // ✅ tolerance-based comparison instead of exact Contains()
        bool isRealNeighbor = false;
        foreach (Point3d realNeighbor in realNeighbors)
        {
          if (candidate.DistanceTo(realNeighbor) < 0.1)
          {
            isRealNeighbor = true;
            break;
          }
        }

        if (!isRealNeighbor)
        {
          areasForMaterialAndWaiting.Add(candidate);
        }
      }

      if (areasForMaterialAndWaiting.Count < 2) continue;

      Point3d materialPickPt = areasForMaterialAndWaiting[0];
      Vector3d materialPickUpDir = materialPickPt - homePt;
      Point3d firstWaitingPt = areasForMaterialAndWaiting[1];
      Vector3d EnterTheFieldDir = homePt - firstWaitingPt;

      if (!selectedHomeBase.ContainsKey(homePt) || selectedHomeBase[homePt] == null)
      {
        selectedHomeBase[homePt] = new HomeBaseData(homePt, materialPickPt, materialPickUpDir, firstWaitingPt, EnterTheFieldDir);

      }

    }
    return selectedHomeBase;
  }

  public Dictionary<int, HomeBaseData> ConvertHomeBaseData1(Dictionary<Point3d, HomeBaseData> selectedHomes, PointCloud allCloud, double structuralResolution)
  {
    Dictionary<int, HomeBaseData> outDic = new Dictionary<int, HomeBaseData>();
    foreach (var home in selectedHomes)
    {
      Point3d homeBase = home.Key;
      HomeBaseData homeData = home.Value;
      int homeIndex = allCloud.ClosestPoint(homeBase);
      if (!outDic.ContainsKey(homeIndex))
      {
        outDic.Add(homeIndex, homeData);
      }

    }
    return outDic;
  }


  // BUILD ADJACENCY MAP
  // Build RTree ONCE for all neighbor searches
  public RTree CreateNewRTreeFromPoints(List<Point3d> pts)
  {
    RTree rTree = new RTree();
    for (int i = 0; i < pts.Count; i++)
      rTree.Insert(pts[i], i);
    return rTree;
  }

  // find neighbors for a particular point
  public List<int> FindNeighborsInPointList(int pointIndex, RTree rTree, List<Point3d> pts, double structuralResolution)
  {
    Point3d needlePt = pts[pointIndex];
    List<int> myNeighborIndices = new List<int>();

    // ✅ use 1.1x radius to avoid boundary exclusion at exact distance
    double searchRadius = structuralResolution * 1.1;
    Sphere boundingBox = new Sphere(needlePt, searchRadius);

    rTree.Search(boundingBox, (sender, args) =>
      {
        if (args.Id != pointIndex)
        {
          // ✅ secondary check: only accept points within structuralResolution
          double dist = needlePt.DistanceTo(pts[args.Id]);
          if (dist <= structuralResolution + 0.01)
            myNeighborIndices.Add(args.Id);
        }
      });
    return myNeighborIndices;
  }


  public RTree CreateNewRTreeFromPointCloud(PointCloud allCloud)
  {
    RTree rTree = new RTree();
    for (int i = 0; i < allCloud.Count; i++)
    {
      rTree.Insert(allCloud[i].Location, i);
    }
    return rTree;
  }

  public List<int> FindNeighborsInPointCloud(int pointIndex, RTree rTree, PointCloud allCloud, double structuralResolution)
  {
    Point3d needlePt = allCloud[pointIndex].Location;
    List<int> myNeighborIndices = new List<int>();
    Sphere boundingBox = new Sphere(needlePt, structuralResolution);
    rTree.Search(boundingBox, (sender, args) =>
      {
        if (args.Id != pointIndex) // Don't include self as neighbor
          myNeighborIndices.Add(args.Id);
      });

    return myNeighborIndices;
  }



  //------------------------------------------SUPPORTING CLASS FOR HOMEBASE-----------------------------------

  public class HomeBaseData
  {
    // static state data
    public Point3d HomeBasePt; // the list of these home base points
    public Point3d MaterialPickUpPt; // the list of the material pick up locations for each home base
    public Vector3d MaterialPickUpDir; // the list of the material pick up directions at each home base
    public Point3d FirstWaitingSpot; // the waiting line for agents who exit the field, [0] = first waiting spot, [1] = second, etc.
    public Vector3d WaitingDir;

    // dynamic state -chagnes as agents arrive/leave
    public int OccupyingAgentId; // -1 if the home base is free
    public Queue<int> WaitingQueue; // agent IDs waiting in line, in order
    public HomeBaseData(Point3d homeBasePt, Point3d materialPickUpPt, Vector3d materialPickUpDir, Point3d firstWaitingSpot, Vector3d waitingDir)
    {
      this.HomeBasePt = homeBasePt;
      this.MaterialPickUpPt = materialPickUpPt;
      this.MaterialPickUpDir = materialPickUpDir;
      this.FirstWaitingSpot = firstWaitingSpot;
      this.WaitingDir = waitingDir;
      if (waitingDir.Length > 1e-6)
      {
        waitingDir.Unitize();
      }
      this.OccupyingAgentId = -1;
      this.WaitingQueue = new Queue<int>();
    }

    public bool IsOccupied()
    {
      if (OccupyingAgentId != -1)
      {
        return true;
      }
      else
      {
        return false;
      }
    }

    public Point3d GetWaitingSpotFor(int agentId)
    {
      // returns which physical spot this agent should stand at
      if (WaitingQueue.Count == 0) return WaitingDir + HomeBasePt;

      int waitingLineIndex = 0;
      for (int i = 0; i < WaitingQueue.Count; i++)
      {
        int id = WaitingQueue.ElementAt(i);
        if (id == agentId)
        {
          Point3d waitingSpot = (-1) * WaitingDir * (i + 1) + HomeBasePt;
          return waitingSpot;
        }
        waitingLineIndex++;
        if (waitingLineIndex >= WaitingQueue.Count) break;
      }
      // overflow to last spot
      Point3d lastAvailbleSpot = WaitingDir * (WaitingQueue.Count + 1) + HomeBasePt;
      return lastAvailbleSpot;
    }
  }
# ---------- end selecthomes ----------
points = PointList(Points=geo, Size=0.3)
pt = Point(selecthomes.oSelectedHomeBases)
vdis = VectorDisplay(Anchor=selecthomes.oAllHomeBases, Vector=selecthomes.oAllMaterialPickDirs)
vdis_2 = VectorDisplay(Anchor=selecthomes.oAllWaitingBases, Vector=selecthomes.oAllEnterTheFieldDirs)

# ----
# Raft zoning assignment - visualization
panel_3 = Panel("""0
1""")
item = ListItem(List=selecthomes.oAllHomeBases, Index=panel_3, Wrap=True)
raft_zoning = CSharpScript(iDesignGeo=pre_processing.oDesignGeo, iSupports=pre_processing.oSupports, iRaft=pre_processing.oRaft, iHomes=item)  # -> out, oRaftZoning; inputs iDesignGeo: list of Point3d, iSupports: list of Point3d, iRaft: list of Point3d, iHomes: list of Point3d
# ---------- raft_zoning: C# ----------
    PointCloud allCloud = new PointCloud();
    allCloud.AddRange(iDesignGeo);
    allCloud.AddRange(iSupports);
    allCloud.AddRange(iRaft);

    Dictionary<int, List<int>> adjacencyMap = new Dictionary<int, List<int>>();
    RTree rTree = CreateNewRTreeFromPointCloud(allCloud);
    for (int i = 0; i < allCloud.Count; i++)
    {
      Point3d point = allCloud[i].Location;
      List<int> myNeighbors = FindNeighborsInPointCloud(i, rTree, allCloud, 1);
      adjacencyMap[i] = myNeighbors;
    }



    HashSet<Point3d> raftSet = new HashSet<Point3d>(iRaft);
    List<int> raftIndices = new List<int>();
    foreach (Point3d pt in raftSet)
    {
      int index = ComputeCorrectPointIndex(pt, allCloud);
      raftIndices.Add(index);
    }

    List<int> homeBaseIndices = new List<int>();
    foreach(Point3d home in iHomes){
      int homeIndex = ComputeCorrectPointIndex(home, allCloud);
      homeBaseIndices.Add(homeIndex);
    }

    Dictionary<int, int> raftZones = AssignRaftZones(allCloud, raftIndices, homeBaseIndices, adjacencyMap);

    List<List<int>> homeToRafts = new List<List<int>>();
    foreach(int homeIndex in homeBaseIndices){
      List < int> thisHomeRafts = new List<int>();
      foreach(var kvp in raftZones){
        int raftIndex = kvp.Key;
        int homeRaftBelongs = kvp.Value;
        if (homeRaftBelongs == homeIndex){
          thisHomeRafts.Add(raftIndex);
        }
      }
      homeToRafts.Add(thisHomeRafts);
    }



    oRaftZoning = NestedListToTree(homeToRafts);
# ---------- raft_zoning: C# additional code ----------
  private DataTree<T> NestedListToTree<T>(List<List<T>> nestedList){
  DataTree<T> tree = new DataTree<T>();
  int i = 0;
  foreach(List<T> innerList in nestedList){
tree.AddRange(innerList, new GH_Path(new int[]{0,i}));
           i++;
       }
   return tree;
}

private Dictionary<int, int> AssignRaftZones(PointCloud allCloud, List<int> rafts, List<int> homeIndices, Dictionary<int, List<int>> adjacencyMap)
{
  // map each raft index to the home index it belongs to
  Dictionary<int, int> raftZones = new Dictionary<int, int>();

  foreach (int raft in rafts)
  {
    Point3d raftPos = allCloud[raft].Location;

    // assign to nearest home by ground-level BFS distance
    // not Euclidean distance, but actual traverssal distance
    int nearestHome = -1;
    int shortestPath = int.MaxValue;
    HashSet<int> blocked = new HashSet<int>(); // nothing blocked yet
    foreach (int home in homeIndices)
    {
      int pathLength = GetBFSDistance(home, raft, blocked, allCloud, adjacencyMap);
      if (pathLength >= 0 && pathLength < shortestPath)
      {
        shortestPath = pathLength;
        nearestHome = home;
      }
    }

    if (nearestHome >= 0)
    {
      raftZones[raft] = nearestHome;
    }
  }

  return raftZones;
}


private int GetBFSDistance(int startIndex, int endIndex, HashSet<int> blocked, PointCloud allCloud, Dictionary<int, List<int>> adjacencyMap)
{
  if (startIndex == endIndex) return 0;

  double groundZ = allCloud[startIndex].Location.Z;
  double tolerance = 0.1;

  Queue<int> queue = new Queue<int>();
  Dictionary<int, int> dist = new Dictionary<int, int>();
  queue.Enqueue(startIndex);
  dist[startIndex] = 0;

  while (queue.Count > 0)
  {
    int current = queue.Dequeue();
    if (current == endIndex) return dist[current];

    if (!adjacencyMap.ContainsKey(current)) continue;
    foreach (int neighbor in adjacencyMap[current])
    {
      if (dist.ContainsKey(neighbor)) continue;
      if (blocked.Contains(neighbor)) continue;
      //if (buildStates[neighbor] != BuildState.Deployed) continue;
      double nz = allCloud[neighbor].Location.Z;
      if (Math.Abs(nz - groundZ) > tolerance) continue;
      dist[neighbor] = dist[current] + 1;
      queue.Enqueue(neighbor);
    }
  }

  return -1; // unreachable
}


private int ComputeCorrectPointIndex(Point3d testPt, PointCloud allCloud)
{
  int tentativeIndex = allCloud.ClosestPoint(testPt);

  if (tentativeIndex < 0) return tentativeIndex;
  // to verify whether tentativeIndex is the correct index for the testPt
  // the reason to verify is that PointCloud.ClosestPoint() returns -1 only when the pointcloud is empty
  double tolerance = 0.1;
  Point3d pointInCloud = allCloud[tentativeIndex].Location;
  double dist = pointInCloud.DistanceTo(testPt);
  if (dist < tolerance)
  {
    return tentativeIndex;
  }
  else
  {
    return -1;
  }
}



public RTree CreateNewRTreeFromPointCloud(PointCloud allCloud)
{
  RTree rTree = new RTree();
  for (int i = 0; i < allCloud.Count; i++)
  {
    rTree.Insert(allCloud[i].Location, i);
  }
  return rTree;
}

public RTree CreateNewRTreeFromPoints(List<Point3d> pts)
{
  RTree rTree = new RTree();
  for (int i = 0; i < pts.Count; i++)
    rTree.Insert(pts[i], i);
  return rTree;
}


  // find neighbors for a particular point
public List<int> FindNeighborsInPointCloud(int pointIndex, RTree rTree, PointCloud allCloud, double structuralResolution)
{
  // RTree rTree = new RTree(); // this is just to create an empty RTree, with an empty rTree, you cannot use PointCloudClosestPoint() method
  // move -create a new RTree- to persistent data
  Point3d needlePt = allCloud[pointIndex].Location;
  List<int> myNeighborIndices = new List<int>();
  Sphere boundingBox = new Sphere(needlePt, structuralResolution);
  rTree.Search(boundingBox, (sender, args) =>
    {
    if (args.Id != pointIndex) // Don't include self as neighbor
      myNeighborIndices.Add(args.Id);
    });

  return myNeighborIndices;
}

public List<int> FindNeighborsInPointList(int pointIndex, RTree rTree, List<Point3d> pts, double structuralResolution)
{
  Point3d needlePt = pts[pointIndex];
  List<int> myNeighborIndices = new List<int>();

  // ✅ use 1.1x radius to avoid boundary exclusion at exact distance
  double searchRadius = structuralResolution * 1.1;
  Sphere boundingBox = new Sphere(needlePt, searchRadius);

  rTree.Search(boundingBox, (sender, args) =>
    {
    if (args.Id != pointIndex)
    {
      // ✅ secondary check: only accept points within structuralResolution
      double dist = needlePt.DistanceTo(pts[args.Id]);
      if (dist <= structuralResolution + 0.01)
        myNeighborIndices.Add(args.Id);
    }
    });
  return myNeighborIndices;
}

public RTree CreateNewRTree2(List<int> pointIndices, PointCloud allCloud)
{
  RTree rTree = new RTree();
  for (int i = 0; i < pointIndices.Count; i++)
  {
    rTree.Insert(allCloud[pointIndices[i]].Location, pointIndices[i]);
  }
  return rTree;
}

  // find neighbors for a list of points
  // only need to call this method once and then adjacencyMap can be stored in the custom data. The results of neighborhood is persistent, regardless things changes during simulation
public Tuple<List<List<int>>, Dictionary<int, List<int>>> FindNeighbors2(List<int> pointIndices, RTree rTree, PointCloud allCloud, double structuralResolution)
{
  List<List<int>> neighborIndices = new List<List<int>>();
  Dictionary<int, List<int>> adjancencyMap = new Dictionary<int, List<int>>();

  for (int i = 0; i < pointIndices.Count; i++)
  {
    //RTree rTree = CreateNewRTree2(pointIndices, allCloud); // you SHOULD NOT create rTree for every point in every iteration
    List<int> myNeighborIndices = new List<int>();
    Point3d needlePt = allCloud[pointIndices[i]].Location;
    Sphere boundingBox = new Sphere(needlePt, structuralResolution);
    rTree.Search(boundingBox, (sender, args) =>
      {
      if (args.Id != pointIndices[i]) // Don't include self as neighbor
        myNeighborIndices.Add(args.Id);
      });

    adjancencyMap[i] = myNeighborIndices;
    neighborIndices.Add(myNeighborIndices);
  }

  return Tuple.Create(neighborIndices, adjancencyMap);
}
# ---------- end raft_zoning ----------
bang = ExplodeTree(Data=raft_zoning.oRaftZoning)  # -> Branch0, Branch1
num = Number(bang.Branch1)
item_2 = ListItem(List=pre_processing.oAllCloud, Index=num, Wrap=True)

# ----
# Multi-Agent Assembly Algorithm
toggle_2 = BooleanToggle(False)
assembly_behavior = CSharpScript(
    iDebugMode=toggle_2,
    Reference="C:\Users\siennasun513\AppData\Roaming\McNeel\Rhinoceros\packages\7.0\ABxM-Core\1.7.0\ABxM.Core.dll")  # -> out, oBehavior; inputs iDebugMode: Boolean
# ---------- assembly_behavior: C# usings ----------
using ABxM.Core.Agent;
using ABxM.Core.AgentSystem;
using ABxM.Core.Behavior;
using ABxM.Core.Environments;
using System.Linq;
# ---------- assembly_behavior: C# ----------
    behavior.SetDebugMode(iDebugMode);
    oBehavior = behavior;
# ---------- assembly_behavior: C# additional code ----------
  AssemblyBehavior behavior = new AssemblyBehavior();

  // --------------------------------PERSISTENT DATA --------------------------------
  // static storage for agent movement status
  private static Dictionary<int, Dictionary<string, object>> persistentAgentData = new Dictionary<int, Dictionary<string, object>>();

  // track when system resets
  private static long lastResetTick = 0;



  // --------------------------------BEHAVIOR CLASS--------------------------------
  public class AssemblyBehavior : BehaviorBase
  {
    // static fields to store the static states in Environment.CustomData
    private static Dictionary<int, HomeBaseData> CachedHomeBases = new Dictionary<int, HomeBaseData>();
    private static double CachedStructuralResolution = 0;
    private static PointCloud CachedAllCloud = new PointCloud();
    private static List<VoxelType> CachedVoxelTypes = new List<VoxelType>();
    private static Dictionary<int, int> CachedPointToSupport = new Dictionary<int, int>();
    private static Dictionary<int, List<int>> CachedSupportToPoints = new Dictionary<int, List<int>>();
    private static Dictionary<int, List<int>> CachedSupportCols = new Dictionary<int, List<int>>();
    private static Dictionary<int, int> CachedBindP = new Dictionary<int, int>();
    private static Dictionary<int, List<int>> CachedBindL = new Dictionary<int, List<int>>();
    private static Dictionary<int, List<int>> CachedAdjacencyMap = new Dictionary<int, List<int>>();
    private static List<int> CachedBasements = new List<int>();

    // static fields to record the dynamic states in Environment: homeBase-related and targets-related
    private static Dictionary<int, int> HomeBaseOccupant = new Dictionary<int, int>(); // track the ID of the agent who is currently physically occupying the home
    private static Dictionary<int, Queue<int>> HomeBaseEntryQueues = new Dictionary<int, Queue<int>>(); // the waiting queues of the agents waiting outside the field
    private static Dictionary<int, Queue<int>> HomeBaseReturnQueues = new Dictionary<int, Queue<int>>(); // the waiting queues of the agents returning to the home

    private static HashSet<int> CachedReservedTargets = new HashSet<int>(); // save the reserved targets in memory, not serialized to environment
    // static fields to specify certain values
    private static int MaxWaitingQueueSize = 2; // queue size limit for return queue
    private static int YieldThreshold = MaxWaitingQueueSize + 1; // how many steps the agent is away from the target
    // the max number of ticks the agent has not moved, if exceeding and canEnterfield is true, agent is in deadlock, needs replanning path or task
    private static int DeadLockThreshold = 10;

    // track system reset
    private static int GlobalIterationCount = 0;
    private const int Emergency_Stop = 1000;
    private static bool EmergencyStopped = false;
    private static DateTime lastExecuteTime = DateTime.Now;

    // Print diagnostic logs in CommandHistory of Rhino Viewport if set to true
    private static bool DebugMode = false;

    public void SetDebugMode(bool debugMode)
    {
      DebugMode = debugMode;
    }

    public AssemblyBehavior() { }

    private void InitializeAgentPersistentData(int agentID, int assignedHome, int currentHome)
    {
      persistentAgentData[agentID][AgentKeys.WorkState] = WorkState.Idle;
      persistentAgentData[agentID][AgentKeys.Target] = null;
      persistentAgentData[agentID][AgentKeys.Path] = new List<int>();
      persistentAgentData[agentID][AgentKeys.CurrentStep] = 0;

      persistentAgentData[agentID][AgentKeys.ExtendArm] = false;
      persistentAgentData[agentID][AgentKeys.PrevState] = WorkState.Idle;
      persistentAgentData[agentID][AgentKeys.ShouldMoveForward] = false;
      persistentAgentData[agentID][AgentKeys.HasMaterial] = false;

      persistentAgentData[agentID][AgentKeys.HomeBase] = assignedHome;
      persistentAgentData[agentID][AgentKeys.CurrentHome] = currentHome;

      // DEBUGGING LOG:
      if (DebugMode) RhinoApp.WriteLine("homeBases keys: " + string.Join(", ", CachedHomeBases.Keys));
      if (DebugMode) RhinoApp.WriteLine("assignedHome = " + assignedHome);
      if (DebugMode) RhinoApp.WriteLine("homeBases.ContainsKey(assignedHome) = " + CachedHomeBases.ContainsKey(assignedHome));
      if (DebugMode) RhinoApp.WriteLine("currentHome = " + currentHome);

      HomeBaseData agentHomeData = CachedHomeBases[assignedHome];
      Point3d homeBase = agentHomeData.HomeBasePt;
      Point3d materialPickUpPt = agentHomeData.MaterialPickUpPt;
      Vector3d materialPickUpDir = agentHomeData.MaterialPickUpDir;
      Vector3d waitingDir = agentHomeData.WaitingDir;
      Queue<int> waitingQueue = agentHomeData.WaitingQueue;

      if (!HomeBaseOccupant.ContainsKey(assignedHome) || HomeBaseOccupant[assignedHome] == -1)
      {
        HomeBaseOccupant[assignedHome] = agentID;
        persistentAgentData[agentID][AgentKeys.EntertheField] = true;
        persistentAgentData[agentID][AgentKeys.Position] = homeBase;
        persistentAgentData[agentID][AgentKeys.Orientation] = materialPickUpDir;
      }
      else
      {
        persistentAgentData[agentID][AgentKeys.EntertheField] = false;
        // Step 1: enqueue (this creates the key if missing)
        if (!HomeBaseEntryQueues.ContainsKey(assignedHome))
        {
          waitingQueue.Enqueue(agentID);
          HomeBaseEntryQueues.Add(assignedHome, waitingQueue);
        }
        else
        {
          waitingQueue = HomeBaseEntryQueues[assignedHome];
          waitingQueue.Enqueue(agentID);
        }
        // Step 2: sync - now the key ALWAYS exists because step 1 guarantees it
        agentHomeData.WaitingQueue = HomeBaseEntryQueues[assignedHome];

        Point3d waitingSpot = agentHomeData.GetWaitingSpotFor(agentID);
        persistentAgentData[agentID][AgentKeys.Position] = waitingSpot;
        persistentAgentData[agentID][AgentKeys.Orientation] = waitingDir;
      }

      persistentAgentData[agentID][AgentKeys.DeadLockTicks] = 0;
      if (DebugMode) RhinoApp.WriteLine("Agent " + agentID + ": Persistent Data Initalized.");
    }



    public override void Execute(AgentBase agent)
    {
      // from AgentBase you can get: behaviors, agent system, custom data;
      // from CartesianAgent, you can get: Position, StartPosition, Moves, Weights,
      // from AgentSystemBase, you can get: agents, custom data
      // from CartesianAgentSystem, you can get: VoronoiCells, CartesianEnvironment
      // from EnvironmentBase, you can get: agent system, custom data
      // from CartesianEnvironment, you can get: boundary corners
      // from BehaviorBase, you can get: solver, custom data

      // ✅ Measure time BETWEEN Execute() calls
      DateTime now = DateTime.Now;
      double timeSinceLastCall = (now - lastExecuteTime).TotalMilliseconds;
      lastExecuteTime = now;
      if (DebugMode) RhinoApp.WriteLine("⏱️ TIME SINCE LAST Execute(): " + timeSinceLastCall + "ms");


      CartesianAgent assemblyAgent = null;
      int agentID = -1;

      try
      {
        assemblyAgent = agent as CartesianAgent;
        if (assemblyAgent == null) return;
        agentID = assemblyAgent.Id;
        if (DebugMode) RhinoApp.WriteLine("=== Execute() called for Agent " + agent.Id + " ===");
        if (DebugMode) RhinoApp.WriteLine("Agent " + agentID + ": Cast to CartesianAgent OK");

        // Check if multiple agents share the same behavior instance or not (they should not)
        if (DebugMode) RhinoApp.WriteLine("Agent " + agentID + " has behavior hash: " + this.GetHashCode());

        CartesianAgentSystem assemblySystem = (CartesianAgentSystem)assemblyAgent.AgentSystem;
        if (assemblySystem == null) return;
        if (DebugMode) RhinoApp.WriteLine("Agent " + agentID + ": Got AgentSystem");

        CartesianEnvironment assemblyEnv = (CartesianEnvironment)assemblySystem.CartesianEnvironment;
        if (assemblyEnv == null)
        {
          RhinoApp.WriteLine("ERROR: Agent " + agentID + " - Environment is NULL!");
          return;
        }

        //If (DebugMode) RhinoApp.WriteLine("Agent " + agentID + ": Accessing environment data...");
        if (assemblyEnv.CustomData == null)
        {
          RhinoApp.WriteLine("ERROR: Agent " + agentID + " - CustomData is NULL!");
          return;
        }

        // More robust than checking count:
        if (!assemblyEnv.CustomData.ContainsKey(EnvironmentKeys.AllCloud))
        {
          RhinoApp.WriteLine("ERROR: Environment not initialized");
          return;
        }




        // --------- CHECK FOR SYSTEM RESET ------------------
        if (assemblyEnv.CustomData.ContainsKey(EnvironmentKeys.SystemReset))
        {
          long resetTick = (long)assemblyEnv.CustomData[EnvironmentKeys.SystemReset];
          if (resetTick != lastResetTick)
          {
            persistentAgentData.Clear();
            HomeBaseEntryQueues.Clear();
            HomeBaseOccupant.Clear();
            HomeBaseReturnQueues.Clear();
            CachedHomeBases.Clear();
            CachedReservedTargets.Clear();
            lastResetTick = resetTick;
            GlobalIterationCount = 0;
            EmergencyStopped = false;
            if (DebugMode) RhinoApp.WriteLine("GlobalIterationCount reset to 0, agent data cleared");

            // pupulate with all the environment static values
            CachedAllCloud = (PointCloud)assemblyEnv.CustomData[EnvironmentKeys.AllCloud];
            CachedAdjacencyMap = (Dictionary<int, List<int>>)assemblyEnv.CustomData[EnvironmentKeys.AdjacencyMap];
            CachedStructuralResolution = (double)assemblyEnv.CustomData[EnvironmentKeys.StructuralResolution];
            List<int> voxelInts = (List<int>)assemblyEnv.CustomData[EnvironmentKeys.VoxelType];
            CachedVoxelTypes = voxelInts.Select(i => (VoxelType)i).ToList();
            CachedSupportToPoints = (Dictionary<int, List<int>>)assemblyEnv.CustomData[EnvironmentKeys.SpToP];
            CachedPointToSupport = (Dictionary<int, int>)assemblyEnv.CustomData[EnvironmentKeys.PToSp];
            CachedSupportCols = (Dictionary<int, List<int>>)assemblyEnv.CustomData[EnvironmentKeys.SpDic];
            CachedBindP = (Dictionary<int, int>)assemblyEnv.CustomData[EnvironmentKeys.BindP];
            CachedBindL = (Dictionary<int, List<int>>)assemblyEnv.CustomData[EnvironmentKeys.BindL];
            CachedBasements = (List<int>)assemblyEnv.CustomData[EnvironmentKeys.Basement];
            // Pre-populate with all home indices
            CachedHomeBases = LoadHomeBaseData(assemblyEnv); // convert Dictionary<int, object[]> to Dictionary<int, HomeBaseData>
            foreach (int homeIndex in CachedHomeBases.Keys)
            {
              HomeBaseOccupant[homeIndex] = -1;
              HomeBaseReturnQueues[homeIndex] = new Queue<int>();
              HomeBaseEntryQueues[homeIndex] = new Queue<int>();
            }
          }
        }

        /* Uncomment if you need this
        // Add Emergency Stop--Stop executing after 100 iterations
        if (EmergencyStopped) return;
        GlobalIterationCount++;
        if (GlobalIterationCount >= Emergency_Stop)
        {
          If (DebugMode) RhinoApp.WriteLine("Emergency_Stop: Reached " + Emergency_Stop + "  iterations!");
          EmergencyStopped = true;
          If (DebugMode) RhinoApp.WriteLine("Emergency stop triggered permanently.");
          GlobalIterationCount = 0;
          return;
        }
        */

        //------------------- LOAD DYNAMIC ENVIRONMENT DATA -------------------
        List<int> buildStateInts = (List<int>)assemblyEnv.CustomData[EnvironmentKeys.BuildState];
        List<BuildState> buildStates = buildStateInts.Select(i => (BuildState)i).ToList();


        //------------------- LOAD STATIC ENVIRONMENT DATA -------------------
        CachedStructuralResolution = (double)assemblyEnv.CustomData[EnvironmentKeys.StructuralResolution];
        CachedAllCloud = (PointCloud)assemblyEnv.CustomData[EnvironmentKeys.AllCloud];
        List<int> voxelTypeInts = (List<int>)assemblyEnv.CustomData[EnvironmentKeys.VoxelType];
        CachedVoxelTypes = voxelTypeInts.Select(i => (VoxelType)i).ToList();
        CachedPointToSupport = (Dictionary<int, int>)assemblyEnv.CustomData[EnvironmentKeys.PToSp];
        CachedSupportToPoints = (Dictionary<int, List<int>>)assemblyEnv.CustomData[EnvironmentKeys.SpToP];
        CachedSupportCols = (Dictionary<int, List<int>>)assemblyEnv.CustomData[EnvironmentKeys.SpDic];
        CachedBindP = (Dictionary<int, int>)assemblyEnv.CustomData[EnvironmentKeys.BindP];
        CachedBindL = (Dictionary<int, List<int>>)assemblyEnv.CustomData[EnvironmentKeys.BindL];
        CachedAdjacencyMap = (Dictionary<int, List<int>>)assemblyEnv.CustomData[EnvironmentKeys.AdjacencyMap];
        CachedBasements = (List<int>)assemblyEnv.CustomData[EnvironmentKeys.Basement];
        CachedHomeBases = LoadHomeBaseData(assemblyEnv);
        if (CachedHomeBases.Count == 0)
        {
          RhinoApp.WriteLine("ERROR: No home bases found for agent " + agentID);
          return;
        }
        List<int> homeIndices = CachedHomeBases.Keys.ToList();
        if (DebugMode) RhinoApp.WriteLine("Agent " + agentID + ": All environment data loaded successfully");


        //----------------------------ASSIGN HOME AND UPDATE HOME------------
        // assign a home base index to the agent
        int assignedHomeIndex = -1;
        if (persistentAgentData.ContainsKey(agentID) && persistentAgentData[agentID].ContainsKey(AgentKeys.HomeBase))
        {
          assignedHomeIndex = (int)persistentAgentData[agentID][AgentKeys.HomeBase];
        }
        else
        {
          assignedHomeIndex = homeIndices[agentID % CachedHomeBases.Count];

        }

        KeyValuePair<int, HomeBaseData> assignedHome = CachedHomeBases.FirstOrDefault(kvp => kvp.Key == assignedHomeIndex);
        if (!CachedHomeBases.ContainsKey(assignedHomeIndex))
        {
          if (DebugMode) RhinoApp.WriteLine("No valid home base found for index " + assignedHomeIndex);
          return;
        }
        if (DebugMode) RhinoApp.WriteLine("The environment has " + CachedHomeBases.Count + " home bases. The Agent " + agentID + " is assigned to home base index = " + assignedHome.Key);


        // update homebase.WatingQueue
        foreach (var home in CachedHomeBases)
        {
          int homeIndex = home.Key;
          Queue<int> waitingQueue = home.Value.WaitingQueue;
          waitingQueue = HomeBaseEntryQueues.ContainsKey(homeIndex)
            ? HomeBaseEntryQueues[homeIndex]
            : new Queue<int>();
          home.Value.WaitingQueue = waitingQueue;
        }


        int currentHomeIndex = -1;
        if (persistentAgentData.ContainsKey(agentID) && persistentAgentData[agentID].ContainsKey(AgentKeys.CurrentHome))
        {
          currentHomeIndex = (int)persistentAgentData[agentID][AgentKeys.CurrentHome];
        }
        else
        {
          currentHomeIndex = assignedHomeIndex;

        }


        // -----------INITIALIZE PERSISTENT AGENT DATA IF FIRST TIME ------------
        if (!persistentAgentData.ContainsKey(agentID))
        {
          persistentAgentData[agentID] = new Dictionary<string, object>();
          InitializeAgentPersistentData(agentID, assignedHomeIndex, currentHomeIndex);
        }

        //-------------RESTORE AGENT CUSTOM DATA FROM PERSISTENT DATA ----------
        assemblyAgent.CustomData = new Dictionary<string, object>(persistentAgentData[agentID]);


        //------------INITIALIZE MOVEMENT DICTIONARY--------------
        // Initialize agent's movement status in Environment on first Execution
        // This is to Store for post-processing visualization
        InitializeMovementDic(assemblyAgent, assignedHomeIndex, assemblyEnv);


        //--------------GET ALL OTHER AGENTS------------------
        // know other agents who are currently working for the current timestep
        List<AgentBase> allAgents = (List<AgentBase>)assemblySystem.Agents;
        List<CartesianAgent> allOtherCartesianAgents = new List<CartesianAgent>();
        foreach (AgentBase other in allAgents)
        {
          CartesianAgent otherAgent = other as CartesianAgent;
          if (otherAgent != assemblyAgent) allOtherCartesianAgents.Add(otherAgent);
        }



        //----------------------ACCESS AGENTKEYS FIELDS-------------
        // ✅ FIX: SAFE access with TryGetValue
        object workStateObj;
        WorkState agentState;
        if (assemblyAgent.CustomData.TryGetValue(AgentKeys.WorkState, out workStateObj))
        {
          agentState = (WorkState)workStateObj;
        }
        else
        {
          RhinoApp.WriteLine("ERROR: WorkState key missing for Agent " + agentID);
          agentState = WorkState.Idle;  // Default
          assemblyAgent.CustomData[AgentKeys.WorkState] = WorkState.Idle;
        }
        if (DebugMode) RhinoApp.WriteLine("Agent " + agentID + ": WorkState = " + agentState);



        Point3d agentCurrentPos;
        if (assemblyAgent.CustomData.ContainsKey(AgentKeys.Position))
        {
          agentCurrentPos = (Point3d)assemblyAgent.CustomData[AgentKeys.Position];
        }
        else
        {
          agentCurrentPos = assemblyAgent.Position;  // Fallback
        }
        int currentAgentIndex = ComputeCorrectPointIndex(agentCurrentPos);
        if (DebugMode) RhinoApp.WriteLine(" Agent " + agent.Id + "- Current Position = " + agentCurrentPos + ", with index at: " + currentAgentIndex);


        bool hasMaterial;
        if (assemblyAgent.CustomData.ContainsKey(AgentKeys.HasMaterial))
        {
          hasMaterial = (bool)assemblyAgent.CustomData[AgentKeys.HasMaterial];
        }
        else
        {
          hasMaterial = false;
        }
        if (DebugMode) RhinoApp.WriteLine("Agent " + agent.Id + "- Has Material = " + hasMaterial);


        bool extendArm;
        if (assemblyAgent.CustomData.ContainsKey(AgentKeys.ExtendArm))
        {
          extendArm = (bool)assemblyAgent.CustomData[AgentKeys.ExtendArm];
        }
        else
        {
          extendArm = false;
        }
        if (DebugMode) RhinoApp.WriteLine("Agent " + agent.Id + "- Extend Arm = " + extendArm);



        //--------GUARD CHECK: CLEAR HOME OCCUPANCY IF AGENT PHYISCALLY LEFT--------
        ReleaseAgentFromHomeOccupancy(currentHomeIndex, agent.Id, currentAgentIndex);

        // DEBUGGING: verify home occupancy
        foreach (int home in homeIndices)
        {
          if (DebugMode) RhinoApp.WriteLine("The home " + home + " is being occupied by agentID = " + HomeBaseOccupant[home]);
          Queue<int> entryQueue = HomeBaseEntryQueues[home];
          Queue<int> returnQueue = HomeBaseReturnQueues[home];
          if (DebugMode) RhinoApp.WriteLine("The home " + home + ": entry queue = [" + string.Join(",", entryQueue.ToList()) + "]");
          if (DebugMode) RhinoApp.WriteLine("The home " + home + ": return queue = [" + string.Join(",", returnQueue.ToList()) + "]");
        }

        // DEBUGGING: verify reserved targets
        if (DebugMode) RhinoApp.WriteLine("CachedReservedTargets = [" + string.Join(",", CachedReservedTargets.ToList()) + "]");

        // DEBUGGING: verify active raft removers
        var activeRaftRemovers = assemblyEnv.CustomData.ContainsKey(EnvironmentKeys.RaftRemovers)
          ? (Dictionary<int, int>)assemblyEnv.CustomData[EnvironmentKeys.RaftRemovers]
          : null;

        if (activeRaftRemovers == null || activeRaftRemovers.Count == 0)
        {
          if (DebugMode) RhinoApp.WriteLine("RaftRemovers: not yet assigned (empty or null)");
        }
        else
        {
          foreach (var kvp in activeRaftRemovers)
          {
            if (DebugMode) RhinoApp.WriteLine("Active Raft Remover = " + kvp.Value + " , is operating at home = " + kvp.Key);
          }
        }



        //--------------------STOP IF CONSTRUCTION IS COMPLETE---------------------------
        GlobalIterationCount++;
        bool structureIsComplete = IsStructureComplete(buildStates, assemblyEnv);
        bool raftIsRemoved = HasRaftRemoved(buildStates); // true, all removed
        bool inField = (bool)assemblyAgent.CustomData[AgentKeys.EntertheField];
        bool atHome = homeIndices.Contains(currentAgentIndex);
        if (DebugMode) RhinoApp.WriteLine("Is Structure Complete = " + structureIsComplete + ". Has all rafts removed = " + raftIsRemoved);

        if (structureIsComplete && raftIsRemoved)
        {
          if (DebugMode) RhinoApp.WriteLine("Construction Is Complete: Reached " + GlobalIterationCount + "  iterations!");

          if (inField && !atHome && agentState == WorkState.Idle)
          {
            // set up return to home
            SetUpReturnToBase(assemblyAgent, currentAgentIndex, assemblyEnv);
          }
          else if (atHome || !inField)
          {
            agent.CustomData[AgentKeys.ExtendArm] = false;
            agent.CustomData[AgentKeys.HasMaterial] = false; // because DropOffMaterial in REturnToBase() has 2 ticks, so in the end extendArm might not go through but stop here
            EmergencyStopped = true;
            GlobalIterationCount = 0;
            if (DebugMode) RhinoApp.WriteLine("Agent is now back to home or waiting spot. Simulation will stop permanently from the next tick.");
            return;
          }
        }



        //---------------CHECK CAN ENTER THE FIELD-----------
        bool canEnterPrevious = (bool)assemblyAgent.CustomData[AgentKeys.EntertheField];
        if (!canEnterPrevious)
        {
          agentState = WorkState.Idle;
          assemblyAgent.CustomData[AgentKeys.WorkState] = agentState;
          assemblyAgent.CustomData[AgentKeys.CurrentHome] = currentHomeIndex;
          assemblyAgent.CustomData[AgentKeys.HasMaterial] = false;
          bool canEnterNow = CanEnterTheField(assemblyAgent, currentHomeIndex, assemblyEnv, allOtherCartesianAgents, homeIndices);

          if (canEnterNow)
          {
            // update agent status
            assemblyAgent.CustomData[AgentKeys.EntertheField] = true;
            // FIX: need to add a step to move into the home
            bool hasEntered = EnterTheHomeFromOutsideStructure(assemblyAgent, currentHomeIndex);

            if (hasEntered)
            {
              // update home occupant and home entry queue and agent's active path
              OccupyHomeFromEntryQueue(assemblyAgent, currentHomeIndex, agentID, assemblyEnv);
              if (DebugMode) RhinoApp.WriteLine("Agent " + agentID + ": Can now enter field. Remove it from the Entry Queue..., And the home base occupant of home " + currentHomeIndex + " is updated to " + agentID);
            }

            // updat agent persistent data and emovement dict
            persistentAgentData[agentID] = new Dictionary<string, object>(assemblyAgent.CustomData);
            UpdateMovementDicForVisualization(assemblyAgent, agentState, assemblyEnv);
            return;

          }
          else
          {
            persistentAgentData[agentID] = new Dictionary<string, object>(assemblyAgent.CustomData);

            var agentUpdatedLocation = UpdateAgentToEntryQueue(agent.Id, currentHomeIndex, false);
            Point3d newWaitingSpot = agentUpdatedLocation.Item1;
            Vector3d newWaitingDir = agentUpdatedLocation.Item2;

            UpdateAgentStatusAfterExitField(assemblyAgent, assemblyAgent, agentState, currentHomeIndex, newWaitingSpot, newWaitingDir, assemblyEnv);

            UpdateMovementDicForVisualization(assemblyAgent, agentState, assemblyEnv);

            if (DebugMode) RhinoApp.WriteLine("Agent " + agentID + ": Cannot enter field");
            return;
          }
        }





        //--------------ASSIGN TASK BASED ON AGENT WORKSTATE-------------
        switch (agentState)
        {
          case (WorkState.Idle):
            if (DebugMode) RhinoApp.WriteLine("Agent " + agentID + ": Executing HandleIdleState");
            HandleIdleState(assemblyAgent, currentAgentIndex, hasMaterial, currentHomeIndex, allOtherCartesianAgents, assemblyEnv, homeIndices);
            break;
          case (WorkState.Assemble):
            if (DebugMode) RhinoApp.WriteLine("Agent " + agentID + ": Executing AssemblyTask");
            ExecuteAssemblyTask(assemblyAgent, assemblyEnv, allOtherCartesianAgents, homeIndices);
            break;
          case (WorkState.Disassemble): // but does this need to differ between disassemble support and disassemble structure?
            if (DebugMode) RhinoApp.WriteLine("Agent " + agentID + ": Executing DisassemblyTask");
            ExecuteSupportDisassemblyTask(assemblyAgent, assemblyEnv, allOtherCartesianAgents, homeIndices);
            break;
          case (WorkState.Remove):
            if (DebugMode) RhinoApp.WriteLine("Agent " + agentID + ": Executing RemovalTask");
            ExecuteRaftRemovalTask(assemblyAgent, assemblyEnv, allOtherCartesianAgents, homeIndices);
            break;
          case (WorkState.Return):
            if (DebugMode) RhinoApp.WriteLine("Agent " + agentID + ": Executing ReturnToHome");
            ReturnToBase(assemblyAgent, assemblyEnv, allOtherCartesianAgents, homeIndices);
            break;
        }






        // -----------CHECK FOR DEADLOCK SITUATION---------------------------------
        object targetObj = assemblyAgent.CustomData.ContainsKey(AgentKeys.Target)
          ? assemblyAgent.CustomData[AgentKeys.Target]
          : null;
        int agentTarget = targetObj != null ? (int)targetObj : -1;
        WorkState finalState = (WorkState)assemblyAgent.CustomData[AgentKeys.WorkState];
        Point3d newPos = (Point3d)assemblyAgent.CustomData[AgentKeys.Position];
        int newPosIndex = ComputeCorrectPointIndex(newPos);
        if (DebugMode) RhinoApp.WriteLine("Checking DeadLock--- Agent " + agentID
            + "： Before executing task, agentPos = " + currentAgentIndex
            + ", After executing task, agentPos = " + newPosIndex);
        inField = (bool)assemblyAgent.CustomData[AgentKeys.EntertheField];
        bool agentMovedAtThicTick = newPos.DistanceTo(agentCurrentPos) > 0.1;
        int waitCount = assemblyAgent.CustomData.ContainsKey(AgentKeys.DeadLockTicks)
          ? (int)assemblyAgent.CustomData[AgentKeys.DeadLockTicks]
          : 0;

        if (agentMovedAtThicTick)
        {
          waitCount = 0;
          if (DebugMode) RhinoApp.WriteLine("Agent " + agentID + ": has moved at this tick, waitCount = " + waitCount);
        }
        else
        {
          waitCount++;
          if (DebugMode) RhinoApp.WriteLine("Agent " + agentID + ": has not moved at this tick, waitCount = " + waitCount);
        }
        assemblyAgent.CustomData[AgentKeys.DeadLockTicks] = waitCount;

        // if stuck for too long: deadlock situation-->replan a task with a path
        bool encounterDeadLock = (waitCount >= DeadLockThreshold && inField);
        if (DebugMode) RhinoApp.WriteLine(" waitCount = " + waitCount + " | encounterDeadLock = " + encounterDeadLock);
        if (encounterDeadLock)
        {
          if (DebugMode) RhinoApp.WriteLine("Agent " + agentID + ": deadlock detected after " + waitCount + " waits, forcing replanning");
          finalState = WorkState.Idle;
          assemblyAgent.CustomData[AgentKeys.WorkState] = finalState;
          assemblyAgent.CustomData[AgentKeys.Target] = null;
          assemblyAgent.CustomData[AgentKeys.Path] = new List<int>();
          assemblyAgent.CustomData[AgentKeys.CurrentStep] = 0;
          assemblyAgent.CustomData[AgentKeys.PrevState] = agentState;
          assemblyAgent.CustomData[AgentKeys.ExtendArm] = false;
          assemblyAgent.CustomData[AgentKeys.DeadLockTicks] = 0;

          // remove from ActivePath so other agents can use these nodes
          var activePaths = (Dictionary<int, List<int>>)assemblyEnv.CustomData[EnvironmentKeys.ActivePath];
          activePaths[agentID] = new List<int> { newPosIndex };
          assemblyEnv.CustomData[EnvironmentKeys.ActivePath] = activePaths;

          ReleaseAgentTargetReservations(agentID, assemblyEnv);
          ReleaseAgentFromReturnQueue(agentID);

          var allTargets = LoadTargets(assemblyEnv);
          if (agentTarget >= 0 && allTargets.ContainsKey(agentTarget) && allTargets[agentTarget].ReservedBy.Contains(agentID))
          {
            CachedReservedTargets.Remove(agentTarget);
            List<int> reservedBy = allTargets[agentTarget].ReservedBy.ToList();
            reservedBy.Remove(agentID);
            allTargets[agentTarget].ReservedBy = reservedBy.ToArray();
            SaveTargets(assemblyEnv, allTargets);
          }
        }



        //-----------UPDATE PERSISTENT AGENT DATA AND MOVEMENT DICTIONARY--------
        if (DebugMode) RhinoApp.WriteLine("Agent " + agentID + ": finalState = " + finalState);

        // store the updated custom data to persistent storage
        persistentAgentData[agentID] = new Dictionary<string, object>(assemblyAgent.CustomData);
        // Update agent's movement status to environment custom data for post-processing to access these data
        UpdateMovementDicForVisualization(assemblyAgent, finalState, assemblyEnv);


        if (DebugMode) RhinoApp.WriteLine("Agent " + agentID + ": Execute() completed successfully");

      }
      catch (NullReferenceException ex)
      {
        if (DebugMode) RhinoApp.WriteLine("NULL REFERENCE in Agent " + agentID + ": " + ex.Message);
        if (DebugMode) RhinoApp.WriteLine("Stack: " + ex.StackTrace);
      }
      catch (KeyNotFoundException ex)
      {
        if (DebugMode) RhinoApp.WriteLine("KEY NOT FOUND in Agent " + agentID + ": " + ex.Message);
        if (DebugMode) RhinoApp.WriteLine("Stack: " + ex.StackTrace);
      }
      catch (Exception ex)
      {
        if (DebugMode) RhinoApp.WriteLine("EXCEPTION in Agent " + agentID + ": " + ex.Message);
        if (DebugMode) RhinoApp.WriteLine("Type: " + ex.GetType().Name);
        if (DebugMode) RhinoApp.WriteLine("Stack: " + ex.StackTrace);
      }
      finally
      {
        if (assemblyAgent != null && agentID >= 0 &&
          assemblyAgent.CustomData.ContainsKey(AgentKeys.EntertheField)) // only save if fully initialized
        {
          persistentAgentData[agentID] = new Dictionary<string, object>(assemblyAgent.CustomData);
        }
      }

    }



    //----------------------------------TASK ALLOCATION-----------------------------------------
    private void HandleIdleState(CartesianAgent agent, int currentIndex, bool hasMaterial, int currentHome, List<CartesianAgent> allOtherAgents, CartesianEnvironment env, List<int> homeIndices)
    {
      if (DebugMode) RhinoApp.WriteLine("Start HandleIdleState()...");

      WorkState finalState = WorkState.Idle;
      List<int> buildStateInts = (List<int>)env.CustomData[EnvironmentKeys.BuildState];
      List<BuildState> buildStates = buildStateInts.Select(i => (BuildState)i).ToList();
      bool structureIsComplete = IsStructureComplete(buildStates, env);

      if (currentIndex == currentHome)
      {
        // ✅ Idle at current home
        if (DebugMode) RhinoApp.WriteLine("Agent " + agent.Id + " At home → Checking if it should move onto a task or yield home to others...");

        // proximity-based yield rule
        bool isHomeClaimed = IsHomeClaimed(currentHome, agent.Id);
        bool isReturnerCloseEnough = isHomeClaimed && IsReturnerWithinThreshold(currentHome, allOtherAgents);

        //Priority Order Rules - when agent is at home index while a returner is returning and/or a waiter is waiting outside
        //Priority rule 1: the agent should get a valid task first to try to leave to home to returner or waiter
        TaskAssignment(agent, currentIndex, currentHome, allOtherAgents, env);

        // Priority rule 2: if the agent cannot get a valid task, then it needs to yield the home to the returner if the returner is very close
        WorkState newState = (WorkState)agent.CustomData[AgentKeys.WorkState];
        if (newState != WorkState.Idle)
        {
          if (DebugMode) RhinoApp.WriteLine("Agent " + agent.Id + " is assigned to a valid task, so will leave the home to others now....");

          if (newState == WorkState.Assemble)
          {
            // if assemble, adjust agent's dir to materialPickUpDir to get a material
            Vector3d dirToMaterial = CachedHomeBases[currentHome].MaterialPickUpDir;
            dirToMaterial.Unitize();
            Vector3d agentCurrentDir = (Vector3d)agent.CustomData[AgentKeys.Orientation];
            agentCurrentDir.Unitize();
            Point3d agentCurrentPos = CachedAllCloud[currentIndex].Location;
            bool shouldRotateToMaterial = ShouldRotate(agentCurrentDir, dirToMaterial);
            if (shouldRotateToMaterial)
            {
              Vector3d alignedDir = RotateBodyToAlignToDesiredDir(agentCurrentPos, agentCurrentDir, dirToMaterial);
              agent.CustomData[AgentKeys.Orientation] = alignedDir;
            }
          }
        }
        else
        {
          if (DebugMode) RhinoApp.WriteLine("Agent " + agent.Id + " cannot find a valid task, so needs to check how far a returner is....");

          // Priority rule 3: no valid task to departure, no nearby returner, then stay idle
          if (!isReturnerCloseEnough)
          {
            if (DebugMode) RhinoApp.WriteLine("Agent " + agent.Id + " no tasks, no close returner, so will stay idle at home...");
          }
          else
          {
            if (DebugMode) RhinoApp.WriteLine("Other agent is returning to this home and is within the threshold. -> run YieldHomeToReturner()...");
            List<CartesianAgent> allAgents = new List<CartesianAgent> { agent };
            allAgents.AddRange(allOtherAgents);
            int returnerID = (HomeBaseReturnQueues.ContainsKey(currentHome) && HomeBaseReturnQueues[currentHome].Count > 0)
              ? HomeBaseReturnQueues[currentHome].Peek()
              : -1;
            CartesianAgent returningAgent = allAgents.FirstOrDefault(a => a.Id == returnerID);
            if (returnerID != -1 && returningAgent != null)
            {
              YieldHomeToReturner(returningAgent, agent, currentHome, allAgents, env);
            }
          }
        }
      }
      else
      {
        // ✅ Not at home - stranded or waiting
        if (DebugMode) RhinoApp.WriteLine("Agent Is Not at home (stranded/waiting in the structure...)");
        if (hasMaterial)
        {
          // Has material → Try to find assembly target
          if (DebugMode) RhinoApp.WriteLine("  Has material When Being Idle In the Structure → Looking for assembly task, Or Set Up Return");

          if (!structureIsComplete)
          {
            TryChainTaskToAssemble(agent, currentIndex, env); // this method handles SetUpReturnToBase() if no assemble task could be found
          }
          else
          {
            SetUpReturnToBase(agent, currentIndex, env);
          }
          // ✅ NEW: If can't find assembly task nor a valid path home, stay idle (don't exit field)
          finalState = (WorkState)agent.CustomData[AgentKeys.WorkState];
          if (finalState == WorkState.Idle)
          {
            if (DebugMode) RhinoApp.WriteLine("Finishing HandleIdleState - WARNING: With Material, but No assemble task nor home path found, agent stranded but staying in field");
          }

        }
        else
        {
          // No material → Try disassembly first, then return home
          if (DebugMode) RhinoApp.WriteLine("  No material When Being Idle In the Structure → Looking for disassembly task, Or Set Up Return");

          if (!structureIsComplete)
          {
            // if no disassemble, then try to find path home!!! this method handles SetUpReturnToBase() if no disassemble could be found
            TryChainTaskToDisassemble(agent, currentIndex, env);
          }
          else
          {
            SetUpReturnToBase(agent, currentIndex, env);
          }

          // ✅ NEW: If can't find disassembly task nor a valid path home, stay idle (don't exit field)
          finalState = (WorkState)agent.CustomData[AgentKeys.WorkState];
          if (finalState == WorkState.Idle)
          {
            RhinoApp.WriteLine("Finishing HandleIdleState - WARNING: Without material and No assemble task nor home path found, agent stranded but staying in field");
          }
        }
      }

      if (DebugMode) RhinoApp.WriteLine("Completed HandleIdleState(), Agent " + agent.Id + " work state is " + (WorkState)agent.CustomData[AgentKeys.WorkState]);
    }

    private void TaskAssignment(CartesianAgent agent, int currentAgentIndex, int homeBaseIndex, List<CartesianAgent> otherAgents, CartesianEnvironment env)
    {
      try
      {
        // access environment data --static
        List<int> homeIndices = CachedHomeBases.Keys.ToList();

        // access environment data --dynamic
        List<int> buildStateInts = (List<int>)env.CustomData[EnvironmentKeys.BuildState];
        List<BuildState> buildStates = buildStateInts.Select(i => (BuildState)i).ToList();
        HashSet<int> deployed = (HashSet<int>)env.CustomData[EnvironmentKeys.Deployed];

        bool isStructureComplete = IsStructureComplete(buildStates, env);
        bool hasRaftRemoved = HasRaftRemoved(buildStates);
        bool canRaftRemovalStart = isStructureComplete && !hasRaftRemoved;
        // remove invalid targets from allTargets (targets that are already deployed or removed or with invalid path)
        CleanUpTargetsBeforeTaskAssignment(agent, env, canRaftRemovalStart);

        // Convert to TargetData when needed
        Dictionary<int, TargetData> allTargets = LoadTargets(env);

        // access agent's states
        WorkState agentState = (WorkState)agent.CustomData[AgentKeys.WorkState];
        bool hasMaterial = (bool)agent.CustomData[AgentKeys.HasMaterial];

        // release any reservations in ReservedBy of TargetData
        if (agentState == WorkState.Idle)
        {
          ReleaseAgentTargetReservations(agent.Id, env);
        }

        WorkState newState;
        int task = -1;

        if (!isStructureComplete)
        {
          if (DebugMode) RhinoApp.WriteLine("Structure NOT complete, looking for tasks...");

          int deployedSupportCount = deployed.Where(i => CachedVoxelTypes[i] == VoxelType.Support).Count();
          if (DebugMode) RhinoApp.WriteLine("Agent " + agent.Id + ": support points in deployed is " + deployedSupportCount);

          List<int> allowAssemble = UpdateNextAssembleList(env, homeIndices);
          List<int> allowDisassemble = UpdateSupportDisassembleList(env);

          if (deployedSupportCount == 0 || allowDisassemble.Count == 0)
          {
            // looking for assemle tasks
            if (DebugMode) RhinoApp.WriteLine("No targets available in deployedSupport nor in allowDisassemble, looking for if assemble tasks available...");
            if (DebugMode) RhinoApp.WriteLine("Agent " + agent.Id + ": checking for assemble tasks... AllowAssemble count=" + allowAssemble.Count);

            if (allowAssemble.Count != 0)
            {
              if (DebugMode) RhinoApp.WriteLine("Found targets in allAssembles, with count = " + allowAssemble.Count);
              if (DebugMode) RhinoApp.WriteLine("Verify: Agent's pos at agent.Position = " + agent.Position + ", which is at point " + ComputeCorrectPointIndex(agent.Position));
              if (DebugMode) RhinoApp.WriteLine("Verify: Agent currentIndex = " + currentAgentIndex);
              task = AssignAssembleTask(agent, currentAgentIndex, allowAssemble, env);
            }
            else
            {
              task = -1;
            }

            if (task != -1)
            {
              if (DebugMode) RhinoApp.WriteLine("Found a valid assemble task = " + task);
              if (DebugMode) RhinoApp.WriteLine("About to UpdateAgentStatusAfterTaskAssignment...");
              newState = WorkState.Assemble;
              OccupyPathAfterTaskAssignment(true, agent, currentAgentIndex, task, env);
              AddAgentIDToReservationAfterTargetAssignment(agent, env, task); //ATTENTION: may need to separate work targets from home targets
              UpdateAgentStatusAfterTargetAssignment(agent, hasMaterial, currentAgentIndex, task, newState, agentState, env);
              if (DebugMode) RhinoApp.WriteLine("Agent " + agent.Id + ": currentIndex= " + currentAgentIndex + " | TargetIndex= " + task + " | next WorkState = " + newState);

              return;
            }
            else
            {
              if (DebugMode) RhinoApp.WriteLine("Failed to found a valid assemble task, the assigned task = -1, set agent to idle...");
              newState = WorkState.Idle;
              agent.CustomData[AgentKeys.WorkState] = newState;
              return;
            }
          }
          else
          {
            // looking for disassemble tasks
            if (DebugMode) RhinoApp.WriteLine("When deployedSupportCount is not 0 and allowDisassemble is not 0: ");
            if (DebugMode) RhinoApp.WriteLine("Agent " + agent.Id + ": Check for disassemble tasks... AllowDisassemble = " + allowDisassemble);
            if (DebugMode) RhinoApp.WriteLine("Found targets in allDisassembles, with count = " + allowDisassemble.Count);
            if (DebugMode) RhinoApp.WriteLine("Verify: Agent's pos at agent.Position = " + agent.Position + ", which is at point " + ComputeCorrectPointIndex(agent.Position));
            if (DebugMode) RhinoApp.WriteLine("Verify: Agent currentIndex = " + currentAgentIndex);

            task = AssignDisassembleTask(agent, currentAgentIndex, allowDisassemble, env);

            if (task != -1)
            {
              if (DebugMode) RhinoApp.WriteLine("Found a valid disassemble task = " + task);
              if (DebugMode) RhinoApp.WriteLine("About to UpdateAgentStatusAfterTaskAssignment...");
              newState = WorkState.Disassemble;
              UpdateAgentStatusAfterTargetAssignment(agent, hasMaterial, currentAgentIndex, task, newState, agentState, env);
              OccupyPathAfterTaskAssignment(true, agent, currentAgentIndex, task, env);
              AddAgentIDToReservationAfterTargetAssignment(agent, env, task);
              if (DebugMode) RhinoApp.WriteLine("Agent " + agent.Id + ": currentIndex= " + currentAgentIndex + " | nextTargetIndex= " + task + " | next WorkState = " + newState);
              return;
            }
            else
            {
              if (DebugMode) RhinoApp.WriteLine("Failed to found a valid support disassemble task, the assigned task = -1, set agent to idle...");
              newState = WorkState.Idle;
              agent.CustomData[AgentKeys.WorkState] = newState;
              return;
            }
          }
        }
        else // Structure complete, remove raft or return
        {
          if (DebugMode) RhinoApp.WriteLine("Structure complete, Checking raft removal...");

          if (!hasRaftRemoved)
          {

            var activeRaftRemovers = env.CustomData.ContainsKey(EnvironmentKeys.RaftRemovers)
              ? (Dictionary<int, int>)env.CustomData[EnvironmentKeys.RaftRemovers]
              : null;

            activeRaftRemovers = AssignAgentsForRaftRemovalTask(env);
            env.CustomData[EnvironmentKeys.RaftRemovers] = activeRaftRemovers;

            bool isThisAgentAssigned = activeRaftRemovers.Values.Contains(agent.Id);

            if (!isThisAgentAssigned && activeRaftRemovers.Keys.Count >= CachedHomeBases.Keys.Count)
            {
              // if it is already out of the field, keep the way it is
              if (!(bool)agent.CustomData[AgentKeys.EntertheField]) return;

              // if it is currently at home index, make it exit the field
              if (currentAgentIndex == homeBaseIndex)
              {
                //update agent status, and add it to entry queue
                var agentUpdatedLocation = UpdateAgentToEntryQueue(agent.Id, homeBaseIndex, true);
                Point3d newWaitingSpot = agentUpdatedLocation.Item1;
                Vector3d newWaitingDir = agentUpdatedLocation.Item2;
                UpdateAgentStatusAfterExitField(agent, agent, agentState, homeBaseIndex, newWaitingSpot, newWaitingDir, env);
                return;
              }
              else
              {
                SetUpReturnToBase(agent, currentAgentIndex, env);
                return;
              }
            }

            if (isThisAgentAssigned)
            {
              int operatingHome = activeRaftRemovers.FirstOrDefault(a => a.Value == agent.Id).Key;
              agent.CustomData[AgentKeys.CurrentHome] = operatingHome;

              List<int> removalTargets = FindRaftToRemove(env, buildStates, operatingHome);
              if (DebugMode) RhinoApp.WriteLine("Raft NOT removed, finding raft targets..." + "Active raft remover = " + agent.Id + ": Raft removal targets=" + removalTargets.Count);

              if (removalTargets.Count != 0)
              {
                task = AssignRaftRemovalTask(agent, currentAgentIndex, removalTargets, env);
                if (task != -1)
                {
                  if (DebugMode) RhinoApp.WriteLine("Found a valid raft removal task = " + task);
                  if (DebugMode) RhinoApp.WriteLine("About to UpdateAgentStatusAfterTaskAssignment...");
                  newState = WorkState.Remove;
                  UpdateAgentStatusAfterTargetAssignment(agent, hasMaterial, currentAgentIndex, task, newState, agentState, env);
                  OccupyPathAfterTaskAssignment(true, agent, currentAgentIndex, task, env);
                  AddAgentIDToReservationAfterTargetAssignment(agent, env, task);
                  if (DebugMode) RhinoApp.WriteLine("Agent " + agent.Id + ": currentIndex= " + currentAgentIndex + " | nextTargetIndex= " + task + " | next WorkState = " + newState);
                  return;
                }
                else
                {
                  if (DebugMode) RhinoApp.WriteLine("Failed to found a valid raft removal task, the assigned task = -1, set agent to idle...");
                  newState = WorkState.Idle;
                  agent.CustomData[AgentKeys.WorkState] = newState;
                  return;
                }
              }
              else
              {
                RhinoApp.WriteLine("ERROR: Raft NOT removed, But Can Not Found a raft removal task... Set Agent State to Idle...");
                newState = WorkState.Idle;
                agent.CustomData[AgentKeys.WorkState] = newState;
                return;
              }
            }


          }
          else // structure complete, raft removed-->Return home or stay at home or exit the field
          {
            if (!(bool)agent.CustomData[AgentKeys.EntertheField])
            {
              // construction complete, agent is not in the field, stay out of the field
              if (DebugMode) RhinoApp.WriteLine("All rafts removed and agent is out of the field, stay outside the field...");
              newState = WorkState.Idle;
              agent.CustomData[AgentKeys.WorkState] = newState;
              return;
            }

            if (currentAgentIndex == homeBaseIndex)
            {
              // already home, construction complete — exit field
              if (DebugMode) RhinoApp.WriteLine("All rafts removed and agent is at home, exiting field...");
              bool extendArm = (bool)agent.CustomData[AgentKeys.ExtendArm];
              if (hasMaterial)
              {
                DropOffMaterialAtHomeBase(agent, extendArm, homeBaseIndex, currentAgentIndex);
                return;
              }

              newState = WorkState.Idle;
              agent.CustomData[AgentKeys.WorkState] = newState;
              OccupyHomeFromReturnQueue(agent, homeBaseIndex, agent.Id, env);
              return;
            }

            // not at home yet nor out of the field — find path home
            if (DebugMode) RhinoApp.WriteLine("Raft removed, attempting return home...");
            SetUpReturnToBase(agent, currentAgentIndex, env);
            return;

          }
        }

      }
      catch (Exception ex)
      {
        if (DebugMode) RhinoApp.WriteLine("Agent " + agent.Id + " TaskAssignment CRASHED: " + ex.Message);
        if (DebugMode) RhinoApp.WriteLine("StackTrace: " + ex.StackTrace);
        throw;
      }
    }



    //--------------------------------EXECUTE TASKS BY WORKSTATE------------------------------------
    private void ExecuteAssemblyTask(CartesianAgent agent, CartesianEnvironment env, List<CartesianAgent> allOtherAgents, List<int> homeIndices)
    {
      if (DebugMode) RhinoApp.WriteLine("---START ExecuteAssemblyTask()...");
      int agentTarget = (int)agent.CustomData[AgentKeys.Target];
      List<int> agentPath = (List<int>)agent.CustomData[AgentKeys.Path];
      int agentStep = (int)agent.CustomData[AgentKeys.CurrentStep];
      int agentID = agent.Id;

      int currentHome = (int)agent.CustomData[AgentKeys.CurrentHome];
      int whereAgentIs = agentPath[agentStep];
      bool hasMaterial = (bool)agent.CustomData[AgentKeys.HasMaterial];

      // ✅ ADD THIS DEBUGGER
      if (DebugMode) RhinoApp.WriteLine("ExecuteAssemblyTask: target index =" + agentTarget + ", step=" + agentStep + "/" + (agentPath.Count - 1));
      if (DebugMode) RhinoApp.WriteLine("  Agent Position: " + agent.Position + ",  Target Position: " + CachedAllCloud[agentTarget].Location);
      if (DebugMode) RhinoApp.WriteLine(" Agent Current Index from agent.Position = " + ComputeCorrectPointIndex(agent.Position) + ", Agent Current Index from Path[step] = " + agentPath[agentStep]);


      // Step 1: first to check if the agent needs to rotate to pick up the material at the home base
      bool shouldGrabMaterial = agentPath[0] == currentHome
        && whereAgentIs == agentPath[0]
        && !hasMaterial;
      bool extendArm = (bool)agent.CustomData[AgentKeys.ExtendArm];
      if (DebugMode) RhinoApp.WriteLine("ExecuteAssemblyTask: Not at target, shouldGrabMaterial = " + shouldGrabMaterial);
      if (shouldGrabMaterial)
      {
        PickUpMaterialAtHomeBase(agent, extendArm, currentHome, whereAgentIs);
        return;
      }

      // step 2: check if agentPath will be encountering collision with all the other agent's path
      var collisionRawInfo = GetCollisionInformation(agent, agentTarget, agentPath, homeIndices, allOtherAgents, env);
      // return includes: hasCollision, collidingAgentID, conflictingblocks with this collidingAgent in List<int>, and collision type wtih this collidingAgent
      bool hasCollisionPath = collisionRawInfo.Item1;
      Dictionary<int, CollisionData> collisionDataByStep = collisionRawInfo.Item2;


      if (hasCollisionPath)
      {
        foreach (var step in collisionDataByStep)
        {
          if (DebugMode) RhinoApp.WriteLine("    at step=" + step.Key + ":");
          foreach (var agentCollision in step.Value.PerAgentCollisions)
          {
            if (DebugMode) RhinoApp.WriteLine("        vs agent=" + agentCollision.Key
                + " type=" + agentCollision.Value.Item2
                + " blocks=[" + string.Join(",", agentCollision.Value.Item1) + "]");
          }
        }
      }

      // Step 3: agent leaves the agentPath[0] and move on to the path for the assembly task
      bool isTaskComplete = false;

      if (IsTargetReached(agentTarget, agentStep, agentPath, homeIndices, env))
      {
        if (DebugMode) RhinoApp.WriteLine("ExecuteAssemblyTask: At target, checking agentDir to see if it aligns towards the target");

        // double check if need to rotate to align to the right direction
        Vector3d agentDir = (Vector3d)agent.CustomData[AgentKeys.Orientation];
        agentDir.Unitize();
        Point3d agentPos = (Point3d)agent.CustomData[AgentKeys.Position];
        int targetIndex = agentPath[agentPath.Count - 1];
        if (DebugMode) RhinoApp.WriteLine("ExecuteAssemblyTask: Has Reached Target - Confirm agent current index and target index... ");
        if (DebugMode) RhinoApp.WriteLine("Agent current voxel index from agentPath[agentStep] = " + whereAgentIs + ", agentTarget from AgentKeys = " + agentTarget + ", agentTarget from agentPath[agentPath.Count-1] = " + targetIndex);
        Vector3d desiredDir = CachedAllCloud[agentTarget].Location - CachedAllCloud[whereAgentIs].Location;
        desiredDir.Unitize();
        bool shouldRotate = ShouldRotate(agentDir, desiredDir); // should robot rotate the body to align to the material direction to grab/put new material
        if (DebugMode) RhinoApp.WriteLine("Before rotating, agentDir = " + agentDir + ", desiredDir = " + desiredDir + ", shouldRotate = " + shouldRotate);
        if (shouldRotate)
        {
          agentDir = RotateBodyToAlignToDesiredDir(agentPos, agentDir, desiredDir);
          agent.CustomData[AgentKeys.Orientation] = agentDir;
          if (DebugMode) RhinoApp.WriteLine("After rotating body, agentDir = " + agentDir);
        }

        if (DebugMode) RhinoApp.WriteLine("ExecuteAssemblyTask: At target and after rotation, calling MovementController to check isTaskComplete");
        isTaskComplete = MovementController(agent); // to assemble

      }
      else
      {
        // continue to move forward along the agentPath
        if (DebugMode) RhinoApp.WriteLine("ExecuteAssemblyTask: Not at target, Moving forward");
        MoveForwardAndAvoidCollision(hasCollisionPath, agent, agentPath, agentStep, collisionDataByStep, allOtherAgents, homeIndices, env);
      }

      // Step 4: agent finishes the assembly task, update environment and itself.
      if (isTaskComplete)
      {
        // ✅ ADD THIS - Confirm position before updating
        if (DebugMode) RhinoApp.WriteLine("isTaskComplete is True, ABOUT TO CALL UpdateEnvAfterAssembly:");

        // update environment
        UpdateEnvAfterAssembly(agent, agentTarget, env);

        // clear agent's custom data of target and path and currentstep
        hasMaterial = false;
        WorkState prevState = WorkState.Assemble;
        extendArm = false;
        UpdateAgentStatusAfterTaskExecution(agent, hasMaterial, prevState, extendArm, env);

        Point3d agentPos = (Point3d)agent.CustomData[AgentKeys.Position];
        whereAgentIs = ComputeCorrectPointIndex(agentPos);
        if (DebugMode) RhinoApp.WriteLine(" Current Agent.Position = " + agent.Position + ", which is point " + ComputeCorrectPointIndex(agent.Position));
        if (DebugMode) RhinoApp.WriteLine(" Current AgentKeys.Position = " + agentPos + ", which is point " + whereAgentIs);
        if (DebugMode) RhinoApp.WriteLine(" Current agentTarget = " + agentTarget);

        // if agent is not at home, but somewhere else in the field:
        if (whereAgentIs == currentHome)
        {
          agent.CustomData[AgentKeys.WorkState] = WorkState.Idle;
          if (DebugMode) RhinoApp.WriteLine("ExecuteAssemblyTask: Completed, Agent stayed at home after assembly, going Idle");
        }
        else
        {
          // agent is outside the home, then try chain the task
          TryChainTaskToDisassemble(agent, whereAgentIs, env); // shall I set it to return here? or try chain task?
          if (DebugMode) RhinoApp.WriteLine("ExecuteAssemblyTask: Completed, Agent is outside the home, so chained to next task, new state=" + agent.CustomData[AgentKeys.WorkState]);
        }
      }
    }


    private void ExecuteSupportDisassemblyTask(CartesianAgent agent, CartesianEnvironment env, List<CartesianAgent> allOtherAgents, List<int> homeIndices)
    {
      if (DebugMode) RhinoApp.WriteLine("---START ExecuteSupportDisassemblyTask()...");
      int agentTarget = (int)agent.CustomData[AgentKeys.Target];
      List<int> agentPath = (List<int>)agent.CustomData[AgentKeys.Path];
      int agentStep = (int)agent.CustomData[AgentKeys.CurrentStep];
      int agentID = agent.Id;

      int currentHome = (int)agent.CustomData[AgentKeys.CurrentHome];
      int whereAgentIs = agentPath[agentStep];
      bool hasMaterial = (bool)agent.CustomData[AgentKeys.HasMaterial];
      bool extendArm = (bool)agent.CustomData[AgentKeys.ExtendArm];
      // ✅ ADD THIS DEBUGGER
      if (DebugMode) RhinoApp.WriteLine("ExecuteDisassemblyTask: target index =" + agentTarget + ", step=" + agentStep + "/" + (agentPath.Count - 1));
      if (DebugMode) RhinoApp.WriteLine("  Agent Position: " + agent.Position + ",  Target Position: " + CachedAllCloud[agentTarget].Location);
      if (DebugMode) RhinoApp.WriteLine(" Agent Current Index from CachedAllCloud = " + ComputeCorrectPointIndex(agent.Position) + ", Agent Current Index from Path[step] = " + agentPath[agentStep]);

      // step 1: if agent starts disassembly task from home, and if it has material, it should drop off the material first
      bool shouldReleaseMaterial = agentPath[0] == currentHome
        && whereAgentIs == agentPath[0]
        && hasMaterial && !extendArm;
      if (DebugMode) RhinoApp.WriteLine("ExecuteSupportDisassemblyTask: Not at target, shouldReleaseMaterial = " + shouldReleaseMaterial);

      if (shouldReleaseMaterial)
      {
        DropOffMaterialAtHomeBase(agent, extendArm, currentHome, whereAgentIs);
        return;
      }



      // step 2: check if agentPath will be encountering collision with all the other agent's path
      var collisionRawInfo = GetCollisionInformation(agent, agentTarget, agentPath, homeIndices, allOtherAgents, env);
      // return includes: hasCollision, List<collisionSteps>, collidingAgentID, conflictingblocks in List<int>, and collision type wtih this collidingAgent
      bool hasCollisionPath = collisionRawInfo.Item1;
      Dictionary<int, CollisionData> collisionDataByStep = collisionRawInfo.Item2;

      // DEBUGGER FOR COLLISION CHECK
      if (DebugMode) RhinoApp.WriteLine(">>> ExecuteSupportDisassemblyTask(): COLLISION CHECK START agentID = " + agent.Id
          + " task=" + agentTarget
          + " step=" + agentStep + "/" + (agentPath.Count - 1)
          + " pos=" + (Point3d)agent.CustomData[AgentKeys.Position]);

      if (DebugMode) RhinoApp.WriteLine(">>> COLLISION CHECK END agent=" + agent.Id
          + " hasCollision=" + hasCollisionPath
          + " collidingSteps=" + collisionDataByStep.Count);
      if (hasCollisionPath)
      {
        foreach (var step in collisionDataByStep)
        {
          if (DebugMode) RhinoApp.WriteLine("    at step=" + step.Key + ":");
          foreach (var agentCollision in step.Value.PerAgentCollisions)
          {
            if (DebugMode) RhinoApp.WriteLine("        vs agent=" + agentCollision.Key
                + " type=" + agentCollision.Value.Item2
                + " blocks=[" + string.Join(",", agentCollision.Value.Item1) + "]");
          }
        }
      }


      bool isTaskComplete = false;

      if (IsTargetReached(agentTarget, agentStep, agentPath, homeIndices, env))
      {
        if (DebugMode) RhinoApp.WriteLine("ExecuteDisassemblyTask: At target, checking agentDir to see if it aligns towards the target");

        // double check if need to rotate to align to the right direction
        Vector3d agentDir = (Vector3d)agent.CustomData[AgentKeys.Orientation];
        agentDir.Unitize();
        Point3d agentPos = (Point3d)agent.CustomData[AgentKeys.Position];
        int targetIndex = agentPath[agentPath.Count - 1];
        if (DebugMode) RhinoApp.WriteLine("ExecuteDisassemblyTask: Has Reached Target - Confirm agent current index and target index... ");
        if (DebugMode) RhinoApp.WriteLine("Agent current voxel index from agentPath[agentStep] = " + whereAgentIs + ", agentTarget from AgentKeys = " + agentTarget + ", agentTarget from agentPath[agentPath.Count-1] = " + targetIndex);
        Vector3d desiredDir = CachedAllCloud[agentTarget].Location - CachedAllCloud[whereAgentIs].Location;
        desiredDir.Unitize();
        bool shouldRotate = ShouldRotate(agentDir, desiredDir); // should robot rotate the body to align to the material direction to grab/put new material
        if (DebugMode) RhinoApp.WriteLine("Before rotating, agentDir = " + agentDir + ", desiredDir = " + desiredDir + ", shouldRotate = " + shouldRotate);
        if (shouldRotate)
        {
          agentDir = RotateBodyToAlignToDesiredDir(agentPos, agentDir, desiredDir);
          agent.CustomData[AgentKeys.Orientation] = agentDir;
          if (DebugMode) RhinoApp.WriteLine("After rotating body, agentDir = " + agentDir);
          //shouldRotate = ShouldRotate(agentDir, desiredDir);
        }

        if (DebugMode) RhinoApp.WriteLine("ExecuteDisassemblyTask: At target and after rotation, calling MovementController to check isTaskComplete");
        isTaskComplete = MovementController(agent); // to assemble
      }
      else
      {
        if (DebugMode) RhinoApp.WriteLine("ExecuteSupportDisassemblyTask: Not at target, Moving forward");
        MoveForwardAndAvoidCollision(hasCollisionPath, agent, agentPath, agentStep, collisionDataByStep, allOtherAgents, homeIndices, env);
      }

      if (isTaskComplete)
      {
        if (DebugMode) RhinoApp.WriteLine("isTaskComplete is True, ABOUT TO CALL UpdateEnvAfterDisassembly:");
        // update environment
        UpdateEnvAfterDisassembly(agent, agentTarget, env);

        // clear agent's custom data of target and path and currentstep
        hasMaterial = true;
        WorkState prevState = WorkState.Disassemble;
        extendArm = false;
        UpdateAgentStatusAfterTaskExecution(agent, hasMaterial, prevState, extendArm, env);

        Point3d agentPos = (Point3d)agent.CustomData[AgentKeys.Position];
        whereAgentIs = ComputeCorrectPointIndex(agentPos);
        if (DebugMode) RhinoApp.WriteLine("Verify: Agent's pos at agent.Position = " + agent.Position + ", which is at point from CachedAllCloud " + ComputeCorrectPointIndex(agent.Position));
        if (DebugMode) RhinoApp.WriteLine("Verify: Agent's pos at AgentKeys.Position = " + agentPos + ", which is point " + whereAgentIs);
        if (DebugMode) RhinoApp.WriteLine(" Current agentTarget = " + agentTarget);

        // if agent is not at home, but somewhere else in the field: try chain the task
        // if agent is at home, set to idle, next time frame, start from task assignment
        if (whereAgentIs == currentHome)
        {
          agent.CustomData[AgentKeys.WorkState] = WorkState.Idle;
          if (DebugMode) RhinoApp.WriteLine("ExecuteDisassemblyTask: Completed, Agent is still at home, new state=" + agent.CustomData[AgentKeys.WorkState]);
          // if it has material and it is already at home, needs to drop off the material?
          if (hasMaterial)
          {
            DropOffMaterialAtHomeBase(agent, extendArm, currentHome, whereAgentIs);
            return;
          }

        }
        else // if not at home, try re-use this disassembled material if structure is incomplete
        {
          // tryChainTRask to find out agent's next workstate and next task
          TryChainTaskToAssemble(agent, whereAgentIs, env);
          if (DebugMode) RhinoApp.WriteLine("ExecuteAssemblyTask: Completed, Agent is outside the home, so chained to next task, new state=" + agent.CustomData[AgentKeys.WorkState]);

        }
      }
    }

    private void ExecuteRaftRemovalTask(CartesianAgent agent, CartesianEnvironment env, List<CartesianAgent> allOtherAgents, List<int> homeIndices)
    {
      if (DebugMode) RhinoApp.WriteLine("---START ExecuteRaftRemovalTask()...");
      int agentTarget = (int)agent.CustomData[AgentKeys.Target];
      List<int> agentPath = (List<int>)agent.CustomData[AgentKeys.Path];
      int agentStep = (int)agent.CustomData[AgentKeys.CurrentStep];
      int agentID = agent.Id;

      int currentHome = (int)agent.CustomData[AgentKeys.CurrentHome];
      int whereAgentIs = agentPath[agentStep];
      bool hasMaterial = (bool)agent.CustomData[AgentKeys.HasMaterial];
      bool extendArm = (bool)agent.CustomData[AgentKeys.ExtendArm];
      // step 1: if it starts RaftRemoval task from home base and if it has material, then it should drop off the material first
      bool shouldReleaseMaterial = agentPath[0] == currentHome
        && whereAgentIs == agentPath[0]
        && hasMaterial && !extendArm;
      if (DebugMode) RhinoApp.WriteLine("ExecuteSupportDisassemblyTask: arrive at target, shouldReleaseMaterial = " + shouldReleaseMaterial);

      if (shouldReleaseMaterial)
      {
        DropOffMaterialAtHomeBase(agent, extendArm, currentHome, whereAgentIs);
        return;
      }

      // step 2: check collisions
      var collisionRawInfo = GetCollisionInformation(agent, agentTarget, agentPath, homeIndices, allOtherAgents, env);
      // return includes: hasCollision, List<collisionSteps>, collidingAgentID, conflictingblocks in List<int>, and collision type wtih this collidingAgent
      bool hasCollisionPath = collisionRawInfo.Item1;
      Dictionary<int, CollisionData> collisionDataByStep = collisionRawInfo.Item2;

      // DEBUGGER FOR COLLISION CHECK
      if (DebugMode) RhinoApp.WriteLine(">>> ExecuteRaftRemovalTask(): COLLISION CHECK START agentID = " + agent.Id
          + " task=" + agentTarget
          + " step=" + agentStep + "/" + (agentPath.Count - 1)
          + " pos=" + (Point3d)agent.CustomData[AgentKeys.Position]);

      if (DebugMode) RhinoApp.WriteLine(">>> COLLISION CHECK END agent=" + agent.Id
          + " hasCollision=" + hasCollisionPath
          + " collidingSteps=" + collisionDataByStep.Count);
      if (hasCollisionPath)
      {
        foreach (var step in collisionDataByStep)
        {
          if (DebugMode) RhinoApp.WriteLine("    at step=" + step.Key + ":");
          foreach (var agentCollision in step.Value.PerAgentCollisions)
          {
            if (DebugMode) RhinoApp.WriteLine("        vs agent=" + agentCollision.Key
                + " type=" + agentCollision.Value.Item2
                + " blocks=[" + string.Join(",", agentCollision.Value.Item1) + "]");
          }
        }
      }



      bool isTaskComplete = false;

      if (IsTargetReached(agentTarget, agentStep, agentPath, homeIndices, env))
      {
        if (DebugMode) RhinoApp.WriteLine("ExecuteRaftRemovalTask: At target, checking agentDir to see if it aligns towards the target");

        // double check if need to rotate to align to the right direction
        Vector3d agentDir = (Vector3d)agent.CustomData[AgentKeys.Orientation];
        agentDir.Unitize();
        Point3d agentPos = (Point3d)agent.CustomData[AgentKeys.Position];
        int targetIndex = agentPath[agentPath.Count - 1];
        if (DebugMode) RhinoApp.WriteLine("ExecuteRaftRemovalTask: Has Reached Target - Confirm agent current index and target index... ");
        if (DebugMode) RhinoApp.WriteLine("Agent current voxel index from agentPath[agentStep] = " + whereAgentIs + ", agentTarget from AgentKeys = " + agentTarget + ", agentTarget from agentPath[agentPath.Count-1] = " + targetIndex);
        Vector3d desiredDir = CachedAllCloud[agentTarget].Location - CachedAllCloud[whereAgentIs].Location;
        desiredDir.Unitize();
        bool shouldRotate = ShouldRotate(agentDir, desiredDir); // should robot rotate the body to align to the material direction to grab/put new material
        if (DebugMode) RhinoApp.WriteLine("Before rotating, agentDir = " + agentDir + ", desiredDir = " + desiredDir + ", shouldRotate = " + shouldRotate);
        if (shouldRotate)
        {
          agentDir = RotateBodyToAlignToDesiredDir(agentPos, agentDir, desiredDir);
          agent.CustomData[AgentKeys.Orientation] = agentDir;
          if (DebugMode) RhinoApp.WriteLine("After rotating body, agentDir = " + agentDir);
        }

        if (DebugMode) RhinoApp.WriteLine("ExecuteRaftRemovalTask: At target and after rotation, calling MovementController to check isTaskComplete");
        isTaskComplete = MovementController(agent); // to assemble
      }
      else
      {
        if (DebugMode) RhinoApp.WriteLine("ExecuteRaftRemovalTask: Not at target, Moving forward");
        MoveForwardAndAvoidCollision(hasCollisionPath, agent, agentPath, agentStep, collisionDataByStep, allOtherAgents, homeIndices, env);
      }

      if (isTaskComplete)
      {
        if (DebugMode) RhinoApp.WriteLine("isTaskComplete is True, ABOUT TO CALL UpdateEnvAfterDisassembly:");
        // update environment
        UpdateEnvAfterDisassembly(agent, agentTarget, env);

        // clear agent's custom data of target and path and currentstep
        hasMaterial = true;
        WorkState prevState = WorkState.Remove;
        extendArm = false;
        UpdateAgentStatusAfterTaskExecution(agent, hasMaterial, prevState, extendArm, env);
        agent.CustomData[AgentKeys.WorkState] = WorkState.Return;

        // check if it can return to base:
        Point3d agentPos = (Point3d)agent.CustomData[AgentKeys.Position];
        whereAgentIs = ComputeCorrectPointIndex(agentPos);
        if (DebugMode) RhinoApp.WriteLine("Verify: Agent's pos at agent.Position = " + agent.Position + ", which is at point from CachedAllCloud " + ComputeCorrectPointIndex(agent.Position));
        if (DebugMode) RhinoApp.WriteLine("Verify: Agent's pos at AgentKeys.Position = " + agentPos + ", which is point " + whereAgentIs);
        if (DebugMode) RhinoApp.WriteLine(" Current agentTarget = " + agentTarget);

        // if agent is not at home, but somewhere else in the field: try chain the task
        // if agent is at home, set to idle, next time frame, start from task assignment
        if (whereAgentIs == currentHome)
        {
          agent.CustomData[AgentKeys.WorkState] = WorkState.Idle;
          if (DebugMode) RhinoApp.WriteLine("ExecuteRaftRemovalTask: Completed, Agent is still at home, new state=" + agent.CustomData[AgentKeys.WorkState]);
          // if it has material and it is already at home, needs to drop off the material?
          hasMaterial = (bool)agent.CustomData[AgentKeys.HasMaterial];
          extendArm = (bool)agent.CustomData[AgentKeys.ExtendArm];
          if (hasMaterial)
          {
            DropOffMaterialAtHomeBase(agent, extendArm, currentHome, whereAgentIs);
            return;
          }

        }
        else
        {
          SetUpReturnToBase(agent, whereAgentIs, env);
          if (DebugMode) RhinoApp.WriteLine("ExecuteRaftRemovalTask: Completed, Agent is outside home, So SetUpReturnToBase(), new state=" + agent.CustomData[AgentKeys.WorkState]);
        }
      }
    }




    private void ReturnToBase(CartesianAgent agent, CartesianEnvironment env, List<CartesianAgent> allOtherAgents, List<int> homeIndices)
    {

      if (DebugMode) RhinoApp.WriteLine("---START ReturnToBase()...");
      // add null check, otherwise, it could be assigned to return to base, but without find a valid target/path
      if (!agent.CustomData.ContainsKey(AgentKeys.Target) || agent.CustomData[AgentKeys.Target] == null)
      {
        RhinoApp.WriteLine("ERROR: Agent " + agent.Id + " has no target in ReturnToBase");
        agent.CustomData[AgentKeys.WorkState] = WorkState.Idle;
        return;
      }

      if (!agent.CustomData.ContainsKey(AgentKeys.Path) || agent.CustomData[AgentKeys.Path] == null)
      {
        RhinoApp.WriteLine("ERROR: Agent " + agent.Id + " has no valid path in ReturnToBase");
        agent.CustomData[AgentKeys.WorkState] = WorkState.Idle;
        return;
      }

      Point3d agentPos = (Point3d)agent.CustomData[AgentKeys.Position];
      int currentAgentIndex = ComputeCorrectPointIndex(agentPos);
      int agentTarget = (int)agent.CustomData[AgentKeys.Target]; // the target should be the bestHome
      List<int> agentPath = (List<int>)agent.CustomData[AgentKeys.Path];
      int agentStep = (int)agent.CustomData[AgentKeys.CurrentStep];
      int agentID = agent.Id;
      Vector3d materialDirection = CachedHomeBases[agentTarget].MaterialPickUpDir;

      bool hasMaterial = (bool)agent.CustomData[AgentKeys.HasMaterial];
      bool extendArm = (bool)agent.CustomData[AgentKeys.ExtendArm];

      var allTargets = LoadTargets(env);
      var collisionRawInfo = GetCollisionInformation(agent, agentTarget, agentPath, homeIndices, allOtherAgents, env);
      // return includes: hasCollision, List<collisionSteps>, collidingAgentID, conflictingblocks in List<int>, and collision type wtih this collidingAgent
      bool hasCollisionPath = collisionRawInfo.Item1;
      Dictionary<int, CollisionData> collisionDataByStep = collisionRawInfo.Item2;

      if (DebugMode) RhinoApp.WriteLine(">>> COLLISION CHECK END agent=" + agent.Id
          + " hasCollision=" + hasCollisionPath
          + " collidingSteps=" + collisionDataByStep.Count);
      if (hasCollisionPath)
      {
        foreach (var step in collisionDataByStep)
        {
          if (DebugMode) RhinoApp.WriteLine("    at step=" + step.Key + ":");
          foreach (var agentCollision in step.Value.PerAgentCollisions)
          {
            if (DebugMode) RhinoApp.WriteLine("        vs agent=" + agentCollision.Key
                + " type=" + agentCollision.Value.Item2
                + " blocks=[" + string.Join(",", agentCollision.Value.Item1) + "]");
          }
        }
      }



      bool isTaskComplete = false;

      if (IsTargetReached(agentTarget, agentStep, agentPath, homeIndices, env))
      {
        RhinoApp.WriteLine("ReturnToBase: Checking IsTargetReached = true, setting isTaskComplete to true now...");
        isTaskComplete = true;
      }
      else
      {
        // check if the agent is one step away from the home
        bool isAgentOneStepFromHome = agentStep == agentPath.Count - 2;

        if (!isAgentOneStepFromHome)
        {
          if (DebugMode) RhinoApp.WriteLine("Execut ReturnToBase Task: Not at target, Moving forward");
          MoveForwardAndAvoidCollision(hasCollisionPath, agent, agentPath, agentStep, collisionDataByStep, allOtherAgents, homeIndices, env);
          return;
        }


        // if agent is one step away from home
        if (DebugMode) RhinoApp.WriteLine("Agent is one step away from the home now, check home entry situation...");
        var homeCheckResult = CanEnterTheHome(agent, agentTarget);
        bool canEnterTheHome = homeCheckResult.Item1;
        bool shallNegotiateForYielding = homeCheckResult.Item2;
        if (DebugMode) RhinoApp.WriteLine("canEnterTheHome = " + canEnterTheHome + ", shallNegotiateForYielding = " + shallNegotiateForYielding);


        // Strategy of handling one-step away from home
        //canEnterTheHome is true, FollowPath()
        //canEnterTheHome is false && shallNegotiateForYield is false->Wait()
        //canEnterTheHome is false && shallNegotiateForYield is true:
        //    - hasSwap: SideStep first -> no success, YieldHome later
        //    - hasTrailing, Wait()

        if (canEnterTheHome)
        {
          FollowPath(agent, agentStep, agentPath, homeIndices);
          isTaskComplete = true;

        }
        else if (shallNegotiateForYielding)
        {
          // canEnterTheHome is false, shallNegotiate is true->depending on collision type
          if (DebugMode) RhinoApp.WriteLine("Agent cannot enter the home, and is trying to negotiate with the occupying agent to yield the home or resolve the potential collisions...");

          int occupantID = HomeBaseOccupant[agentTarget];
          List<CartesianAgent> allAgents = new List<CartesianAgent> { agent };
          allAgents.AddRange(allOtherAgents);
          CartesianAgent occupyingAgent = allAgents.FirstOrDefault(a => a.Id == occupantID);

          // verify if the occupant is acutally phyiscally at home
          bool isOccupantPhysicallyAtHome = false;
          if (occupantID >= 0 && persistentAgentData.ContainsKey(occupantID))
          {
            Point3d occupantPos = (Point3d)persistentAgentData[occupantID][AgentKeys.Position];
            int occupantPosIndex = ComputeCorrectPointIndex(occupantPos);
            isOccupantPhysicallyAtHome = (occupantPosIndex == agentTarget);
          }

          if (!isOccupantPhysicallyAtHome)
          {
            // Agent is not phyisciall at home, but canEnterTheHome is false
            // this means there's a Stale account record - clear it and proceed
            HomeBaseOccupant[agentTarget] = -1;
            agent.CustomData[AgentKeys.ShouldMoveForward] = true;
            if (DebugMode) RhinoApp.WriteLine("Agent " + agent.Id
                + ": HomeBaseOccupant[" + agentTarget + "] = " + occupantID
                + " is stale (agent not physically at home). Clearing.");
          }

          // Check if the agent will have collision in the next step
          if (DebugMode) RhinoApp.WriteLine("Agent is one step away from the home now, check if there's any collisions detected...");
          CollisionData collisionDataAtNextStep = null;
          collisionDataByStep.TryGetValue(agentStep + 1, out collisionDataAtNextStep);
          var nextStepCollisionDataDict = collisionDataAtNextStep != null
            ? collisionDataAtNextStep.PerAgentCollisions
            : new Dictionary<int, Tuple<List<int>, CollisionType>>();


          // occupant is genuinely at home, check what collision type if has and start Yielding Home...
          CollisionType occupantCollisionType = CollisionType.Other;
          if (collisionDataAtNextStep != null
            && collisionDataAtNextStep.PerAgentCollisions.ContainsKey(occupantID))
          {
            occupantCollisionType = collisionDataAtNextStep.PerAgentCollisions[occupantID].Item2;
          }

          if (occupantCollisionType == CollisionType.Static)
          {
            // case Static Collision: occupant is idle with no path — yield is appropriate
            if (occupyingAgent != null)
            {
              YieldHomeToReturner(agent, occupyingAgent, agentTarget, allOtherAgents, env);
            }
          }
          else if (occupantCollisionType == CollisionType.Swap)
          {
            bool canSideStep = TrySideStepToYield(agent, agentPath[agentStep], agentStep, env);
            if (!canSideStep)
            {
              YieldHomeToReturner(agent, occupyingAgent, agentTarget, allOtherAgents, env);
            }
          }
          else if (occupantCollisionType == CollisionType.Trailing)
          {
            Wait(agent, agentStep, agentPath, homeIndices);
          }
        }
        else
        {
          // canEnterTheHome is false, shallNegotiate is false, wait anyway
          Wait(agent, agentStep, agentPath, homeIndices);

        }
      }



      if (isTaskComplete)
      {
        if (DebugMode) RhinoApp.WriteLine("Execute ReturnToBase Task: isTaskComplete is True, ABOUT TO CALL Update Agent Status: ");

        // release path
        agentPos = (Point3d)agent.CustomData[AgentKeys.Position];
        int whereAgentIs = ComputeCorrectPointIndex(agentPos);
        if (DebugMode) RhinoApp.WriteLine("Verify: Before Release Path After executing task, currentIndex= " + whereAgentIs + ", assignedTarget = " + agentTarget + ", path[path.Count-1] = " + agentPath[agentPath.Count - 1]);
        ReleasePathAfterExecuteTask(false, agent, agentTarget, env);
        OccupyHomeFromReturnQueue(agent, agentTarget, agentID, env); // set occupant id to agent, and remove agent from return queue

        if (DebugMode) RhinoApp.WriteLine("Execute ReturnToBase Task: Agent " + agent.Id + ", starts to drop off the material...");
        if (DebugMode) RhinoApp.WriteLine("Execute ReturnToBase Task: Agent " + agent.Id + ", hasMaterial = " + hasMaterial + ", extendArm = " + extendArm);

        if (hasMaterial)
        {
          if (DebugMode) RhinoApp.WriteLine("Execute ReturnToBase Task: agent has material and need to release the material...");
          DropOffMaterialAtHomeBase(agent, extendArm, agentTarget, agentTarget);
          return;
        }

        // clear agent's custom data of target and path and currentstep
        WorkState prevState = WorkState.Return;
        extendArm = false;
        hasMaterial = false;
        UpdateAgentStatusAfterTaskExecution(agent, hasMaterial, prevState, extendArm, env);
        agent.CustomData[AgentKeys.WorkState] = WorkState.Idle;
      }
    }




    //----------------------TASK OPTIMIZATION - REUSE MATERIAL -------------------------------------
    private void TryChainTaskToAssemble(CartesianAgent agent, int whereAgentIs, CartesianEnvironment env)
    {
      if (DebugMode) RhinoApp.WriteLine("Start Running TryChainTaskToAssemble...");
      // access environment data --static
      List<int> homeIndices = CachedHomeBases.Keys.ToList();

      // remove invalid targets from allTargets:
      CleanUpTargetsBeforeTaskAssignment(agent, env);

      List<int> assembleTargets = UpdateNextAssembleList(env, homeIndices);

      // ✅ Add detailed logging
      if (DebugMode) RhinoApp.WriteLine("TryChainTaskToAssemble: assembleTargets.Count=" + assembleTargets.Count);

      WorkState currentState = (WorkState)agent.CustomData[AgentKeys.WorkState];
      WorkState nextState = WorkState.Return; // by default, return
      int nextTask = -1;

      // Found Assemble Task
      // if agent's prevState is disassemble, then tryChianTask for assemble task
      if (DebugMode) RhinoApp.WriteLine("About to AssignAssembleTask through ExecutePathFindingTask...");
      if (DebugMode) RhinoApp.WriteLine("Verify: Agent's pos at agent.Position = " + agent.Position + ", which is at point " + ComputeCorrectPointIndex(agent.Position));
      if (DebugMode) RhinoApp.WriteLine("Verify: Agent currentIndex = " + whereAgentIs);
      nextTask = (int)AssignAssembleTask(agent, whereAgentIs, assembleTargets, env);

      // avoid infinite loop
      int attempts = 0;
      int maxAttempts = assembleTargets.Count + 1;

      // the nextTask cannot be the one you just disassembled!!!
      while (nextTask == whereAgentIs && attempts < maxAttempts)
      {
        assembleTargets.Remove(nextTask);
        if (assembleTargets.Count > 0)
        {
          nextTask = (int)AssignAssembleTask(agent, whereAgentIs, assembleTargets, env);
        }
        else
        {
          nextTask = -1;
          break;
        }
        attempts++;
      }

      int currentHome = (int)agent.CustomData[AgentKeys.CurrentHome];
      if (assembleTargets.Count == 0 || nextTask == -1)
      {
        RhinoApp.WriteLine("ERROR: TryChainTask - No Valid Assemble Task Can Be Found, Set Up Return To Base");
        SetUpReturnToBase(agent, whereAgentIs, env);
        return;
      }

      Dictionary<int, TargetData> allTargets = LoadTargets(env);
      // Add defensive code:
      if (!allTargets.ContainsKey(nextTask))
      {
        RhinoApp.WriteLine("ERROR: TryChainTask - assemble target " + nextTask + " not in Targets dictionary! Set Up Return To Base");
        SetUpReturnToBase(agent, whereAgentIs, env);
        return;
      }

      if (DebugMode) RhinoApp.WriteLine("TryChainTask - Found Valid Assemble Task " + nextTask);
      nextState = WorkState.Assemble;
      bool hasMaterial = true;
      UpdateAgentStatusAfterTargetAssignment(agent, hasMaterial, whereAgentIs, nextTask, nextState, currentState, env);
      OccupyPathAfterTaskAssignment(true, agent, whereAgentIs, nextTask, env);
      AddAgentIDToReservationAfterTargetAssignment(agent, env, nextTask);
      return;

    }


    private void TryChainTaskToDisassemble(CartesianAgent agent, int whereAgentIs, CartesianEnvironment env)
    {
      if (DebugMode) RhinoApp.WriteLine("Start Running TryChainTask...");

      HashSet<int> deployed = (HashSet<int>)env.CustomData[EnvironmentKeys.Deployed];
      int deployedSupportCount = deployed.Where(i => CachedVoxelTypes[i] == VoxelType.Support).Count();

      // remove invalid targets from allTargets:
      CleanUpTargetsBeforeTaskAssignment(agent, env);

      if (DebugMode) RhinoApp.WriteLine("TryChainTask: Checking if there's any disassembled tasks...");
      List<int> disassembleTargets = UpdateSupportDisassembleList(env);

      // ✅ Add detailed logging
      if (DebugMode) RhinoApp.WriteLine("TryChainTask: disassembleTargets.Count=" + disassembleTargets.Count);

      WorkState currentState = (WorkState)agent.CustomData[AgentKeys.WorkState];
      WorkState nextState = WorkState.Return; // by default, return
      int nextTask = -1;

      // Found Disassemble Task
      // if agent's prvState is assemble, then tryChainTask for disassemble task
      int currentHome = (int)agent.CustomData[AgentKeys.CurrentHome];
      if (deployedSupportCount == 0 || disassembleTargets.Count == 0)
      {
        RhinoApp.WriteLine("ERROR: TryChainTask - Either no supports being built or no eligible supports to be disassembled, Set Up Return To Base");
        SetUpReturnToBase(agent, whereAgentIs, env);
        return;
      }
      else
      {
        if (DebugMode) RhinoApp.WriteLine("TryChainTask - Found Supports in the Deployed, to check if there's valid tasks to be assigned...");
        if (DebugMode) RhinoApp.WriteLine("Verify: Agent's pos at agent.Position = " + agent.Position + ", which is at point " + ComputeCorrectPointIndex(agent.Position));
        if (DebugMode) RhinoApp.WriteLine("Verify: Agent currentIndex = " + whereAgentIs);
        nextTask = (int)AssignDisassembleTask(agent, whereAgentIs, disassembleTargets, env);

        // avoid infinite loop
        int attempts = 0;
        int maxAttempts = disassembleTargets.Count + 1;

        // the nextTask cannot be the one you just assembled!!!
        while (nextTask == whereAgentIs && attempts < maxAttempts)
        {
          disassembleTargets.Remove(nextTask);
          if (disassembleTargets.Count > 0)
          {

            nextTask = (int)AssignDisassembleTask(agent, whereAgentIs, disassembleTargets, env);
          }
          else
          {
            nextTask = -1;
            break;
          }
          attempts++;
        }

        if (attempts >= maxAttempts)
        {
          nextTask = -1;
        }

        if (disassembleTargets.Count == 0 || nextTask == -1)
        {
          RhinoApp.WriteLine("ERROR: TryChainTask - No Valid Disassemble Task Can Be Found, Set Up Return To Base");
          SetUpReturnToBase(agent, whereAgentIs, env);
          return;
        }

        Dictionary<int, TargetData> allTargets = LoadTargets(env);
        // Add defensive code:
        if (!allTargets.ContainsKey(nextTask))
        {
          RhinoApp.WriteLine("ERROR: TryChainTask - disassemble target " + nextTask + " not in Targets dictionary! Set Up Return To Base");
          SetUpReturnToBase(agent, whereAgentIs, env);
          return;
        }

        if (DebugMode) RhinoApp.WriteLine("TryChainTask - Found Valid Disassemble Task " + nextTask);
        nextState = WorkState.Disassemble;
        bool hasMaterial = false;
        UpdateAgentStatusAfterTargetAssignment(agent, hasMaterial, whereAgentIs, nextTask, nextState, currentState, env);
        OccupyPathAfterTaskAssignment(true, agent, whereAgentIs, nextTask, env);
        AddAgentIDToReservationAfterTargetAssignment(agent, env, nextTask);
        return;
      }
    }






    // ------------------------ CHECK COLLISIONS--------------------------------
    public Dictionary<int, List<int>> GetReservedTargetAndPath(int agentID, int agentTarget, CartesianEnvironment env)
    {
      var agentActivePath = (Dictionary<int, List<int>>)env.CustomData[EnvironmentKeys.ActivePath];
      var reservedTargets = agentActivePath.Where(a => a.Key != agentID)
        .Where(a => a.Value != null && a.Value.Count >= 1)
        .ToDictionary(a => a.Key, a => a.Value);

      if (DebugMode) RhinoApp.WriteLine("GetReservedTargetAndPath:  The number of targets that are reserved by agents = " + reservedTargets.Count);
      foreach (var kvp in reservedTargets)
      {
        if (DebugMode) RhinoApp.WriteLine("  Other Agent " + kvp.Key + ": reserved target = " + kvp.Value[kvp.Value.Count - 1] + ", with path: [" +
            string.Join(", ", kvp.Value) + "]");
      }

      return reservedTargets;
    }



    private Tuple<bool, Dictionary<int, CollisionData>> GetCollisionInformation(CartesianAgent agent, int agentTarget, List<int> agentPath, List<int> homeIndices, List<CartesianAgent> allOtherAgents, CartesianEnvironment env)
    {
      // check if this agent has a colliding path with other agents
      int agentID = agent.Id;
      if (DebugMode) RhinoApp.WriteLine("--- GetCollisionInformation() START: agent=" + agentID
          + " target=" + agentTarget
          + " step=" + agent.CustomData[AgentKeys.CurrentStep]
          + " path=[" + string.Join(",", agentPath) + "]");


      var otherAgentPaths = (Dictionary<int, List<int>>)GetReservedTargetAndPath(agentID, agentTarget, env);


      if (otherAgentPaths.Count == 0)
      {
        if (DebugMode) RhinoApp.WriteLine("    Other agents dont not have reserved path yet, skipping collision check");
        Dictionary<int, CollisionData> collisionResults = new Dictionary<int, CollisionData>();
        return Tuple.Create(false, collisionResults);
      }

      var finalCollisionResults = CheckPathCollision(agent, agentTarget, agentPath, otherAgentPaths, homeIndices, allOtherAgents, env);
      return finalCollisionResults;
    }



    public Tuple<bool, Dictionary<int, CollisionData>> CheckPathCollision(CartesianAgent agent, int agentTarget, List<int> agentPath, Dictionary<int, List<int>> otherAgentPaths, List<int> homeIndices, List<CartesianAgent> allOtherAgents, CartesianEnvironment env)
    {
      // this is to update each agent's step's collision information--with which collding agent, at List<int> blocks, for what collision type
      if (DebugMode) RhinoApp.WriteLine("CheckPathCollision: START");
      // at each agent's colliding step, what are the collision data for this given step
      Dictionary<int, CollisionData> collisionsByStep = new Dictionary<int, CollisionData>();
      bool hasCollision = false;

      if (otherAgentPaths.Count == 0)
      {
        return Tuple.Create(hasCollision, collisionsByStep);
      }

      // this agent's current and next node index, current footprint list and next footprint list
      int agentStep = (int)agent.CustomData[AgentKeys.CurrentStep];
      bool extendArm = (bool)agent.CustomData[AgentKeys.ExtendArm];
      var agentFootprintResult = AgentCurrentAndNextFoorPrint(agent, agentPath, agentTarget, agentStep, extendArm);

      int agentCurrentIndex = agentFootprintResult.Item1[0];
      int agentNextIndex = agentFootprintResult.Item1[1];
      List<int> agentCurrentFootprint = agentFootprintResult.Item2[0];
      List<int> agentNextFootprint = agentFootprintResult.Item2[1];


      // DEBUGGING
      if (DebugMode) RhinoApp.WriteLine("=== CheckPathCollision agent=" + agent.Id
          + " step=" + agentStep
          + " current=" + agentCurrentIndex   // add after footprint call
          + " next=" + agentNextIndex);

      // after computing footprints, log them:
      if (DebugMode) RhinoApp.WriteLine("    agentCurrentFootprint=["
          + string.Join(",", agentCurrentFootprint) + "]");
      if (DebugMode) RhinoApp.WriteLine("    agentNextFootprint=["
          + string.Join(",", agentNextFootprint) + "]");


      foreach (var kvp in otherAgentPaths)
      {
        int otherAgentID = kvp.Key;
        List<int> otherAgentPath = kvp.Value;

        CartesianAgent otherAgent = allOtherAgents.FirstOrDefault(a => a.Id == otherAgentID);
        if (otherAgent == null)
        {
          if (DebugMode) RhinoApp.WriteLine("CheckPathCollision: could not find agent "
              + otherAgentID + ", skipping");
          continue;
        }

        // get other agent's step and arm state from persistentAgentData
        // IMPORTANT: must read from persistentAgentData, not otherAgent.CustomData
        // because otherAgent.CustomData may not be restored yet this tick
        int otherAgentCurrentStep = 0;
        if (persistentAgentData.ContainsKey(otherAgentID)
          && persistentAgentData[otherAgentID].ContainsKey(AgentKeys.CurrentStep))
        {
          otherAgentCurrentStep = (int)persistentAgentData[otherAgentID][AgentKeys.CurrentStep];
        }

        // get arm extension from persistent data too
        bool otherAgentArmExtended = false;
        if (persistentAgentData.ContainsKey(otherAgentID)
          && persistentAgentData[otherAgentID].ContainsKey(AgentKeys.ExtendArm))
        {
          otherAgentArmExtended = (bool)persistentAgentData[otherAgentID][AgentKeys.ExtendArm];
        }

        // get other agent's target index
        int otherAgentTargetIndex = otherAgentPath[otherAgentPath.Count - 1];

        var otherAgentFootprintResult = AgentCurrentAndNextFoorPrint(otherAgent, otherAgentPath, otherAgentTargetIndex, otherAgentCurrentStep, otherAgentArmExtended);
        int otherAgentCurrentIndex = otherAgentFootprintResult.Item1[0];
        int otherAgentNextIndex = otherAgentFootprintResult.Item1[1];
        List<int> otherAgentCurrentFootprint = otherAgentFootprintResult.Item2[0];
        List<int> otherAgentNextFootprint = otherAgentFootprintResult.Item2[1];


        // --- DETECT COLLISION TYPE ---

        // case 1 - Swap: A.current == B.next AND B.current == A.next
        bool isSwap = agentNextIndex >= 0
          && otherAgentNextIndex >= 0
          && agentCurrentIndex == otherAgentNextIndex
          && agentNextIndex == otherAgentCurrentIndex;

        // case 2 - Head-On: agent's next foot print overlaps with each other's next footprint
        List<int> headOnBlocks = agentNextFootprint.Intersect(otherAgentNextFootprint).ToList();
        bool isHeadOn = headOnBlocks.Count > 0 && !isSwap;

        // case 3 - static occupier: the agent is not moving, but is occupying the moving agent's next index
        bool isStaticBlock = agentNextIndex >= 0
          && otherAgentNextIndex < 0 // the colliding agent has no next step
          && agentNextIndex == otherAgentCurrentIndex
          && !isSwap;

        // case 4 - trailing: // A.next == B.current  AND  B has a next step && B has not run yet this tick (B.Id > A.Id)
        bool isTrailing = agentNextIndex >= 0
          && agentNextIndex == otherAgentCurrentIndex
          && otherAgentNextIndex >= 0
          && !isSwap;


        //DEBUGGING
        if (DebugMode) RhinoApp.WriteLine("    checking vs agent= " + otherAgentID
            + " isSwap=" + isSwap
            + " isHeadOn=" + isHeadOn
            + " isStatic=" + isStaticBlock
            + " isTrailing=" + isTrailing
            + " headOnBlocks=[" + string.Join(",", headOnBlocks) + "]");


        // --- DETERMINE CONFLICT BLOCKS AND COLLISION TYPE ---
        // use else if because for a given agent pair at this step,
        // only one collision type can apply:
        // swap and head-on are mutually exclusive
        // static and trailing both require B.current == A.next
        // which is already excluded from head-on and swap

        CollisionType collisionType = CollisionType.Other;
        List<int> conflictBlocks = new List<int>();
        if (isHeadOn)
        {
          conflictBlocks.AddRange(headOnBlocks);
          collisionType = CollisionType.HeadOn;
        }
        else if (isSwap)
        {
          conflictBlocks.Add(agentNextIndex);
          collisionType = CollisionType.Swap;
        }
        else if (isStaticBlock)
        {
          conflictBlocks.Add(agentNextIndex);
          collisionType = CollisionType.Static;
        }
        else if (isTrailing)
        {
          conflictBlocks.Add(agentNextIndex);
          collisionType = CollisionType.Trailing;
        }


        // --- STORE IN collisionsByStep ---

        //conflictBlocks = conflictBlocks.Distinct().ToList(); // actually need to keep the duplicates
        if (conflictBlocks.Count > 0)
        {
          //int stepInPath = agentPath.IndexOf(conflictBlocks[0]);
          // NOTE: indexOf only return the first occurence. If you have the same point in the conflictBlock, it will not return all of them!!!
          int stepInPath = agentStep + 1;
          // verify the block is actually there as a sanity check
          if (stepInPath >= agentPath.Count)
          {
            if (DebugMode) RhinoApp.WriteLine("CheckPathCollision: stepInPath out of range, skipping");
            continue;
          }

          if (stepInPath < 0)
          {
            if (DebugMode) RhinoApp.WriteLine("CheckPathCollision: conflict block " + conflictBlocks[0]
                + " not found in agentPath, skipping");
            continue;
          }

          if (!collisionsByStep.ContainsKey(stepInPath))
          {
            collisionsByStep[stepInPath] = new CollisionData();
          }
          // Add this other agent's collision into the CollisionData for this step.
          // Multiple other agents can collide with the agent at the same step --
          // each gets its own entry in CollisionData.PerAgentCollisions.
          collisionsByStep[stepInPath].Add(otherAgentID, conflictBlocks, collisionType);

          hasCollision = true;

          if (DebugMode) RhinoApp.WriteLine("CheckPathCollision: COLLISION STORED: agent=" + agent.Id
              + " | vs agent=" + otherAgentID
              + " | type=" + collisionType
              + " | at step=" + stepInPath
              + " | blocks=[" + string.Join(", ", conflictBlocks) + "]");
        }
        else
        {
          if (DebugMode) RhinoApp.WriteLine("    NO COLLISION: agent=" + agent.Id
              + " vs agent=" + otherAgentID);
        }
      }

      if (DebugMode) RhinoApp.WriteLine("CheckPathCollision: END"
          + " | hasCollision=" + hasCollision
          + " | colliding steps=["
          + string.Join(", ", collisionsByStep.Keys) + "]");

      return Tuple.Create(hasCollision, collisionsByStep);
    }


    private Tuple<List<int>, List<List<int>>> AgentCurrentAndNextFoorPrint(CartesianAgent agent, List<int> path, int targetIndex, int agentStep, bool agentArmExtension)
    {
      List<int> agentCurrentAndNextIndex = new List<int>();
      List<List<int>> agentCurrentAndNextFootprint = new List<List<int>>();
      List<int> homeIndices = CachedHomeBases.Keys.ToList();

      int agentCurrentIndex = -1;
      if (agentStep < path.Count)
      {
        agentCurrentIndex = path[agentStep];
      }

      int agentNextIndex = -1;
      if (agentStep + 1 < path.Count)
      {
        agentNextIndex = path[agentStep + 1];
      }

      agentCurrentAndNextIndex = new List<int> { agentCurrentIndex, agentNextIndex };

      // colliding agent's current footprint
      List<int> agentCurrentFootprint = new List<int>();
      if (agentCurrentIndex >= 0)
      {
        agentCurrentFootprint.Add(agentCurrentIndex);
      }
      if (agentArmExtension && agentNextIndex >= 0)
      {
        agentCurrentFootprint.Add(agentNextIndex);
      }

      // colliding agent's next footprint
      List<int> agentNextFootprint = new List<int>();
      if (agentNextIndex >= 0)
      {
        agentNextFootprint.Add(agentNextIndex);

        // arm only matters when agent will be one step from target next tick
        // i.e. agentNextIndex is the body stop position (path[Count-2] for tasks,
        // path[Count-1] for home return)
        bool isTargetHome = homeIndices.Contains(targetIndex);
        int bodyStopStep = WhereBodyShouldEnd(targetIndex, homeIndices, path);
        bool nextStepIsBodyStop = (agentStep + 1 == bodyStopStep);

        if (nextStepIsBodyStop && !isTargetHome)
        {
          // next tick the agent will be at body stop position and will
          // extend arm toward the target -- include target in footprint
          agentNextFootprint.Add(targetIndex);
        }
      }

      agentCurrentAndNextFootprint = new List<List<int>> { agentCurrentFootprint, agentNextFootprint };

      return Tuple.Create(agentCurrentAndNextIndex, agentCurrentAndNextFootprint);
    }



    // --------------------------COLLISION NEGOTIATION AND AVOIDANCE------------------------------------

    private Tuple<bool, bool, bool, bool> DetectNextStepCollisionType(Dictionary<int, Tuple<List<int>, CollisionType>> nextStepCollisionDataDict)
    {
      // RETURN: bool for hasHeadOn, bool for hasSwap, bool for hasTrailing, bool for hasStatic

      // find the collision data at the given step, and check what type of the collision it will be in the next step
      // Dictionary<int, Tuple<List<int>, CollisionType>> collisions
      bool hasHeadOn = false;
      bool hasSwap = false;
      bool hasTrailing = false;
      bool hasStatic = false;

      var headOnCollision = nextStepCollisionDataDict.Where(c => c.Value.Item2 == CollisionType.HeadOn);
      hasHeadOn = headOnCollision.ToList().Count() > 0;
      hasSwap = nextStepCollisionDataDict.Any(c => c.Value.Item2 == CollisionType.Swap);
      hasTrailing = nextStepCollisionDataDict.Any(c => c.Value.Item2 == CollisionType.Trailing);
      hasStatic = nextStepCollisionDataDict.Any(c => c.Value.Item2 == CollisionType.Static);

      return Tuple.Create(hasHeadOn, hasSwap, hasTrailing, hasStatic);
    }

    private Tuple<bool, bool> DecideCollisionSolution(CartesianAgent agent, List<CartesianAgent> allOtherAgents, int agentStep, List<int> agentPath,
      bool hasHeadOn, bool hasSwap, bool hasTrailing, bool hasStatic,
      Dictionary<int, Tuple<List<int>, CollisionType>> nextStepCollisionDataDict, CartesianEnvironment env)
    {
      // case 0: if deadlock here for more than 5 ticks, then find to find a new assignment with a new path
      // handled outside this method

      Point3d agentPos = (Point3d)agent.CustomData[AgentKeys.Position];
      int whereAgentIs = ComputeCorrectPointIndex(agentPos);
      WorkState agentState = (WorkState)agent.CustomData[AgentKeys.WorkState];

      bool canSideStep = false;
      bool requiresWaiting = false;
      var headOnCollision = nextStepCollisionDataDict.Where(c => c.Value.Item2 == CollisionType.HeadOn);
      // Case 1: if there exists swap collision, try to find a sidestep neighbor
      if (hasSwap)
      {
        canSideStep = TrySideStepToYield(agent, whereAgentIs, agentStep, env);
        if (canSideStep == false)
        {
          requiresWaiting = true;
          agent.CustomData[AgentKeys.ShouldMoveForward] = false;
        }
        else
        {
          requiresWaiting = false;
          agent.CustomData[AgentKeys.ShouldMoveForward] = true;
          // path was updated in TrySideStepToYield, re-read it
          agentPath = (List<int>)agent.CustomData[AgentKeys.Path];
        }
      }
      else if ((hasStatic || hasTrailing))
      {
        requiresWaiting = true;
        agent.CustomData[AgentKeys.ShouldMoveForward] = false;
      }
      else if (hasHeadOn && !requiresWaiting)
      {
        List<WorkState> collidingAgentStates = new List<WorkState>();
        foreach (var kvp in headOnCollision)
        {
          int collidingAgentID = kvp.Key;
          CartesianAgent collidingAgent = allOtherAgents.FirstOrDefault(a => a.Id == collidingAgentID);
          if (collidingAgentID < 0 || collidingAgent == null) continue;
          WorkState collidingAgentState = ((persistentAgentData.ContainsKey(collidingAgentID)
            && persistentAgentData[collidingAgentID].ContainsKey(AgentKeys.WorkState))
            ? (WorkState)persistentAgentData[collidingAgentID][AgentKeys.WorkState]
            : WorkState.Idle);
          collidingAgentStates.Add(collidingAgentState);
          if (agentState == WorkState.Return && collidingAgentState != WorkState.Return)
          {
            requiresWaiting = true;
            agent.CustomData[AgentKeys.ShouldMoveForward] = false;
            break;
          }
          else if (agentState != WorkState.Return && collidingAgentState == WorkState.Return)
          {
            requiresWaiting = false;
            agent.CustomData[AgentKeys.ShouldMoveForward] = true;
            break;
          }
          else if (agent.Id < collidingAgentID)
          {
            requiresWaiting = false;
            agent.CustomData[AgentKeys.ShouldMoveForward] = true;
            break;
          }
          else if (agent.Id > collidingAgentID)
          {
            requiresWaiting = true;
            agent.CustomData[AgentKeys.ShouldMoveForward] = false;
            break;
          }
        }

      }

      return Tuple.Create(canSideStep, requiresWaiting);
    }





    private bool TrySideStepToYield(CartesianAgent agent, int whereAgentIs, int agentStep, CartesianEnvironment env)
    {
      if (DebugMode) RhinoApp.WriteLine("---START TrySideStepToYield(): agent=" + agent.Id
          + " whereAgentIs=" + whereAgentIs
          + " agentStep=" + agentStep);

      bool canSideStep = false;

      // first to find its adjacent neighbors based on where agent is
      List<int> buildStateInts = (List<int>)env.CustomData[EnvironmentKeys.BuildState];
      List<BuildState> buildStates = buildStateInts.Select(i => (BuildState)i).ToList();

      var activePathDict = (Dictionary<int, List<int>>)env.CustomData[EnvironmentKeys.ActivePath];
      HashSet<int> activePathSet = new HashSet<int>(); // the set is to union all the active path in one flattened set
      if (DebugMode) RhinoApp.WriteLine("    activePathSet=[" + string.Join(",", activePathSet.ToList()) + "]");

      foreach (var kvp in activePathDict)
      {
        if (kvp.Key == agent.Id) continue;
        foreach (int path in kvp.Value) activePathSet.Add(path);
      }

      List<int> agentNeighbors = (CachedAdjacencyMap.ContainsKey(whereAgentIs))
        ? CachedAdjacencyMap[whereAgentIs]
        : new List<int>();
      if (DebugMode) RhinoApp.WriteLine("    agentNeighbors=[" + string.Join(",", agentNeighbors) + "]");

      if (agentNeighbors.Count == 0)
      {
        canSideStep = false;
        return canSideStep;
      }

      // among the adjacent neighbors, find which neighbor is available for side stepping
      // the neighbor should be deployed and not in other agent's path
      List<int> neighborsSureForSideStep = new List<int>(); // neighbors that are absolutely safe for side stepping
      List<int> neighborsCouldForSideStep = new List<int>(); // neighbors that are less safe but could be used for side step in the next 1-2 ticks
      foreach (int neighbor in agentNeighbors)
      {
        BuildState neighborState = buildStates[neighbor];
        if (neighborState != BuildState.Deployed) continue;
        bool isNeighborInActivePath = activePathSet.Contains(neighbor);
        if (DebugMode) RhinoApp.WriteLine("    neighbor=" + neighbor
            + " buildState=" + neighborState
            + " isNeighborInActivePath=" + isNeighborInActivePath);

        if (!isNeighborInActivePath)
        {
          neighborsSureForSideStep.Add(neighbor);
        }
        else
        {
          // how to check if neighbors will be occupied by other agent in the next 1-2 ticks?
          // -- to check where the occupied agent's step is and how far it is from the neighbor
          bool couldNeighborForSideSteping = true;
          foreach (var kvp in activePathDict)
          {
            int otherAgentID = kvp.Key;
            List<int> otherAgentPath = kvp.Value;
            int whereNeighborInPath = otherAgentPath.IndexOf(neighbor);
            int otherAgentCurrentStep = (persistentAgentData.ContainsKey(otherAgentID)
              && persistentAgentData[otherAgentID].ContainsKey(AgentKeys.CurrentStep))
              ? (int)persistentAgentData[otherAgentID][AgentKeys.CurrentStep]
              : -1;

            bool otherAgentWillPassSoon = otherAgentCurrentStep >= 0
              && otherAgentPath.Contains(neighbor)
              && whereNeighborInPath >= otherAgentCurrentStep
              && (whereNeighborInPath - otherAgentCurrentStep) <= 2;

            if (otherAgentWillPassSoon)
            {
              couldNeighborForSideSteping = false;
              break;
            }

          }

          if (couldNeighborForSideSteping) neighborsCouldForSideStep.Add(neighbor);
        }
      }


      int neighborIndexForSideStep = -1;
      if (neighborsSureForSideStep.Count != 0)
      {
        canSideStep = true;
        foreach (int neighbor in neighborsSureForSideStep)
        {
          bool isNeighborTheOccupiedHome = (HomeBaseOccupant.ContainsKey(neighbor) && HomeBaseOccupant[neighbor] != -1);
          if (isNeighborTheOccupiedHome) continue;
          neighborIndexForSideStep = neighborsSureForSideStep[0];
        }
      }
      else if (neighborsCouldForSideStep.Count != 0)
      {
        canSideStep = true;
        Random random = new Random(agent.Id + GlobalIterationCount * 100);
        foreach (int neighbor in neighborsCouldForSideStep)
        {
          bool isNeighborTheOccupiedHome = (HomeBaseOccupant.ContainsKey(neighbor) && HomeBaseOccupant[neighbor] != -1);
          if (isNeighborTheOccupiedHome) continue;
          neighborIndexForSideStep = neighborsCouldForSideStep[random.Next(0, neighborsCouldForSideStep.Count)];
        }
      }
      else
      {
        canSideStep = false;
      }

      //DEBUGGING:
      if (DebugMode) RhinoApp.WriteLine("    neighborsSure=[" + string.Join(",", neighborsSureForSideStep) + "]");
      if (DebugMode) RhinoApp.WriteLine("    neighborsCould=[" + string.Join(",", neighborsCouldForSideStep) + "]");
      if (DebugMode) RhinoApp.WriteLine("    neighborIndexForSideStep=" + neighborIndexForSideStep);


      List<int> agentOriginalPath = (List<int>)agent.CustomData[AgentKeys.Path];
      List<int> agentUpdatedPath = new List<int>();
      if (neighborIndexForSideStep != -1 && canSideStep)
      {
        List<int> sideStepList = new List<int> { neighborIndexForSideStep, whereAgentIs };
        agentUpdatedPath = new List<int>(agentOriginalPath);
        if (agentStep < agentUpdatedPath.Count)
        {
          agentUpdatedPath.InsertRange(agentStep + 1, sideStepList);
        }
        // update agentPath
        agent.CustomData[AgentKeys.Path] = agentUpdatedPath;
        //update ActivePath to include sideStep position
        activePathDict[agent.Id] = agentUpdatedPath;
        env.CustomData[EnvironmentKeys.ActivePath] = activePathDict;

        if (DebugMode) RhinoApp.WriteLine("Agent can side step to neighbor = " + neighborIndexForSideStep
            + ", with updatedPath = [" + string.Join(",", agentUpdatedPath) + "]");

      }

      if (DebugMode) RhinoApp.WriteLine("---COMPLETE TrySideStepToYield(): canSideStep=" + canSideStep);
      return canSideStep;
    }





    //------------------------FOLLOW PATH TO MOVE FORWARD--------------------------------------
    private void MoveForwardAndAvoidCollision(bool hasCollisionPath, CartesianAgent agent, List<int> agentPath, int agentStep, Dictionary<int, CollisionData> collisionsByStep, List<CartesianAgent> allOtherAgents, List<int> homeIndices, CartesianEnvironment env)
    {
      if (DebugMode) RhinoApp.WriteLine("--- START MoveForwardAndAvoidCollision(): agent=" + agent.Id
          + " step=" + agentStep
          + " hasCollision=" + hasCollisionPath
          + " collidingSteps=[" + string.Join(",", collisionsByStep.Keys) + "]");

      //-------------------NO COLLISION FOR ENTIRE AGENT PATH------------------
      if (!hasCollisionPath)
      {
        if (DebugMode) RhinoApp.WriteLine("No collision on entire path, calling FollowPath()...");
        agent.CustomData[AgentKeys.ShouldMoveForward] = true;
        FollowPath(agent, agentStep, agentPath, homeIndices); // inside the method, agentStep is increased by 1
        return;
      }

      //---------WILL COLLISION OCCUR AT NEXT STEP---------------
      // at which step will encounter collision-> how many collisions the agent will encounter at that step
      CollisionData collisionDataAtNextStep = null;
      collisionsByStep.TryGetValue(agentStep + 1, out collisionDataAtNextStep);

      //----------IF NO, CONTINUE ON THE PATH--------------------
      // Does agent need to check next-block collisions at the current step
      bool isCollisionAtNextStep = collisionDataAtNextStep != null && hasCollisionPath;
      int collisionEncounters = (isCollisionAtNextStep && hasCollisionPath)
        ? collisionDataAtNextStep.CollisionCountPerStep()
        : 0;
      if (DebugMode) RhinoApp.WriteLine("    isCollisionAtNextStep=" + isCollisionAtNextStep
          + " collisionEncounters=" + collisionEncounters);

      if (!isCollisionAtNextStep)
      {
        if (DebugMode) RhinoApp.WriteLine("No collision at next step, calling FollowPath()...");
        agent.CustomData[AgentKeys.ShouldMoveForward] = true;
        FollowPath(agent, agentStep, agentPath, homeIndices); // inside the method, agentStep is increased by 1
        return;
      }


      //------------IF YES, COLLISION AVOIDANCE SOLUTIONS BASED ON COLLISION TYPES----------------
      // find the collision data at the given step, and check what type of the collision it will be in the next step
      // Dictionary<int, Tuple<List<int>, CollisionType>> collisions
      Dictionary<int, Tuple<List<int>, CollisionType>> nextStepCollisionDataDict = collisionDataAtNextStep.PerAgentCollisions;
      var nextStepCollisionType = DetectNextStepCollisionType(nextStepCollisionDataDict);
      bool hasHeadOn = nextStepCollisionType.Item1;
      bool hasSwap = nextStepCollisionType.Item2;
      bool hasTrailing = nextStepCollisionType.Item3;
      bool hasStatic = nextStepCollisionType.Item4;

      //DEBUGGING
      if (DebugMode) RhinoApp.WriteLine("DetectNextStepCollisionType():  hasHeadOn=" + hasHeadOn
          + " | hasSwap=" + hasSwap
          + " | hasTrailing=" + hasTrailing
          + " | hasStatic=" + hasStatic);

      //----------DETERMINE COLLISION RESOLUTIONS ---------------------------
      // case 0: if deadlock here for more than 5 ticks, then find to find a new assignment with a new path
      int deadLockTicks = (int)agent.CustomData[AgentKeys.DeadLockTicks];
      bool inField = (bool)agent.CustomData[AgentKeys.EntertheField];
      bool encounterDeadLock = (inField && deadLockTicks >= DeadLockThreshold);
      if (DebugMode) RhinoApp.WriteLine(" deadLockTicks=" + deadLockTicks + " | encounterDeadLock=" + encounterDeadLock);
      if (encounterDeadLock) return; // return here would lead to "Handle DeadLock Sitatuation" at the end of Execute()?


      // Case 1-4: avoidance solution if there's headon/swap/trailing/stationary collision
      var collisionStrategy = DecideCollisionSolution(agent, allOtherAgents, agentStep, agentPath,
        hasHeadOn, hasSwap, hasTrailing, hasStatic,
        nextStepCollisionDataDict, env);
      bool canSideStep = collisionStrategy.Item1;
      bool requiresWaiting = collisionStrategy.Item2;
      // get the updated agentPath after deciding the collision solution
      agentPath = (List<int>)agent.CustomData[AgentKeys.Path];

      if (DebugMode) RhinoApp.WriteLine("DecideCollisionSolution():  canSideStep = " + canSideStep
          + " | requiresWaiting=" + requiresWaiting);

      //----------------------APPLY AVOIDANCE SOLUTIONS----------------------
      if (!requiresWaiting)
      {
        FollowPath(agent, agentStep, agentPath, homeIndices); // inside the method, agentStep is increased by 1
      }
      else
      {
        Wait(agent, agentStep, agentPath, homeIndices); // wait, do not move forward, step size not increased
      }

      // at the final decision:
      if (DebugMode) RhinoApp.WriteLine("    FINAL DECISION: agent=" + agent.Id
          + " shouldMoveForward=" + agent.CustomData[AgentKeys.ShouldMoveForward]
          + " deadLockTicks=" + deadLockTicks);
      if (DebugMode) RhinoApp.WriteLine("--- COMPLETE MoveForwardAndAvoidCollision()......");
    }



    private void FollowPath(CartesianAgent agent, int agentStep, List<int> agentPath, List<int> homeIndices)
    {
      // check the current agent's direciton, whether is aligned with the next move direction
      // if not, RotateBody to align
      // if yes, move a step forward, increase currentStep, adjust orientation for the next movement

      // Get the actual target from the path
      int targetIndex = agentPath[agentPath.Count - 1];

      // Determine where agent body should stop
      int AgentStepBodyShouldEnd = WhereBodyShouldEnd(targetIndex, homeIndices, agentPath);
      if (agentStep >= AgentStepBodyShouldEnd) return;
      if (agentPath == null || agentPath.Count < 2) return; // already at target

      Vector3d agentDir = (Vector3d)agent.CustomData[AgentKeys.Orientation];
      agentDir.Unitize();

      int currentVoxelIndex = agentPath[agentStep];
      int nextVoxelIndex = agentPath[agentStep + 1];
      Vector3d desiredDir = CachedAllCloud[nextVoxelIndex].Location - CachedAllCloud[currentVoxelIndex].Location;
      desiredDir.Unitize();

      // check if two vectors are in exact same direction with dot product
      bool shouldRotate = ShouldRotate(agentDir, desiredDir);
      if (DebugMode) RhinoApp.WriteLine("The agent " + agent.Id + ": Before rotation, the current agentDir = " + agentDir + ", desiredDir = " + desiredDir + ". Thus, shouldRotate = " + shouldRotate);

      if (!shouldRotate)
      {
        agentDir = desiredDir * CachedStructuralResolution; // agentDir is already the same as the next moveDir
        if (DebugMode) RhinoApp.WriteLine("Because the agent shouldRotate is false, agentDir is kept at " + agentDir);
      }
      else
      {
        // agentDir is not in the same as the moveDir
        // agent need to first rotate its body to align the dir and then move step forward
        Point3d agentPos = (Point3d)agent.CustomData[AgentKeys.Position];
        agentDir = RotateBodyToAlignToDesiredDir(agentPos, agentDir, desiredDir);
        if (DebugMode) RhinoApp.WriteLine("Because the agent shouldRotate is true. After rotating, agentDir = " + agentDir);
      }

      agent.CustomData[AgentKeys.Orientation] = agentDir;

      // update agent's position and step
      agentStep++;
      agent.CustomData[AgentKeys.CurrentStep] = agentStep;
      Point3d nextPos = CachedAllCloud[agentPath[agentStep]].Location;
      agent.CustomData[AgentKeys.Position] = nextPos;
      if (DebugMode) RhinoApp.WriteLine("Agent " + agent.Id + ": Current position = " + CachedAllCloud[agentPath[agentStep - 1]].Location + ", Current Index  = " + agentPath[agentStep - 1]);
      if (DebugMode) RhinoApp.WriteLine("Agent " + agent.Id + ": Moved to step " + agentStep + ", new position: " + nextPos + ", new index = " + agentPath[agentStep] + ", Orientation: " + agentDir);

      agent.Moves.Add(agentDir);
      agent.Weights.Add(1.0);

    }


    private void Wait(CartesianAgent agent, int agentStep, List<int> agentPath, List<int> homeIndices)
    {
      int targetIndex = agentPath[agentPath.Count - 1];
      int AgentStepBodyShouldEnd = WhereBodyShouldEnd(targetIndex, homeIndices, agentPath);
      if (agentStep >= AgentStepBodyShouldEnd) return;
      //if (agentStep >= agentPath.Count - 1) return;
      if (agentPath == null || agentPath.Count < 2) return; // already at target

      Vector3d agentDir = (Vector3d)agent.CustomData[AgentKeys.Orientation];
      agent.Moves.Add(agentDir);
      agent.Weights.Add(0.0);
    }


    private bool IsTargetReached(int agentTarget, int agentStep, List<int> path, List<int> homeIndices, CartesianEnvironment env)
    {
      // how to check if agent reached the target?--you should use current step rather than calculating distance
      bool isTargetReached = false;

      int targetIndex = path[path.Count - 1];
      // Determine where agent body should stop
      int AgentStepBodyShouldEnd = WhereBodyShouldEnd(targetIndex, homeIndices, path);

      int currentIndex = path[agentStep];

      // ✅ ADD: Print entire path
      if (DebugMode) RhinoApp.WriteLine("IsTargetReached DEBUG:");
      if (DebugMode) RhinoApp.WriteLine("  Path: [" + string.Join(", ", path) + "]");
      if (DebugMode) RhinoApp.WriteLine("  Path.Count: " + path.Count);
      if (DebugMode) RhinoApp.WriteLine("  agentStep: " + agentStep + "/" + (path.Count - 1));
      if (DebugMode) RhinoApp.WriteLine("  TargetIndex from path[path.Count-1]: " + targetIndex + " at " + CachedAllCloud[targetIndex].Location);
      if (DebugMode) RhinoApp.WriteLine("  TargetIndex from Agent Customdata: " + agentTarget + " at " + CachedAllCloud[agentTarget].Location);
      if (DebugMode) RhinoApp.WriteLine("  Current: " + currentIndex + " at " + CachedAllCloud[currentIndex].Location);
      if (DebugMode) RhinoApp.WriteLine("  Body should stop at the step: " + AgentStepBodyShouldEnd + ", which is at index " + path[AgentStepBodyShouldEnd] + ", and at location " + CachedAllCloud[path[AgentStepBodyShouldEnd]].Location);
      bool isTargetHomeBase = homeIndices.Contains(targetIndex);
      if (DebugMode) RhinoApp.WriteLine("  Is target home? " + isTargetHomeBase);

      if (targetIndex != agentTarget)
      {
        if (DebugMode) RhinoApp.WriteLine("IsTargetReached WARNING: agent target index is not matching with agentStep, isTargetReached is false");
        return isTargetReached;
      }

      if (agentStep == AgentStepBodyShouldEnd)
      {
        isTargetReached = true;
        if (DebugMode) RhinoApp.WriteLine("agentStep = " + agentStep + "AgentStepBodyShouldEnd = " + AgentStepBodyShouldEnd + ".Therefore, isTargetReached = true");
        return isTargetReached;
      }


      if (DebugMode) RhinoApp.WriteLine("agentStep = " + agentStep + "AgentStepBodyShouldEnd = " + AgentStepBodyShouldEnd + ".Therefore, isTargetReached = false");
      return isTargetReached;

    }







    //------------------------------ROBOT BODY/ARM CYCLING--------------------------------
    private int WhereBodyShouldEnd(int targetIndex, List<int> homeIndices, List<int> agentPath)
    {
      bool isTargetHomeBase = homeIndices.Contains(targetIndex);

      // Determine where agent body should stop
      int AgentStepBodyShouldEnd;
      if (isTargetHomeBase)
      {
        // Going home: body goes all the way to home base
        AgentStepBodyShouldEnd = agentPath.Count - 1;
      }
      else
      {
        // Assembly/Disassembly: body stops one step before target
        if (agentPath.Count >= 2)
        {
          AgentStepBodyShouldEnd = agentPath.Count - 2;
        }
        else
        {
          // Edge case: path too short (shouldn't happen)
          AgentStepBodyShouldEnd = agentPath.Count - 1;
        }
      }

      return AgentStepBodyShouldEnd;
    }


    // check if two vectors are in exact same direction with dot product
    private bool ShouldRotate(Vector3d agentDir, Vector3d desiredDir)
    {
      bool shouldRotate = false;
      double dotProduct = agentDir.X * desiredDir.X + agentDir.Y * desiredDir.Y + agentDir.Z * desiredDir.Z;

      if (dotProduct >= 1.0 - (1e-6))
      {
        shouldRotate = false; // agentDir is already the same as the next moveDir
      }
      else
      {
        shouldRotate = true;
      }
      return shouldRotate;
    }


    private Vector3d RotateBodyToAlignToDesiredDir(Point3d agentPos, Vector3d agentDir, Vector3d desiredDir)
    {
      Plane plane = new Plane(agentPos, agentDir, desiredDir);
      double angle = Vector3d.VectorAngle(agentDir, desiredDir, plane);
      Vector3d normal = plane.Normal;
      agentDir.Rotate(angle, normal);
      agentDir *= CachedStructuralResolution;
      return agentDir;
    }


    private bool MovementController(CartesianAgent agent)
    {
      // extend arm, or set it to true
      bool extendArm = (bool)agent.CustomData[AgentKeys.ExtendArm];
      bool isTaskComplete = false;
      if (!extendArm) // if false, set to true
      {
        agent.CustomData[AgentKeys.ExtendArm] = true;
        isTaskComplete = false;
        return isTaskComplete;
      }
      else // if true, set to false
      {
        // place or remove a voxel on the positon
        //Brep newVoxel = DeployAModule(agent, CachedStructuralResolution);
        agent.CustomData[AgentKeys.ExtendArm] = false; // contract the arm after the deployment
        isTaskComplete = true;
        return isTaskComplete;
      }
    }


    private void PickUpMaterialAtHomeBase(CartesianAgent agent, bool extendArm, int homeBaseIndex, int currentAgentIndex)
    {
      Vector3d agentDir = (Vector3d)agent.CustomData[AgentKeys.Orientation];
      agentDir.Unitize();
      Vector3d dirToMaterial = CachedHomeBases[homeBaseIndex].MaterialPickUpDir;
      dirToMaterial.Unitize();
      Point3d agentPos = CachedAllCloud[currentAgentIndex].Location;
      bool shouldRotate = ShouldRotate(agentDir, dirToMaterial);
      if (shouldRotate)
      {
        Vector3d alignedDir = RotateBodyToAlignToDesiredDir(agentPos, agentDir, dirToMaterial);
        agent.CustomData[AgentKeys.Orientation] = alignedDir;
      }

      if (!extendArm)
      {
        agent.CustomData[AgentKeys.ExtendArm] = true;
      }
      else
      {
        // next tick: retract arm, has the material now
        agent.CustomData[AgentKeys.ExtendArm] = false;
        agent.CustomData[AgentKeys.HasMaterial] = true;
      }
    }


    private void DropOffMaterialAtHomeBase(CartesianAgent agent, bool extendArm, int homeBaseIndex, int currentAgentIndex)
    {
      if (DebugMode) RhinoApp.WriteLine("START DropOffMaterialAtrHomeBase: agent " + agent.Id + ", hasMaterial = true, extendArm = " + extendArm);

      Vector3d agentDir = (Vector3d)agent.CustomData[AgentKeys.Orientation];
      agentDir.Unitize();
      Vector3d dirToMaterial = CachedHomeBases[homeBaseIndex].MaterialPickUpDir;
      dirToMaterial.Unitize();
      Point3d agentPos = CachedAllCloud[currentAgentIndex].Location;
      bool shouldRotate = ShouldRotate(agentDir, dirToMaterial);
      if (shouldRotate)
      {
        Vector3d alignedDir = RotateBodyToAlignToDesiredDir(agentPos, agentDir, dirToMaterial);
        agent.CustomData[AgentKeys.Orientation] = alignedDir;
      }

      if (!extendArm)
      {
        // tick 1: extend arm toward pickup point
        agent.CustomData[AgentKeys.ExtendArm] = true;
        if (DebugMode) RhinoApp.WriteLine("After extending the arm: Agent " + agent.Id + ", hasMateria = true, extendArm = true");
        // hasMaterial stays true = not yet dropped
      }
      else
      {
        // tick 2: retract arm, material is released
        agent.CustomData[AgentKeys.ExtendArm] = false;
        agent.CustomData[AgentKeys.HasMaterial] = false;
        if (DebugMode) RhinoApp.WriteLine("After releasing the material and retracting the arm: Agent " + agent.Id + ", hasMateria = false, extendArm = false");
      }
    }





    //------------------------- EXIT / ENTER THE FIELD ------------------------------
    private bool CanEnterTheField(CartesianAgent agent, int currentHome, CartesianEnvironment env, List<CartesianAgent> allOtherAgents, List<int> homeIndices)
    {
      // when agent can enter the field:
      // a) startPos is not occupied,
      // b) there's valid task with valid path can be assigned
      if (DebugMode) RhinoApp.WriteLine("Running CanEnterTheField(): START...");
      // access environment data --dynamic
      List<int> buildStateInts = (List<int>)env.CustomData[EnvironmentKeys.BuildState];
      List<BuildState> buildStates = buildStateInts.Select(i => (BuildState)i).ToList();

      bool isHomePosAvailable = false;
      bool canEnterTheField = false;

      bool isHomePhysicallyOccupied = IsHomePhysicallyOccupied(currentHome, agent.Id);
      bool isHomeClaimed = IsHomeClaimed(currentHome, agent.Id);
      bool isReturnerCloseEnough = IsReturnerWithinThreshold(currentHome, allOtherAgents);
      if (!isHomePhysicallyOccupied && !isHomeClaimed)
      {
        isHomePosAvailable = true;
        if (DebugMode) RhinoApp.WriteLine("The home is not occupied nor claimed, isHomePosAvailable is true.");
      }
      else if (isHomePhysicallyOccupied)
      {
        isHomePosAvailable = false;
        if (DebugMode) RhinoApp.WriteLine("The home is occupied, isHomePosAvailable is false.");
      }
      else if (isHomeClaimed)
      {
        // Home is claimed by an agent in HomeBaseReturnQueues
        // check where the agent is on its path to this home
        if (!isReturnerCloseEnough)
        {
          isHomePosAvailable = true;
          if (DebugMode) RhinoApp.WriteLine("The home is claimed, and the returning agent is not within the threshold, isHomePosAvailable is true.");
        }
        else
        {
          isHomePosAvailable = false;
          if (DebugMode) RhinoApp.WriteLine("The home is claimed, and the returning agent is within the threshold, isHomePosAvailable is false.");
        }
      }

      // add a guard before the queue check:
      if (!HomeBaseEntryQueues.ContainsKey(currentHome))
      {
        HomeBaseEntryQueues[currentHome] = new Queue<int>();
      }

      // Add before final canEnterTheField assignment:
      bool isFirstInEntryQueue = true;
      if (HomeBaseEntryQueues[currentHome].Count > 0)
      {
        isFirstInEntryQueue = HomeBaseEntryQueues[currentHome].Peek() == agent.Id;
      }
      else
      {
        isFirstInEntryQueue = false;
      }


      // update target list
      List<int> allowRaftRemovalTargets = new List<int>();
      if (IsStructureComplete(buildStates, env) && !HasRaftRemoved(buildStates))
      {
        var activeRaftRemovers = (Dictionary<int, int>)env.CustomData[EnvironmentKeys.RaftRemovers];
        if (activeRaftRemovers != null)
        {
          bool isThisAgentAssigned = activeRaftRemovers.Values.Contains(agent.Id);
          // if agent is not assigned as active raft remover, stay outside the field
          if (!isThisAgentAssigned)
          {
            if (DebugMode) RhinoApp.WriteLine("CanEnterTheField: agent " + agent.Id + " is not assigned as raft remover, staying outside");
            canEnterTheField = false;
            agent.CustomData[AgentKeys.EntertheField] = false;
            return canEnterTheField;
          }
          else
          {
            allowRaftRemovalTargets = FindRaftToRemove(env, buildStates, currentHome);
          }
        }
      }

      List<int> allowAssembleTargets = UpdateNextAssembleList(env, homeIndices);
      List<int> allowDisassembleTargets = UpdateSupportDisassembleList(env);

      Dictionary<int, TargetData> allTargets = LoadTargets(env);
      HashSet<int> readyToDeploy = (HashSet<int>)env.CustomData[EnvironmentKeys.ReadyToDeploy];
      HashSet<int> allowDisassemble2 = (HashSet<int>)env.CustomData[EnvironmentKeys.AllowDisassemble];
      int targetCount = readyToDeploy.Count + allowDisassemble2.Count + allowRaftRemovalTargets.Count;
      if (DebugMode) RhinoApp.WriteLine("CanEnterTheField: allTargets.Count=" + allTargets.Count
          + " readyToDeploy.Count=" + readyToDeploy.Count
          + " allowDisassemble.Count=" + allowDisassemble2.Count);

      // then separately: if the entry queue size is 0, the agent should also be able to enter the field
      bool canSkipQueue = HomeBaseEntryQueues[currentHome].Count == 0;

      if (isHomePosAvailable && targetCount > 0
        && (isFirstInEntryQueue || canSkipQueue))
      {
        canEnterTheField = true;
        agent.CustomData[AgentKeys.EntertheField] = true;

      }
      else
      {
        canEnterTheField = false;
        agent.CustomData[AgentKeys.EntertheField] = false;
        if (DebugMode) RhinoApp.WriteLine("set EnterTheField to false...");
      }

      if (DebugMode) RhinoApp.WriteLine("Running CanEnterTheField(): COMPLETE...");
      return canEnterTheField;
    }




    private bool EnterTheHomeFromOutsideStructure(CartesianAgent agent, int currentHomeIndex)
    {
      if (DebugMode) RhinoApp.WriteLine("EnterHomeFromOutSideStructure(): START...");
      agent.CustomData[AgentKeys.EntertheField] = true;
      Point3d homePos = CachedHomeBases[currentHomeIndex].HomeBasePt;
      Point3d agentCurrentPos = (agent.CustomData.ContainsKey(AgentKeys.Position)) ? (Point3d)agent.CustomData[AgentKeys.Position] : agent.Position;
      Vector3d agentCurrentDir = (Vector3d)agent.CustomData[AgentKeys.Orientation];
      agentCurrentDir.Unitize();
      Vector3d dirToHome = homePos - agentCurrentPos; // direction from agentCurrentPos to homePos
      if (dirToHome.Length > 1e-6)
      {
        dirToHome.Unitize();
      }
      else
      {
        dirToHome = agentCurrentDir; // agent is already at home, keep current dir
      }

      // adjust the direction towards the home direction
      bool hasAgentEntered = false;
      bool shouldRotateToHome = ShouldRotate(agentCurrentDir, dirToHome);
      Vector3d agentMoveDir;

      if (shouldRotateToHome)
      {
        agentMoveDir = RotateBodyToAlignToDesiredDir(agentCurrentPos, agentCurrentDir, dirToHome);
        hasAgentEntered = false;
        // set agent position to home position, and direction towards home
        agent.CustomData[AgentKeys.Orientation] = agentMoveDir;
        agent.Moves.Add(agentMoveDir); // what's in moves should be displacement vector
        agent.Weights.Add(1.0);
        return hasAgentEntered;
      }
      else
      {
        agentMoveDir = agentCurrentDir * CachedStructuralResolution;
        agent.CustomData[AgentKeys.Position] = homePos;
        hasAgentEntered = true;
        if (DebugMode) RhinoApp.WriteLine("Agent " + agent.Id + ": Just entered field, with its new pos at home = " + homePos + ", and new direction = " + agentMoveDir);
        return hasAgentEntered;
      }
    }





    //---------------------UPDATE AGENT STATUS---------------------------------
    private void AddAgentIDToReservationAfterTargetAssignment(CartesianAgent agent, CartesianEnvironment env, int nextTask)
    {
      Dictionary<int, TargetData> allTargets = LoadTargets(env);
      List<int> reservedAgentIndices = allTargets[nextTask].ReservedBy.ToList();
      if (!reservedAgentIndices.Contains(agent.Id))
      {
        reservedAgentIndices.Add(agent.Id);
        allTargets[nextTask].ReservedBy = reservedAgentIndices.ToArray();
        SaveTargets(env, allTargets);
      }
    }


    private void UpdateAgentStatusAfterTargetAssignment(CartesianAgent agent, bool hasMaterial, int currentIndex, int assignedTask, WorkState newState, WorkState currentState, CartesianEnvironment env)
    {
      if (DebugMode) RhinoApp.WriteLine("UpdateAgentStatusAfterTargetAssignment: START");
      if (DebugMode) RhinoApp.WriteLine("  Agent ID: " + agent.Id);
      if (DebugMode) RhinoApp.WriteLine("  Assigned Task: " + assignedTask);
      if (DebugMode) RhinoApp.WriteLine("  New State: " + newState);

      // Refresh targets dictionary
      Dictionary<int, TargetData> allTargets = LoadTargets(env);
      if (DebugMode) RhinoApp.WriteLine("  Total targets loaded: " + allTargets.Count);
      if (DebugMode) RhinoApp.WriteLine("  Contains assignedTask? " + allTargets.ContainsKey(assignedTask));

      // add defensive code
      if (!allTargets.ContainsKey(assignedTask))
      {
        RhinoApp.WriteLine("ERROR: Task " + assignedTask + " NOT IN TARGETS! set agent new state to idle...");
        if (DebugMode) RhinoApp.WriteLine("Available targets: " + string.Join(", ", allTargets.Keys));
        newState = WorkState.Idle;
        agent.CustomData[AgentKeys.WorkState] = newState;
        agent.CustomData[AgentKeys.PrevState] = currentState;
        return;
      }

      if (DebugMode) RhinoApp.WriteLine("  Path length: " + allTargets[assignedTask].Path.Length);

      agent.CustomData[AgentKeys.WorkState] = newState;
      agent.CustomData[AgentKeys.PrevState] = currentState;
      agent.CustomData[AgentKeys.Target] = assignedTask;
      agent.CustomData[AgentKeys.Path] = allTargets[assignedTask].Path.ToList();
      agent.CustomData[AgentKeys.CurrentStep] = 0;
      agent.CustomData[AgentKeys.HasMaterial] = hasMaterial;

      if (DebugMode) RhinoApp.WriteLine("UpdateAgentStatusAfterTaskAssignment: COMPLETE");
    }

    private void UpdateAgentStatusAfterClaimHome(CartesianAgent agent, bool hasMaterial, int currentIndex, int homeToReturn, WorkState newState, WorkState prevState, List<int> pathToHome, CartesianEnvironment env)
    {
      if (DebugMode) RhinoApp.WriteLine("UpdateAgentStatusAfterClaimHome: START");
      if (DebugMode) RhinoApp.WriteLine("  Agent ID: " + agent.Id);
      if (DebugMode) RhinoApp.WriteLine("  Assigned Home To Return: " + homeToReturn);
      if (DebugMode) RhinoApp.WriteLine("  New State: " + newState);
      if (DebugMode) RhinoApp.WriteLine("Path To Home: [" + string.Join(", ", pathToHome) + "]");

      // add defensive code
      if (!CachedHomeBases.ContainsKey(homeToReturn))
      {
        RhinoApp.WriteLine("ERROR: Home " + homeToReturn + " NOT IN Home Bases! set agent new state to idle...");
        if (DebugMode) RhinoApp.WriteLine("Available targets: " + string.Join(", ", CachedHomeBases.Keys));
        newState = WorkState.Idle;
        agent.CustomData[AgentKeys.WorkState] = newState;
        agent.CustomData[AgentKeys.PrevState] = prevState;
        return;
      }

      agent.CustomData[AgentKeys.WorkState] = newState;
      agent.CustomData[AgentKeys.PrevState] = prevState;
      agent.CustomData[AgentKeys.Target] = homeToReturn;
      agent.CustomData[AgentKeys.Path] = pathToHome; // ATTENTION: if separate home from targets, how to store path to home to agentPath?
      agent.CustomData[AgentKeys.CurrentStep] = 0;
      agent.CustomData[AgentKeys.HasMaterial] = hasMaterial;
      agent.CustomData[AgentKeys.CurrentHome] = homeToReturn;

      //update agent's path to environment's ActivePath key
      var activePath = (Dictionary<int, List<int>>)env.CustomData[EnvironmentKeys.ActivePath];
      if (!activePath.ContainsKey(agent.Id))
      {
        activePath.Add(agent.Id, new List<int>());
      }
      activePath[agent.Id] = pathToHome;
      env.CustomData[EnvironmentKeys.ActivePath] = activePath;

      if (DebugMode) RhinoApp.WriteLine("UpdateAgentStatusAfterClaimHome: COMPLETE");
    }


    private void UpdateAgentStatusAfterTaskExecution(CartesianAgent agent, bool hasMaterial, WorkState prevState, bool extendArm, CartesianEnvironment env)
    {
      // clear agent's custom data of target and path and currentstep
      agent.CustomData[AgentKeys.Target] = null;
      agent.CustomData[AgentKeys.Path] = new List<int>();
      agent.CustomData[AgentKeys.CurrentStep] = 0;
      agent.CustomData[AgentKeys.HasMaterial] = hasMaterial;
      agent.CustomData[AgentKeys.PrevState] = prevState;
      agent.CustomData[AgentKeys.ExtendArm] = extendArm;
    }


    private void UpdateAgentStatusAfterExitField(CartesianAgent thisAgent, CartesianAgent agentToUpdate, WorkState prevState, int homeBaseIndex, Point3d waitingPos, Vector3d waitingDir, CartesianEnvironment env)
    {
      if (DebugMode) RhinoApp.WriteLine("START UpdateAgentStatusAfterExitField()...");
      // "agentToUpdate" is the agent who need to stay out of the field
      // "thisAgent" is the agent who is currently calling Execute() at the current tick
      // thisAgent could be the one who needs to exit the field or not
      // - if it is, then update its customdata directly; if not, then update the other agent's persistentAgentData

      int agentToUpdateID = -1;
      if (thisAgent.Id == agentToUpdate.Id)
      {
        agentToUpdateID = thisAgent.Id;
        thisAgent.CustomData[AgentKeys.WorkState] = WorkState.Idle;
        thisAgent.CustomData[AgentKeys.PrevState] = prevState;
        thisAgent.CustomData[AgentKeys.EntertheField] = false;
        thisAgent.CustomData[AgentKeys.Position] = waitingPos;
        thisAgent.CustomData[AgentKeys.Orientation] = waitingDir;
        thisAgent.CustomData[AgentKeys.ExtendArm] = false;
        thisAgent.CustomData[AgentKeys.HasMaterial] = false;
        thisAgent.CustomData[AgentKeys.CurrentHome] = homeBaseIndex;
        thisAgent.CustomData[AgentKeys.Target] = null;
        thisAgent.CustomData[AgentKeys.Path] = new List<int>();
        thisAgent.CustomData[AgentKeys.CurrentStep] = 0;
      }
      else
      {
        agentToUpdateID = agentToUpdate.Id;
        var agentPersistData = persistentAgentData[agentToUpdateID];
        persistentAgentData[agentToUpdateID][AgentKeys.Position] = waitingPos;
        persistentAgentData[agentToUpdateID][AgentKeys.Orientation] = waitingDir;
        persistentAgentData[agentToUpdateID][AgentKeys.EntertheField] = false;
        persistentAgentData[agentToUpdateID][AgentKeys.WorkState] = WorkState.Idle;
        persistentAgentData[agentToUpdateID][AgentKeys.PrevState] = prevState;
        persistentAgentData[agentToUpdateID][AgentKeys.ExtendArm] = false;
        persistentAgentData[agentToUpdateID][AgentKeys.HasMaterial] = false;
        persistentAgentData[agentToUpdateID][AgentKeys.CurrentHome] = homeBaseIndex;
        persistentAgentData[agentToUpdateID][AgentKeys.Target] = null;
        persistentAgentData[agentToUpdateID][AgentKeys.Path] = new List<int>();
        persistentAgentData[agentToUpdateID][AgentKeys.CurrentStep] = 0;
      }

      // When agent exits field, clear its active path
      var activePath = (Dictionary<int, List<int>>)env.CustomData[EnvironmentKeys.ActivePath];
      activePath[agentToUpdate.Id] = new List<int>(); // empty — not physically anywhere that blocks others
      env.CustomData[EnvironmentKeys.ActivePath] = activePath;
    }

    private Tuple<Point3d, Vector3d> UpdateAgentToEntryQueue(int agentID, int currentHomeIndex, bool exitFieldFromHome)
    {
      Queue<int> entryQueue = HomeBaseEntryQueues.ContainsKey(currentHomeIndex)
        ? HomeBaseEntryQueues[currentHomeIndex]
        : new Queue<int>();
      List<int> entryList = entryQueue.ToList();
      if (!entryList.Contains(agentID))
      {
        // if exit the field from the home, agent joins the front of the entry queue
        // if not, then agent joins from the end of the entry queue
        if (exitFieldFromHome)
        {
          entryList.Insert(0, agentID);
        }
        else
        {
          entryList.Add(agentID);
        }
      }
      HomeBaseEntryQueues[currentHomeIndex] = new Queue<int>(entryList);
      CachedHomeBases[currentHomeIndex].WaitingQueue = HomeBaseEntryQueues[currentHomeIndex];
      Vector3d waitingDir = CachedHomeBases[currentHomeIndex].WaitingDir;
      Point3d homeBasePt = CachedHomeBases[currentHomeIndex].HomeBasePt;
      int indexInQueue = entryList.IndexOf(agentID);
      Point3d newWaitingSpot = (-1) * waitingDir * (indexInQueue + 1) + homeBasePt;

      return Tuple.Create(newWaitingSpot, waitingDir);
    }




    // CLEAR AGENT RESERAVATIONS AND TARGETS BEFORE TASK ASSIGNMENT
    // release AgentID from ReservedBy in TargetData - Claude make this correct
    private void ReleaseAgentTargetReservations(int agentID, CartesianEnvironment env)
    {
      if (DebugMode) RhinoApp.WriteLine("ReleaseAgentTargetReservations: Checking all targets for reservations to release");

      Dictionary<int, TargetData> allTargets = LoadTargets(env);
      List<int> targetsToRelease = new List<int>();
      bool anyReleased = false;


      // collect targets to modify (avoid modifying during iteration)
      foreach (var kvp in allTargets)
      {
        if (kvp.Value.ReservedBy.Contains(agentID))
        {
          targetsToRelease.Add(kvp.Key);
        }
      }

      // modify Targets after iteration complete
      if (targetsToRelease.Count > 0)
      {
        foreach (int targetIndex in targetsToRelease)
        {
          TargetData targetData = allTargets[targetIndex];
          List<int> reservedList = targetData.ReservedBy.ToList();
          reservedList.Remove(agentID);
          targetData.ReservedBy = reservedList.ToArray();
          allTargets[targetIndex] = targetData;
          CachedReservedTargets.Remove(targetIndex);
          anyReleased = true;
        }
      }

      if (anyReleased)
      {
        SaveTargets(env, allTargets);
        if (DebugMode) RhinoApp.WriteLine(targetsToRelease.Count + " number of targets who are reserved by Agent " + agentID + " are released now");
      }
      else
      {
        if (DebugMode) RhinoApp.WriteLine("Agent " + agentID + ": No reservations found to release");
      }

      if (DebugMode) RhinoApp.WriteLine("ReleaseAgentReservations: released " + targetsToRelease.Count + " targets");
    }



    private void ReleaseAgentFromReturnQueue(int agentID)
    {
      if (DebugMode) RhinoApp.WriteLine("ReleaseAgentHomeClaim: Checking home return queue for reservations to release");

      // if agent was previously in a return queue from an abandoned task, clean the return queue
      foreach (var homeIndex in HomeBaseReturnQueues.Keys.ToList())
      {
        Queue<int> returnQueue = HomeBaseReturnQueues[homeIndex];
        if (returnQueue.Contains(agentID))
        {
          List<int> returnList = returnQueue.ToList();
          returnList.Remove(agentID);
          HomeBaseReturnQueues[homeIndex] = new Queue<int>(returnList);
          if (DebugMode) RhinoApp.WriteLine("Agent " + agentID
              + ": removed from HomeBaseReturnQueues[" + homeIndex + "] during reset");
        }
      }
    }



    private void ReleaseAgentFromEntryQueue(int agentID)
    {
      List<int> homeIndices = CachedHomeBases.Keys.ToList();
      foreach (int home in homeIndices)
      {
        Queue<int> entryQueue = HomeBaseEntryQueues[home];
        if (entryQueue.Contains(agentID))
        {
          List<int> entryList = entryQueue.ToList();
          entryList.Remove(agentID);
          HomeBaseEntryQueues[home] = new Queue<int>(entryList);
          if (DebugMode) RhinoApp.WriteLine("Agent " + agentID
              + ": removed from HomeBaseEntryQueues[" + home + "]");
        }
      }
    }

    private void ReleaseAgentFromHomeOccupancy(int currentHome, int agentID, int whereAgentIsNow)
    {

      // check ALL homes this agent might be recorded as occupying
      List<int> homeIndices = CachedHomeBases.Keys.ToList();

      foreach (int homeIndex in homeIndices)
      {
        if (HomeBaseOccupant.ContainsKey(homeIndex) && (HomeBaseOccupant[homeIndex] == agentID) && (whereAgentIsNow != homeIndex))
        {
          HomeBaseOccupant[homeIndex] = -1;
          if (DebugMode) RhinoApp.WriteLine("Agent " + agentID
              + ": cleared from HomeBaseOccupant[" + homeIndex + "]"
              + " — now at " + whereAgentIsNow);
        }
      }
    }




    // ==================== Methods Belong to Environment Responsibilities ==============================

    //----------------------CHECK CONSTRUCTION PROGRESS----------------------------------
    public bool IsStructureComplete(List<BuildState> buildStates, CartesianEnvironment env)
    {
      var activePathDict = (Dictionary<int, List<int>>)env.CustomData[EnvironmentKeys.ActivePath];
      List<int> activePathList = new List<int>();
      foreach (var kvp in activePathDict)
      {
        int agentID = kvp.Key;
        List<int> agentPath = kvp.Value;
        foreach (int i in agentPath)
        {
          activePathList.Add(i);
        }
      }

      // Logic for determining structure completion
      bool isStructureDeployed = true;
      bool isSupportAllDisassembled = false;

      for (int i = 0; i < CachedAllCloud.Count; i++)
      {
        if (CachedVoxelTypes[i] == VoxelType.Structure
          && buildStates[i] != BuildState.Deployed)
        {
          isStructureDeployed = false;
          break;
        }
      }

      if (isStructureDeployed)
      {
        isSupportAllDisassembled = AreSupportsDisassembled(buildStates);
        if (isSupportAllDisassembled)
        {
          return true;
        }
        else
        {
          return false;
        }
      }
      else
      {
        return false;
      }
    }

    public bool CanSupportBeDisassembled(int supportPt, List<BuildState> buildStates, CartesianEnvironment env)
    {

      if (DebugMode) RhinoApp.WriteLine("Checking CanSupportBeDisassembled ... ");

      // the premise the supportPt can be disassembled is that a) it is support type, b) it is deployed yet unoccpied, c) it has no support or structural points depending on it
      // a) already met, because the input is supportPt
      // b) check if this support point is not deployed yet, return false;

      bool canBeDisassembled = false;

      var activePathDict = (Dictionary<int, List<int>>)env.CustomData[EnvironmentKeys.ActivePath];
      HashSet<int> activePathSet = new HashSet<int>();
      foreach (var kvp in activePathDict)
      {
        List<int> agentPath = kvp.Value;
        foreach (var p in agentPath)
        {
          if (!activePathSet.Contains(p)) activePathSet.Add(p);
        }
      }
      bool isOccupied = activePathSet.Contains(supportPt);
      bool isDeployed = buildStates[supportPt] == BuildState.Deployed;

      if (!isDeployed || isOccupied)
      {
        canBeDisassembled = false;
        if (DebugMode) RhinoApp.WriteLine("CanSupportBeDisassembled: the point " + supportPt + " is not Deployed or being occupied. Thus, canBeDisassembled is false");
        return canBeDisassembled;
      }

      // c) check if it is on the top of a support column that can be disassembled
      // if it is a key, so it is the support top of that support column, then if it can be dissasembled, add it to allowdisassemble, and add its value to pending to disasemble by order
      // if it is not key, but is in a value list, check whether its key and the other point on top of it has been removed, if no, then cannot be dissassembled, if yes, then add it to allowdisasemble
      bool isSupportTop = CachedSupportToPoints.ContainsKey(supportPt);
      if (DebugMode) RhinoApp.WriteLine("CanSupportBeDisassembled: the point " + supportPt + " is a support top is " + isSupportTop);

      if (isSupportTop)
      {
        // check if its structural points--are they all deployed
        List<int> pointsBeingSupported = CachedSupportToPoints[supportPt];
        if (DebugMode) RhinoApp.WriteLine("CanSupportBeDisassembled: the point " + supportPt + " is a support top and has " + pointsBeingSupported.Count + " number of points being supported");
        foreach (int i in pointsBeingSupported)
        {
          if (buildStates[i] != BuildState.Deployed)
          {
            canBeDisassembled = false;
            if (DebugMode) RhinoApp.WriteLine("CanSupportBeDisassembled: the point " + supportPt + " is a support top and its dependent point " + i + " is not in deployed or occupied state, and this support top can not Be Disassembled");
            return canBeDisassembled;
          }
        }

        canBeDisassembled = true;
        if (DebugMode) RhinoApp.WriteLine("CanSupportBeDisassembled: the point " + supportPt + " is a support top and its dependent points are all either deployed or occupied, thus this support point can Be Disassembled");
        return canBeDisassembled;
      }
      else
      {
        if (DebugMode) RhinoApp.WriteLine("CanSupportBeDisassembled: the point " + supportPt + " is not a support top");

        // check if its support top and other points on its top have been removed
        foreach (KeyValuePair<int, List<int>> pair in CachedSupportCols)
        {
          List<int> columnPoints = pair.Value;
          // check if this point is in the column
          int indexInList = columnPoints.IndexOf(supportPt);
          if (indexInList >= 0) // found it in column
          {
            if (DebugMode) RhinoApp.WriteLine("CanSupportBeDisassembled: found this point " + supportPt + " in a support column, and is positioned at " + indexInList + " in a support column");
            // check all the points above it, but not including it
            for (int i = 0; i < indexInList; i++)
            {
              if (buildStates[columnPoints[i]] != BuildState.Removed)
              {
                canBeDisassembled = false;
                if (DebugMode) RhinoApp.WriteLine("CanSupportBeDisassembled: this point has points above it that are not removed, thus it can not be disassembled");
                return canBeDisassembled;
              }
            }

            canBeDisassembled = true;
            if (DebugMode) RhinoApp.WriteLine("CanSupportBeDisassembled: this point has points above it that are removed, thus it can be disassembled");
            return canBeDisassembled;
          }

        }
      }

      if (DebugMode) RhinoApp.WriteLine("CanSupportBeDisassembled: this point  can not be disassembled");
      return canBeDisassembled;
    }



    public bool HasRaftRemoved(List<BuildState> buildStates)
    {
      bool isRaftRemoved = true;

      foreach (int i in CachedBasements)
      {
        if (buildStates[i] != BuildState.Removed)
        {
          isRaftRemoved = false;
          break;
        }
      }

      return isRaftRemoved;
    }

    public bool AreSupportsDisassembled(List<BuildState> buildStates)
    {
      bool isSupportRemoved = true;

      for (int i = 0; i < CachedAllCloud.Count; i++)
      {
        if (CachedVoxelTypes[i] != VoxelType.Support) continue;
        if (buildStates[i] == BuildState.Deployed)
        {
          isSupportRemoved = false;
          break;
        }
      }
      return isSupportRemoved;
    }



    // this is to check if any neighbor of point has been deployed
    public bool HasDeployedNeighbors(int pointIndex, List<int> neighborIndices, List<BuildState> buildStates)
    {
      // check if it is available to deploy: a) pendingToDeploy, b) at least one neighbor is deployed?-
      // this is to decide for the available list
      bool isReachable = false;
      int reachableCount = 0;

      foreach (int index in neighborIndices)
      {
        if (buildStates[index] == BuildState.Deployed) reachableCount++;
      }

      if (reachableCount > 0) isReachable = true;

      return isReachable;
    }




    //----------------UPDATE ASSEMBLE OR DISASSEMBLE LIST FOR THE NEXT TIMESTEP----------------------

    // find out the list of potential assemble targets, update it to CustomData.ReadyToDeploy, and CustomData.Targets
    public List<int> UpdateNextAssembleList(CartesianEnvironment env, List<int> homeIndices)
    {
      // update assemble targets means update ReadyToDeploy, which is based on:
      // a) the updated voxel state == PendingToDeploy; and it has at least one neighbor is deployed(unoccupied)

      // DEBUG: check if CachedAdjacencyMap is populated
      string msg = "ERROR: this data is  empty or null!";
      if (CachedAdjacencyMap == null || CachedAdjacencyMap.Count == 0) throw new Exception(msg);
      if (CachedAllCloud == null) throw new Exception(msg);

      // access environment data -- dynamic
      HashSet<int> readyToDeploy = (HashSet<int>)env.CustomData[EnvironmentKeys.ReadyToDeploy];
      if (DebugMode) RhinoApp.WriteLine("Before UpdateNextAssembleList...");
      if (DebugMode) RhinoApp.WriteLine("Current allowAssemble Count = " + readyToDeploy.Count);


      List<int> buildStateInts = (List<int>)env.CustomData[EnvironmentKeys.BuildState];
      List<BuildState> buildStates = buildStateInts.Select(i => (BuildState)i).ToList();
      Dictionary<int, TargetData> allTargets;
      object obj;
      if (!env.CustomData.TryGetValue(EnvironmentKeys.Targets, out obj) || obj == null)
      {
        allTargets = new Dictionary<int, TargetData>();
        SaveTargets(env, allTargets);
      }
      else
      {
        allTargets = LoadTargets(env);
      }

      // loop through all cloud to update ReadyToDeploy
      for (int i = 0; i < CachedAllCloud.Count; i++)
      {
        Point3d point = CachedAllCloud.PointAt(i);
        if (homeIndices.Contains(i)) { continue; }
        // ! FIX: defensive check to prevent removed ones from being added to readyToDeploy again
        if (buildStates[i] == BuildState.Removed) continue;

        if (buildStates[i] == BuildState.PendingToDeploy)
        {
          List<int> myNeighborIndices;
          if (!CachedAdjacencyMap.TryGetValue(i, out myNeighborIndices))
          {
            continue; // skip if no neighbors found
          }

          bool hasNeighborDeployed = HasDeployedNeighbors(i, myNeighborIndices, buildStates); // any neighbor deployed
          if (hasNeighborDeployed) // pendingToDeploy + at least one neighbor deployed==? readyToDeploy
          {
            if (!readyToDeploy.Contains(i))
            {
              readyToDeploy.Add(i);
            }
            if (!allTargets.ContainsKey(i))
            {
              TargetData targetDataPt = new TargetData(
                i,
                new int[] { i },
                0.0,
                new int[] { }
                );
              allTargets.Add(i, targetDataPt);
            }
          }
        }
      }

      // write to environment's custom data -- in UpdateEnvAfterAssignAssembleTask()
      env.CustomData[EnvironmentKeys.ReadyToDeploy] = readyToDeploy;
      SaveTargets(env, allTargets);
      if (DebugMode) RhinoApp.WriteLine("After UpdateNextAssembleList..., Current allowAssemble Count = " + readyToDeploy.Count);
      return readyToDeploy.ToList();
    }


    // get the list of potential support targets to disassemble, this is to update allowDissemble
    public List<int> UpdateSupportDisassembleList(CartesianEnvironment env)
    {
      // this should come from and udpate to AllowDisassemble list
      // loop through deploycloud, find the points's type = support && BuildState = Deployed first
      // check which supports are supporting other strutural points in spToP dictionary(spToP[key].Count != 0)
      // then loop through spToP[key], to check the sutrcutral point's BuildState, if all = deployed, then this supports is disassemable
      // add this point to AllowDisassemble

      HashSet<int> deployed = (HashSet<int>)env.CustomData[EnvironmentKeys.Deployed];
      int deployedSupportCount = deployed.Where(i => CachedVoxelTypes[i] == VoxelType.Support).Count();
      HashSet<int> allowDisassemble = (HashSet<int>)env.CustomData[EnvironmentKeys.AllowDisassemble];
      if (DebugMode) RhinoApp.WriteLine("Before UpdateSupportDisassembleList...");
      if (DebugMode) RhinoApp.WriteLine("Current allowDisassemble Count = " + allowDisassemble.Count + " | Current deployedSupportCount = " + deployedSupportCount);

      List<int> buildStateInts = (List<int>)env.CustomData[EnvironmentKeys.BuildState];
      List<BuildState> buildStates = buildStateInts.Select(i => (BuildState)i).ToList();
      Dictionary<int, TargetData> allTargets;
      object obj;
      if (!env.CustomData.TryGetValue(EnvironmentKeys.Targets, out obj) || obj == null)
      {
        allTargets = new Dictionary<int, TargetData>();
        SaveTargets(env, allTargets);
      }
      else
      {
        allTargets = LoadTargets(env);
      }

      //-------------------------------LOOK FOR SUPPORTS CAN BE REMOVED------------------------------------
      if (DebugMode) RhinoApp.WriteLine("UpdateSupportDisassembleList -  Looping Through DeployedCloud To Find Supports For Disassembly...");
      for (int i = 0; i < deployed.Count; i++)
      {
        int pointIndex = deployed.ElementAt(i);
        Point3d point = CachedAllCloud[pointIndex].Location;
        if (CachedVoxelTypes[pointIndex] != VoxelType.Support) continue;
        // ✅ FIX: Verify it's actually deployed!
        if (buildStates[pointIndex] != BuildState.Deployed) continue;
        bool canBeDisassembled = CanSupportBeDisassembled(pointIndex, buildStates, env);
        if (DebugMode) RhinoApp.WriteLine("Point index" + pointIndex + " at location " + point + " canBeDisassembled is " + canBeDisassembled);

        if (canBeDisassembled)
        {
          if (!allowDisassemble.Contains(pointIndex))
          {
            allowDisassemble.Add(pointIndex);
            if (DebugMode) RhinoApp.WriteLine("Point index" + pointIndex + " at location " + point + " can be disassembled and is now added to allowDisassemble");
          }

          if (DebugMode) RhinoApp.WriteLine("Point index" + pointIndex + " at location " + point + " can be disassembled, but is already in allowDisassemble");

          if (!allTargets.ContainsKey(pointIndex))
          {
            TargetData targetDataPt = new TargetData(
              pointIndex,
              new int[] { pointIndex },
              0,
              new int[] { }
              );
            allTargets.Add(pointIndex, targetDataPt);
          }

        }
      }

      // ----------------CLEAN UP GUARD: IF PT IN ACTIVEPATH, REMOVE IT FROM ALLOWDISASSEMBLE-------------------------
      var activePathDict = (Dictionary<int, List<int>>)env.CustomData[EnvironmentKeys.ActivePath];
      HashSet<int> currentlyOccupied = new HashSet<int>();
      foreach (var kvp in activePathDict)
        foreach (int p in kvp.Value) currentlyOccupied.Add(p);

      List<int> toRemoveFromAllowDisassemble = new List<int>();
      foreach (int idx in allowDisassemble)
      {
        if (currentlyOccupied.Contains(idx))
          toRemoveFromAllowDisassemble.Add(idx);
      }
      foreach (int idx in toRemoveFromAllowDisassemble)
      {
        allowDisassemble.Remove(idx);
        if (DebugMode) RhinoApp.WriteLine("UpdateSupportDisassembleList: removed " + idx
            + " from allowDisassemble — because it is now in activePath");
      }

      //----------------------WRITE TO CUSTOM DATA-----------------------------------------------------------
      env.CustomData[EnvironmentKeys.AllowDisassemble] = allowDisassemble;
      SaveTargets(env, allTargets);
      if (DebugMode) RhinoApp.WriteLine("After UpdateSupportDisassembleList - Current allowDisassemble Count = " + allowDisassemble.Count);
      return allowDisassemble.ToList();
    }




    public List<int> FindRaftToRemove(CartesianEnvironment env, List<BuildState> buildStates, int currentHome)
    {
      List<int> homeIndices = CachedHomeBases.Keys.ToList();
      // find all the unremoved rafts
      List<int> unRemovedRafts = CachedBasements.Where(i => buildStates[i] == BuildState.Deployed).ToList();

      if (DebugMode) RhinoApp.WriteLine("---START FindRaftToRemove(): CachedBasements="
          + CachedBasements.Count + " unRemovedRafts=" + unRemovedRafts.Count);
      if (DebugMode) RhinoApp.WriteLine("FindRaftToRemove(): homeIndex=" + currentHome + " neighbors=" + string.Join(",", CachedAdjacencyMap[currentHome]));

      if (unRemovedRafts.Count == 0) return new List<int>();

      //---------------------GET THE REMAINING UNREMOVED RAFTS--------------------
      // build baseline: nodes already removed or assigned to other agents
      HashSet<int> baseLineBlocked = new HashSet<int>();
      foreach (int b in CachedBasements)
      {
        if (buildStates[b] == BuildState.Removed)
        {
          baseLineBlocked.Add(b);
        }
      }

      // also treat rafts currently reverseved by other agents as blocked
      Dictionary<int, TargetData> allTargets = LoadTargets(env);
      foreach (var kvp in allTargets)
      {
        if (CachedBasements.Contains(kvp.Key) && kvp.Value.ReservedBy.Length > 0)
        {
          baseLineBlocked.Add(kvp.Key);
          if (DebugMode) RhinoApp.WriteLine("FindRaftToRemove: raft " + kvp.Key
              + " reserved by another agent, treating as blocked");
        }
      }

      foreach (int t in CachedReservedTargets)
      {
        if (!baseLineBlocked.Contains(t) && CachedBasements.Contains(t)) baseLineBlocked.Add(t);
      }

      //-----------GET UNREMOVED/UNRESERVED RAFTS AND FIND ITS ZONE------------
      var raftZones = env.CustomData.ContainsKey(EnvironmentKeys.RaftZones)
        ? (Dictionary<int, int>)env.CustomData[EnvironmentKeys.RaftZones]
        : null;

      // include rafts that belong to this agent's zone, and also include any rafts that somehow slipped through zone assignment without being categorized
      List<int> unassignedRafts = unRemovedRafts.Where(i => !baseLineBlocked.Contains(i))
        .Where(i => raftZones == null || !raftZones.ContainsKey(i) || raftZones[i] == currentHome)
        .ToList();



      //-----------SIMULATING REMOVAL CANDIDATES TO FIND SAFE RAFTS FOR REMOVAL--------------------
      // find safe candidates
      List<int> safeCandidates = new List<int>();
      foreach (int candidateToRemove in unassignedRafts)
      {
        // simulate: blocked = everything already removed + this candidate (if it is removed as well)
        HashSet<int> simulatedBlocked = new HashSet<int>(baseLineBlocked);
        simulatedBlocked.Add(candidateToRemove);

        // simulate: remaining rafts after this removal
        List<int> simulatedRemainingRafts = unRemovedRafts.Where(i => !simulatedBlocked.Contains(i)).ToList();
        List<int> simulatedRemaingRaftInMyZone = simulatedRemainingRafts
          .Where(r => raftZones.ContainsKey(r)
          && raftZones[r] == currentHome).ToList();

        // check every remaining raft in the simulateRemainingRafts can reach my home
        bool stillConnectedInMyZone = simulatedRemaingRaftInMyZone.Count == 0
          || simulatedRemaingRaftInMyZone.All(raft => IsRaftSafeToRemoveWithBFS(currentHome, raft, simulatedBlocked, buildStates));


        if (stillConnectedInMyZone)
        {
          safeCandidates.Add(candidateToRemove);
          if (DebugMode) RhinoApp.WriteLine("FindRaftToRemove: candidate " + candidateToRemove + " is safe");
        }
        else
        {
          if (DebugMode) RhinoApp.WriteLine("FindRaftToRemove: candidate " + candidateToRemove + " is NOT safe");
        }
      }


      // order safe candidates by distance to the current home
      Point3d homePos = CachedAllCloud[currentHome].Location;
      safeCandidates = safeCandidates.OrderByDescending(i => CachedAllCloud[i].Location.DistanceTo(homePos)).ToList();

      // update allowDisassemble and targets
      HashSet<int> allowDisassemble = (HashSet<int>)env.CustomData[EnvironmentKeys.AllowDisassemble];
      foreach (int i in safeCandidates)
      {
        if (!allowDisassemble.Contains(i)) allowDisassemble.Add(i);
        if (!allTargets.ContainsKey(i))
        {
          allTargets[i] = new TargetData(i, new int[] { i }, 0, new int[] { });
        }
      }
      env.CustomData[EnvironmentKeys.AllowDisassemble] = allowDisassemble;

      Dictionary<int, TargetData> freshTargets = LoadTargets(env);
      foreach (int i in safeCandidates)
      {
        if (!freshTargets.ContainsKey(i))
        {
          freshTargets[i] = new TargetData(i, new int[] { i }, 0, new int[] { });
        }
      }
      SaveTargets(env, freshTargets);

      if (DebugMode) RhinoApp.WriteLine("FindRaftToRemove: safeCandidates=" + safeCandidates.Count
          + " order (farthest first): [" + string.Join(",", safeCandidates) + "]");
      return safeCandidates;
    }


    private bool IsRaftSafeToRemoveWithBFS(int startIndex, int raftTarget, HashSet<int> simulatedBlockedNodes, List<BuildState> buildStates)
    {
      // simulate BFS search: the research is restricted to raft-layer nodes only
      // cannot use structural nodes as shortcuts
      // BFS = “starting from home bases, spread out and mark everything you can reach”

      if (startIndex == raftTarget) return true;

      HashSet<int> visited = new HashSet<int>(); // points that are visited are reachable
      Queue<int> queue = new Queue<int>(); // points that still need to explore
      queue.Enqueue(startIndex);
      visited.Add(startIndex); // start BFS from the startIndex (home)

      while (queue.Count > 0)
      {
        int current = queue.Dequeue(); // expand from the first point in queue
        if (current == raftTarget) return true; // if it can finally reached raft, then return true

        if (!CachedAdjacencyMap.ContainsKey(current)) continue;

        // check its neighbors, to determine whether it is reachable ONLY IF:
        // a) the neighbor is walkable (meaning not removed) b) has not been in visited before
        // Basically, BSF is to add only valid, connected/walkable neighbor to visited
        foreach (int neighbor in CachedAdjacencyMap[current])
        {
          // to check if the neighbor of the current is traversable
          if (visited.Contains(neighbor)) continue;
          if (simulatedBlockedNodes.Contains(neighbor)) continue;
          if (buildStates[neighbor] != BuildState.Deployed) continue;

          bool isNeighborOnGround = IsPointOnGroundLevel(raftTarget, neighbor);
          if (!isNeighborOnGround) continue;

          visited.Add(neighbor);
          queue.Enqueue(neighbor);
        }
      }

      return false;

    }




    //-------------------ASSIGN RAFT ZONES AND RAFT REMOVERS-----------------------------------
    private Dictionary<int, int> AssignRaftZones(List<int> unRemovedRafts, List<int> homeIndices, List<BuildState> buildStates)
    {
      // map each raft index to the home index it belongs to
      Dictionary<int, int> raftZones = new Dictionary<int, int>();

      foreach (int raft in unRemovedRafts)
      {
        Point3d raftPos = CachedAllCloud[raft].Location;

        // assign to nearest home by ground-level BFS distance
        // not Euclidean distance, but actual traverssal distance
        int nearestHome = -1;
        int shortestPath = int.MaxValue;
        HashSet<int> blocked = new HashSet<int>(); // nothing blocked yet
        foreach (int home in homeIndices)
        {
          int pathLength = GetBFSDistance(home, raft, blocked, buildStates);
          if (pathLength >= 0 && pathLength < shortestPath)
          {
            shortestPath = pathLength;
            nearestHome = home;
          }
        }

        if (nearestHome >= 0)
        {
          raftZones[raft] = nearestHome;
        }
      }

      return raftZones;
    }


    private int GetBFSDistance(int startIndex, int endIndex, HashSet<int> blocked, List<BuildState> buildStates)
    {
      if (startIndex == endIndex) return 0;

      double groundZ = CachedAllCloud[startIndex].Location.Z;
      double tolerance = 0.1;

      Queue<int> queue = new Queue<int>();
      Dictionary<int, int> dist = new Dictionary<int, int>();
      queue.Enqueue(startIndex);
      dist[startIndex] = 0;

      while (queue.Count > 0)
      {
        int current = queue.Dequeue();
        if (current == endIndex) return dist[current];

        if (!CachedAdjacencyMap.ContainsKey(current)) continue;
        foreach (int neighbor in CachedAdjacencyMap[current])
        {
          if (dist.ContainsKey(neighbor)) continue;
          if (blocked.Contains(neighbor)) continue;
          if (buildStates[neighbor] != BuildState.Deployed) continue;
          double nz = CachedAllCloud[neighbor].Location.Z;
          if (Math.Abs(nz - groundZ) > tolerance) continue;
          dist[neighbor] = dist[current] + 1;
          queue.Enqueue(neighbor);
        }
      }

      return -1; // unreachable
    }


    public Dictionary<int, int> AssignAgentsForRaftRemovalTask(CartesianEnvironment env)
    {
      // this method is to ensure ONLY ONE agent to one home for raft removal task
      // no two or more agents can share the same home for raft removal due to the RaftZone Dictionary where each home is assigned to certain rafts

      // map homeIndex to agentId who will operate that home for raft removal task
      List<int> homeIndices = CachedHomeBases.Keys.ToList();
      Dictionary<int, int> homeToAgent = new Dictionary<int, int>();
      HashSet<int> assignedAgents = new HashSet<int>();

      foreach (int home in homeIndices)
      {
        int selectedAgent = -1;
        // first preference: agent currently occupying this home
        int occupant = HomeBaseOccupant.ContainsKey(home)
          ? HomeBaseOccupant[home] : -1;
        Queue<int> returnQueue = HomeBaseReturnQueues.ContainsKey(home)
          ? HomeBaseReturnQueues[home] : new Queue<int>();
        Queue<int> entryQueue = HomeBaseEntryQueues.ContainsKey(home)
          ? HomeBaseEntryQueues[home] : new Queue<int>();

        if (occupant >= 0 && !assignedAgents.Contains(occupant))
        {
          selectedAgent = occupant;
        }
        else if (returnQueue.Count > 0)
        { // second preference: first agent in returner for this home
          foreach (int returner in returnQueue)
          {
            if (returner >= 0 && !assignedAgents.Contains(returner))
            {
              selectedAgent = returner;
              break;
            }
          }

        }
        else if (entryQueue.Count > 0)
        {
          // 3rd preference: check if there's any agent waiting to enter the home from outside the field
          foreach (int entryer in entryQueue)
          {
            if (entryer >= 0 && !assignedAgents.Contains(entryer))
            {
              selectedAgent = entryer;
              break;
            }
          }
        }

        if (selectedAgent >= 0)
        {
          assignedAgents.Add(selectedAgent);
          homeToAgent[home] = selectedAgent;
          if (DebugMode) RhinoApp.WriteLine("AssignAgentsForRaftRemovalTask: home=" + home + " assigned to agent=" + selectedAgent);
        }
        else
        {
          if (DebugMode) RhinoApp.WriteLine("AssignAgentsForRaftRemovalTask: home=" + home + " has no available agent to assign");
        }
      }
      return homeToAgent;
    }





    // -------------------ASSIGN A PARTICULAR ASSEMBLE OR SUPPORT DISASSEMBLE OR RAFT REMOVAL TASK--------------------
    public int AssignAssembleTask(CartesianAgent agent, int currentIndex, List<int> allAssembles, CartesianEnvironment env)
    {
      if (DebugMode) RhinoApp.WriteLine("AssignAssembleTask: allAssembles.Count=" + allAssembles.Count);

      if (allAssembles.Count == 0)
      {
        return -1;
      }

      Dictionary<int, Tuple<List<int>, double>> localPaths = ExecutePathFindingTask(agent, currentIndex, allAssembles, env);

      if (localPaths.Count == 0)
      {
        return -1;
      }

      int pickedTarget = PickBestTargetPath(agent.Id, localPaths, env);

      if (DebugMode) RhinoApp.WriteLine("AssignAssembleTask: pickedTarget=" + pickedTarget);

      return pickedTarget;
    }


    // assign a particular support disassemble task to the agent
    public int AssignDisassembleTask(CartesianAgent agent, int currentIndex, List<int> allowDisassemble, CartesianEnvironment env)
    {
      if (DebugMode) RhinoApp.WriteLine("About to AssignDisassembleTask through ExecutePathFindingTask...");

      int task = -1;
      // use path finding to find the best target-path for the agent
      var localPaths = ExecutePathFindingTask(agent, currentIndex, allowDisassemble, env);
      if (localPaths.Count == 0)
      {
        if (DebugMode) RhinoApp.WriteLine("AssignDisassembleTask: After ExecutePathFindingTask - No valid paths found");
        task = -1;
      }
      task = PickBestTargetPath(agent.Id, localPaths, env);
      if (DebugMode) RhinoApp.WriteLine("AssignDisassembleTask: After ExecutePathFindingTask - pickedTarget= " + task);

      return task;
    }



    public int AssignRaftRemovalTask(CartesianAgent agent, int agentIndex, List<int> removalTargets, CartesianEnvironment env)
    {
      if (removalTargets.Count == 0) return -1;

      // removalTargets coming from FindRaftToRemove(): is already sorted farthest-first
      // need to respect this order, and iterate it in that order to pick the FIRST one with a valid path
      // DO NOT sort by path cost from AStar - this would override the farthest-first ordering

      // filter out already reserved targets
      Dictionary<int, TargetData> targets = LoadTargets(env);
      var singleEntry = new Dictionary<int, Tuple<List<int>, double>>();

      foreach (int target in removalTargets)
      {
        if (CachedReservedTargets.Contains(target)) continue;
        if (targets.ContainsKey(target) && targets[target].ReservedBy.Length > 0 && !targets[target].ReservedBy.Contains(agent.Id)) continue;
        // check path exists using ground-level A*
        var result = AStarPathFinding(agent, agentIndex, target, env, groundTravelPreferred: true);
        if (result == null || result.Item1.Count <= 1)
        {
          if (DebugMode) RhinoApp.WriteLine("AssignRaftRemovalTask: no ground-level path to "
              + target + ", skipping");
          continue;
        }

        // reserve this specific target - pass single entry dict to pick best target
        // so it cannot swap to a different cheaper pathcost target
        singleEntry.Add(target, result);
      }

      int pickedTarget = PickBestTargetPath(agent.Id, singleEntry, env);

      if (pickedTarget != -1)
      {
        // double-check no other agent grabbed it between FindRaftToRemove2 and here
        var freshTargets = LoadTargets(env);

        if (freshTargets.ContainsKey(pickedTarget)
          && freshTargets[pickedTarget].ReservedBy.Length > 0
          && !freshTargets[pickedTarget].ReservedBy.Contains(agent.Id))
        {
          if (DebugMode) RhinoApp.WriteLine("AssignRaftRemovalTask: target " + pickedTarget
              + " was grabbed by another agent, skipping");
          return -1;
        }

        if (DebugMode) RhinoApp.WriteLine("AssignRaftRemovalTask: picked farthest reachable="
            + pickedTarget + " path=["
            + string.Join(",", freshTargets[pickedTarget].Path.ToList()) + "]");
        return pickedTarget;
      }
      else
      {
        if (DebugMode) RhinoApp.WriteLine("AssignRaftRemovalTask: no valid target found");
        return -1;
      }

    }



    //------------ UPDATE ENVIRONMENT AFTER TASK ASSIGNMENT AND EXECUTION FOR TARGETS -----------------
    public void OccupyPathAfterTaskAssignment(bool isTaskATarget, CartesianAgent agent, int currentIndex, int assignedTarget, CartesianEnvironment env)
    {
      //for assemble: set path(including target) to occupied, remove them(excluding target, because it is not deployed anyway) from deployed cloud
      //for dissassemble and raft removal: set path(including target) to occupied, remove them(including target, because it is in deployed) from deployed cloud
      if (DebugMode) RhinoApp.WriteLine("Occupy Path Start...");

      Dictionary<int, TargetData> allTargets = LoadTargets(env);

      // a) get the path based on the task type
      List<int> path = new List<int>();
      if (!isTaskATarget)
      {
        // the target is a home base
        if (!agent.CustomData.ContainsKey(AgentKeys.Path)) return;
        path = (List<int>)agent.CustomData[AgentKeys.Path];
      }
      else
      {
        // the target is an assemble/disassemble task
        if (!allTargets.Any(kvp => kvp.Key == assignedTarget)) return;
        TargetData targetInfo = allTargets[assignedTarget];
        path = targetInfo.Path.ToList();
      }

      // b) occupy path: set path from deployed to occupied
      if (path == null || path.Count == 0) return;
      if (DebugMode) RhinoApp.WriteLine("Before Occupy Path, Verify - currentIndex= " + currentIndex + ", path[0] = " + path[0] + ", assignedTarget = " + assignedTarget);
      if (currentIndex != path[0])
      {
        RhinoApp.WriteLine("ERROR WANRING: agent's current index is not the same as path[0], failed to skip occupying the first in the path...");
      }

      //update agent's path to environment's ActivePath key
      var activePath = (Dictionary<int, List<int>>)env.CustomData[EnvironmentKeys.ActivePath];
      if (!activePath.ContainsKey(agent.Id))
      {
        activePath.Add(agent.Id, new List<int>());
      }
      activePath[agent.Id] = path;
      env.CustomData[EnvironmentKeys.ActivePath] = activePath;
    }



    public void ReleasePathAfterExecuteTask(bool isTaskATarget, CartesianAgent agent, int assignedTarget, CartesianEnvironment env)
    {
      if (DebugMode) RhinoApp.WriteLine("Release Path Start...");

      Dictionary<int, TargetData> targets = LoadTargets(env);

      // a) get the path based on the task type
      List<int> path = new List<int>();
      if (!isTaskATarget)
      {
        // the target is a home base
        if (!agent.CustomData.ContainsKey(AgentKeys.Path)) return;
        path = (List<int>)agent.CustomData[AgentKeys.Path];
      }
      else
      {
        // the target is an assemble/disassemble task
        if (!targets.Any(kvp => kvp.Key == assignedTarget)) return;
        TargetData targetInfo = targets[assignedTarget];
        path = targetInfo.Path.ToList();
      }

      // Guard: nothing to release if path is empty or too short
      if (path == null || path.Count < 2)
      {
        if (DebugMode) RhinoApp.WriteLine("ReleasePathAfterExecuteTask: path is null or too short, skipping");
        return;
      }

      // b) release path:
      // for assemble, set path(including target) from occupied back to deployed, add them(including target) to deployed cloud
      // for disassemble and raft, set path(excluding target, because target become removed) from occupied to deployed, add them(excluding target) to deployed
      if (assignedTarget != path[path.Count - 1])
      {
        RhinoApp.WriteLine("ERROR WANRING: agent's target index is not the same as the last point index in the path, failed to skip releasing the last point in the path...");
      }

      // clear the ActivePath in environment:
      var activePath = (Dictionary<int, List<int>>)env.CustomData[EnvironmentKeys.ActivePath];
      if (activePath.ContainsKey(agent.Id))
      {
        activePath[agent.Id] = new List<int> { assignedTarget };
        env.CustomData[EnvironmentKeys.ActivePath] = activePath;
      }

    }


    public void UpdateEnvAfterAssembly(CartesianAgent agent, int agentTarget, CartesianEnvironment env)
    {
      // update this target's buildstate:
      List<int> buildStateInts = (List<int>)env.CustomData[EnvironmentKeys.BuildState];
      List<BuildState> buildStates = buildStateInts.Select(i => (BuildState)i).ToList();
      if (DebugMode) RhinoApp.WriteLine("  Target BuildState BEFORE: " + buildStates[agentTarget]);
      // ✅ CRITICAL: Don't deploy if already deployed!
      if (buildStates[agentTarget] == BuildState.Deployed)
      {
        return;
      }
      buildStates[agentTarget] = BuildState.Deployed;
      env.CustomData[EnvironmentKeys.BuildState] = buildStates.Select(s => (int)s).ToList();

      // add this target into deployedCloud
      HashSet<int> deployed = (HashSet<int>)env.CustomData[EnvironmentKeys.Deployed];

      bool isAlreadyInDeployedCloud = false;
      if (deployed.Contains(agentTarget))
      {
        isAlreadyInDeployedCloud = true;
        if (DebugMode) RhinoApp.WriteLine("UpdateEnvAfterAssembly: WARNING - this targetPt is already in deployedCloud");

      }

      if (!isAlreadyInDeployedCloud)
      {
        deployed.Add(agentTarget);
        if (DebugMode) RhinoApp.WriteLine("UpdateEnvAfterAssembly: target " + agentTarget + " added to deployedCloud");
      }

      env.CustomData[EnvironmentKeys.Deployed] = deployed;

      Point3d agentPos = (Point3d)agent.CustomData[AgentKeys.Position];
      int whereAgentIs = ComputeCorrectPointIndex(agentPos);
      if (DebugMode) RhinoApp.WriteLine("Before Release Path After executing Assembly, currentIndex= " + whereAgentIs + ", assignedTarget = " + agentTarget);
      ReleasePathAfterExecuteTask(true, agent, agentTarget, env);


      // remove target from ready to deploy
      HashSet<int> readyToDeploy = (HashSet<int>)env.CustomData[EnvironmentKeys.ReadyToDeploy];
      if (readyToDeploy.Contains(agentTarget))
      {
        readyToDeploy.Remove(agentTarget);
        if (DebugMode) RhinoApp.WriteLine("UpdateEnvAfterAssembly: Removed target " + agentTarget + " from ReadyToDeploy");
        env.CustomData[EnvironmentKeys.ReadyToDeploy] = readyToDeploy;
      }

      // remove the target from cached reserved targets
      CachedReservedTargets.Remove(agentTarget);

      // remove target from serialized reservation
      Dictionary<int, TargetData> targets = LoadTargets(env);
      if (targets.ContainsKey(agentTarget))
      {
        targets.Remove(agentTarget);
        if (DebugMode) RhinoApp.WriteLine("UpdateEnvAfterAssembly: Removed target " + agentTarget + " from Targets");
      }
      SaveTargets(env, targets);

      // update voxel dependency relations
      UpdateDependencyAfterAssembly(agentTarget, env);

    }


    public void UpdateEnvAfterDisassembly(CartesianAgent agent, int agentTarget, CartesianEnvironment env)
    {
      if (DebugMode) RhinoApp.WriteLine("========================================");
      if (DebugMode) RhinoApp.WriteLine("UpdateEnvAfterDisassembly CALLED for target " + agentTarget);

      // Check what type this point is
      if (DebugMode) RhinoApp.WriteLine("  Target " + agentTarget + " VoxelType: " + CachedVoxelTypes[agentTarget]);

      // update this target's buildstate from deployed to removed
      List<int> buildStateInts = (List<int>)env.CustomData[EnvironmentKeys.BuildState];
      List<BuildState> buildStates = buildStateInts.Select(i => (BuildState)i).ToList();
      if (DebugMode) RhinoApp.WriteLine("  BuildState BEFORE: " + buildStates[agentTarget]);
      buildStates[agentTarget] = BuildState.Removed;
      env.CustomData[EnvironmentKeys.BuildState] = buildStates.Select(s => (int)s).ToList();

      // Verify immediately
      List<int> checkInts = (List<int>)env.CustomData[EnvironmentKeys.BuildState];
      List<BuildState> checkStates = checkInts.Select(i => (BuildState)i).ToList();
      if (DebugMode) RhinoApp.WriteLine("  BuildState AFTER: " + checkStates[agentTarget]);

      // remove this target from deployedCloud
      HashSet<int> deployed = (HashSet<int>)env.CustomData[EnvironmentKeys.Deployed];
      if (deployed != null && deployed.Count > 0)
      {
        if (deployed.Contains(agentTarget))
        {
          deployed.Remove(agentTarget);
          env.CustomData[EnvironmentKeys.Deployed] = deployed;
          if (DebugMode) RhinoApp.WriteLine("UpdateEnvAfterDisassembly: Removed target " + agentTarget + " from Deployed ");
        }
        else
        {
          if (DebugMode) RhinoApp.WriteLine("UpdateEnvAfterDisassembly: WARNING - agentTarget " + agentTarget + " was not found in Deployed, therefore, unable to remove it from deployed");
        }
      }

      // release occupied path, add them back to deployedCloud
      Point3d agentPos = (Point3d)agent.CustomData[AgentKeys.Position];
      int whereAgentIs = ComputeCorrectPointIndex(agentPos);
      if (DebugMode) RhinoApp.WriteLine("Before Release Path After executing disassembly, currentIndex= " + whereAgentIs + ", assignedTarget = " + agentTarget);
      ReleasePathAfterExecuteTask(true, agent, agentTarget, env);

      // remove target from allowDisassemble
      HashSet<int> allowDisassemble = (HashSet<int>)env.CustomData[EnvironmentKeys.AllowDisassemble];
      if (allowDisassemble.Contains(agentTarget))
      {
        allowDisassemble.Remove(agentTarget);
        env.CustomData[EnvironmentKeys.AllowDisassemble] = allowDisassemble;
        if (DebugMode) RhinoApp.WriteLine("UpdateEnvAfterDisassembly: Removed target " + agentTarget + " from AllowDisassemble");
      }


      // add it to disassembled
      HashSet<int> disassembled = (HashSet<int>)env.CustomData[EnvironmentKeys.Disassembled];
      if (!disassembled.Contains(agentTarget))
      {
        disassembled.Add(agentTarget);
        env.CustomData[EnvironmentKeys.Disassembled] = disassembled;
        if (DebugMode) RhinoApp.WriteLine("UpdateEnvAfterDisassembly: added target " + agentTarget + " to Disassembled");
      }

      // remove the target from cached reserved targets
      CachedReservedTargets.Remove(agentTarget);

      // remove from Targets
      Dictionary<int, TargetData> targets = LoadTargets(env);
      if (targets.ContainsKey(agentTarget))
      {
        targets.Remove(agentTarget);
        if (DebugMode) RhinoApp.WriteLine("UpdateEnvAfterDisassembly: Removed target " + agentTarget + " from Targets");
      }
      SaveTargets(env, targets);

      if (DebugMode) RhinoApp.WriteLine("UpdateEnvAfterDisassembly COMPLETE");
      if (DebugMode) RhinoApp.WriteLine("========================================");

    }



    public void UpdateDependencyAfterAssembly(int assignedTarget, CartesianEnvironment env)
    {
      List<int> buildStateInts = (List<int>)env.CustomData[EnvironmentKeys.BuildState];
      List<BuildState> buildStates = buildStateInts.Select(i => (BuildState)i).ToList();

      var activePathDict = (Dictionary<int, List<int>>)env.CustomData[EnvironmentKeys.ActivePath];
      List<int> activePathList = new List<int>();
      foreach (var kvp in activePathDict)
      {
        List<int> agentPath = kvp.Value;
        foreach (var p in agentPath)
        {
          activePathList.Add(p);
        }
      }

      // first check the voxel type--support or structure or raft
      // deployed, pendingToDeploy, needSp, removed, occupied
      BuildState targetState = buildStates[assignedTarget]; // assuning targetState is deployed now after assembly

      // if support: check sPToP, ptoSp
      if (CachedVoxelTypes[assignedTarget] == VoxelType.Support)
      {
        if (CachedSupportToPoints.ContainsKey(assignedTarget))
        { // if this support is the support top-> the voxels beneath it in the same supportcol have been built
          List<int> dependentPts = CachedSupportToPoints[assignedTarget];
          foreach (int pt in dependentPts)
          {
            // check if this pt needs more than the assignedTarget as the support
            Dictionary<int, int> requiredSupports = CachedPointToSupport.Where(kvp => kvp.Key == pt).ToDictionary(kvp => kvp.Key, kvp => kvp.Value);
            if (requiredSupports.Count == 0) continue;

            bool isPtOccupied = activePathList.Contains(pt);
            if (buildStates[pt] != BuildState.Deployed && !isPtOccupied && buildStates[pt] != BuildState.Removed)
            {
              bool hasUnmetDependency = requiredSupports.Any(kvp => buildStates[kvp.Value] != BuildState.Deployed); // if true, then not met, if not true, then met
              if (!hasUnmetDependency)
              {
                buildStates[pt] = BuildState.PendingToDeploy;
              }
            }
          }
        }
        else
        {
          // then this support is not the support top, then it is inCachedSupportCols
          // check which support above it, set it to pending to deploy--in which support col, at which index from the support top
          bool isSupportColExisting = CachedSupportCols.Any(kvp => kvp.Value.Contains(assignedTarget));
          if (isSupportColExisting)
          {
            KeyValuePair<int, List<int>> mySupportCol = CachedSupportCols.FirstOrDefault(kvp => kvp.Value.Contains(assignedTarget));
            int mySupportTop = mySupportCol.Key;
            List<int> mySupportBuddies = mySupportCol.Value;
            int myIndexInCol = mySupportBuddies.IndexOf(assignedTarget);
            if (myIndexInCol > 0)
            {
              int myUpperIndexInCol = myIndexInCol - 1;
              int myUpperIndexInCloud = mySupportBuddies[myUpperIndexInCol];

              // if I needSP, myUp is needSP; if I readyToDeploy, myUp is needSP, if I deployed, myUP is pendingToDeploy
              // if I occupied, keep myUp. if I removed, keey muUp (if not for disassemble structure)

              // ✅ FIX: Don't change if already Removed!
              if (buildStates[myUpperIndexInCloud] != BuildState.Removed)
              {
                if (targetState == BuildState.NeedSupport || targetState == BuildState.PendingToDeploy)
                {
                  buildStates[myUpperIndexInCloud] = BuildState.NeedSupport;
                }
                else if (targetState == BuildState.Deployed)
                {
                  buildStates[myUpperIndexInCloud] = BuildState.PendingToDeploy;
                }
              }
            }

          }
        }
      }

      if (CachedVoxelTypes[assignedTarget] == VoxelType.Structure)
      {
        // check if it has any point that depends on it or it depends on some other point
        if (CachedBindL.ContainsKey(assignedTarget))
        {
          List<int> dependentPts = CachedBindL[assignedTarget];
          // check these dependentPts, to see if they reqruie other binding dependencies
          foreach (var pt in dependentPts)
          {
            // ✅ FIX: Don't change if already Removed!
            if (buildStates[pt] == BuildState.Removed)
            {
              continue;
            }

            Dictionary<int, int> bindPts = CachedBindP.Where(kvp => kvp.Key == pt).ToDictionary(kvp => kvp.Key, kvp => kvp.Value);
            if (bindPts.Count == 0) continue;

            bool hasUnmetDependency = false;
            hasUnmetDependency = bindPts.Any(kvp => buildStates[kvp.Value] != BuildState.Deployed); // if true, not met
            if (!hasUnmetDependency)
            {
              buildStates[pt] = BuildState.PendingToDeploy;
            }
          }
        }

      }

      // ✅ Dont Forget - Save updated buildStates back to environment
      env.CustomData[EnvironmentKeys.BuildState] = buildStates.Select(s => (int)s).ToList();
    }



    // remove invalid the targets before assigning assemble/disassemble tasks in TaskAssignment() or TryChainTask()
    private void CleanUpTargetsBeforeTaskAssignment(CartesianAgent agent, CartesianEnvironment env, bool raftRemovalProcess = false)
    {
      Dictionary<int, TargetData> allTargets = LoadTargets(env);
      List<int> buildStateInts = (List<int>)env.CustomData[EnvironmentKeys.BuildState];
      List<BuildState> buildStates = buildStateInts.Select(i => (BuildState)i).ToList();
      HashSet<int> targetsToRemove = new HashSet<int>();

      //-----------------FIND TARGETS FROM CUSTOMDATA TARGETS---------------------
      foreach (var target in allTargets)
      {
        int targetIndex = target.Key;
        TargetData targetData = target.Value;
        int[] path = targetData.Path;

        if (!raftRemovalProcess)
        {
          // for assembly and support disassembly, remove all points that deployed and removed
          if (buildStates[targetIndex] == BuildState.Deployed
            || buildStates[targetIndex] == BuildState.Removed)
          {
            targetsToRemove.Add(targetIndex);
          }
        }
        else
        {
          // for raft removal process, remove points that are in removed buildstate only
          if (buildStates[targetIndex] == BuildState.Removed)
          {
            targetsToRemove.Add(targetIndex);
          }
        }

      }

      //-------------------------UPDATE TO CUSTOMDATA>TARGET--------------------------
      foreach (int targetIndex in targetsToRemove)
      {
        allTargets.Remove(targetIndex);
        if (CachedReservedTargets.Contains(targetIndex))
        {
          CachedReservedTargets.Remove(targetIndex);
        }
      }

      SaveTargets(env, allTargets);
    }


    //------------------------- UPDATE MOVEMENT DICS------------------------------------------
    private string GetMovementKey(int agentID)
    {
      return "Agent " + agentID + " Position";
    }

    private void InitializeMovementDic(CartesianAgent agent, int assignedHomeIndex, CartesianEnvironment env)
    {
      if (DebugMode) RhinoApp.WriteLine("InitializeMovementDic: START...");

      string movementKeys = GetMovementKey(agent.Id);

      if (!env.CustomData.ContainsKey(movementKeys))
      {
        Dictionary<string, object> movementDic = new Dictionary<string, object>();

        bool isHomeFree = !IsHomePhysicallyOccupied(assignedHomeIndex, agent.Id);
        if (isHomeFree)
        {
          movementDic["Position"] = CachedHomeBases[assignedHomeIndex].HomeBasePt;
          movementDic["Orientation"] = CachedHomeBases[assignedHomeIndex].MaterialPickUpDir;
        }
        else
        {
          movementDic["Position"] = CachedHomeBases[assignedHomeIndex].GetWaitingSpotFor(agent.Id);
          movementDic["Orientation"] = CachedHomeBases[assignedHomeIndex].WaitingDir;
        }
        movementDic["WorkState"] = WorkState.Idle;
        movementDic["ExtendArm"] = false;
        movementDic["HasMaterial"] = false;
        movementDic["HomeBase"] = assignedHomeIndex;
        movementDic["Target"] = -1;
        movementDic["Path"] = new List<int>();
        movementDic["CurrentStep"] = 0;
        movementDic["CanEnterTheField"] = (HomeBaseOccupant[assignedHomeIndex] == -1) ? true : false;
        env.CustomData[movementKeys] = movementDic;
      }
    }
    private void UpdateMovementDicForVisualization(CartesianAgent agent, WorkState newState, CartesianEnvironment env)
    {
      if (DebugMode) RhinoApp.WriteLine("UpdateMovementDic: START...");

      string movementKeys = GetMovementKey(agent.Id);

      // using persistent agent data, rather than agent.CustomData
      if (!persistentAgentData.ContainsKey(agent.Id)) return;
      var agentPersistentData = persistentAgentData[agent.Id];

      Dictionary<string, object> movementDic;
      if (!env.CustomData.ContainsKey(movementKeys))
      {
        movementDic = new Dictionary<string, object>();
      }
      movementDic = (Dictionary<string, object>)env.CustomData[movementKeys];

      Point3d positionToStore;
      if (agentPersistentData.ContainsKey(AgentKeys.Position))
      {
        positionToStore = (Point3d)agentPersistentData[AgentKeys.Position];
      }
      else
      {
        positionToStore = agent.Position;  // Fallback
      }
      movementDic["Position"] = positionToStore;

      movementDic["Orientation"] = agentPersistentData.ContainsKey(AgentKeys.Orientation)
        ? agentPersistentData[AgentKeys.Orientation]
        : Vector3d.XAxis;

      movementDic["WorkState"] = newState;

      if (newState == WorkState.Idle)
      {
        agentPersistentData[AgentKeys.ExtendArm] = false;
      }
      movementDic["ExtendArm"] = agentPersistentData[AgentKeys.ExtendArm];

      movementDic["HasMaterial"] = agentPersistentData.ContainsKey(AgentKeys.HasMaterial)
        ? agentPersistentData[AgentKeys.HasMaterial]
        : false;

      movementDic["Target"] = agentPersistentData.ContainsKey(AgentKeys.Target)
        ? agentPersistentData[AgentKeys.Target]
        : -1;

      movementDic["HomeBase"] = agentPersistentData.ContainsKey(AgentKeys.HomeBase)
        ? agentPersistentData[AgentKeys.HomeBase] : -1;

      movementDic["Path"] = agentPersistentData.ContainsKey(AgentKeys.Path)
        ? agentPersistentData[AgentKeys.Path]
        : new List<int>();

      movementDic["CurrentStep"] = agentPersistentData.ContainsKey(AgentKeys.CurrentStep)
        ? agentPersistentData[AgentKeys.CurrentStep] : 0;

      bool canEnterTheField = agentPersistentData.ContainsKey(AgentKeys.EntertheField)
        ? (bool)agentPersistentData[AgentKeys.EntertheField]
        : false;
      movementDic["CanEnterTheField"] = canEnterTheField;

      env.CustomData[movementKeys] = movementDic;

      if (DebugMode) RhinoApp.WriteLine("Verify Agent " + agent.Id + ": Position Mismatch...");
      if (DebugMode) RhinoApp.WriteLine("AgentKeys.Position = " + positionToStore + ", Agent.Position = " + agent.Position);
      if (canEnterTheField)
      {
        if (DebugMode) RhinoApp.WriteLine("the Agent " + agent.Id + ": canEnterTheField = true");
      }
      if (DebugMode) RhinoApp.WriteLine("UpdateMovementDic: COMPLETE...");
    }


    //----------------------------A* PATH FINDING RELATED ----------------------------------
    public Tuple<List<int>, double> AStarPathFinding(CartesianAgent agent, int currentIndex, int targetIndex, CartesianEnvironment env, bool groundTravelPreferred = false)
    {
      // access environment data --dynamic
      List<int> buildStateInts = (List<int>)env.CustomData[EnvironmentKeys.BuildState];
      List<BuildState> buildStates = buildStateInts.Select(i => (BuildState)i).ToList();

      // ✅ CHECK: Print BuildState of recently disassembled points
      List<int> disassembled = ((HashSet<int>)env.CustomData[EnvironmentKeys.Disassembled]).ToList();


      // access environment data -- static
      // ✅ ADD: Special case - if already at target
      if (currentIndex == targetIndex)
      {
        if (DebugMode) RhinoApp.WriteLine("A*: Already at target " + targetIndex + ", not creating target entry");
        return Tuple.Create(new List<int>(), 0.0);  // ✅ Just return, don't create target!
      }

      List<int> openSet = new List<int>();
      HashSet<int> closedSet = new HashSet<int>();
      openSet.Add(currentIndex);
      var gScore = new Dictionary<int, double>();
      var fScore = new Dictionary<int, double>();
      var cameFrom = new Dictionary<int, int>();
      List<int> validPath = new List<int>();
      double pathCost = 0;
      gScore[currentIndex] = 0;
      fScore[currentIndex] = gScore[currentIndex] + HeuristicHCost(currentIndex, targetIndex);
      while (openSet.Count > 0)
      {
        int winnerIndex = openSet[0]; // set the currentPos's index as the winnerIndex, this index is index in CachedAllCloud
        // loop through openSet, if any item's fcost is smaller than the current winner's, set this item to winner
        foreach (int i in openSet)
        {
          if (fScore[i] < fScore[winnerIndex])
          {
            winnerIndex = i;
          }
        }
        // Find the target
        if (winnerIndex == targetIndex)
        {
          pathCost = gScore[winnerIndex];
          validPath = ReconstructPath(cameFrom, winnerIndex);

          return Tuple.Create(validPath, pathCost);
        }
        // this winner has just been evaluated, so remove from openSet and add it to closedSet
        openSet.Remove(winnerIndex);
        closedSet.Add(winnerIndex);
        // evaluating neighbors of the winner: only consider neighbor is deployed but not occpied, and is not in closedSet
        if (!CachedAdjacencyMap.ContainsKey(winnerIndex)) continue;  // skip if no neighbors
        List<int> neighbors = CachedAdjacencyMap[winnerIndex];
        foreach (int neighbor in neighbors)
        {
          // ✅ FIX: Allow target even if not deployed, and allow occupied nodes as waypoints
          bool isTarget = (neighbor == targetIndex);
          bool isDeployed = (buildStates[neighbor] == BuildState.Deployed);

          // Can traverse if: (deployed OR occupied) OR is the target
          bool canTraverse = isTarget || isDeployed;
          if (!canTraverse) continue;

          // for raft removal, groundTravelPreferred = true.
          // So for path that would pass through above-ground points, add some penalty cost
          if (groundTravelPreferred)
          {
            bool isGroundPt = IsPointOnGroundLevel(currentIndex, neighbor);
            bool isReserved = false;
            var allTargetsCheck = LoadTargets(env);
            if (CachedBasements.Contains(neighbor))
            {
              isReserved = (CachedReservedTargets.Contains(neighbor))
                || ((allTargetsCheck.ContainsKey(neighbor)
                && allTargetsCheck[neighbor].ReservedBy.Length > 0)
                && !allTargetsCheck[neighbor].ReservedBy.Contains(agent.Id));
            }
            if (!isGroundPt || isReserved) continue;

            // block if in another agent's zone and not a connector node
            int currentHome = (int)agent.CustomData[AgentKeys.CurrentHome];
            var raftZones = (Dictionary<int, int>)env.CustomData[EnvironmentKeys.RaftZones];
            if (raftZones != null && raftZones.ContainsKey(neighbor) && raftZones[neighbor] != currentHome) continue;
          }

          if (closedSet.Contains(neighbor)) continue;
          double tentativeG = gScore[winnerIndex] + CachedStructuralResolution + PenalizeTraversalCostToBuildState(agent, neighbor, targetIndex, buildStates, env);
          bool foundNewPath = false;
          if (openSet.Contains(neighbor))
          {
            // if neighbor is already in openSet, it has gScore[neighbor] for sure, because a node is added to openSet only after you assign its gScore
            if (tentativeG < gScore[neighbor])
            {
              foundNewPath = true;
            }
          }
          else
          {
            foundNewPath = true;
            openSet.Add(neighbor);
          }
          if (foundNewPath)
          {
            cameFrom[neighbor] = winnerIndex;
            gScore[neighbor] = tentativeG;
            fScore[neighbor] = gScore[neighbor] + HeuristicHCost(neighbor, targetIndex);
          }
        }
      }
      // ✅ No valid path found
      if (DebugMode) RhinoApp.WriteLine("A*: No path found from " + currentIndex + " to " + targetIndex);
      return Tuple.Create(new List<int>(), 0.0);
    }


    private bool IsPointOnGroundLevel(int ptForReference, int ptToCompare)
    {
      double tolerance = 0.1;
      double groundZ = CachedAllCloud[ptForReference].Location.Z;
      double neighborZ = CachedAllCloud[ptToCompare].Location.Z;
      bool isGroundPt = Math.Abs(groundZ - neighborZ) <= tolerance;

      return isGroundPt;
    }

    private void SaveAStarPathToTargets(int targetIndex, List<int> path, double pathCost, CartesianEnvironment env)
    {
      // if the targetIndex is an assemble/disassembly target (not home bases), then save it to Targets' TargetData
      var targets = LoadTargets(env);
      int[] pathArray = path.ToArray();
      if (path == null || path.Count == 0)
      {
        pathArray = new int[] { targetIndex };
      }
      if (targets.ContainsKey(targetIndex))
      {
        targets[targetIndex].Path = pathArray;
        targets[targetIndex].Cost = pathCost;
      }
      else
      {
        TargetData targetData = new TargetData(targetIndex, pathArray, pathCost, new int[] { });
        targets.Add(targetIndex, targetData);
      }
      SaveTargets(env, targets);
      if (DebugMode) RhinoApp.WriteLine("AStar: Found Path to target - " + targetIndex + ", with path - " + path + ", pathCost - " + pathCost);

    }


    private double HeuristicHCost(int currentIndex, int targetIndex)
    {
      Point3d targetPt = CachedAllCloud[targetIndex].Location;
      Point3d currentPt = CachedAllCloud[currentIndex].Location;
      double hCost = double.PositiveInfinity;

      //Euclidean Distance
      //hCost = currentPt.DistanceTo(targetPt);

      // Manhattan Distance
      hCost = Math.Abs(currentPt.X - targetPt.X) + Math.Abs(currentPt.Y - targetPt.Y) + Math.Abs(currentPt.Z - targetPt.Z);

      return hCost;
    }

    private List<int> ReconstructPath(Dictionary<int, int> cameFrom, int endIndex)
    {
      List<int> path = new List<int>();
      path.Add(endIndex);

      int tempt = endIndex;

      while (cameFrom.ContainsKey(tempt))
      {
        int parentNode = cameFrom[tempt];
        path.Add(parentNode);
        tempt = parentNode;
      }

      path.Reverse(); // this is for agent's path ordering purpose, because agent starts from current, not from end
      return path;
    }

    private double PenalizeTraversalCostToBuildState(CartesianAgent agent, int nodeIndex, int targetIndex, List<BuildState> buildStates, CartesianEnvironment env)
    {
      List<int> homeIndices = CachedHomeBases.Keys.ToList();
      BuildState state = buildStates[nodeIndex];

      bool isExemptFromCostPenalty = (homeIndices.Contains(nodeIndex) || nodeIndex == targetIndex);

      var activePath = (Dictionary<int, List<int>>)env.CustomData[EnvironmentKeys.ActivePath];

      double cost = 0.0;

      if (state != BuildState.Deployed && !isExemptFromCostPenalty)
      {
        cost = double.MaxValue / 2;
        return cost;
      }

      // count how many other agents have this node in their active path
      int occupancyCount = 0;
      foreach (var kvp in activePath)
      {
        if (kvp.Key == agent.Id) continue;
        if (kvp.Value.Contains(nodeIndex)) occupancyCount++;
      }

      cost = 1.0 + occupancyCount * 4.0;
      return cost;

    }


    private Dictionary<int, Tuple<List<int>, double>> ExecutePathFindingTask(CartesianAgent agent, int currentIndex, List<int> targetIndices, CartesianEnvironment env, bool raftRemovalTask = false)
    {
      if (DebugMode) RhinoApp.WriteLine("ExecutePathFindingTask: Running AStar from currentIndex = " + currentIndex + " to a list of " + targetIndices.Count + " targetIndices");

      // A better way is to collect path locally instead of saving it immediately
      Dictionary<int, Tuple<List<int>, double>> localPath = new Dictionary<int, Tuple<List<int>, double>>();
      bool groundTraverse = raftRemovalTask;
      foreach (int target in targetIndices)
      {
        var AStarResults = AStarPathFinding(agent, currentIndex, target, env, groundTraverse);
        if (AStarResults != null && AStarResults.Item1.Count > 1)
        {
          localPath[target] = AStarResults;
          if (DebugMode) RhinoApp.WriteLine("A*: path from " + currentIndex + " to " + target
              + " cost=" + AStarResults.Item2
              + " path=[" + string.Join(",", AStarResults.Item1) + "]");
        }
      }

      var sortedLocalPaths = localPath.OrderBy(kvp => kvp.Value.Item2).ToDictionary(kvp => kvp.Key, kvp => kvp.Value);
      return sortedLocalPaths;
    }


    private int PickBestTargetPath(int agentID, Dictionary<int, Tuple<List<int>, double>> localPathDic, CartesianEnvironment env)
    {

      int pickedTarget = -1;
      var targets = LoadTargets(env);

      foreach (var target in localPathDic)
      {

        int targetIndex = target.Key;
        var targetInfo = target.Value;
        List<int> targetPath = targetInfo.Item1;
        double targetCost = targetInfo.Item2;

        // check cached reserved targets first--to see if this target has been reserved by other agents
        // this is to prevent multiple agents from selecting the same target in multi-threading
        if (CachedReservedTargets.Contains(targetIndex)) continue;

        // check serialized reservation if target exists in dic
        TargetData targetData;
        if (targets.ContainsKey(targetIndex))
        {
          targetData = targets[targetIndex];
          // check if the targetIndex is already reserved by another agent
          if (targetData.ReservedBy.Length > 0 && !targetData.ReservedBy.Contains(agentID)) continue;
        }
        else
        {
          targetData = new TargetData(targetIndex, targetPath.ToArray(), targetCost, new int[] { });
          targets[targetIndex] = targetData;
        }

        // add reservation to the seralized targets
        List<int> reservationList = targetData.ReservedBy.ToList();
        if (!reservationList.Contains(agentID))
        {
          reservationList.Add(agentID);
          targetData.ReservedBy = reservationList.ToArray();
        }

        // FIX: write back to targets before saving:
        targetData.Path = targetPath.ToArray();
        targetData.Cost = targetCost;
        targets[targetIndex] = targetData;
        pickedTarget = targetIndex;

        // claim the target and add it into the cached reseraved targets - next agent's Execute will see this
        CachedReservedTargets.Add(targetIndex);

        break;

      }

      if (pickedTarget != -1)
      {
        // now save the version with the reservation
        SaveTargets(env, targets);
      }

      if (DebugMode) RhinoApp.WriteLine("PickBestTargetPath: Returning " + pickedTarget);
      return pickedTarget;
    }




    //------------------------------SET UP RETURN TO HOME----------------------------------
    // if the home is not physically occupied, nor claimed, yes, the agent can set return home to this home
    // if the home is not physically occupied, but it has been claimed by other agents:
    // -- then first check if there's other home is not occupied nor claimed, if yes, set that home as return home
    // -- if all the homes are either occupied or claimed, check which home has the least queue size and within shortest distance

    private void SetUpReturnToBase(CartesianAgent agent, int whereAgentIs, CartesianEnvironment env)
    {
      if (DebugMode) RhinoApp.WriteLine("Start SetUpReturnToBase()...");
      // clear agent previous reservations in the Targets before setting up return to home
      ReleaseAgentTargetReservations(agent.Id, env);

      // if no assemble/disassemble task is assigned, set to return
      // then calculate if it has valid target path, otherwise, set to Idle and EnterTheField to false
      WorkState prevState = (WorkState)agent.CustomData[AgentKeys.PrevState];
      WorkState nextState = WorkState.Return;
      bool extendArm = (bool)agent.CustomData[AgentKeys.ExtendArm];
      bool hasMaterial = (bool)agent.CustomData[AgentKeys.HasMaterial];
      int bestHome = -1;
      List<int> pathToHome = new List<int>();

      bool isPathToHomeAfterRaftRemoval = false;
      if (prevState == WorkState.Remove)
      {
        // prefer to choose the assigned operating home for raft removal
        bestHome = (int)agent.CustomData[AgentKeys.CurrentHome];
        var pathTohomeResult = IsValidPathToHome(agent, env, bestHome, whereAgentIs);
        isPathToHomeAfterRaftRemoval = pathTohomeResult.Item1;
        if (isPathToHomeAfterRaftRemoval)
        {
          if (DebugMode) RhinoApp.WriteLine("the assigned operating home for raft removal is " + bestHome + ", and successfully found a valid path home");
          pathToHome = pathTohomeResult.Item2;
        }
        else
        {
          if (DebugMode) RhinoApp.WriteLine("the assigned operating home for raft removal is " + bestHome + ", but failed to found a valid path home");

        }
      }

      if (!isPathToHomeAfterRaftRemoval || prevState != WorkState.Remove)
      {
        var bestHomeResult = FindBestAvailableHome(agent, whereAgentIs, env);
        bestHome = bestHomeResult.Item1;
        pathToHome = bestHomeResult.Item2;
      }


      if (bestHome == -1)
      {
        // no valid home found to return, let the agent idle in place, wait for next iteration in HandleIdleState()
        RhinoApp.WriteLine("ERROR: SetUpReturnToBase - Cannot find path home! Set to Idle");
        nextState = WorkState.Idle;
        agent.CustomData[AgentKeys.WorkState] = nextState;
      }
      else if (bestHome == whereAgentIs)
      {
        if (DebugMode) RhinoApp.WriteLine("SetUpReturnToBase: Agent is already at the best home, no need to return to home");

        nextState = WorkState.Idle;
        agent.CustomData[AgentKeys.WorkState] = nextState;
        OccupyHomeFromReturnQueue(agent, bestHome, agent.Id, env);

        if (hasMaterial)
        {
          DropOffMaterialAtHomeBase(agent, extendArm, bestHome, whereAgentIs);
          return;
        }
      }
      else
      {
        ClaimHome(agent, bestHome, agent.Id);
        UpdateAgentStatusAfterClaimHome(agent, hasMaterial, whereAgentIs, bestHome, nextState, prevState, pathToHome, env);
        OccupyPathAfterTaskAssignment(false, agent, whereAgentIs, bestHome, env);
        if (DebugMode) RhinoApp.WriteLine("SetUpReturnToBase: agent " + agent.Id + ": successfully set up return to home from current = " + whereAgentIs + "to home = " + bestHome + ", with path length=" + pathToHome.Count);
      }
    }


    private Tuple<bool, List<int>> IsValidPathToHome(CartesianAgent agent, CartesianEnvironment env, int homeBaseIndex, int whereAgentIs)
    {
      if (DebugMode) RhinoApp.WriteLine("Start IsValidPathHome()...");
      bool isValidPathToHome = false;
      if (DebugMode) RhinoApp.WriteLine("Agent " + agent.Id + ": checking IsValidPathToHome - current agent Index= " + whereAgentIs);

      // Run A* to find path home
      WorkState prevState = (WorkState)agent.CustomData[AgentKeys.PrevState];
      bool isGroundTravelPreferred = prevState == WorkState.Remove;
      var AStarResults = AStarPathFinding(agent, whereAgentIs, homeBaseIndex, env, isGroundTravelPreferred);
      List<int> pathToHome = AStarResults.Item1;
      double pathCost = AStarResults.Item2;

      if (pathToHome == null || pathToHome.Count == 0)
      {
        if (DebugMode) RhinoApp.WriteLine("No Valid Path Home, isValidPathToHome is false");
        return Tuple.Create(isValidPathToHome, new List<int>());
      }
      else
      {
        isValidPathToHome = true;
        if (DebugMode) RhinoApp.WriteLine("Found Valid Path Home, isValidPathToHome is true: path.Count=" + pathToHome.Count);
        return Tuple.Create(isValidPathToHome, pathToHome);
      }

    }

    private Tuple<int, List<int>> FindBestAvailableHome(CartesianAgent agent, int currentIndex, CartesianEnvironment env)
    {
      if (DebugMode) RhinoApp.WriteLine("Start FindBestAvailableHome()...");

      ReleaseAgentFromReturnQueue(agent.Id); // clear agent from return queue if it has previously reserved one.

      int bestHome = -1;
      int agentID = agent.Id;
      Point3d agentPos = CachedAllCloud[currentIndex].Location; // here, shall I use agent.Position or AgentKeys.Position or CachedAllCloud?
      List<int> homeIndices = CachedHomeBases.Keys.ToList();

      // create a homeCostDict to store the home with cost that agent is able to return--either not occupied or return queue is not full
      double bestHomeScore = double.MaxValue;
      List<int> agentPath = (List<int>)agent.CustomData[AgentKeys.Path];

      foreach (int home in homeIndices)
      {
        Point3d homePos = CachedAllCloud[home].Location;
        double distToHome = homePos.DistanceTo(agentPos);
        bool isHomeOccupied = IsHomePhysicallyOccupied(home, agentID);
        bool isHomeReserved = IsHomeClaimed(home, agentID);
        int returnQueueSize = isHomeReserved && HomeBaseReturnQueues.ContainsKey(home)
          ? HomeBaseReturnQueues[home].Count : 0;
        if (isHomeOccupied && isHomeReserved && returnQueueSize >= MaxWaitingQueueSize) continue;

        var pathToHomeResults = IsValidPathToHome(agent, env, home, currentIndex);
        bool isValidPathToHome = pathToHomeResults.Item1;
        if (!isValidPathToHome) continue;

        double penalityCost = GetHomePenaltyCost(agent, home);
        double returnHomeCost = penalityCost + distToHome;
        if (returnHomeCost < bestHomeScore)
        {
          bestHomeScore = returnHomeCost;
          bestHome = home;
          agentPath = pathToHomeResults.Item2;
        }
      }
      if (DebugMode) RhinoApp.WriteLine("Complete FindBestAvailableHome(): the best home is " + bestHome);
      return Tuple.Create(bestHome, agentPath);
    }


    private double GetHomePenaltyCost(CartesianAgent agent, int homeIndex)
    {
      HomeBaseOccupant[homeIndex] = HomeBaseOccupant.ContainsKey(homeIndex)
        ? HomeBaseOccupant[homeIndex] : -1;

      bool isHomeOccupied = IsHomePhysicallyOccupied(homeIndex, agent.Id);
      bool isHomeReserved = IsHomeClaimed(homeIndex, agent.Id);
      int returnQueueSize = isHomeReserved && HomeBaseReturnQueues.ContainsKey(homeIndex)
        ? HomeBaseReturnQueues[homeIndex].Count : 0;

      double penaltyCost = 0.0;
      if (isHomeOccupied) penaltyCost += 10;
      if (isHomeReserved) penaltyCost += returnQueueSize * 5.0;

      return penaltyCost;

    }


    //-------------------- HOME MANAGEMENT ------------------------------------------
    private bool IsHomePhysicallyOccupied(int homeIndex, int agentID)
    {
      bool isHomePhysicallyOccupied = true;

      bool isHomeFree = !HomeBaseOccupant.ContainsKey(homeIndex)
        || HomeBaseOccupant[homeIndex] == -1
        || HomeBaseOccupant[homeIndex] == agentID;

      if (isHomeFree)
      {
        isHomePhysicallyOccupied = false;
      }
      else
      {
        isHomePhysicallyOccupied = true;
      }

      if (DebugMode) RhinoApp.WriteLine("Is home " + homeIndex + " is occupied = " + isHomePhysicallyOccupied);
      return isHomePhysicallyOccupied;
    }

    private bool IsHomeClaimed(int homeIndex, int agentID)
    {
      // if the home is reserved by other agents to return to
      bool isHomeClaimed = true;

      int returnQueueSize = HomeBaseReturnQueues[homeIndex].Count;
      if (returnQueueSize > 0 && !HomeBaseReturnQueues[homeIndex].Contains(agentID))
      {
        isHomeClaimed = true;
      }
      else
      {
        isHomeClaimed = false;
      }

      if (DebugMode) RhinoApp.WriteLine("Is home " + homeIndex + " is claimed = " + isHomeClaimed);
      return isHomeClaimed;
    }


    private bool IsReturnerWithinThreshold(int homeIndex, List<CartesianAgent> allOtherAgents)
    {
      bool isReturnerWithinThreshold = true;
      Queue<int> returnQueue = HomeBaseReturnQueues[homeIndex];

      if (returnQueue.Count == 0)
      {
        isReturnerWithinThreshold = false;
        return isReturnerWithinThreshold;
      }
      else
      {
        int firstReturningAgentID = returnQueue.Peek();
        CartesianAgent firstReturningAgent = allOtherAgents.FirstOrDefault(a => a.Id == firstReturningAgentID);
        if (firstReturningAgent == null)
        {
          HomeBaseReturnQueues[homeIndex].Dequeue();
          isReturnerWithinThreshold = false;
          return isReturnerWithinThreshold;
        }


        //if you need to access other agent's custom data, you MUST access from persistentAgentData, not from their custom data
        if (!persistentAgentData.ContainsKey(firstReturningAgentID))
        {
          isReturnerWithinThreshold = false;
          return isReturnerWithinThreshold;
        }
        var agentData = persistentAgentData[firstReturningAgentID];
        if (!agentData.ContainsKey(AgentKeys.CurrentStep) || !agentData.ContainsKey(AgentKeys.Path))
        {
          isReturnerWithinThreshold = false;
          return isReturnerWithinThreshold;
        }

        int returningAgentStep = (int)agentData[AgentKeys.CurrentStep];
        List<int> returningAgentPath = (List<int>)agentData[AgentKeys.Path];

        if (returningAgentPath == null || returningAgentPath.Count == 0)
        {
          isReturnerWithinThreshold = false;
          return isReturnerWithinThreshold;
        }
        int stepsRemaining = returningAgentPath.Count - returningAgentStep - 1;

        if (stepsRemaining > YieldThreshold)
        {
          isReturnerWithinThreshold = false;
          return isReturnerWithinThreshold;
        }
        else
        {
          isReturnerWithinThreshold = true;
          return isReturnerWithinThreshold;
        }
      }
    }


    // inside ReturnToBase(), when agentStep is a step away from the home
    private Tuple<bool, bool> CanEnterTheHome(CartesianAgent agent, int homeIndex)
    {
      if (DebugMode) RhinoApp.WriteLine("START CanEnterTheHome()...");
      // when an agent can enter the home:
      // check HomeBaseReturnQueues[homeIndex]--the agent is at which index.
      // if agent is the first one in the return queues
      // check HomeBaseOccupant[homeIndex], if it mathces anotehr agentId, then communicate with this agent to yield
      // if no matching agentId, then it can enter?
      bool canEnterTheHome = false;
      bool shallNegotiateForYielding = false;


      Queue<int> returnQueues = HomeBaseReturnQueues[homeIndex];
      int firstAgentInReturnQueue = returnQueues.Peek();
      if (DebugMode) RhinoApp.WriteLine("the first agent in return queue for home " + homeIndex + " is: " + firstAgentInReturnQueue);


      if (!returnQueues.Contains(agent.Id)) return Tuple.Create(false, false);

      if (firstAgentInReturnQueue != agent.Id)
      {
        canEnterTheHome = false;
        shallNegotiateForYielding = false;
        if (DebugMode) RhinoApp.WriteLine("Agent " + agent.Id + " is not the firstAgentInReturnQueue, therefore, canEnterTheHome is false, shallNegotiateForYielding is false;");

      }
      else
      {
        // the agent is the first one in the waiting queue
        // so check if the home is currently physically occupied, if yes, negotiate with the occupant agent to yield
        // if not occupied, then can enter the home
        bool isHomeFree = !IsHomePhysicallyOccupied(homeIndex, agent.Id);

        if (isHomeFree)
        {
          canEnterTheHome = true;
          shallNegotiateForYielding = false;
          if (DebugMode) RhinoApp.WriteLine("Agent is the firstAgentInReturnQueue, and No one else is occupying the home, therefore, Agent canEnterTheHome is true, shallNegotiateForYielding is false");
        }
        else
        {
          // home is occupied-> cannot enter, but shall negotiate to yield home to returner
          canEnterTheHome = false;
          shallNegotiateForYielding = true;
          if (DebugMode) RhinoApp.WriteLine("Agent is the firstAgentInReturnQueue, and someone is occupying the home, therefore, Agent canEnterTheHome is false, shallNegotiateForYielding is true");
        }
      }

      if (DebugMode) RhinoApp.WriteLine("COMPLETE: CanEnterTheHome()...Agent " + agent.Id + ", canEnterHome is: " + canEnterTheHome);

      return Tuple.Create(canEnterTheHome, shallNegotiateForYielding);
    }


    private void YieldHomeToReturner(CartesianAgent returner, CartesianAgent occupyingAgent, int homeIndex, List<CartesianAgent> agentList, CartesianEnvironment env)
    {
      if (DebugMode) RhinoApp.WriteLine("Start YieldHomeToReturner...");
      // the otherAgent should check if any agents in the EntryQueue outside the field
      // if not, then otherAgent just move to the firstWaitingSpot
      // if yes, then cascading communication and yielding

      HomeBaseData homeData = CachedHomeBases[homeIndex];
      Point3d firstWaitingSpot = homeData.FirstWaitingSpot;
      Vector3d waitingDir = homeData.WaitingDir;
      Point3d homeBasePt = homeData.HomeBasePt;

      Queue<int> entryQueue = HomeBaseEntryQueues.ContainsKey(homeIndex)
        ? HomeBaseEntryQueues[homeIndex]
        : new Queue<int>();

      List<int> entryList = entryQueue.ToList();
      if (!entryList.Contains(occupyingAgent.Id))
      {
        entryList.Insert(0, occupyingAgent.Id);
      }

      for (int i = 0; i < entryList.Count; i++)
      {
        int agentID = entryList[i];
        CartesianAgent agentInEntryQueue = agentList.FirstOrDefault(a => a.Id == agentID);
        if (agentInEntryQueue == null) continue;

        // instead, access other agent's custom data from persistent agent data
        if (!persistentAgentData.ContainsKey(agentID)) continue;
        var agentPersistData = persistentAgentData[agentID];
        if (!agentPersistData.ContainsKey(AgentKeys.Position)
          || !agentPersistData.ContainsKey(AgentKeys.Orientation)) continue;

        WorkState entryAgentState = (WorkState)agentPersistData[AgentKeys.WorkState];
        Point3d entryAgentCurrentPos = (Point3d)agentPersistData[AgentKeys.Position];
        Vector3d entryAgentCurrentDir = (Vector3d)agentPersistData[AgentKeys.Orientation];
        if (!entryAgentCurrentDir.IsUnitVector && entryAgentCurrentDir.Length != 0)
        {
          entryAgentCurrentDir = entryAgentCurrentDir / entryAgentCurrentDir.Length;
        }
        if (DebugMode) RhinoApp.WriteLine("Agent in Entry Queue No. " + i + ", ID = " + agentID + ": current position from AgentKeys is: " + entryAgentCurrentPos + ", current direction from AgentKeys is: " + entryAgentCurrentDir);

        Point3d newWaitingSpot = (-1) * waitingDir * (i + 1) + homeBasePt;
        if (DebugMode) RhinoApp.WriteLine("Agent in Entry Queue No. " + i + ", ID = " + agentID + ": new waiting spot is: " + newWaitingSpot + ", new waiting dirtion is: " + waitingDir);

        bool shouldRotate = ShouldRotate(entryAgentCurrentDir, waitingDir);
        Vector3d newAgentDir = entryAgentCurrentDir;
        if (shouldRotate)
        {
          newAgentDir = RotateBodyToAlignToDesiredDir(entryAgentCurrentPos, entryAgentCurrentDir, waitingDir);
          if (DebugMode) RhinoApp.WriteLine("Agent in Entry Queue No. " + i + ", ID = " + agentID + "： should rotate is true, and its new direction is " + newAgentDir + " after RotateBodyToAlignToDesiredDir()");
        }
        else
        {
          if (DebugMode) RhinoApp.WriteLine("Agent in Entry Queue No. " + i + ", ID = " + agentID + ": does not need to rotate to align with the waiting direction.");
        }

        // need to update other agent's position in its custom data and persistentAgentData
        UpdateAgentStatusAfterExitField(returner, agentInEntryQueue, entryAgentState, homeIndex, newWaitingSpot, newAgentDir, env);
        WorkState entryAgentNewState = WorkState.Idle;


        // FIX: also need to update the movement dictionary so post-processing can visualize correctly occupying agent's position in this timestep
        UpdateMovementDicForVisualization(agentInEntryQueue, entryAgentNewState, env);
      }

      // Save updated queue
      HomeBaseEntryQueues[homeIndex] = new Queue<int>(entryList);
      homeData.WaitingQueue = HomeBaseEntryQueues[homeIndex];

      // pre-reserve the home to the returner
      HomeBaseOccupant[homeIndex] = returner.Id;
      if (DebugMode) RhinoApp.WriteLine("Pre-reserved home " + homeIndex + " for returning agent " + returner.Id);

      if (DebugMode) RhinoApp.WriteLine("Occupying agent " + occupyingAgent.Id + " yielded home " + homeIndex +
          " to returning agent " + returner.Id + ", and moved to waiting spot");
      if (DebugMode) RhinoApp.WriteLine("Agent " + occupyingAgent.Id + " current position is " + persistentAgentData[occupyingAgent.Id][AgentKeys.Position]);
      if (DebugMode) RhinoApp.WriteLine("And the first waiting spot position of the home " + homeIndex + " is: " + firstWaitingSpot);
      if (DebugMode) RhinoApp.WriteLine("Complete YieldHomeToReturner...");
    }


    private void ClaimHome(CartesianAgent agent, int homeIndex, int agentID)
    {
      // update HomeBase return queues when agent set the bestHome to this home and start returning
      if (HomeBaseReturnQueues.ContainsKey(homeIndex))
      {
        if (HomeBaseReturnQueues[homeIndex].Contains(agentID)) return;
        HomeBaseReturnQueues[homeIndex].Enqueue(agentID);
      }
      else
      {
        Queue<int> returnQueue = new Queue<int>();
        returnQueue.Enqueue(agentID);
        HomeBaseReturnQueues.Add(homeIndex, returnQueue);
      }
    }

    private void OccupyHomeFromReturnQueue(CartesianAgent agent, int homeIndex, int agentID, CartesianEnvironment env)
    {
      // update HomeBaseOccupant when agent officially moves into the home
      HomeBaseOccupant[homeIndex] = agentID;

      if (HomeBaseReturnQueues[homeIndex].Contains(agentID))
      {
        int firstAgentInQueue = HomeBaseReturnQueues[homeIndex].Peek();
        if (firstAgentInQueue == agentID)
        {
          HomeBaseReturnQueues[homeIndex].Dequeue();
        }
        else
        {
          RhinoApp.WriteLine("ERROR When UpdateHomeAfterReturnHome: agent " + agentID + "is occupying the home and is in the return queue, but is not the first one in the return queue as it is supposed to...");
        }
      }

      agent.CustomData[AgentKeys.CurrentHome] = homeIndex;

      // When agent returns home, update its activePath to only the home it is occupying
      var activePath = (Dictionary<int, List<int>>)env.CustomData[EnvironmentKeys.ActivePath];
      if (activePath.ContainsKey(agentID))
      {
        activePath[agentID] = new List<int> { homeIndex }; // empty — not physically anywhere that blocks others
        env.CustomData[EnvironmentKeys.ActivePath] = activePath;
      }
    }


    private void OccupyHomeFromEntryQueue(CartesianAgent agent, int homeIndex, int agentID, CartesianEnvironment env)
    {
      // update home occupant and home entry queue
      HomeBaseOccupant[homeIndex] = agentID; // after entering, set the occupant to the agent
      // remove from entry queue since agent is now entering
      ReleaseAgentFromEntryQueue(agentID);

      agent.CustomData[AgentKeys.CurrentHome] = homeIndex;

      // set agent's activePath to this home
      var activePath = (Dictionary<int, List<int>>)env.CustomData[EnvironmentKeys.ActivePath];
      activePath[agentID] = new List<int> { homeIndex }; // empty — not physically anywhere that blocks others
      env.CustomData[EnvironmentKeys.ActivePath] = activePath;
    }



    // HELPER METHODS TO LOAD ALL THE STATIC DATA IN HOMEBASEDATA:
    private Dictionary<int, HomeBaseData> LoadHomeBaseData(CartesianEnvironment env)
    {
      var allHomes = new Dictionary<int, HomeBaseData>();

      if (!env.CustomData.ContainsKey(EnvironmentKeys.HomeBases))
      {
        return allHomes;
      }

      object rawHomeBases = env.CustomData[EnvironmentKeys.HomeBases];
      if (rawHomeBases == null)
      {
        return allHomes;
      }

      IDictionary homeBaseDic = (IDictionary)rawHomeBases;
      foreach (DictionaryEntry entry in homeBaseDic)
      {
        int homeIndex = (int)entry.Key;
        object[] data = (object[])entry.Value;
        Point3d homePt = (Point3d)data[0];
        Point3d materialPickUpSpot = (Point3d)data[1];
        Vector3d materialPickUpDir = (Vector3d)data[2];
        Point3d firstWaitingSpot = (Point3d)data[3];
        Vector3d waitingDir = (Vector3d)data[4];


        allHomes[homeIndex] = new HomeBaseData(homePt, materialPickUpSpot, materialPickUpDir, firstWaitingSpot, waitingDir);
      }

      return allHomes;
    }





    // HELPERS TO LOAD / UPDATE TARGETS

    private Dictionary<int, TargetData> LoadTargets(CartesianEnvironment env)
    {
      var allTargets = new Dictionary<int, TargetData>();
      if (!env.CustomData.ContainsKey(EnvironmentKeys.Targets))
      {
        return allTargets;
      }

      object rawTargets = env.CustomData[EnvironmentKeys.Targets];
      if (rawTargets == null)
      {
        return allTargets;
      }

      IDictionary targetsDic = (IDictionary)rawTargets;
      foreach (DictionaryEntry entry in targetsDic)
      {
        int key = (int)entry.Key;
        object[] data = (object[])entry.Value;
        int targetIndex = (int)data[0];
        int[] path = (int[])data[1];
        // ✅ Handle both int and double for cost
        double cost;
        if (data[2] is int)
        {
          cost = (double)(int)data[2];  // Convert int to double
        }
        else
        {
          cost = (double)data[2];
        }
        int[] reservedBy = (int[])data[3];
        allTargets[key] = new TargetData(targetIndex, path, cost, reservedBy);
      }

      return allTargets;
    }


    private void SaveTargets(CartesianEnvironment env, Dictionary<int, TargetData> allTargets)
    {
      // use Hashtable instead of generic dictionary
      Hashtable targetsRaw = new Hashtable();

      foreach (var kvp in allTargets)
      {
        int targetIndex = kvp.Key;
        TargetData targetData = kvp.Value;
        targetsRaw[targetIndex] = new object[]
          {
          targetData.TargetIndex,
          targetData.Path,
          targetData.Cost,
          targetData.ReservedBy
          };
      }
      env.CustomData[EnvironmentKeys.Targets] = targetsRaw;
    }




    // -----------------BUILD ADJACENCY MAP------------------------------------
    // Build RTree ONCE for all neighbor searches
    public RTree CreateNewRTree()
    {
      RTree rTree = new RTree();
      for (int i = 0; i < CachedAllCloud.Count; i++)
      {
        rTree.Insert(CachedAllCloud[i].Location, i);
      }
      return rTree;
    }



    // find neighbors for a list of points
    // only need to call this method once and then CachedAdjacencyMap can be stored in the custom data. The results of neighborhood is persistent, regardless things changes during simulation
    public Tuple<List<List<int>>, Dictionary<int, List<int>>> FindNeighbors2(List<int> pointIndices, RTree rTree)
    {
      List<List<int>> neighborIndices = new List<List<int>>();
      Dictionary<int, List<int>> adjancencyMap = new Dictionary<int, List<int>>();

      for (int i = 0; i < pointIndices.Count; i++)
      {
        //RTree rTree = CreateNewRTree2(pointIndices, CachedAllCloud); // you SHOULD NOT create rTree for every point in every iteration
        List<int> myNeighborIndices = new List<int>();
        Point3d needlePt = CachedAllCloud[pointIndices[i]].Location;
        Sphere boundingBox = new Sphere(needlePt, CachedStructuralResolution);
        rTree.Search(boundingBox, (sender, args) =>
          {
            if (args.Id != pointIndices[i]) // Don't include self as neighbor
              myNeighborIndices.Add(args.Id);
          });

        adjancencyMap[i] = myNeighborIndices;
        neighborIndices.Add(myNeighborIndices);
      }

      return Tuple.Create(neighborIndices, adjancencyMap);
    }

    // find neighbors for a particular point
    public List<int> FindNeighbors(int pointIndex, RTree rTree)
    {
      // RTree rTree = new RTree(); // this is just to create an empty RTree, with an empty rTree, you cannot use PointCloudClosestPoint() method
      // move -create a new RTree- to persistent data
      Point3d needlePt = CachedAllCloud[pointIndex].Location;
      List<int> myNeighborIndices = new List<int>();
      Sphere boundingBox = new Sphere(needlePt, CachedStructuralResolution);
      rTree.Search(boundingBox, (sender, args) =>
        {
          if (args.Id != pointIndex) // Don't include self as neighbor
            myNeighborIndices.Add(args.Id);
        });

      return myNeighborIndices;
    }

    private int ComputeCorrectPointIndex(Point3d testPt)
    {
      int tentativeIndex = CachedAllCloud.ClosestPoint(testPt);

      if (tentativeIndex < 0) return tentativeIndex;
      // to verify whether tentativeIndex is the correct index for the testPt
      // the reason to verify is that PointCloud.ClosestPoint() returns -1 only when the pointcloud is empty
      double tolerance = 0.1;
      Point3d pointInCloud = CachedAllCloud[tentativeIndex].Location;
      double dist = pointInCloud.DistanceTo(testPt);
      if (dist < tolerance)
      {
        return tentativeIndex;
      }
      else
      {
        return -1;
      }
    }

  }





  //--------------------------------------------------SUPPORTING CLASS FOR AGENT --------------------------------------------------

  public enum WorkState
  {
    Idle,        // At start, deciding next task
    Assemble,    // Building a structure point
    Disassemble, // Removing a support for reuse
    Remove,      // Removing base/raft
    Return       // Returning to start position
  }

  public enum HomeStatus
  {
    Occupying,        // agent is occupying its home base
    Waiting,
    InField      // agent is in the field working
  }

  public enum CollisionType
  {
    HeadOn, // A.next == B.next  (both moving toward same node)
    Swap, // A.current == B.next  AND  B.current == A.next
    Static, // A.next == B.current  AND  B has no next step
    Trailing, // A.next == B.current  AND  B has a next step && B has not run yet this tick (B.Id > A.Id)
    Other // no collision or other collisions that I could miss
  }


  public class CollisionData
  {
    // at agent's given step, it may collide with a colldingAgent at a colldingBlock for a collisionType
    public Dictionary<int, Tuple<List<int>, CollisionType>> PerAgentCollisions;
    // collidingAgentId -> (conflictBlocks, collisionType)

    public CollisionData()
    {
      PerAgentCollisions = new Dictionary<int, Tuple<List<int>, CollisionType>>();
    }

    public void Add(int collidingAgentID, List<int> collidingBlocks, CollisionType collisionType)
    {
      PerAgentCollisions[collidingAgentID] = Tuple.Create(collidingBlocks, collisionType);
    }

    public bool HasCollisions()
    {
      return PerAgentCollisions.Count != 0;
    }

    public int CollisionCountPerStep()
    {
      int count = 0;
      foreach (var kvp in PerAgentCollisions)
      {
        int colldingAgentID = kvp.Key;
        var collision = kvp.Value;
        List<int> conflictBlocks = collision.Item1;
        if (colldingAgentID >= 0 && conflictBlocks.Count > 0) count++;
      }

      return count;
    }

    private bool HasAnyWaitRequriedCollision()
    {
      foreach (var kvp in PerAgentCollisions)
      {
        CollisionType type = kvp.Value.Item2;
        if (type == CollisionType.HeadOn
          || type == CollisionType.Static
          || type == CollisionType.Trailing)
        {
          return true;
        }
      }
      return false;
    }

    private bool HasSwapCollisions()
    {
      foreach (var kvp in PerAgentCollisions)
      {
        if (kvp.Value.Item2 != CollisionType.Swap) return false;
      }
      return true;
      // return true only if all collisions are swap type
      // if any collision requires waiting, the agent must wait
    }
  }

  public static class AgentKeys
  {
    public static readonly string WorkState = "WorkState";
    //public static readonly string Task = "task";
    public static readonly string Target = "target";
    public static readonly string Path = "path";
    public static readonly string CurrentStep = "currentStep";
    public static readonly string Orientation = "orientation";
    public static readonly string EntertheField = "entertheField";
    public static readonly string ExtendArm = "extendArm";
    public static readonly string PrevState = "previousWorkState";
    //public static readonly string VoxelState = "voxelState";
    public static readonly string ShouldMoveForward = "shouldMoveForward";
    public static readonly string Position = "position";
    //public static readonly string PrevTarget = "prevTarget";
    public static readonly string HasMaterial = "hasMaterial";
    public static readonly string HomeBase = "homeIndex"; // which home index is assigned to the agent
    //public static readonly string HomeStatus = "homeStatus"; // track agent's relationship w
    public static readonly string CurrentHome = "currentHome"; // the temporary home the agent is current occupying or returning to or waiting at
    public static readonly string DeadLockTicks = "deadlockTicks"; // how many ticks have passed when agent is not moving. If passing a threshold, agent needs to replanning a path or task

  }



  //--------------------------------------------------SUPPORTING CLASS FOR ENVIRONMENT--------------------------------------------------
  public enum BuildState
  {
    Deployed, // Successfully built and placed
    PendingToDeploy, //  Can be built, no dependencies blocking
    NeedSupport, // Has dependencies blocking, can't build yet
    Removed  // Was deployed, now removed (for supports/base)
    // ReadyToDeploy: not as a state, but stored in a list<int>; It is points that are pendingToDeploy and also have at least one neighbor deployed. they are initialized in Targets
  }

  public enum VoxelType
  {
    Structure,
    Support,
    Base
  }

  // used for path finding with A*
  public class TargetData
  {
    public int TargetIndex;
    public int[] Path; // path from agent index to target index
    public double Cost;
    public int[] ReservedBy; // reserved by agentIds, here HashSet is better than list
    public TargetData(int targetIndex, int[] path, double cost, int[] reservedBy)
    {
      this.TargetIndex = targetIndex;
      this.Path = path;
      this.Cost = cost;
      this.ReservedBy = reservedBy;
    }
  }


  public class HomeBaseData
  {
    // static state data
    public Point3d HomeBasePt; // the list of these home base points
    public Point3d MaterialPickUpPt; // the list of the material pick up locations for each home base
    public Vector3d MaterialPickUpDir; // the list of the material pick up directions at each home base
    public Point3d FirstWaitingSpot; // the waiting line for agents who exit the field, [0] = first waiting spot, [1] = second, etc.
    public Vector3d WaitingDir;

    // dynamic state -chagnes as agents arrive/leave
    public int OccupyingAgentId; // -1 if the home base is free
    public Queue<int> WaitingQueue; // agent IDs waiting in line, in order
    public HomeBaseData(Point3d homeBasePt, Point3d materialPickUpPt, Vector3d materialPickUpDir, Point3d firstWaitingSpot, Vector3d waitingDir)
    {
      this.HomeBasePt = homeBasePt;
      this.MaterialPickUpPt = materialPickUpPt;
      this.MaterialPickUpDir = materialPickUpDir;
      this.FirstWaitingSpot = firstWaitingSpot;
      this.WaitingDir = waitingDir;
      if (waitingDir.Length > 1e-6)
      {
        waitingDir.Unitize();
      }
      this.OccupyingAgentId = -1;
      this.WaitingQueue = new Queue<int>();
    }

    public bool IsOccupied()
    {
      if (OccupyingAgentId != -1)
      {
        return true;
      }
      else
      {
        return false;
      }
    }

    public Point3d GetWaitingSpotFor(int agentId)
    {
      // returns which physical spot this agent should stand at
      if (WaitingQueue.Count == 0) return WaitingDir + HomeBasePt;

      int waitingLineIndex = 0;
      for (int i = 0; i < WaitingQueue.Count; i++)
      {
        int id = WaitingQueue.ElementAt(i);
        if (id == agentId)
        {
          Point3d waitingSpot = (-1) * WaitingDir * (i + 1) + HomeBasePt;
          return waitingSpot;
        }
        waitingLineIndex++;
        if (waitingLineIndex >= WaitingQueue.Count) break;
      }
      // overflow to last spot
      Point3d lastAvailbleSpot = WaitingDir * (WaitingQueue.Count + 1) + HomeBasePt;
      return lastAvailbleSpot;
    }
  }

  // class to store the keys for the CustomData
  public static class EnvironmentKeys
  {
    public const string BuildState = "BuildState"; // List<BuildState>: "deployed", "needSP", "pendingToDeploy"
    public const string VoxelType = "VoxelType"; //List<VoxelType>: "Structure", "Support", "Base"
    public const string ReadyToDeploy = "ReadyToDeploy"; // List<int>: strucutre points that are a) pendingToDeploy, b) at least one neighbor is deployed
    public const string Targets = "Targets"; //Dictionary<int, TargetData>: for agent's path finding. What's in Targets come from ReadyToDeploy; Targets specifically for points to be assembled
    //public const string Deployed = "DeployedCLoud"; // PointCloud
    public const string Deployed = "Deployed"; // pointIndex in HashSet<int> according to allCloud, saved to Deployed
    public const string PToSp = "PToSp"; // dictionary<intA, intB>: structural pointA needs support pointB as support
    public const string SpToP = "SpToP"; // dictionary<intA, List<int>>: support pointA supports all this list of structural points
    public const string SpDic = "SpDic"; // dictionary<intA, list<int>>: support top pointA leads the vertical support column
    public const string BindP = "BindP"; // dictionary<intA, intB>: structural pointA needs structural pointB to be built first
    public const string BindL = "BindL"; // dictionary<intA, List<int>>: structural pointA suuports all this list of structural points
    public const string Disassembled = "Disassembled"; // List<int>
    public const string AllowDisassemble = "AllowDisassemble"; // List<int>
    public const string Basement = "Basement"; // List<int>
    public const string AllCloud = "AllCloud";  // PointCloud
    public const string AdjacencyMap = "AdjacencyMap"; // Dictionary <int, List<int>>, each point's neighbors
    public const string StructuralResolution = "StructuralResolution";
    public const string SystemReset = "SystemReset";
    public const string HomeBases = "homeBases";
    public const string ActivePath = "activePath"; // path is to track which points are being occupied by the agent, which is also used for collision detection
    public const string RaftZones = "raftZones"; // assign each raft to a zone that is closer to a home
    public const string RaftRemovers = "raftRemovers"; // track who become the active raft removers and return to which home

  }
# ---------- end assembly_behavior ----------
agents = CSharpScript(
    iDebugMode=toggle_2,
    iRAmount=number_slider,
    iBehaviors=assembly_behavior.oBehavior,
    Reference="C:\Users\siennasun513\AppData\Roaming\McNeel\Rhinoceros\packages\7.0\ABxM-Core\1.7.0\ABxM.Core.dll")  # -> out, oAgents; inputs iDebugMode: Boolean, iRAmount: Int32, iBehaviors: list
# ---------- agents: C# usings ----------
using ABxM.Core.Agent;
using ABxM.Core.Behavior;
# ---------- agents: C# ----------
    // NOTE: if you have multiple agents, you cannot do behaviors like this
    // because ABxM is for per-agent behavior. If you do this, then every agents share
    // the same custom data, same internal fields, mutate the same state, which would cause crash
    //List<BehaviorBase> behaviors = new List<BehaviorBase>();
    //foreach (var b in iBehaviors)
    //{
    //  BehaviorBase behavior = b as BehaviorBase;
    //  behaviors.Add(behavior);
    //}

    if (cachedAgents != null && cachedAgentCount == iRAmount) return;

    if (iDebugMode) RhinoApp.WriteLine("---INITIALIZING AGENTS---");

    Point3d placeholderPosition = Point3d.Origin; // will be overwritten in Execute()
    Vector3d placeholderOrientation = Vector3d.XAxis; // will be overwritten in Execute()

    // initialize the agents
    List<CartesianAgent> agents = new List<CartesianAgent>();
    for (int i = 0; i < iRAmount; i++)
    {
      // FIX BEHAVIOR FOR MULTI-AGENTS: clone behaviors per agent
      List<BehaviorBase> behaviors = new List<BehaviorBase>();
      foreach (var b in iBehaviors)
      {
        BehaviorBase behaviorOriginal = b as BehaviorBase;
        BehaviorBase behaviorCopy = (BehaviorBase)Activator.CreateInstance(behaviorOriginal.GetType());
        behaviors.Add(behaviorCopy);
      }

      CartesianAgent assemblyAgent = new CartesianAgent(placeholderPosition, behaviors);
      // assemblyAgent.Moves = iOrientation; // dangerous
      assemblyAgent.Moves = new List<Vector3d> { placeholderOrientation };
      assemblyAgent.Id = i;
      assemblyAgent.Weights = new List<double> { 1.0 };

      // Read agent's updated properties: work state, position, orientation, task, current target, on what path, current step,
      agents.Add(assemblyAgent);

      if (iDebugMode) RhinoApp.WriteLine("Agent " + assemblyAgent.Id + " has been initialized. It has " + assemblyAgent.Moves.Count + " in Moves, and " + assemblyAgent.Weights.Count + " in Weights");
    }

    cachedAgents = agents;
    oAgents = cachedAgents;
# ---------- agents: C# additional code ----------
  // Cache agents
  private static List<CartesianAgent> cachedAgents = null;
  private static int cachedAgentCount = -1;

  //--------------------------------------------HELPER METHODS-----------------------------------------


  //--------------------------------------------------SUPPORTING CLASS FOR AGENT --------------------------------------------------

  public enum WorkState
  {
    Idle,        // At start, deciding next task
    Assemble,    // Building a structure point
    Disassemble, // Removing a support for reuse
    Remove,      // Removing base/raft
    Return       // Returning to start position
  }

  public enum HomeStatus
  {
    Occupying,        // agent is occupying its home base
    Waiting,
    InField      // agent is in the field working
  }

  public static class AgentKeys
  {
    public static readonly string WorkState = "WorkState";
    public static readonly string Target = "target";
    public static readonly string Path = "path";
    public static readonly string CurrentStep = "currentStep";
    public static readonly string Orientation = "orientation";
    public static readonly string EntertheField = "entertheField";
    public static readonly string ExtendArm = "extendArm";
    public static readonly string PrevState = "previousWorkState";
    public static readonly string ShouldMoveForward = "shouldMoveForward";
    public static readonly string Position = "position";
    public static readonly string HasMaterial = "hasMaterial";
    public static readonly string HomeBase = "homeIndex"; // which home index is assigned to the agent
    public static readonly string CurrentHome = "currentHome"; // the temporary home the agent is current occupying or returning to or waiting at
    public static readonly string ISidestepped = "isSidestepped"; // whether the agent has sidestepped to yield to other agent to avoid collision
    public static readonly string SidestepData = "sidestepData"; // the index where the agent is before it sidestepped, and its sidestepped index
    public static readonly string DeadLockTicks = "deadlockTicks"; // how many ticks have passed when agent is not moving. If passing a threshold, agent needs to replanning a path or task

  }
# ---------- end agents ----------
cartesian_environment = CSharpScript(
    iReset=toggle,
    iDebugMode=toggle_2,
    iUnitLen=structural_resolution_2,
    iDesignGeo=pre_processing.oDesignGeo,
    iSupports=pre_processing.oSupports,
    iRaft=pre_processing.oRaft,
    iPToSp=pre_processing.oPToSp,
    iSpToP=pre_processing.oSpToP,
    iSpDic=pre_processing.oSpDic,
    iBindP=pre_processing.oBindP,
    iBindL=pre_processing.oBindL,
    iHomeBases=selecthomes.oSelectedHomeBases,
    iMaterialBases=selecthomes.oSelectedMaterialPickBases,
    iMaterialPickUpDir=selecthomes.oSelectedMaterialPickUpDir,
    iFirstWaitingSpots=selecthomes.oSelectedFirstWaitingSpot,
    iWaitingDir=selecthomes.oSelectedWaitingDir,
    Reference="C:\Users\siennasun513\AppData\Roaming\McNeel\Rhinoceros\packages\7.0\ABxM-Core\1.7.0\ABxM.Core.dll")  # -> out, oEnvironment, oDebugInfo; inputs iReset: Boolean, iDebugMode: Boolean, iUnitLen: Double, iStartPosition: Point3d, iDesignGeo: list of Point3d, iSupports: list of Point3d, iRaft: list of Point3d, iPToSp: list, iSpToP: list, iSpDic: list, iBindP: list, iBindL: list, iHomeBases: list of Point3d, iMaterialBases: list of Point3d, iMaterialPickUpDir: list of Vector3d, iFirstWaitingSpots: list of Point3d, iWaitingDir: list of Vector3d
# ---------- cartesian_environment: C# usings ----------
using ABxM.Core.Environments;
using System.Linq;
# ---------- cartesian_environment: C# ----------
    // Toggle OFF, iReset = false → Everything resets
    // Toggle ON, iReset = true → Environment recreates, Solver gets fresh environment
    // Click Enable → Solver runs with fresh data

    //1. initialize the cartesian environment by take the boundary points of the design geo\
    BoundingBox bbox = new BoundingBox(iDesignGeo);
    List<Point3d> boundaryCorners = bbox.GetCorners().ToList();
    CartesianEnvironment env = new CartesianEnvironment(boundaryCorners);

    if (iReset && !lastResetState)
    {
      // clear persistent data
      if (iDebugMode) RhinoApp.WriteLine("RESET TRIGGERED - CLEARING ALL PERSISTENT DATA");
      globalEnvData.Clear();
      persistentEnv = null;
      lastResetState = true;

      // initialize new environment
      if (iDebugMode) RhinoApp.WriteLine("CREATING NEW ENVIRONMENT");
      if (iDebugMode) RhinoApp.WriteLine("CREATING NEW ENVIRONMENT");
      if (iDebugMode) RhinoApp.WriteLine("CREATING NEW ENVIRONMENT");
      DateTime startTime = DateTime.Now;
      // 2. Create a PointCloud containing all design geometry points
      // prepare geometry for neighbor calculations
      //  this is to find which points are near each other--needed for pathfinding and A*
      PointCloud allCloud = new PointCloud();
      allCloud.AddRange(iDesignGeo);
      allCloud.AddRange(iSupports);
      allCloud.AddRange(iRaft);
      //oStartPos = allCloud[0].Location;


      //3. convert the point-based dictionaries to index based (index in a pointcloud). this is to define assembly constraints
      Dictionary<int, int> pointToSupport = DictionaryConversion1(iPToSp, allCloud);
      Dictionary<int, List<int>> supportToPoints = DictionaryConversion2(iSpToP, allCloud);
      Dictionary<int, List<int>> supportDict = DictionaryConversion2(iSpDic, allCloud);
      Dictionary<int, int> bindPoints = DictionaryConversion1(iBindP, allCloud);
      Dictionary<int, List<int>> bindLines = DictionaryConversion2(iBindL, allCloud);


      //4. Build adjacency map--only neighbors of deployed modules are buildable
      // Use RTree to find all points within iUnitLen distance of iStartPosition
      //These are the initially "reachable" points
      Dictionary<int, List<int>> adjacencyMap = new Dictionary<int, List<int>>();
      RTree rTree = CreateNewRTreeFromPointCloud(allCloud);
      for (int i = 0; i < allCloud.Count; i++)
      {
        Point3d point = allCloud[i].Location;
        List<int> myNeighbors = FindNeighborsInPointCloud(i, rTree, allCloud, iUnitLen);
        adjacencyMap[i] = myNeighbors;
      }



      // 5. initialize state containers
      //List<string> buildState = new List<string>(new string[allCloud.Count]); // tracks assembly status: "deployed", "pendingToDeploy", "needSP"
      //List<string> voxelType = new List<string>(new string[allCloud.Count]); // "structure", "base", or "support",
      List<BuildState> buildStates = new List<BuildState>(new BuildState[allCloud.Count]);
      List<VoxelType> voxelTypes = new List<VoxelType>(new VoxelType[allCloud.Count]);
      /*or:
      List<string> buildState = Enumerable.Repeat("undeployed", allCloud.Count).ToList();
      List<string> voxelType = Enumerable.Repeat("", allCloud.Count).ToList();*/
      //PointCloud deployedCloud = new PointCloud(); // PointCloud of already-deployed points; used for neighbor search


      // 6. find the structural points on the base and convert home information from the inputs
      HashSet<int> deployed = new HashSet<int>();
      List<Point3d> pointsOnGround = FilterOutPointsOnGround(iDesignGeo, iRaft);
      // build availableHomes dictionary
      Dictionary<int, HomeBaseData> availableHomes = new Dictionary<int, HomeBaseData>();
      if (iMaterialBases != null && iMaterialPickUpDir != null && iFirstWaitingSpots != null && iWaitingDir != null)
      {
        //method 2: from the selected homebases and other inputs:
        availableHomes = BuildHomeBaseDataFromPreComputed(iHomeBases, iMaterialBases, iMaterialPickUpDir, iFirstWaitingSpots, iWaitingDir, allCloud);
      }
      else
      {
        //method 1: from the selected homebases only:
        availableHomes = ConvertHomeBaseData2(iHomeBases, pointsOnGround, allCloud, iUnitLen);
      }
      List<int> homeBaseIndices = availableHomes.Keys.ToList();

      // FIX: update buildstates of neighbors of selected homes
      // since you selectHomes after Pre-processing geometry, so you need to update pendingToDeploy
      // because when you do Pre-Process geometry, the bindP or pointToSupport these dict does not consider home status
      // so it will be likely that the point right above the home will be set to needSupport incorrectly\
      Print("There are " + pointsOnGround.Count + " points on the ground");
      if (pointsOnGround.Count > 0)
      {
        foreach (int homeIndex in homeBaseIndices)
        {
          buildStates[homeIndex] = BuildState.Deployed;
          voxelTypes[homeIndex] = VoxelType.Structure;
          deployed.Add(homeIndex);
          Print("Selected home bases are: " + homeIndex
            + ", At position = " + availableHomes[homeIndex].HomeBasePt
            + ", With materialPickUpPt = " + availableHomes[homeIndex].MaterialPickUpPt
            + ", At materialPickUpDir = " + availableHomes[homeIndex].MaterialPickUpDir
            + ", With firstWaitingPt = " + availableHomes[homeIndex].FirstWaitingSpot
            + ", At waitingDir = " + availableHomes[homeIndex].WaitingDir);

          // re-set home neighbor's buildstate
          List<int> homeNeighbors = adjacencyMap[homeIndex];
          foreach (int neighbor in homeNeighbors)
          {
            if (homeBaseIndices.Contains(neighbor)) continue;
            buildStates[neighbor] = BuildState.PendingToDeploy;
            //Print("the home = " + homeIndex + ", BuildState = " + buildStates[homeIndex] + ". Its neighbor = " + neighbor + ", Buildstate = " + buildStates[neighbor]);
          }
        }
      }




      // 8. classify all the design points--for each pt in the cloud:
      HashSet<Point3d> supportsSet = new HashSet<Point3d>(iSupports); // use list.Contains() will be bad for large list
      HashSet<Point3d> raftSet = new HashSet<Point3d>(iRaft);

      // assign voxel type-structure, base, support
      // determine build state--deployed, undeployed, needsupport
      for (int i = 0; i < allCloud.Count; i++)
      {
        int pointIndex = i;
        if (homeBaseIndices.Contains(pointIndex)) continue; // skip all the home points
        Point3d point = allCloud[i].Location;

        // assign voxel type
        if (supportsSet.Contains(point))
        {
          //voxelType[pointIndex] = "support";
          voxelTypes[pointIndex] = VoxelType.Support;
        }
        else if (raftSet.Contains(point))
        {
          //voxelType[pointIndex] = "base";
          voxelTypes[pointIndex] = VoxelType.Base;
        }
        else
        {
          //voxelType[pointIndex] = "structure";
          voxelTypes[pointIndex] = VoxelType.Structure;
        }

        // assign build states
        //bool isPendingToDeploy = IsPendingToDeploy(pointIndex, pointToSupport, bindPoints); // if dependency requirement is met and is undeployed
        //now IsSupportNeeded() can work, because fields are initialized

        // check dependency dictionaries
        bool needSupport = false;
        if ((pointToSupport.ContainsKey(pointIndex)) || (bindPoints.ContainsKey(pointIndex) && buildStates[bindPoints[pointIndex]] != BuildState.Deployed))
        {
          needSupport = true;
        }

        //bool needSupport = env.IsSupportNeeded(pointIndex); // check dependency dictionaries
        if (needSupport)
        {
          //buildState[pointIndex] = "needSP";
          buildStates[pointIndex] = BuildState.NeedSupport;
        }
        else
        {
          //buildState[pointIndex] = "pendingToDeploy";
          buildStates[pointIndex] = BuildState.PendingToDeploy;
        }
      }





      // 9. assign all the points in the basement (raft)
      List<int> raftIndices = new List<int>();
      foreach (Point3d pt in raftSet)
      {
        int index = ComputeCorrectPointIndex(pt, allCloud);
        raftIndices.Add(index);
      }


      //10. compute each raft's zones: 1st int for raftIndex, 2nd int for homeIndex
      Dictionary<int, int> raftZones = AssignRaftZones(allCloud, raftIndices, homeBaseIndices, adjacencyMap);


      //11. convert List<BuildState>, List<VoxelType> to int list
      List<int> buildStateInts = buildStates.Select(s => (int) s).ToList();
      List<int> voxelTypeInts = voxelTypes.Select(v => (int) v).ToList();

      //12. store homebases - store as raw primitives (not HomeBaseData), same as TargetData
      Dictionary<int, object[]> homeBasesRaw = new Dictionary<int, object[]>();
      foreach (var kvp in availableHomes)
      {
        HomeBaseData h = kvp.Value;
        homeBasesRaw[kvp.Key] = new object[]
          {
          h.HomeBasePt,                                                    // [0] Point3d
          h.MaterialPickUpPt,                                              // [1] Point3d
          h.MaterialPickUpDir,                                             // [2] Vector3d
          h.FirstWaitingSpot,                                              // [3] Point3d
          h.WaitingDir,                                                    // [4] Vector3d
          // the following two dynamic data will be stored in Behahvor as static field
          //h.OccupyingAgentId,                                              // [5] int
          //h.WaitingQueue.ToArray()                                         // [6] int[]
          };
      }

      //13. initialize active path per agent and store as Dictionary<int, List<int>>
      Dictionary<int, List<int>> agentActivePaths = new Dictionary<int, List<int>>();


      //14. store everything in the custom data
      env.CustomData[EnvironmentKeys.AllCloud] = allCloud;
      env.CustomData[EnvironmentKeys.BuildState] = buildStateInts;
      env.CustomData[EnvironmentKeys.VoxelType] = voxelTypeInts;
      env.CustomData[EnvironmentKeys.Deployed] = deployed;
      env.CustomData[EnvironmentKeys.PToSp] = pointToSupport;
      env.CustomData[EnvironmentKeys.SpToP] = supportToPoints;
      env.CustomData[EnvironmentKeys.SpDic] = supportDict;
      env.CustomData[EnvironmentKeys.BindP] = bindPoints;
      env.CustomData[EnvironmentKeys.BindL] = bindLines;
      env.CustomData[EnvironmentKeys.Disassembled] = new HashSet<int>();  // HashSet
      env.CustomData[EnvironmentKeys.AllowDisassemble] = new HashSet<int>(); // HashSet
      env.CustomData[EnvironmentKeys.Basement] = raftIndices;
      //env.CustomData[EnvironmentKeys.StartIndex] = startIndex;
      env.CustomData[EnvironmentKeys.AdjacencyMap] = adjacencyMap;
      env.CustomData[EnvironmentKeys.StructuralResolution] = iUnitLen;
      env.CustomData[EnvironmentKeys.SystemReset] = DateTime.Now.Ticks;
      env.CustomData[EnvironmentKeys.HomeBases] = homeBasesRaw;
      env.CustomData[EnvironmentKeys.ActivePath] = agentActivePaths;
      env.CustomData[EnvironmentKeys.RaftZones] = raftZones;
      env.CustomData[EnvironmentKeys.RaftRemovers] = new Dictionary<int, int>(); // first int for agentId, 2nd int for homne it is assigned to for the raft removal task

      // this step should be after InitilizeFeilds() because HasDeployedNeighbors() needs to access BuildStates in custom data
      // if you put this step before the last step, BuildStates are not in custom data yet
      //15. determine availability by checking if it is: a) pendToDeploy, b) neighbors are deployed
      HashSet<int> availableSet = new HashSet<int>(); // updated dynamically, tracks list of points currently available to build, used for target search
      Dictionary<int, object[]> targets = new Dictionary<int, object[]>(); // dictionary mapping points to their target info
      //System.Collections.Hashtable targets = new System.Collections.Hashtable();
      for (int i = 0; i < allCloud.Count; i++)
      {
        int pointIndex = i;
        if (homeBaseIndices.Contains(pointIndex)) continue;
        Point3d point = allCloud[i].Location;
        // find readyToDeploy points and add to availableSet and targets
        List<int> myNeighborIndices = adjacencyMap[pointIndex];
        bool hasNeighborDeployed = HasDeployedNeighbors(pointIndex, myNeighborIndices, buildStates);
        if (buildStates[pointIndex] == BuildState.PendingToDeploy && hasNeighborDeployed)
        {
          availableSet.Add(pointIndex);
          // if this point is in available, initialize the targets dictionary by creating the TargetData for the available point
          targets[pointIndex] = new object[] {
            pointIndex,
            new int[] { pointIndex },
            0.0,
            new int[] { }
            };

        }
      }

      env.CustomData[EnvironmentKeys.ReadyToDeploy] = availableSet; // HashSet, points that are pending to deploy and also at least one neighbor is deployed; Each Pt in this data has a TargetData
      env.CustomData[EnvironmentKeys.Targets] = targets; // in Dictionary<int, TargetData>, each comes from pt in ReadyToDeploy. Targets specifically for points to be assembled
      // you dont need to initialize fields for ReadyToDeploy and Targets, because they are not in the InitializeFields()


      //16. Store all the custom data to globalEnvData:
      globalEnvData[EnvironmentKeys.AllCloud] = allCloud;
      globalEnvData[EnvironmentKeys.BuildState] = buildStateInts;
      globalEnvData[EnvironmentKeys.VoxelType] = voxelTypeInts;
      globalEnvData[EnvironmentKeys.Deployed] = deployed;
      globalEnvData[EnvironmentKeys.PToSp] = pointToSupport;
      globalEnvData[EnvironmentKeys.SpToP] = supportToPoints;
      globalEnvData[EnvironmentKeys.SpDic] = supportDict;
      globalEnvData[EnvironmentKeys.BindP] = bindPoints;
      globalEnvData[EnvironmentKeys.BindL] = bindLines;
      globalEnvData[EnvironmentKeys.Disassembled] = new HashSet<int>();
      globalEnvData[EnvironmentKeys.AllowDisassemble] = new HashSet<int>();
      globalEnvData[EnvironmentKeys.Basement] = raftIndices;
      //globalEnvData[EnvironmentKeys.StartIndex] = startIndex;
      globalEnvData[EnvironmentKeys.AdjacencyMap] = adjacencyMap;
      globalEnvData[EnvironmentKeys.StructuralResolution] = iUnitLen;
      globalEnvData[EnvironmentKeys.SystemReset] = DateTime.Now.Ticks; ;
      globalEnvData[EnvironmentKeys.ReadyToDeploy] = availableSet;
      globalEnvData[EnvironmentKeys.Targets] = targets;
      globalEnvData[EnvironmentKeys.HomeBases] = homeBasesRaw;
      globalEnvData[EnvironmentKeys.ActivePath] = agentActivePaths;
      globalEnvData[EnvironmentKeys.RaftZones] = raftZones;
      globalEnvData[EnvironmentKeys.RaftRemovers] = new Dictionary<int, int>();

      //16. cached this environment to global persistent environment
      persistentEnv = env;
      if (iDebugMode) RhinoApp.WriteLine("After init: persistentEnv.CustomData.Count = " + persistentEnv.CustomData.Count);

      for (int i = 0; i < allCloud.Count; i++)
      {
        BuildState state = buildStates[i];
        bool isTheHome = homeBaseIndices.Contains(i);
        Print("the point index = " + i + " has buildstate = " + state + ", isHome = " + isTheHome);
      }

    }
    else if (!iReset)
    {
      lastResetState = false;
      if (iDebugMode) RhinoApp.WriteLine("=== Environment: Reset is FALSE, REUSING CACHED ENVIRONMENT ===");
    }

    // ✅ -ALWAYS use persistentEnv (cached data) if it exists
    if (persistentEnv != null)
    {
      env = persistentEnv;
      if (iDebugMode) RhinoApp.WriteLine("Using cached persistentEnv with " + persistentEnv.CustomData.Count + " keys");

      // ✅ CRITICAL: If CustomData was cleared, restore from globalEnvData!
      // More robust than checking count:
      if (!env.CustomData.ContainsKey(EnvironmentKeys.AllCloud))
      {
        RhinoApp.WriteLine("ERROR: Environment not initialized");
        foreach (var kvp in globalEnvData)
        {
          env.CustomData[kvp.Key] = kvp.Value;
        }
        if (iDebugMode) RhinoApp.WriteLine("Restored " + env.CustomData.Count + " keys");
        //return;
      }
      //if (env.CustomData.Count < 19 && globalEnvData.Count == 19)
      //{
      //  if(iDebugMode) RhinoApp.WriteLine("WARNING: CustomData was cleared! Restoring from globalEnvData...");
      //  foreach (var kvp in globalEnvData)
      //  {
      //    env.CustomData[kvp.Key] = kvp.Value;
      //  }
      //  if(iDebugMode) RhinoApp.WriteLine("Restored " + env.CustomData.Count + " keys");
      //}

    }
    else
    {
      // ✅ If persistentEnv is null AND we haven't just initialized, create empty env
      RhinoApp.WriteLine("WARNING: persistentEnv is NULL, creating empty environment");
      //BoundingBox bbox = new BoundingBox(iDesignGeo);
      //List<Point3d> boundaryCorners = bbox.GetCorners().ToList();
      //env = new CartesianEnvironment(boundaryCorners);
      //// Restore from globalEnvData if available
      //if (globalEnvData.Count > 0)
      //{
      //  if(iDebugMode) RhinoApp.WriteLine("Restoring from globalEnvData backup...");
      //  foreach (var kvp in globalEnvData)
      //  {
      //    env.CustomData[kvp.Key] = kvp.Value;
      //  }
      //  persistentEnv = env;
      //}
    }

    if (iDebugMode) RhinoApp.WriteLine("=== Environment populated with " + env.CustomData.Count + " keys ===");

    // ✅ OUTPUT env, not persistentEnv
    oEnvironment = env;
# ---------- cartesian_environment: C# additional code ----------
  /*

  // DEBUG
  if(iDebugMode) RhinoApp.WriteLine("=== Environment Component Final Check ===");
  if(iDebugMode) RhinoApp.WriteLine("Environment type: " + persistentEnv.GetType().Name);
  if(iDebugMode) RhinoApp.WriteLine("StructureResolution: " + iUnitLen);
  if(iDebugMode) RhinoApp.WriteLine("StartIndex: " + persistentEnv.CustomData[EnvironmentKeys.StartIndex]);
  PointCloud allCloud = (PointCloud)persistentEnv.CustomData[EnvironmentKeys.AllCloud];
  if(iDebugMode) RhinoApp.WriteLine("AllCloud: " + (persistentEnv.CustomData[EnvironmentKeys.AllCloud] != null ? allCloud.Count + " points" : "NULL"));
  if(iDebugMode) RhinoApp.WriteLine("CustomData count: " + persistentEnv.CustomData.Count);

  // List all CustomData keys
  if(iDebugMode) RhinoApp.WriteLine("CustomData keys:");
  foreach (string key in persistentEnv.CustomData.Keys)
  {
  object value = persistentEnv.CustomData[key];
  string valueInfo = value != null ? value.GetType().Name : "null";
  if(iDebugMode) RhinoApp.WriteLine("  - " + key + " : " + valueInfo);
  }


  // verify the environment IMMEDIATELY after creation
  if(iDebugMode) RhinoApp.WriteLine("=== FINAL VERIFICATION ===");
  if(iDebugMode) RhinoApp.WriteLine("About to output environment...");
  if(iDebugMode) RhinoApp.WriteLine("env.CustomData.Count = " + persistentEnv.CustomData.Count);

  if (persistentEnv.CustomData.Count != 17)
  {
  if(iDebugMode) RhinoApp.WriteLine("ERROR: Expected 17 keys, but have " + persistentEnv.CustomData.Count);
  }
  else
  {
  if(iDebugMode) RhinoApp.WriteLine("=== Environment created with " + persistentEnv.CustomData.Count + " keys ===");
  }

  // List what we have
  foreach (string key in persistentEnv.CustomData.Keys)
  {
  if(iDebugMode) RhinoApp.WriteLine("  - " + key);
  }

  if(iDebugMode) RhinoApp.WriteLine("=== Environment Component Complete ===");
  if(iDebugMode) RhinoApp.WriteLine("Time taken: " + (DateTime.Now - startTime).TotalMilliseconds + "ms");

  //oEnvironment = env;
  // ✅ Add this debug output
  oDebugInfo = "Environment created at " + DateTime.Now.ToString("HH:mm:ss.fff") +
  " with " + persistentEnv.CustomData.Count + " keys";

  */



  //----------------------------------------PERSISTENT DATA----------------------------------------
  // create a persistent environmetn, so that when iReset is false, the environment will not be null and can use the last cached environment
  // if environment is null, AgentSystem cannot cast environment, the system will not run
  private static CartesianEnvironment persistentEnv;
  private static Dictionary<string, object> globalEnvData = new Dictionary<string, object>();
  private static bool lastResetState = false;  // ✅ ADD: Track last reset state


  //---------------------------------------- HELPER FUNCTIONS-----------------------------------------------------

  // this is to check if any neighbor of point has been deployed
  public bool HasDeployedNeighbors(int pointIndex, List<int> neighborIndices, List<BuildState> buildStates)
  {
    // check if it is available to deploy: a) pendingToDeploy, b) at least one neighbor is deployed?-
    // this is to decide for the available list
    bool isReachable = false;
    int reachableCount = 0;
    foreach (int index in neighborIndices)
    {
      if (buildStates[index] == BuildState.Deployed) reachableCount++;
    }

    if (reachableCount > 0) isReachable = true;

    return isReachable;

    // more simple way: neighborIndices.Any(n => buildStates[n] == BuildState.Deployed);
  }


  // DATA CONVERSION
  private List<Point3d> FilterOutPointsOnGround(List<Point3d> designGeo, List<Point3d> raftPts)
  {
    List<Point3d> designWithRaft = new List<Point3d>();
    designWithRaft.AddRange(designGeo);
    designWithRaft.AddRange(raftPts);

    List<Point3d> orderedPtsByZ = new List<Point3d>();
    orderedPtsByZ = designWithRaft.OrderBy(pt => pt.Z).ToList();
    RhinoApp.WriteLine("the total number of points (designWithRaft " + orderedPtsByZ.Count);

    double smallestZ = double.MinValue;
    if (orderedPtsByZ != null && orderedPtsByZ.Count > 0)
    {
      smallestZ = orderedPtsByZ[0].Z;
    }
    else
    {
      return new List<Point3d>();
    }

    List<Point3d> baseDesignPts = new List<Point3d>();
    foreach (Point3d pt in designWithRaft)
    {
      double thisZ = pt.Z;
      double diff = Math.Abs(smallestZ - thisZ);
      if (diff < 0.1)
      {
        baseDesignPts.Add(pt);
      }
    }

    if (baseDesignPts == null || baseDesignPts.Count == 0) { return new List<Point3d>(); }

    return baseDesignPts;
  }


  // Method 1: get all relevant homebase data only from selectedHomes in List of point3d
  public Dictionary<int, HomeBaseData> ConvertHomeBaseData2(List<Point3d> selectedHomes, List<Point3d> allPtsOnGround, PointCloud allCloud, double structuralResolution)
  {
    Dictionary<int, HomeBaseData> selectedHomeDic = new Dictionary<int, HomeBaseData>();

    // ✅ Search neighbors within selectedHomes, not allCloud
    RTree selectedHomesRTree = CreateNewRTreeFromPoints(allPtsOnGround);

    Dictionary<int, List<int>> adjacencyMap = new Dictionary<int, List<int>>();

    // ✅ Map homeIndex -> homePt directly, don't rely on selectedHomes indexing later
    Dictionary<int, Point3d> homeIndexToPoint = new Dictionary<int, Point3d>();

    for (int i = 0; i < allPtsOnGround.Count; i++)
    {
      Point3d pt = allPtsOnGround[i];
      bool isSelectedAsHomes = selectedHomes.Any(h => h.DistanceTo(pt) < 0.01);
      if (!isSelectedAsHomes) continue;
      // find neighbors for each homePt
      Point3d homePt = pt;
      int homeIndex = ComputeCorrectPointIndex(homePt, allCloud);

      if (homeIndex < 0) continue;
      List<int> myNeighbors = FindNeighborsInPointList(i, selectedHomesRTree, allPtsOnGround, structuralResolution);

      adjacencyMap[homeIndex] = myNeighbors;
      homeIndexToPoint[homeIndex] = homePt; // ✅ store the point here
    }

    // filter the ones who has no more than 2 neighbors, so that only pick the ones who can have space for material storage and waiting area
    adjacencyMap = adjacencyMap.Where(kvp => kvp.Value.Count <= 2).ToDictionary(kvp => kvp.Key, kvp => kvp.Value);

    foreach (var kvp in adjacencyMap)
    {
      int ptIndex = kvp.Key;
      if (!homeIndexToPoint.ContainsKey(ptIndex)) continue;
      int homeIndex = ptIndex;
      Point3d homePt = homeIndexToPoint[homeIndex]; // ✅ retrieve correctly
      //Point3d homePt = selectedHomes[homeIndex];
      List<int> neighborIndices = kvp.Value;
      Print("adjacencyMap DEBUG:");
      Print("for home index = " + homeIndex + ": has neighbor indices = [" + string.Join(", ", neighborIndices) + "]");

      // skip it has more than 2 neighbors, it means it does not have 2 other areas for material pick and waiting line
      if (neighborIndices.Count > 2) continue;

      Point3d neighborA = homePt + Vector3d.XAxis;
      Point3d neighborB = homePt - Vector3d.XAxis;
      Point3d neighborC = homePt + Vector3d.YAxis;
      Point3d neighborD = homePt - Vector3d.YAxis;
      List<Point3d> allNeighbors = new List<Point3d> { neighborA, neighborB, neighborC, neighborD }; // including neighbor pt that are not in the intput point list

      // ✅ Build realNeighbors from allCloud using neighbor indices, not selectedHomes
      HashSet<Point3d> realNeighbors = new HashSet<Point3d>();
      foreach (int neighborIndex in neighborIndices)
      {
        Point3d neighborPt = allPtsOnGround[neighborIndex];
        realNeighbors.Add(neighborPt);
      }

      List<Point3d> areasForMaterialAndWaiting = new List<Point3d>();
      foreach (Point3d candidate in allNeighbors)
      {
        //if (realNeighbors.Contains(neighbor)) continue;
        //areasForMaterialAndWaiting.Add(neighbor);

        // ✅ tolerance-based comparison instead of exact Contains()
        bool isRealNeighbor = false;
        foreach (Point3d realNeighbor in realNeighbors)
        {
          if (candidate.DistanceTo(realNeighbor) < 0.1)
          {
            isRealNeighbor = true;
            break;
          }
        }

        if (!isRealNeighbor)
        {
          areasForMaterialAndWaiting.Add(candidate);
        }
      }


      if (areasForMaterialAndWaiting.Count < 2)
      {
        continue;
      }

      Point3d materialPickPt = areasForMaterialAndWaiting[0];
      Vector3d materialPickUpDir = materialPickPt - homePt;
      Point3d firstWaitingPt = areasForMaterialAndWaiting[1];
      Vector3d EnterTheFieldDir = homePt - firstWaitingPt;

      if (!selectedHomeDic.ContainsKey(homeIndex) || selectedHomeDic[homeIndex] == null)
      {
        selectedHomeDic[homeIndex] = new HomeBaseData(homePt, materialPickPt, materialPickUpDir, firstWaitingPt, EnterTheFieldDir);
      }
    }

    RhinoApp.WriteLine("GenerateHomeBaseData: found " + selectedHomeDic.Count + " valid home bases");
    return selectedHomeDic;
  }



  public Dictionary<int, HomeBaseData> ConvertHomeBaseData1(Dictionary<Point3d, HomeBaseData> selectedHomes, PointCloud allCloud, double structuralResolution)
  {
    Dictionary<int, HomeBaseData> outDic = new Dictionary<int, HomeBaseData>();
    foreach (var home in selectedHomes)
    {
      Point3d homeBase = home.Key;
      HomeBaseData homeData = home.Value;
      int homeIndex = ComputeCorrectPointIndex(homeBase, allCloud);
      if (!outDic.ContainsKey(homeIndex))
      {
        outDic.Add(homeIndex, homeData);
      }

    }
    return outDic;
  }



  // Method 2: get all relevant homebase data only from all the relevant inputs
  public Dictionary<int, HomeBaseData> BuildHomeBaseDataFromPreComputed(List<Point3d> homeBasePts, List<Point3d> materialPickUpPts,
    List<Vector3d> materialPickUpDirs, List<Point3d> firstWaitingSpots,
    List<Vector3d> waitingDirs, PointCloud allCloud)
  {
    Dictionary<int, HomeBaseData> selectedHomeRaw = new Dictionary<int, HomeBaseData>();

    for (int i = 0; i < homeBasePts.Count; i++)
    {
      int homeIndex = ComputeCorrectPointIndex(homeBasePts[i], allCloud);
      if (homeIndex < 0) continue;

      selectedHomeRaw[homeIndex] = new HomeBaseData(
        homeBasePts[i],
        materialPickUpPts[i],
        materialPickUpDirs[i],
        firstWaitingSpots[i],
        waitingDirs[i]);

      /*Print("Home " + homeIndex + " at " + homeBasePts[i]
        + ", materialPickUp=" + materialPickUpPts[i]
        + ", dir=" + materialPickUpDirs[i]
        + ", waitingSpot=" + firstWaitingSpots[i]
        + ", waitingDir=" + waitingDirs[i])*/
    }

    return selectedHomeRaw;
  }




  public Dictionary<int, List<int>> DictionaryConversion2(List<object> dictionary, PointCloud allCloud)
  {
    Dictionary<Point3d, List<Point3d>> inputDic = new Dictionary<Point3d, List<Point3d>>();
    foreach (var item in dictionary)
    {
      var pair = (KeyValuePair<Point3d, List<Point3d>>) item;
      Point3d supportPt = pair.Key;
      List<Point3d> designPts = pair.Value;
      inputDic.Add(supportPt, designPts);
    }

    Dictionary<int, List<int>> outputDic = new Dictionary<int, List<int>>();
    foreach (KeyValuePair<Point3d, List<Point3d>> entry in inputDic)
    {
      Point3d ptA = entry.Key;
      List<Point3d> ptB = entry.Value;

      int indexA = ComputeCorrectPointIndex(ptA, allCloud);

      List<int> indexList = new List<int>();
      foreach (Point3d b in ptB)
      {
        int indexB = ComputeCorrectPointIndex(b, allCloud);
        indexList.Add(indexB);
      }

      outputDic.Add(indexA, indexList);
    }
    return outputDic;
  }



  public Dictionary<int, int> DictionaryConversion1(List<object> dictionary, PointCloud allCloud)
  {
    Dictionary<Point3d, Point3d> inputDic = new Dictionary<Point3d, Point3d>();
    foreach (var item in dictionary)
    {
      var pair = (KeyValuePair<Point3d, Point3d>) item; // Safely cast
      Point3d designPt = pair.Key;
      Point3d supportPt = pair.Value;
      inputDic.Add(designPt, supportPt);
    }

    Dictionary<int, int> outputDic = new Dictionary<int, int>();
    foreach (KeyValuePair<Point3d, Point3d> entry in inputDic)
    {
      Point3d ptA = entry.Key;
      Point3d ptB = entry.Value;
      int indexA = ComputeCorrectPointIndex(ptA, allCloud);
      int indexB = ComputeCorrectPointIndex(ptB, allCloud);
      outputDic.Add(indexA, indexB);
    }
    return outputDic;
  }

  // RAFT ZONING ASSIGNMENT
  private Dictionary<int, int> AssignRaftZones(PointCloud allCloud, List<int> rafts, List<int> homeIndices, Dictionary<int, List<int>> adjacencyMap)
  {
    // map each raft index to the home index it belongs to
    Dictionary<int, int> raftZones = new Dictionary<int, int>();

    foreach (int raft in rafts)
    {
      Point3d raftPos = allCloud[raft].Location;

      // assign to nearest home by ground-level BFS distance
      // not Euclidean distance, but actual traverssal distance
      int nearestHome = -1;
      int shortestPath = int.MaxValue;
      HashSet<int> blocked = new HashSet<int>(); // nothing blocked yet
      foreach (int home in homeIndices)
      {
        int pathLength = GetBFSDistance(home, raft, blocked, allCloud, adjacencyMap);
        if (pathLength >= 0 && pathLength < shortestPath)
        {
          shortestPath = pathLength;
          nearestHome = home;
        }
      }

      if (nearestHome >= 0)
      {
        raftZones[raft] = nearestHome;
      }
    }

    return raftZones;
  }


  private int GetBFSDistance(int startIndex, int endIndex, HashSet<int> blocked, PointCloud allCloud, Dictionary<int, List<int>> adjacencyMap)
  {
    if (startIndex == endIndex) return 0;

    double groundZ = allCloud[startIndex].Location.Z;
    double tolerance = 0.1;

    Queue<int> queue = new Queue<int>();
    Dictionary<int, int> dist = new Dictionary<int, int>();
    queue.Enqueue(startIndex);
    dist[startIndex] = 0;

    while (queue.Count > 0)
    {
      int current = queue.Dequeue();
      if (current == endIndex) return dist[current];

      if (!adjacencyMap.ContainsKey(current)) continue;
      foreach (int neighbor in adjacencyMap[current])
      {
        if (dist.ContainsKey(neighbor)) continue;
        if (blocked.Contains(neighbor)) continue;
        //if (buildStates[neighbor] != BuildState.Deployed) continue;
        double nz = allCloud[neighbor].Location.Z;
        if (Math.Abs(nz - groundZ) > tolerance) continue;
        dist[neighbor] = dist[current] + 1;
        queue.Enqueue(neighbor);
      }
    }

    return -1; // unreachable
  }


  private int ComputeCorrectPointIndex(Point3d testPt, PointCloud allCloud)
  {
    int tentativeIndex = allCloud.ClosestPoint(testPt);

    if (tentativeIndex < 0) return tentativeIndex;
    // to verify whether tentativeIndex is the correct index for the testPt
    // the reason to verify is that PointCloud.ClosestPoint() returns -1 only when the pointcloud is empty
    double tolerance = 0.1;
    Point3d pointInCloud = allCloud[tentativeIndex].Location;
    double dist = pointInCloud.DistanceTo(testPt);
    if (dist < tolerance)
    {
      return tentativeIndex;
    }
    else
    {
      return -1;
    }
  }


  // BUILD ADJACENCY MAP
  // Build RTree ONCE for all neighbor searches
  public RTree CreateNewRTreeFromPointCloud(PointCloud allCloud)
  {
    RTree rTree = new RTree();
    for (int i = 0; i < allCloud.Count; i++)
    {
      rTree.Insert(allCloud[i].Location, i);
    }
    return rTree;
  }

  public RTree CreateNewRTreeFromPoints(List<Point3d> pts)
  {
    RTree rTree = new RTree();
    for (int i = 0; i < pts.Count; i++)
      rTree.Insert(pts[i], i);
    return rTree;
  }


  // find neighbors for a particular point
  public List<int> FindNeighborsInPointCloud(int pointIndex, RTree rTree, PointCloud allCloud, double structuralResolution)
  {
    // RTree rTree = new RTree(); // this is just to create an empty RTree, with an empty rTree, you cannot use PointCloudClosestPoint() method
    // move -create a new RTree- to persistent data
    Point3d needlePt = allCloud[pointIndex].Location;
    List<int> myNeighborIndices = new List<int>();
    Sphere boundingBox = new Sphere(needlePt, structuralResolution);
    rTree.Search(boundingBox, (sender, args) =>
      {
      if (args.Id != pointIndex) // Don't include self as neighbor
        myNeighborIndices.Add(args.Id);
      });

    return myNeighborIndices;
  }

  public List<int> FindNeighborsInPointList(int pointIndex, RTree rTree, List<Point3d> pts, double structuralResolution)
  {
    Point3d needlePt = pts[pointIndex];
    List<int> myNeighborIndices = new List<int>();

    // ✅ use 1.1x radius to avoid boundary exclusion at exact distance
    double searchRadius = structuralResolution * 1.1;
    Sphere boundingBox = new Sphere(needlePt, searchRadius);

    rTree.Search(boundingBox, (sender, args) =>
      {
      if (args.Id != pointIndex)
      {
        // ✅ secondary check: only accept points within structuralResolution
        double dist = needlePt.DistanceTo(pts[args.Id]);
        if (dist <= structuralResolution + 0.01)
          myNeighborIndices.Add(args.Id);
      }
      });
    return myNeighborIndices;
  }

  public RTree CreateNewRTree2(List<int> pointIndices, PointCloud allCloud)
  {
    RTree rTree = new RTree();
    for (int i = 0; i < pointIndices.Count; i++)
    {
      rTree.Insert(allCloud[pointIndices[i]].Location, pointIndices[i]);
    }
    return rTree;
  }

  // find neighbors for a list of points
  // only need to call this method once and then adjacencyMap can be stored in the custom data. The results of neighborhood is persistent, regardless things changes during simulation
  public Tuple<List<List<int>>, Dictionary<int, List<int>>> FindNeighbors2(List<int> pointIndices, RTree rTree, PointCloud allCloud, double structuralResolution)
  {
    List<List<int>> neighborIndices = new List<List<int>>();
    Dictionary<int, List<int>> adjancencyMap = new Dictionary<int, List<int>>();

    for (int i = 0; i < pointIndices.Count; i++)
    {
      //RTree rTree = CreateNewRTree2(pointIndices, allCloud); // you SHOULD NOT create rTree for every point in every iteration
      List<int> myNeighborIndices = new List<int>();
      Point3d needlePt = allCloud[pointIndices[i]].Location;
      Sphere boundingBox = new Sphere(needlePt, structuralResolution);
      rTree.Search(boundingBox, (sender, args) =>
        {
        if (args.Id != pointIndices[i]) // Don't include self as neighbor
          myNeighborIndices.Add(args.Id);
        });

      adjancencyMap[i] = myNeighborIndices;
      neighborIndices.Add(myNeighborIndices);
    }

    return Tuple.Create(neighborIndices, adjancencyMap);
  }






  //--------------------------------------------------SUPPORTING CLASS FOR AGENT --------------------------------------------------

  public enum WorkState
  {
    Idle,        // At start, deciding next task
    Assemble,    // Building a structure point
    Disassemble, // Removing a support for reuse
    Remove,      // Removing base/raft
    Return       // Returning to start position
  }

  public enum HomeStatus
  {
    Occupying,        // agent is occupying its home base
    Waiting,
    InField      // agent is in the field working
  }

  public static class AgentKeys
  {
    public static readonly string WorkState = "WorkState";
    //public static readonly string Task = "task";
    public static readonly string Target = "target";
    public static readonly string Path = "path";
    public static readonly string CurrentStep = "currentStep";
    public static readonly string Orientation = "orientation";
    public static readonly string EntertheField = "entertheField";
    public static readonly string ExtendArm = "extendArm";
    public static readonly string PrevState = "previousWorkState";
    //public static readonly string VoxelState = "voxelState";
    public static readonly string ShouldMoveForward = "shouldMoveForward";
    public static readonly string Position = "position";
    //public static readonly string PrevTarget = "prevTarget";
    public static readonly string HasMaterial = "hasMaterial";
    public static readonly string HomeBase = "homeIndex"; // which home index is assigned to the agent
    //public static readonly string HomeStatus = "homeStatus"; // track agent's relationship w
    public static readonly string CurrentHome = "currentHome"; // the temporary home the agent is current occupying or returning to or waiting at
    public static readonly string ISidestepped = "isSidestepped"; // whether the agent has sidestepped to yield to other agent to avoid collision
    public static readonly string SidestepData = "sidestepData"; // the index where the agent is before it sidestepped, and its sidestepped index
    public static readonly string DeadLockTicks = "deadlockTicks"; // how many ticks have passed when agent is not moving. If passing a threshold, agent needs to replanning a path or task

  }



  //--------------------------------------------------SUPPORTING CLASS FOR ENVIRONMENT--------------------------------------------------

  public enum BuildState
  {
    Deployed, // Successfully built and placed
    PendingToDeploy, //  Can be built, no dependencies blocking
    NeedSupport, // Has dependencies blocking, can't build yet
    //Occupied, // was deployed, Agent is currently traveling through/using this point
    Removed  // Was deployed, now removed (for supports/base)
    // ReadyToDeploy: not as a state, but stored in a list<int>; It is points that are pendingToDeploy and also have at least one neighbor deployed. they are initialized in Targets
  }

  public enum VoxelType
  {
    Structure,
    Support,
    Base
  }

  // used for path finding with A*
  public class TargetData
  {
    public int TargetIndex;
    public int[] Path; // path from agent index to target index
    public double Cost;
    public int[] ReservedBy; // reserved by agentIds, here HashSet is better than list
    public TargetData(int targetIndex, int[] path, double cost, int[] reservedBy)
    {
      this.TargetIndex = targetIndex;
      this.Path = path;
      this.Cost = cost;
      this.ReservedBy = reservedBy;
    }
  }


  public class HomeBaseData
  {
    // static state data
    public Point3d HomeBasePt; // the list of these home base points
    public Point3d MaterialPickUpPt; // the list of the material pick up locations for each home base
    public Vector3d MaterialPickUpDir; // the list of the material pick up directions at each home base
    public Point3d FirstWaitingSpot; // the waiting line for agents who exit the field, [0] = first waiting spot, [1] = second, etc.
    public Vector3d WaitingDir;

    // dynamic state -chagnes as agents arrive/leave
    public int OccupyingAgentId; // -1 if the home base is free
    public Queue<int> WaitingQueue; // agent IDs waiting in line, in order
    public HomeBaseData(Point3d homeBasePt, Point3d materialPickUpPt, Vector3d materialPickUpDir, Point3d firstWaitingSpot, Vector3d waitingDir)
    {
      this.HomeBasePt = homeBasePt;
      this.MaterialPickUpPt = materialPickUpPt;
      this.MaterialPickUpDir = materialPickUpDir;
      this.FirstWaitingSpot = firstWaitingSpot;
      this.WaitingDir = waitingDir;
      this.OccupyingAgentId = -1;
      this.WaitingQueue = new Queue<int>();
    }

    public bool IsOccupied()
    {
      if (OccupyingAgentId != -1)
      {
        return true;
      }
      else
      {
        return false;
      }
    }

    public Point3d GetWaitingSpotFor(int agentId)
    {
      // returns which physical spot this agent should stand at
      if (WaitingQueue.Count == 0) return WaitingDir + HomeBasePt;

      int waitingLineIndex = 0;
      for (int i = 0; i < WaitingQueue.Count; i++)
      {
        int id = WaitingQueue.ElementAt(i);
        if (id == agentId)
        {
          Point3d waitingSpot = (-1) * WaitingDir * (i + 1) + HomeBasePt;
          return waitingSpot;
        }
        waitingLineIndex++;
        if (waitingLineIndex >= WaitingQueue.Count) break;
      }
      // overflow to last spot
      Point3d lastAvailbleSpot = WaitingDir * (WaitingQueue.Count + 1) + HomeBasePt;
      return lastAvailbleSpot;
    }


  }

  // class to store the keys for the CustomData
  public static class EnvironmentKeys
  {
    public const string BuildState = "BuildState"; // List<BuildState>: "deployed", "needSP", "pendingToDeploy"
    public const string VoxelType = "VoxelType"; //List<VoxelType>: "Structure", "Support", "Base"
    public const string ReadyToDeploy = "ReadyToDeploy"; // List<int>: strucutre points that are a) pendingToDeploy, b) at least one neighbor is deployed
    public const string Targets = "Targets"; //Dictionary<int, TargetData>: for agent's path finding. What's in Targets come from ReadyToDeploy; Targets specifically for points to be assembled
    //public const string Deployed = "DeployedCLoud"; // PointCloud
    public const string Deployed = "Deployed"; // pointIndex in HashSet<int> according to allCloud, saved to Deployed
    public const string PToSp = "PToSp"; // dictionary<intA, intB>: structural pointA needs support pointB as support
    public const string SpToP = "SpToP"; // dictionary<intA, List<int>>: support pointA supports all this list of structural points
    public const string SpDic = "SpDic"; // dictionary<intA, list<int>>: support top pointA leads the vertical support column
    public const string BindP = "BindP"; // dictionary<intA, intB>: structural pointA needs structural pointB to be built first
    public const string BindL = "BindL"; // dictionary<intA, List<int>>: structural pointA suuports all this list of structural points
    public const string Disassembled = "Disassembled"; // List<int>
    public const string AllowDisassemble = "AllowDisassemble"; // List<int>
    public const string Basement = "Basement"; // List<int>
    public const string AllCloud = "AllCloud";  // PointCloud
    public const string AdjacencyMap = "AdjacencyMap"; // Dictionary <int, List<int>>, each point's neighbors
    public const string StructuralResolution = "StructuralResolution";
    public const string SystemReset = "SystemReset";
    public const string HomeBases = "homeBases";
    public const string ActivePath = "activePath"; // path is to track which points are being occupied by the agent, which is also used for collision detection
    public const string RaftZones = "raftZones"; // assign each raft to a zone that is closer to a home
    public const string RaftRemovers = "raftRemovers"; // track who become the active raft removers and return to which home
  }






  // bool isStructureComplete, bool hasReusableSupport, bool hasRemovableRaft,
  // bool isSupportRequired, bool isSafeToDisassemble,
  // GlobalTargetPool(), DependencyManager(), UpdateDependency()
# ---------- end cartesian_environment ----------
assemblysystem = CSharpScript(
    iDebugMode=toggle_2,
    iAgents=agents.oAgents,
    iEnvironment=cartesian_environment.oEnvironment,
    Reference="C:\Users\siennasun513\AppData\Roaming\McNeel\Rhinoceros\packages\7.0\ABxM-Core\1.7.0\ABxM.Core.dll")  # -> out, oAgentSystem; inputs iDebugMode: Boolean, iAgents: list
# ---------- assemblysystem: C# usings ----------
using ABxM.Core.Agent;
using ABxM.Core.AgentSystem;
using ABxM.Core.Environments;
using System.Linq;
# ---------- assemblysystem: C# ----------
    if (iDebugMode) RhinoApp.WriteLine("=== AgentSystem Component RunScript ===");

    // Check agents input
    if (iAgents == null)
    {
      RhinoApp.WriteLine("ERROR: iAgents input is NULL!");
      return;
    }
    if (iDebugMode) RhinoApp.WriteLine("iAgents count: " + iAgents.Count);

    List<CartesianAgent> agents = new List<CartesianAgent>();
    foreach (var agent in iAgents)
    {
      CartesianAgent cartAgent = agent as CartesianAgent;
      if (cartAgent == null)
      {
        RhinoApp.WriteLine("WARNING: Could not cast agent to CartesianAgent");
      }
      else
      {
        agents.Add(cartAgent);
      }
    }
    if (iDebugMode) RhinoApp.WriteLine("Successfully converted " + agents.Count + " agents");

    // Check environment input
    if (iEnvironment == null)
    {
      RhinoApp.WriteLine("ERROR: iEnvironment input is NULL!");
      return;
    }
    if (iDebugMode) RhinoApp.WriteLine("iEnvironment type: " + iEnvironment.GetType().Name);

    CartesianEnvironment assemblyEnv = iEnvironment as CartesianEnvironment;
    if (assemblyEnv == null)
    {
      RhinoApp.WriteLine("ERROR: Could not cast iEnvironment to CartesianEnvironment!");
      if (iDebugMode) RhinoApp.WriteLine("iEnvironment actual type: " + iEnvironment.GetType().FullName);
      return;
    }
    if (iDebugMode) RhinoApp.WriteLine("Environment cast successful");

    // ✅ CRITICAL: Verify environment is initialized
    if (assemblyEnv.CustomData == null || assemblyEnv.CustomData.Count == 0)
    {
      RhinoApp.WriteLine("ERROR: Environment CustomData is EMPTY or NULL!");
      if (iDebugMode) RhinoApp.WriteLine("The Environment component has not run yet or failed to initialize.");
      oAgentSystem = null;
      return;
    }

    if (iDebugMode) RhinoApp.WriteLine("Environment CustomData verified: " + assemblyEnv.CustomData.Count + " keys");


    // Create agent system
    CartesianAgentSystem assemblySystem = new CartesianAgentSystem(agents, assemblyEnv);


    oAgentSystem = assemblySystem;
    if (iDebugMode) RhinoApp.WriteLine("=== AgentSystem Component Complete ===");
# ---------- assemblysystem: C# additional code ----------
  //--------------------------------------------------SUPPORTING CLASS FOR AGENT --------------------------------------------------

  public enum WorkState
  {
    Idle,        // At start, deciding next task
    Assemble,    // Building a structure point
    Disassemble, // Removing a support for reuse
    Remove,      // Removing base/raft
    Return       // Returning to start position
  }

  public enum HomeStatus
  {
    Occupying,        // agent is occupying its home base
    Waiting,
    InField      // agent is in the field working
  }

  public static class AgentKeys
  {
    public static readonly string WorkState = "WorkState";
    public static readonly string Target = "target";
    public static readonly string Path = "path";
    public static readonly string CurrentStep = "currentStep";
    public static readonly string Orientation = "orientation";
    public static readonly string EntertheField = "entertheField";
    public static readonly string ExtendArm = "extendArm";
    public static readonly string PrevState = "previousWorkState";
    public static readonly string ShouldMoveForward = "shouldMoveForward";
    public static readonly string Position = "position";
    public static readonly string HasMaterial = "hasMaterial";
    public static readonly string HomeBase = "homeIndex"; // which home index is assigned to the agent
    public static readonly string CurrentHome = "currentHome"; // the temporary home the agent is current occupying or returning to or waiting at
    public static readonly string ISidestepped = "isSidestepped"; // whether the agent has sidestepped to yield to other agent to avoid collision
    public static readonly string SidestepData = "sidestepData"; // the index where the agent is before it sidestepped, and its sidestepped index
    public static readonly string DeadLockTicks = "deadlockTicks"; // how many ticks have passed when agent is not moving. If passing a threshold, agent needs to replanning a path or task

  }



  //--------------------------------------------------SUPPORTING CLASS FOR ENVIRONMENT--------------------------------------------------

  public enum BuildState
  {
    Deployed, // Successfully built and placed
    PendingToDeploy, //  Can be built, no dependencies blocking
    NeedSupport, // Has dependencies blocking, can't build yet
    Removed  // Was deployed, now removed (for supports/base)
  }

  public enum VoxelType
  {
    Structure,
    Support,
    Base
  }

  // used for path finding with A*
  public class TargetData
  {
    public int TargetIndex;
    public int[] Path; // path from agent index to target index
    public double Cost;
    public int[] ReservedBy; // reserved by agentIds, here HashSet is better than list
    public TargetData(int targetIndex, int[] path, double cost, int[] reservedBy)
    {
      this.TargetIndex = targetIndex;
      this.Path = path;
      this.Cost = cost;
      this.ReservedBy = reservedBy;
    }
  }


  public class HomeBaseData
  {
    // static state data
    public Point3d HomeBasePt; // the list of these home base points
    public Point3d MaterialPickUpPt; // the list of the material pick up locations for each home base
    public Vector3d MaterialPickUpDir; // the list of the material pick up directions at each home base
    public Point3d FirstWaitingSpot; // the waiting line for agents who exit the field, [0] = first waiting spot, [1] = second, etc.
    public Vector3d WaitingDir;

    // dynamic state -chagnes as agents arrive/leave
    public int OccupyingAgentId; // -1 if the home base is free
    public Queue<int> WaitingQueue; // agent IDs waiting in line, in order
    public HomeBaseData(Point3d homeBasePt, Point3d materialPickUpPt, Vector3d materialPickUpDir, Point3d firstWaitingSpot, Vector3d waitingDir)
    {
      this.HomeBasePt = homeBasePt;
      this.MaterialPickUpPt = materialPickUpPt;
      this.MaterialPickUpDir = materialPickUpDir;
      this.FirstWaitingSpot = firstWaitingSpot;
      this.WaitingDir = waitingDir;
      this.OccupyingAgentId = -1;
      this.WaitingQueue = new Queue<int>();
    }

    public bool IsOccupied()
    {
      if (OccupyingAgentId != -1)
      {
        return true;
      }
      else
      {
        return false;
      }
    }

    public Point3d GetWaitingSpotFor(int agentId)
    {
      // returns which physical spot this agent should stand at
      if (WaitingQueue.Count == 0) return WaitingDir + HomeBasePt;

      int waitingLineIndex = 0;
      for (int i = 0; i < WaitingQueue.Count; i++)
      {
        int id = WaitingQueue.ElementAt(i);
        if (id == agentId)
        {
          Point3d waitingSpot = WaitingDir * (i + 1) + HomeBasePt;
          return waitingSpot;
        }
        waitingLineIndex++;
        if (waitingLineIndex >= WaitingQueue.Count) break;
      }
      // overflow to last spot
      Point3d lastAvailbleSpot = WaitingDir * (WaitingQueue.Count + 1) + HomeBasePt;
      return lastAvailbleSpot;
    }


  }

  // class to store the keys for the CustomData
  public static class EnvironmentKeys
  {
    public const string BuildState = "BuildState"; // List<BuildState>: "deployed", "needSP", "pendingToDeploy"
    public const string VoxelType = "VoxelType"; //List<VoxelType>: "Structure", "Support", "Base"
    public const string ReadyToDeploy = "ReadyToDeploy"; // List<int>: strucutre points that are a) pendingToDeploy, b) at least one neighbor is deployed
    public const string Targets = "Targets"; //Dictionary<int, TargetData>: for agent's path finding. What's in Targets come from ReadyToDeploy; Targets specifically for points to be assembled
    public const string Deployed = "Deployed"; // pointIndex in HashSet<int> according to allCloud, saved to Deployed
    public const string PToSp = "PToSp"; // dictionary<intA, intB>: structural pointA needs support pointB as support
    public const string SpToP = "SpToP"; // dictionary<intA, List<int>>: support pointA supports all this list of structural points
    public const string SpDic = "SpDic"; // dictionary<intA, list<int>>: support top pointA leads the vertical support column
    public const string BindP = "BindP"; // dictionary<intA, intB>: structural pointA needs structural pointB to be built first
    public const string BindL = "BindL"; // dictionary<intA, List<int>>: structural pointA suuports all this list of structural points
    public const string Disassembled = "Disassembled"; // List<int>
    public const string AllowDisassemble = "AllowDisassemble"; // List<int>
    public const string Basement = "Basement"; // List<int>
    public const string AllCloud = "AllCloud";  // PointCloud
    public const string AdjacencyMap = "AdjacencyMap"; // Dictionary <int, List<int>>, each point's neighbors
    public const string StructuralResolution = "StructuralResolution";
    public const string SystemReset = "SystemReset";
    public const string HomeBases = "homeBases";
    public const string ActivePath = "activePath"; // path is to track which points are being occupied by the agent, which is also used for collision detection
    public const string RaftZones = "raftZones"; // assign each raft to a zone that is closer to a home
    public const string RaftRemovers = "raftRemovers"; // track who become the active raft removers and return to which home

  }
# ---------- end assemblysystem ----------
solver = StepByStepSolver(Reset=toggle, Execute=Toggle(False), AgentSystems=assemblysystem.oAgentSystem)  # -> DisplayGeometries, AllAgentSystems, IterationCount; disabled

# ----
# Visualization
# green for structural voxels
# lavendar for raft voxels
# yellow for support voxels
# red for home bases
panel_4 = Panel("0.33")
series = Series(Start=0, Step=panel_4, Count=10)
gradient = Gradient(
    LowerLimit=0,
    UpperLimit=1,
    Parameter=series,
    stops=[0: RGB(255, 0, 255), 0.0312: RGB(255, 7, 247), 0.0625: RGB(255, 16, 238), 0.0938: RGB(255, 24, 230), 0.125: RGB(255, 31, 223), 0.156: RGB(255, 39, 215)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])
structure_visualizer = CSharpScript(
    iDebugMode=toggle_2,
    iAgentSystem=solver.AllAgentSystems,
    Reference="C:\Users\siennasun513\AppData\Roaming\McNeel\Rhinoceros\packages\7.0\ABxM-Core\1.7.0\ABxM.Core.dll")  # -> out, oAllPts, oDeployedStructure, oDeployedSupport, oDeployedRaft, oRemovedStructure, oRemovedSupport, oRemovedRaft, oHomes; inputs iDebugMode: Boolean
# ---------- structure_visualizer: C# usings ----------
using ABxM.Core.Agent;
using ABxM.Core.AgentSystem;
using ABxM.Core.Environments;
using System.Drawing;
using System.Linq;
# ---------- structure_visualizer: C# ----------
    try
    {
      if (iDebugMode) RhinoApp.WriteLine("=== POST-PROCESSING: STRUCTURE VISUALIZER START ===");

      // ✅ Try to cast and handle gracefully if it fails
      CartesianAgentSystem assemblySystem = iAgentSystem as CartesianAgentSystem;

      List<CartesianAgent> allAgents = new List<CartesianAgent>();
      foreach (var agent in assemblySystem.Agents)
      {
        if (agent == null) continue;
        CartesianAgent cartAgent = agent as CartesianAgent;
        if (cartAgent == null) continue;
        allAgents.Add(cartAgent);
      }

      CartesianEnvironment assemblyEnv = assemblySystem.CartesianEnvironment;

      // GET DATA FROM ENVIRONMENT
      List<int> voxelTypeInts = (List<int>)assemblyEnv.CustomData[EnvironmentKeys.VoxelType];
      List<VoxelType> voxelTypes = voxelTypeInts.Select(i => (VoxelType)i).ToList();
      List<int> buildStateInts = (List<int>)assemblyEnv.CustomData[EnvironmentKeys.BuildState];
      List<BuildState> buildStates = buildStateInts.Select(i => (BuildState)i).ToList();
      PointCloud allCloud = (PointCloud)assemblyEnv.CustomData[EnvironmentKeys.AllCloud];
      HashSet<int> disassembled = (HashSet<int>)assemblyEnv.CustomData[EnvironmentKeys.Disassembled];
      HashSet<int> allowDisassemble = (HashSet<int>)assemblyEnv.CustomData[EnvironmentKeys.AllowDisassemble];
      HashSet<int> deployed = (HashSet<int>)assemblyEnv.CustomData[EnvironmentKeys.Deployed];
      HashSet<int> readyToDeploy = (HashSet<int>)assemblyEnv.CustomData[EnvironmentKeys.ReadyToDeploy];
      double structuralResolution = (double)assemblyEnv.CustomData[EnvironmentKeys.StructuralResolution];
      Dictionary<int, TargetData> allTargets = LoadTargets(assemblyEnv);

      // CACHE ALLCLOUDPOINTS
      List<Point3d> allPoints = new List<Point3d>();
      for (int i = 0; i < allCloud.Count; i++)
      {
        allPoints.Add(allCloud[i].Location);
      }

      // CACHE TO PERSISTENT DATA
      cachedVoxelTypes = voxelTypes;
      cachedBuildStates = buildStates;
      cachedStructuralResolution = structuralResolution;
      allCloudPoints = allPoints;

      // TRACK STRUCTURE PROGRESS FOR VISUAL
      List<int> allDeployedIndices = new List<int>();
      List<Point3d> deployedStructurePts = new List<Point3d>();
      List<Point3d> deployedSupportPts = new List<Point3d>();
      List<Point3d> deployedRaftPts = new List<Point3d>();

      List<Point3d> allRemovedPts = new List<Point3d>();
      List<Point3d> removedStructure = new List<Point3d>();
      List<Point3d> removedSupport = new List<Point3d>();
      List<Point3d> removedRaft = new List<Point3d>();


      for (int i = 0; i < deployed.Count; i++)
      {
        int pointIndex = deployed.ElementAt(i);
        Point3d thisPt = allCloud[pointIndex].Location;

        if (!allDeployedIndices.Contains(pointIndex))
        {
          allDeployedIndices.Add(pointIndex);

          if (pointIndex >= 0)
          {
            VoxelType voxelType = voxelTypes[pointIndex];
            if (voxelType == VoxelType.Structure)
            {
              deployedStructurePts.Add(thisPt);
            }
            else if (voxelType == VoxelType.Support)
            {
              deployedSupportPts.Add(thisPt);
            }
            else if (voxelType == VoxelType.Base)
            {
              deployedRaftPts.Add(thisPt);
            }
          }
        }
      }

      foreach (int i in disassembled)
      {
        Point3d thisPt = allCloud[i].Location;
        if (!allRemovedPts.Contains(thisPt))
        {
          allRemovedPts.Add(thisPt);
          VoxelType voxelType = voxelTypes[i];
          if (voxelType == VoxelType.Structure)
          {
            removedStructure.Add(thisPt);
          }
          else if (voxelType == VoxelType.Support)
          {
            removedSupport.Add(thisPt);
          }
          else if (voxelType == VoxelType.Base)
          {
            removedRaft.Add(thisPt);
          }
        }
      }

      // VISUALIZE VOXELS
      oAllPts = allPoints;
      oRemovedStructure = removedStructure;
      oRemovedSupport = removedSupport;
      oRemovedRaft = removedRaft;
      oDeployedStructure = deployedStructurePts;
      oDeployedSupport = deployedSupportPts;
      oDeployedRaft = deployedRaftPts;


      // CACHE HOMES
      Dictionary<int, HomeBaseData> homeBases = LoadHomeBaseData(assemblyEnv);
      if (iDebugMode) RhinoApp.WriteLine("POST-PROCESSING: Home bases loaded: " + homeBases.Count);
      List<Point3d> homeBasePts = new List<Point3d>();
      foreach (var kvp in homeBases)
      {
        if (iDebugMode) RhinoApp.WriteLine("  Home " + kvp.Key + " at " + kvp.Value.HomeBasePt);
        homeBasePts.Add(kvp.Value.HomeBasePt);
      }

      if (homeBases.Count != cachedHomeBases.Count)
      {
        cachedHomeBases = homeBases;
        List<Color> homeC = new List<Color> { Color.Red };
        //List<Color> homeC = iHomeColors;
        cachedHomeColorMap = BuildHomeColorMap(homeC);
      }

      // VISUALIZE HOMES
      oHomes = homeBasePts;


      if (iDebugMode) RhinoApp.WriteLine("=== POST-PROCESSING: STRUCTURE VISULIZER COMPLETE ===");
    }
    catch (Exception ex)
    {
      RhinoApp.WriteLine("FATAL POST-PROCESSING: STRUCTURE VISULIZER ERROR: " + ex.Message);
      if (iDebugMode) RhinoApp.WriteLine("STACK: " + ex.StackTrace);
    }
# ---------- structure_visualizer: C# additional code ----------
  // ------------------------------------PERSISTENT DATA------------------------------------
  private List<Point3d> allCloudPoints = new List<Point3d>();     // for structure viz
  private List<BuildState> cachedBuildStates = new List<BuildState>();
  private List<VoxelType> cachedVoxelTypes = new List<VoxelType>();
  private double cachedStructuralResolution = 0.0;

  private Dictionary<int, HomeBaseData> cachedHomeBases = new Dictionary<int, HomeBaseData>();
  private Dictionary<int, Color> cachedHomeColorMap = new Dictionary<int, Color>();

  // ------------------------------------CUSTOM PREVIEW------------------------------------

  // draw home positions in labels and visualize each home's waiting line
  public override void DrawViewportWires(IGH_PreviewArgs args)
  {
    // a) draw home labels, home waiting line, and home voxel in wireframes
    foreach (var kvp in cachedHomeBases)
    {
      // home labels in text
      Color homeColor = cachedHomeColorMap.ContainsKey(kvp.Key) ? cachedHomeColorMap[kvp.Key] : Color.Gray;
      Point3d homeBasePt = kvp.Value.HomeBasePt;
      Point3d homePtOnGround = new Point3d(homeBasePt.X, homeBasePt.Y, homeBasePt.Z - cachedStructuralResolution * 0.5);
      args.Display.DrawDot(homePtOnGround, "H" + kvp.Key, homeColor, Color.White);

      // also draw the waiting line direction
      Line waitingLine = new Line(homePtOnGround, homePtOnGround + kvp.Value.WaitingDir * 2);
      args.Display.DrawArrow(waitingLine, homeColor);

      // draw home voxel in wireframe
      var homeVoxelResult = BuildVoxelWireFrames(homeBasePt);
      Point3d[] homeCorners = homeVoxelResult.Item1;
      Color homeC = Color.Red;
      int thickness = 2;
      int[,] homeEdges = homeVoxelResult.Item2;
      for (int edge = 0; edge < 12; edge++)
      {
        Line line = new Line(homeCorners[homeEdges[edge, 0]], homeCorners[homeEdges[edge, 1]]);
        args.Display.DrawLine(line, homeC, thickness);
      }
    }

    // b) structural voxels in wireframe
    if (allCloudPoints != null && allCloudPoints.Count > 0 && cachedBuildStates != null && cachedBuildStates.Count > 0)
    {
      for (int i = 0; i < allCloudPoints.Count; i++)
      {
        BuildState bs = cachedBuildStates[i];
        if (bs == BuildState.Removed) continue;
        if (cachedHomeBases.ContainsKey(i)) continue;

        Point3d midPt = allCloudPoints[i];
        VoxelType vt = cachedVoxelTypes[i];
        Color c = VoxelTypeToColor(vt);
        int thickness = VoxelStateToThickness(bs);

        var voxelCornersAndEdges = BuildVoxelWireFrames(midPt);
        Point3d[] voxelCorners = voxelCornersAndEdges.Item1;
        int[,] voxelEdges = voxelCornersAndEdges.Item2;

        for (int edge = 0; edge < 12; edge++)
        {
          Line line = new Line(voxelCorners[voxelEdges[edge, 0]], voxelCorners[voxelEdges[edge, 1]]);
          if (bs == BuildState.Deployed)
          {
            args.Display.DrawLine(line, c, thickness);
          }
          else if (bs == BuildState.PendingToDeploy || bs == BuildState.NeedSupport)
          {
            //args.Display.DrawDottedLine(line, c);
            args.Display.DrawPatternedLine(line, c, 0, thickness);
          }
        }
      }
    }
  }

  private int VoxelStateToThickness(BuildState state)
  {
    switch (state)
    {
      case BuildState.Deployed: return 2;
      case BuildState.PendingToDeploy: return 1;
      case BuildState.NeedSupport: return 1;
      case BuildState.Removed: return 0;
      default: return 0;
    }
  }

  private Color VoxelTypeToColor(VoxelType type)
  {
    switch (type)
    {
      case VoxelType.Structure: return Color.FromArgb(255, 80, 200, 100);   // green;
      case VoxelType.Support: return Color.FromArgb(255, 150, 150, 220);  // blue-gray
      case VoxelType.Base: return Color.FromArgb(255, 220, 200, 60);   // yellow
      default: return Color.White;
    }
  }

  private Color TintVoxelColorToBuildState(Color baseColor, BuildState state)
  {
    switch (state)
    {
      case BuildState.Deployed:
        return TintColor(baseColor, 0.3f); // darkens
      case BuildState.PendingToDeploy:
        return TintColor(baseColor, 0.6f); // lighter
      case BuildState.NeedSupport:
        return TintColor(baseColor, 0.3f);
      case BuildState.Removed:
        return TintColor(baseColor, 0.0f);
      default: return baseColor;
    }
  }

  private Color TintColor(Color baseColor, float factor)
  {
    // factor <1.0 darkens, factor > 1.0 lightens, clamped to 0 - 255
    int r = (int)Math.Min(255, Math.Max(0, baseColor.R * factor));
    int g = (int)Math.Min(255, Math.Max(0, baseColor.G * factor));
    int b = (int)Math.Min(255, Math.Max(0, baseColor.B * factor));
    return Color.FromArgb(baseColor.A, r, g, b);
  }

  private Dictionary<int, Color> BuildHomeColorMap(List<Color> homeColors)
  {
    List<int> homeKeys = cachedHomeBases.Keys.OrderBy(x => x).ToList();

    Dictionary<int, Color> homeColorMap = new Dictionary<int, Color>();

    for (int i = 0; i < homeKeys.Count; i++)
    {
      homeColorMap[homeKeys[i]] = homeColors[i % homeColors.Count];
    }
    return homeColorMap;
  }


  // ------------------------------------HELPER METHODS------------------------------------
  private Mesh BuildVoxelMesh(Point3d deployedPt, double structureResolution)
  {
    Plane constructionPlane = Plane.WorldXY;
    Interval x = new Interval(deployedPt.X - structureResolution / 2, deployedPt.X + structureResolution / 2);
    Interval y = new Interval(deployedPt.Y - structureResolution / 2, deployedPt.Y + structureResolution / 2);
    Interval z = new Interval(deployedPt.Z - structureResolution / 2, deployedPt.Z + structureResolution / 2);
    Box newVoxel = new Box(constructionPlane, x, y, z);
    Brep brep = newVoxel.ToBrep();

    Rhino.Geometry.Mesh unifiedMesh = new Rhino.Geometry.Mesh();
    var meshArray = Rhino.Geometry.Mesh.CreateFromBrep(brep, MeshingParameters.FastRenderMesh);
    foreach (var mesh in meshArray)
    {
      unifiedMesh.Append(mesh);
    }
    unifiedMesh.Weld(Math.PI);
    unifiedMesh.Compact();

    return unifiedMesh;

  }

  private Tuple<Point3d[], int[,]> BuildVoxelWireFrames(Point3d midPt)
  {
    double voxelHalf = cachedStructuralResolution * 0.5;

    Vector3d to1 = new Vector3d(-voxelHalf, -voxelHalf, -voxelHalf);
    Vector3d to2 = new Vector3d(voxelHalf, -voxelHalf, -voxelHalf);
    Vector3d to3 = new Vector3d(voxelHalf, voxelHalf, -voxelHalf);
    Vector3d to4 = new Vector3d(-voxelHalf, voxelHalf, -voxelHalf);
    Vector3d to5 = new Vector3d(-voxelHalf, -voxelHalf, voxelHalf);
    Vector3d to6 = new Vector3d(voxelHalf, -voxelHalf, voxelHalf);
    Vector3d to7 = new Vector3d(voxelHalf, voxelHalf, voxelHalf);
    Vector3d to8 = new Vector3d(-voxelHalf, voxelHalf, voxelHalf);

    // if deployed, what color; if occupied, what color; if need support, what color, if pending, what color
    Point3d pt1 = midPt + to1;
    Point3d pt2 = midPt + to2;
    Point3d pt3 = midPt + to3;
    Point3d pt4 = midPt + to4;
    Point3d pt5 = midPt + to5;
    Point3d pt6 = midPt + to6;
    Point3d pt7 = midPt + to7;
    Point3d pt8 = midPt + to8;

    Point3d[] corners = new Point3d[] {
      pt1, pt2, pt3, pt4,
      pt5, pt6, pt7, pt8
      };


    int[,] edges = new int[,]
      {
      // bottom face
      {0, 1}, {1, 2}, {2, 3 }, {3, 0 },
      // top face
      {4, 5 }, {5, 6 }, {6, 7 }, {7, 4 },
      // verticals
      {0, 4 }, {1, 5 }, {2, 6 }, {3, 7 }
      };

    return Tuple.Create(corners, edges);
  }

  //--------------------------------------------------HELPER METHODS--------------------------------------------------


  // HELPERS TO LOAD / UPDATE TARGETS AND LOAD HOMEBASES
  private Dictionary<int, TargetData> LoadTargets(CartesianEnvironment env)
  {
    if (!env.CustomData.ContainsKey(EnvironmentKeys.Targets))
    {
      return new Dictionary<int, TargetData>();
    }

    object rawTargets = env.CustomData[EnvironmentKeys.Targets];
    if (rawTargets == null)
    {
      return new Dictionary<int, TargetData>();
    }

    System.Collections.IDictionary targetsDict = (System.Collections.IDictionary)rawTargets;
    Dictionary<int, TargetData> allTargets = new Dictionary<int, TargetData>();

    foreach (System.Collections.DictionaryEntry entry in targetsDict)
    {
      int key = (int)entry.Key;
      object[] data = (object[])entry.Value;

      allTargets[key] = new TargetData(
        (int)data[0],
        (int[])data[1],
        (double)data[2],
        (int[])data[3]
        );
    }

    return allTargets;
  }


  private Dictionary<int, HomeBaseData> LoadHomeBaseData(CartesianEnvironment env)
  {
    var allHomes = new Dictionary<int, HomeBaseData>();

    if (!env.CustomData.ContainsKey(EnvironmentKeys.HomeBases))
    {
      return allHomes;
    }

    object rawHomeBases = env.CustomData[EnvironmentKeys.HomeBases];
    if (rawHomeBases == null)
    {
      return allHomes;
    }

    IDictionary homeBaseDic = (IDictionary)rawHomeBases;
    foreach (DictionaryEntry entry in homeBaseDic)
    {
      int homeIndex = (int)entry.Key;
      object[] data = (object[])entry.Value;
      Point3d homePt = (Point3d)data[0];
      Point3d materialPickUpSpot = (Point3d)data[1];
      Vector3d materialPickUpDir = (Vector3d)data[2];
      Point3d firstWaitingSpot = (Point3d)data[3];
      Vector3d waitingDir = (Vector3d)data[4];


      allHomes[homeIndex] = new HomeBaseData(homePt, materialPickUpSpot, materialPickUpDir, firstWaitingSpot, waitingDir);
    }

    return allHomes;
  }


  //--------------------------------------------------SUPPORTING CLASS FOR AGENT --------------------------------------------------

  public enum WorkState
  {
    Idle,        // At start, deciding next task
    Assemble,    // Building a structure point
    Disassemble, // Removing a support for reuse
    Remove,      // Removing base/raft
    Return       // Returning to start position
  }

  public enum HomeStatus
  {
    Occupying,        // agent is occupying its home base
    Waiting,
    InField      // agent is in the field working
  }

  public enum CollisionType
  {
    HeadOn, // A.next == B.next  (both moving toward same node)
    Swap, // A.current == B.next  AND  B.current == A.next
    Static, // A.next == B.current  AND  B has no next step
    Trailing, // A.next == B.current  AND  B has a next step && B has not run yet this tick (B.Id > A.Id)
    Other // no collision or other collisions that I could miss
  }


  public class CollisionData
  {
    // at agent's given step, it may collide with a colldingAgent at a colldingBlock for a collisionType
    public Dictionary<int, Tuple<List<int>, CollisionType>> PerAgentCollisions;
    // collidingAgentId -> (conflictBlocks, collisionType)

    public CollisionData()
    {
      PerAgentCollisions = new Dictionary<int, Tuple<List<int>, CollisionType>>();
    }

    public void Add(int collidingAgentID, List<int> collidingBlocks, CollisionType collisionType)
    {
      PerAgentCollisions[collidingAgentID] = Tuple.Create(collidingBlocks, collisionType);
    }

    public bool HasCollisions()
    {
      return PerAgentCollisions.Count != 0;
    }

    public int CollisionCountPerStep()
    {
      int count = 0;
      foreach (var kvp in PerAgentCollisions)
      {
        int colldingAgentID = kvp.Key;
        var collision = kvp.Value;
        List<int> conflictBlocks = collision.Item1;
        if (colldingAgentID > 0 && conflictBlocks.Count > 0) count++;
      }

      return count;
    }

    private bool HasAnyWaitRequriedCollision()
    {
      foreach (var kvp in PerAgentCollisions)
      {
        CollisionType type = kvp.Value.Item2;
        if (type == CollisionType.HeadOn
          || type == CollisionType.Static
          || type == CollisionType.Trailing)
        {
          return true;
        }
      }
      return false;
    }

    private bool HasSwapCollisions()
    {
      foreach (var kvp in PerAgentCollisions)
      {
        if (kvp.Value.Item2 != CollisionType.Swap) return false;
      }
      return true;
    }
  }

  public static class AgentKeys
  {
    public static readonly string WorkState = "WorkState";
    public static readonly string Target = "target";
    public static readonly string Path = "path";
    public static readonly string CurrentStep = "currentStep";
    public static readonly string Orientation = "orientation";
    public static readonly string EntertheField = "entertheField";
    public static readonly string ExtendArm = "extendArm";
    public static readonly string PrevState = "previousWorkState";
    public static readonly string ShouldMoveForward = "shouldMoveForward";
    public static readonly string Position = "position";
    public static readonly string HasMaterial = "hasMaterial";
    public static readonly string HomeBase = "homeIndex"; // which home index is assigned to the agent
    public static readonly string CurrentHome = "currentHome"; // the temporary home the agent is current occupying or returning to or waiting at
    public static readonly string DeadLockTicks = "deadlockTicks"; // how many ticks have passed when agent is not moving. If passing a threshold, agent needs to replanning a path or task
  }



  //--------------------------------------------------SUPPORTING CLASS FOR ENVIRONMENT--------------------------------------------------

  public enum BuildState
  {
    Deployed, // Successfully built and placed
    PendingToDeploy, //  Can be built, no dependencies blocking
    NeedSupport, // Has dependencies blocking, can't build yet
    Removed  // Was deployed, now removed (for supports/base)
  }

  public enum VoxelType
  {
    Structure,
    Support,
    Base
  }

  // used for path finding with A*
  public class TargetData
  {
    public int TargetIndex;
    public int[] Path; // path from agent index to target index
    public double Cost;
    public int[] ReservedBy; // reserved by agentIds, here HashSet is better than list
    public TargetData(int targetIndex, int[] path, double cost, int[] reservedBy)
    {
      this.TargetIndex = targetIndex;
      this.Path = path;
      this.Cost = cost;
      this.ReservedBy = reservedBy;
    }
  }


  public class HomeBaseData
  {
    // static state data
    public Point3d HomeBasePt; // the list of these home base points
    public Point3d MaterialPickUpPt; // the list of the material pick up locations for each home base
    public Vector3d MaterialPickUpDir; // the list of the material pick up directions at each home base
    public Point3d FirstWaitingSpot; // the waiting line for agents who exit the field, [0] = first waiting spot, [1] = second, etc.
    public Vector3d WaitingDir;

    // dynamic state -chagnes as agents arrive/leave
    public int OccupyingAgentId; // -1 if the home base is free
    public Queue<int> WaitingQueue; // agent IDs waiting in line, in order
    public HomeBaseData(Point3d homeBasePt, Point3d materialPickUpPt, Vector3d materialPickUpDir, Point3d firstWaitingSpot, Vector3d waitingDir)
    {
      this.HomeBasePt = homeBasePt;
      this.MaterialPickUpPt = materialPickUpPt;
      this.MaterialPickUpDir = materialPickUpDir;
      this.FirstWaitingSpot = firstWaitingSpot;
      this.WaitingDir = waitingDir;
      this.OccupyingAgentId = -1;
      this.WaitingQueue = new Queue<int>();
    }

    public bool IsOccupied()
    {
      if (OccupyingAgentId != -1)
      {
        return true;
      }
      else
      {
        return false;
      }
    }

    public Point3d GetWaitingSpotFor(int agentId)
    {
      // returns which physical spot this agent should stand at
      if (WaitingQueue.Count == 0) return WaitingDir + HomeBasePt;

      int waitingLineIndex = 0;
      for (int i = 0; i < WaitingQueue.Count; i++)
      {
        int id = WaitingQueue.ElementAt(i);
        if (id == agentId)
        {
          Point3d waitingSpot = WaitingDir * (i + 1) + HomeBasePt;
          return waitingSpot;
        }
        waitingLineIndex++;
        if (waitingLineIndex >= WaitingQueue.Count) break;
      }
      // overflow to last spot
      Point3d lastAvailbleSpot = WaitingDir * (WaitingQueue.Count + 1) + HomeBasePt;
      return lastAvailbleSpot;
    }


  }

  // class to store the keys for the CustomData
  public static class EnvironmentKeys
  {
    public const string BuildState = "BuildState"; // List<BuildState>: "deployed", "needSP", "pendingToDeploy"
    public const string VoxelType = "VoxelType"; //List<VoxelType>: "Structure", "Support", "Base"
    public const string ReadyToDeploy = "ReadyToDeploy"; // List<int>: strucutre points that are a) pendingToDeploy, b) at least one neighbor is deployed
    public const string Targets = "Targets"; //Dictionary<int, TargetData>: for agent's path finding. What's in Targets come from ReadyToDeploy; Targets specifically for points to be assembled
    public const string Deployed = "Deployed"; // pointIndex in HashSet<int> according to allCloud, saved to Deployed
    public const string PToSp = "PToSp"; // dictionary<intA, intB>: structural pointA needs support pointB as support
    public const string SpToP = "SpToP"; // dictionary<intA, List<int>>: support pointA supports all this list of structural points
    public const string SpDic = "SpDic"; // dictionary<intA, list<int>>: support top pointA leads the vertical support column
    public const string BindP = "BindP"; // dictionary<intA, intB>: structural pointA needs structural pointB to be built first
    public const string BindL = "BindL"; // dictionary<intA, List<int>>: structural pointA suuports all this list of structural points
    public const string Disassembled = "Disassembled"; // List<int>
    public const string AllowDisassemble = "AllowDisassemble"; // List<int>
    public const string Basement = "Basement"; // List<int>
    public const string AllCloud = "AllCloud";  // PointCloud
    public const string AdjacencyMap = "AdjacencyMap"; // Dictionary <int, List<int>>, each point's neighbors
    public const string StructuralResolution = "StructuralResolution";
    public const string SystemReset = "SystemReset";
    public const string HomeBases = "homeBases";
    public const string ActivePath = "activePath"; // path is to track which points are being occupied by the agent, which is also used for collision detection
    public const string RaftZones = "raftZones"; // assign each raft to a zone that is closer to a home
    public const string RaftRemovers = "raftRemovers"; // track who become the active raft removers and return to which home

  }

  // Class to visualize agent's travel path progress
  private struct PathSegment
  {
    public Line Line;
    public double Brightness; // 0.0 = dim (not yet traveled), 1.0 = fully bright (completed path step)
  }
# ---------- end structure_visualizer ----------
debug_inspector = CSharpScript(
    iDebugMode=toggle_2,
    iAgentSystem=solver.AllAgentSystems,
    Reference="C:\Users\siennasun513\AppData\Roaming\McNeel\Rhinoceros\packages\7.0\ABxM-Core\1.7.0\ABxM.Core.dll")  # -> out, oDeployedIndices, oRemovedIndices, oBuildStates, oVoxelTypes, oReadyToDeploy, oPendingToDeploy, oNeedSupport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; inputs iDebugMode: Boolean
# ---------- debug_inspector: C# ----------
    try
    {
      if (iDebugMode) RhinoApp.WriteLine("=== POST-PROCESSING: DEBUG INSPECTOR START ===");

      // DEBUGGING LOGS
      if (iAgentSystem == null)
      {
        RhinoApp.WriteLine("WARNING: iAgentSystem is NULL - skipping this frame");
        return;
      }

      // ✅ Try to cast and handle gracefully if it fails
      CartesianAgentSystem assemblySystem = iAgentSystem as CartesianAgentSystem;

      if (assemblySystem == null)
      {
        RhinoApp.WriteLine("WARNING: iAgentSystem is not CartesianAgentSystem (type: " +
          iAgentSystem.GetType().Name + ") - skipping this frame");
        return;  // ← Just skip this frame, don't crash!
      }

      if (iDebugMode) RhinoApp.WriteLine("POST: assemblySystem cast successful");


      if (assemblySystem.Agents == null)
      {
        RhinoApp.WriteLine("ERROR: assemblySystem.Agents is NULL!");
        return;
      }



      List<CartesianAgent> allAgents = new List<CartesianAgent>();
      int agentCount = 0;
      foreach (var agent in assemblySystem.Agents)
      {
        if (agent == null)
        {
          RhinoApp.WriteLine("ERROR: Agent at ID " + agent.Id + " is NULL!");
          agentCount++;
          continue;
        }

        CartesianAgent cartAgent = agent as CartesianAgent;
        if (cartAgent == null)
        {
          RhinoApp.WriteLine("ERROR: Agent at ID " + agent.Id + " failed to cast to CartesianAgent!");
          agentCount++;
          continue;
        }

        allAgents.Add(cartAgent);
        agentCount++;

      }
      if (iDebugMode) RhinoApp.WriteLine("POST: Successfully loaded " + allAgents.Count + " agents");

      CartesianEnvironment assemblyEnv = assemblySystem.CartesianEnvironment;


      // Check for environment keys:
      string[] environmentKeys = {
        EnvironmentKeys.VoxelType, EnvironmentKeys.BuildState, EnvironmentKeys.AllCloud,
        EnvironmentKeys.ReadyToDeploy, EnvironmentKeys.StructuralResolution, EnvironmentKeys.Targets,
        EnvironmentKeys.Deployed, EnvironmentKeys.PToSp, EnvironmentKeys.SpToP, EnvironmentKeys.SpDic,
        EnvironmentKeys.BindP, EnvironmentKeys.BindL, EnvironmentKeys.Disassembled, EnvironmentKeys.AllowDisassemble,
        EnvironmentKeys.Basement, EnvironmentKeys.AllCloud, EnvironmentKeys.AdjacencyMap,
        EnvironmentKeys.SystemReset, EnvironmentKeys.HomeBases
        };

      foreach (string key in environmentKeys)
      {
        if (!assemblyEnv.CustomData.ContainsKey(key))
        {
          RhinoApp.WriteLine("WARNING: Key '" + key + "' not ready yet, skipping frame");
          return;
        }
      }


      // GET DATA FROM ENVIRONMENT
      List<int> voxelTypeInts = (List<int>)assemblyEnv.CustomData[EnvironmentKeys.VoxelType];
      List<VoxelType> voxelTypes = voxelTypeInts.Select(i => (VoxelType)i).ToList();
      List<int> buildStateInts = (List<int>)assemblyEnv.CustomData[EnvironmentKeys.BuildState];
      List<BuildState> buildStates = buildStateInts.Select(i => (BuildState)i).ToList();
      PointCloud allCloud = (PointCloud)assemblyEnv.CustomData[EnvironmentKeys.AllCloud];
      HashSet<int> disassembled = (HashSet<int>)assemblyEnv.CustomData[EnvironmentKeys.Disassembled];
      HashSet<int> allowDisassemble = (HashSet<int>)assemblyEnv.CustomData[EnvironmentKeys.AllowDisassemble];
      HashSet<int> deployed = (HashSet<int>)assemblyEnv.CustomData[EnvironmentKeys.Deployed];
      HashSet<int> readyToDeploy = (HashSet<int>)assemblyEnv.CustomData[EnvironmentKeys.ReadyToDeploy];
      double structuralResolution = (double)assemblyEnv.CustomData[EnvironmentKeys.StructuralResolution];
      Dictionary<int, TargetData> allTargets = LoadTargets(assemblyEnv);

      Dictionary<int, List<int>> activePathDict = (Dictionary<int, List<int>>)assemblyEnv.CustomData[EnvironmentKeys.ActivePath];
      HashSet<int> activePathSet = new HashSet<int> { 0 };
      foreach (var kvp in activePathDict)
      {
        List<int> path = kvp.Value;
        foreach (int p in path)
        {
          if (!activePathSet.Contains(p)) activePathSet.Add(p);
        }
      }

      // CACHE ALLCLOUDPOINTS
      List<Point3d> allPoints = new List<Point3d>();
      for (int i = 0; i < allCloud.Count; i++)
      {
        allPoints.Add(allCloud[i].Location);
      }


      // TRACK STRUCTURE PROGRESS FOR VISUAL
      List<int> allDeployedIndices = new List<int>();
      List<int> allRemovedIndices = new List<int>();
      List<Point3d> pendingToDeploy = new List<Point3d>();
      List<Point3d> needSupport = new List<Point3d>();

      for (int i = 0; i < deployed.Count; i++)
      {
        int pointIndex = deployed.ElementAt(i);

        if (!allDeployedIndices.Contains(pointIndex))
        {
          allDeployedIndices.Add(pointIndex);
        }
      }

      foreach (int i in disassembled)
      {
        if (!allRemovedIndices.Contains(i))
        {
          allRemovedIndices.Add(i);
        }
      }

      for (int i = 0; i < allPoints.Count; i++)
      {
        if (buildStates[i] == BuildState.PendingToDeploy)
        {
          pendingToDeploy.Add(allPoints[i]);
        }
        else if (buildStates[i] == BuildState.NeedSupport)
        {
          needSupport.Add(allPoints[i]);
        }
      }


      oDeployedIndices = allDeployedIndices;
      oRemovedIndices = allRemovedIndices;
      oPendingToDeploy = pendingToDeploy;
      oReadyToDeploy = readyToDeploy.ToList();
      oNeedSupport = needSupport;
      oOccupied = activePathSet.ToList();
      oTargets = allTargets;
      oAllowDisassemble = allowDisassemble;
      oBuildStates = buildStates;
      oVoxelTypes = voxelTypes;


      if (iDebugMode) RhinoApp.WriteLine("=== POST-PROCESSING: DEBUG INSPECTOR COMPLETE ===");
    }
    catch (Exception ex)
    {
      RhinoApp.WriteLine("FATAL POST-PROCESSING: DEBUG INSPECTOR ERROR: " + ex.Message);
      if (iDebugMode) RhinoApp.WriteLine("STACK: " + ex.StackTrace);
    }
# ---------- debug_inspector: C# additional code ----------
  //--------------------------------------------------HELPER METHODS--------------------------------------------------


  // HELPERS TO LOAD / UPDATE TARGETS AND LOAD HOMEBASES
  private Dictionary<int, TargetData> LoadTargets(CartesianEnvironment env)
  {
    if (!env.CustomData.ContainsKey(EnvironmentKeys.Targets))
    {
      return new Dictionary<int, TargetData>();
    }

    object rawTargets = env.CustomData[EnvironmentKeys.Targets];
    if (rawTargets == null)
    {
      return new Dictionary<int, TargetData>();
    }

    System.Collections.IDictionary targetsDict = (System.Collections.IDictionary)rawTargets;
    Dictionary<int, TargetData> allTargets = new Dictionary<int, TargetData>();

    foreach (System.Collections.DictionaryEntry entry in targetsDict)
    {
      int key = (int)entry.Key;
      object[] data = (object[])entry.Value;

      allTargets[key] = new TargetData(
        (int)data[0],
        (int[])data[1],
        (double)data[2],
        (int[])data[3]
        );
    }

    return allTargets;
  }


  private Dictionary<int, HomeBaseData> LoadHomeBaseData(CartesianEnvironment env)
  {
    var allHomes = new Dictionary<int, HomeBaseData>();

    if (!env.CustomData.ContainsKey(EnvironmentKeys.HomeBases))
    {
      return allHomes;
    }

    object rawHomeBases = env.CustomData[EnvironmentKeys.HomeBases];
    if (rawHomeBases == null)
    {
      return allHomes;
    }

    IDictionary homeBaseDic = (IDictionary)rawHomeBases;
    foreach (DictionaryEntry entry in homeBaseDic)
    {
      int homeIndex = (int)entry.Key;
      object[] data = (object[])entry.Value;
      Point3d homePt = (Point3d)data[0];
      Point3d materialPickUpSpot = (Point3d)data[1];
      Vector3d materialPickUpDir = (Vector3d)data[2];
      Point3d firstWaitingSpot = (Point3d)data[3];
      Vector3d waitingDir = (Vector3d)data[4];


      allHomes[homeIndex] = new HomeBaseData(homePt, materialPickUpSpot, materialPickUpDir, firstWaitingSpot, waitingDir);
    }

    return allHomes;
  }


  //--------------------------------------------------SUPPORTING CLASS FOR AGENT --------------------------------------------------

  public enum WorkState
  {
    Idle,        // At start, deciding next task
    Assemble,    // Building a structure point
    Disassemble, // Removing a support for reuse
    Remove,      // Removing base/raft
    Return       // Returning to start position
  }

  public enum HomeStatus
  {
    Occupying,        // agent is occupying its home base
    Waiting,
    InField      // agent is in the field working
  }

  public enum CollisionType
  {
    HeadOn, // A.next == B.next  (both moving toward same node)
    Swap, // A.current == B.next  AND  B.current == A.next
    Static, // A.next == B.current  AND  B has no next step
    Trailing, // A.next == B.current  AND  B has a next step && B has not run yet this tick (B.Id > A.Id)
    Other // no collision or other collisions that I could miss
  }


  public class CollisionData
  {
    // at agent's given step, it may collide with a colldingAgent at a colldingBlock for a collisionType
    public Dictionary<int, Tuple<List<int>, CollisionType>> PerAgentCollisions;
    // collidingAgentId -> (conflictBlocks, collisionType)

    public CollisionData()
    {
      PerAgentCollisions = new Dictionary<int, Tuple<List<int>, CollisionType>>();
    }

    public void Add(int collidingAgentID, List<int> collidingBlocks, CollisionType collisionType)
    {
      PerAgentCollisions[collidingAgentID] = Tuple.Create(collidingBlocks, collisionType);
    }

    public bool HasCollisions()
    {
      return PerAgentCollisions.Count != 0;
    }

    public int CollisionCountPerStep()
    {
      int count = 0;
      foreach (var kvp in PerAgentCollisions)
      {
        int colldingAgentID = kvp.Key;
        var collision = kvp.Value;
        List<int> conflictBlocks = collision.Item1;
        if (colldingAgentID > 0 && conflictBlocks.Count > 0) count++;
      }

      return count;
    }

    private bool HasAnyWaitRequriedCollision()
    {
      foreach (var kvp in PerAgentCollisions)
      {
        CollisionType type = kvp.Value.Item2;
        if (type == CollisionType.HeadOn
          || type == CollisionType.Static
          || type == CollisionType.Trailing)
        {
          return true;
        }
      }
      return false;
    }

    private bool HasSwapCollisions()
    {
      foreach (var kvp in PerAgentCollisions)
      {
        if (kvp.Value.Item2 != CollisionType.Swap) return false;
      }
      return true;

    }
  }


  public static class AgentKeys
  {
    public static readonly string WorkState = "WorkState";
    public static readonly string Target = "target";
    public static readonly string Path = "path";
    public static readonly string CurrentStep = "currentStep";
    public static readonly string Orientation = "orientation";
    public static readonly string EntertheField = "entertheField";
    public static readonly string ExtendArm = "extendArm";
    public static readonly string PrevState = "previousWorkState";
    public static readonly string ShouldMoveForward = "shouldMoveForward";
    public static readonly string Position = "position";
    public static readonly string HasMaterial = "hasMaterial";
    public static readonly string HomeBase = "homeIndex"; // which home index is assigned to the agent
    public static readonly string CurrentHome = "currentHome"; // the temporary home the agent is current occupying or returning to or waiting at
    public static readonly string DeadLockTicks = "deadlockTicks"; // how many ticks have passed when agent is not moving. If passing a threshold, agent needs to replanning a path or task

  }



  //--------------------------------------------------SUPPORTING CLASS FOR ENVIRONMENT--------------------------------------------------

  public enum BuildState
  {
    Deployed, // Successfully built and placed
    PendingToDeploy, //  Can be built, no dependencies blocking
    NeedSupport, // Has dependencies blocking, can't build yet
    Removed  // Was deployed, now removed (for supports/base)
  }

  public enum VoxelType
  {
    Structure,
    Support,
    Base
  }

  // used for path finding with A*
  public class TargetData
  {
    public int TargetIndex;
    public int[] Path; // path from agent index to target index
    public double Cost;
    public int[] ReservedBy; // reserved by agentIds, here HashSet is better than list
    public TargetData(int targetIndex, int[] path, double cost, int[] reservedBy)
    {
      this.TargetIndex = targetIndex;
      this.Path = path;
      this.Cost = cost;
      this.ReservedBy = reservedBy;
    }
  }


  public class HomeBaseData
  {
    // static state data
    public Point3d HomeBasePt; // the list of these home base points
    public Point3d MaterialPickUpPt; // the list of the material pick up locations for each home base
    public Vector3d MaterialPickUpDir; // the list of the material pick up directions at each home base
    public Point3d FirstWaitingSpot; // the waiting line for agents who exit the field, [0] = first waiting spot, [1] = second, etc.
    public Vector3d WaitingDir;

    // dynamic state -chagnes as agents arrive/leave
    public int OccupyingAgentId; // -1 if the home base is free
    public Queue<int> WaitingQueue; // agent IDs waiting in line, in order
    public HomeBaseData(Point3d homeBasePt, Point3d materialPickUpPt, Vector3d materialPickUpDir, Point3d firstWaitingSpot, Vector3d waitingDir)
    {
      this.HomeBasePt = homeBasePt;
      this.MaterialPickUpPt = materialPickUpPt;
      this.MaterialPickUpDir = materialPickUpDir;
      this.FirstWaitingSpot = firstWaitingSpot;
      this.WaitingDir = waitingDir;
      this.OccupyingAgentId = -1;
      this.WaitingQueue = new Queue<int>();
    }

    public bool IsOccupied()
    {
      if (OccupyingAgentId != -1)
      {
        return true;
      }
      else
      {
        return false;
      }
    }

    public Point3d GetWaitingSpotFor(int agentId)
    {
      // returns which physical spot this agent should stand at
      if (WaitingQueue.Count == 0) return WaitingDir + HomeBasePt;

      int waitingLineIndex = 0;
      for (int i = 0; i < WaitingQueue.Count; i++)
      {
        int id = WaitingQueue.ElementAt(i);
        if (id == agentId)
        {
          Point3d waitingSpot = WaitingDir * (i + 1) + HomeBasePt;
          return waitingSpot;
        }
        waitingLineIndex++;
        if (waitingLineIndex >= WaitingQueue.Count) break;
      }
      // overflow to last spot
      Point3d lastAvailbleSpot = WaitingDir * (WaitingQueue.Count + 1) + HomeBasePt;
      return lastAvailbleSpot;
    }


  }

  // class to store the keys for the CustomData
  public static class EnvironmentKeys
  {
    public const string BuildState = "BuildState"; // List<BuildState>: "deployed", "needSP", "pendingToDeploy"
    public const string VoxelType = "VoxelType"; //List<VoxelType>: "Structure", "Support", "Base"
    public const string ReadyToDeploy = "ReadyToDeploy"; // List<int>: strucutre points that are a) pendingToDeploy, b) at least one neighbor is deployed
    public const string Targets = "Targets"; //Dictionary<int, TargetData>: for agent's path finding. What's in Targets come from ReadyToDeploy; Targets specifically for points to be assembled
    public const string Deployed = "Deployed"; // pointIndex in HashSet<int> according to allCloud, saved to Deployed
    public const string PToSp = "PToSp"; // dictionary<intA, intB>: structural pointA needs support pointB as support
    public const string SpToP = "SpToP"; // dictionary<intA, List<int>>: support pointA supports all this list of structural points
    public const string SpDic = "SpDic"; // dictionary<intA, list<int>>: support top pointA leads the vertical support column
    public const string BindP = "BindP"; // dictionary<intA, intB>: structural pointA needs structural pointB to be built first
    public const string BindL = "BindL"; // dictionary<intA, List<int>>: structural pointA suuports all this list of structural points
    public const string Disassembled = "Disassembled"; // List<int>
    public const string AllowDisassemble = "AllowDisassemble"; // List<int>
    public const string Basement = "Basement"; // List<int>
    public const string AllCloud = "AllCloud";  // PointCloud
    public const string AdjacencyMap = "AdjacencyMap"; // Dictionary <int, List<int>>, each point's neighbors
    public const string StructuralResolution = "StructuralResolution";
    public const string SystemReset = "SystemReset";
    public const string HomeBases = "homeBases";
    public const string ActivePath = "activePath"; // path is to track which points are being occupied by the agent, which is also used for collision detection
    public const string RaftZones = "raftZones"; // assign each raft to a zone that is closer to a home
    public const string RaftRemovers = "raftRemovers"; // track who become the active raft removers and return to which home

  }

  // Class to visualize agent's travel path progress
  private struct PathSegment
  {
    public Line Line;
    public double Brightness; // 0.0 = dim (not yet traveled), 1.0 = fully bright (completed path step)
  }
# ---------- end debug_inspector ----------
agent_visualizer = CSharpScript(
    iDebugMode=toggle_2,
    iAgentSystem=solver.AllAgentSystems,
    iAgentColors=gradient,
    Reference="C:\Users\siennasun513\AppData\Roaming\McNeel\Rhinoceros\packages\7.0\ABxM-Core\1.7.0\ABxM.Core.dll")  # -> out, oRobotAgents, oRobotPositionIndex, oRobotPositions, oRobotOrientations, oRobotTargets; inputs iDebugMode: Boolean, iAgentColors: list of Color
# ---------- agent_visualizer: C# usings ----------
using ABxM.Core.Agent;
using ABxM.Core.AgentSystem;
using ABxM.Core.Environments;
using Rhino.Display;
using System.Drawing;
using System.Linq;
# ---------- agent_visualizer: C# ----------
    try
    {
      if (iDebugMode) RhinoApp.WriteLine("=== POST-PROCESSING: AGENT VISUALIZER START ===");

      CartesianAgentSystem assemblySystem = iAgentSystem as CartesianAgentSystem;

      List<CartesianAgent> allAgents = new List<CartesianAgent>();
      foreach (var agent in assemblySystem.Agents)
      {
        if (agent == null) continue;
        CartesianAgent cartAgent = agent as CartesianAgent;
        if (cartAgent == null) continue;
        allAgents.Add(cartAgent);
      }

      CartesianEnvironment assemblyEnv = assemblySystem.CartesianEnvironment;


      // GET DATA FROM ENVIRONMENT
      PointCloud allCloud = (PointCloud)assemblyEnv.CustomData[EnvironmentKeys.AllCloud];
      double structuralResolution = (double)assemblyEnv.CustomData[EnvironmentKeys.StructuralResolution];
      cachedStructuralResolution = structuralResolution;

      List<Point3d> allPoints = new List<Point3d>();
      for (int i = 0; i < allCloud.Count; i++)
      {
        allPoints.Add(allCloud[i].Location);
      }
      allCloudPoints = allPoints;
      if (iDebugMode) RhinoApp.WriteLine("allCloudPoints are being populated. The number of all cloud is " + allCloudPoints.Count);

      // CACHE HOMES
      Dictionary<int, HomeBaseData> homeBases = LoadHomeBaseData(assemblyEnv);
      if (cachedHomeBases.Count != homeBases.Count)
      {
        cachedHomeBases = homeBases;
        List<Color> homeC = new List<Color> { Color.Red };
        //List<Color> homeC = iHomeColors;
        cachedHomeColorMap = BuildHomeColorMap(homeC);
      }



      // VISUALIZE AGENTS
      List<Mesh> agentMeshList = new List<Mesh>();
      List<Color> agentColorList = new List<Color>();
      List<WorkState> agentStateList = new List<WorkState>();
      List<Point3d> agentPositions = new List<Point3d>();
      List<int> agentPositionIndices = new List<int> { };
      List<Vector3d> agentDirections = new List<Vector3d>();
      List<int> agentTargets = new List<int>();
      foreach (var agent in allAgents)
      {
        Point3d agentPos = agent.Position;
        Vector3d agentDir = Vector3d.XAxis;
        int target = -1;
        bool extendArm = false;
        bool hasMaterial = false;
        bool canEnterTheField = false;
        WorkState agentState = WorkState.Idle;
        int assignedHome = -1;
        Color robotColor = Color.Gray;
        string agentMovementKeys = "Agent " + agent.Id + " Position";
        if (assemblyEnv.CustomData.ContainsKey(agentMovementKeys))
        {
          if (iDebugMode) RhinoApp.WriteLine("Environment contains agentMovementKeys");
          Dictionary<string, object> agentMovements = (Dictionary<string, object>)assemblyEnv.CustomData[agentMovementKeys];
          agentDir = (Vector3d)agentMovements["Orientation"];
          agentPos = (Point3d)agentMovements["Position"];

          object targetObj = agentMovements.ContainsKey("Target")
            ? agentMovements["Target"] : null;
          target = (targetObj != null) ? (int)targetObj : -1;

          extendArm = (bool)agentMovements["ExtendArm"];
          hasMaterial = (bool)agentMovements["HasMaterial"];
          agentState = (WorkState)agentMovements["WorkState"];
          assignedHome = (int)agentMovements["HomeBase"];
          canEnterTheField = (bool)agentMovements["CanEnterTheField"];
          //robotColor = cachedHomeColorMap.ContainsKey(assignedHome) ? cachedHomeColorMap[assignedHome] : Color.Gray;
          robotColor = iAgentColors[agent.Id % iAgentColors.Count];

          agentColorList.Add(robotColor);
          agentStateList.Add(agentState);

          if (iDebugMode) RhinoApp.WriteLine("Agent " + agent.Id + " Post-Processing visualization: ExtendArm Status: " + extendArm);
          if (iDebugMode) RhinoApp.WriteLine("Agent " + agent.Id + " Post-Processing visualization: HasMaterial Status: " + hasMaterial);
          if (iDebugMode) RhinoApp.WriteLine("Agent " + agent.Id + " Post-Processing visualization: WorkState: " + agentState);
          if (iDebugMode) RhinoApp.WriteLine("Agent " + agent.Id + " Post-Processing visualization: pos from agent custom data=" + agentPos + ", index = " + ComputeCorrectPointIndex(agentPos, allCloud) + ", dir=" + agentDir);

          // calculate agent path and step for trail visualization
          int currentStep = 0;
          List<int> path = null;
          if (agentMovements.ContainsKey(AgentKeys.CurrentStep))
          {
            currentStep = (int)agentMovements[AgentKeys.CurrentStep];
          }
          if (agentMovements.ContainsKey(AgentKeys.Path))
          {
            path = (List<int>)agentMovements[AgentKeys.Path];
          }
          // clear segments when agent becomes idle (task finished)
          if (agentState == WorkState.Idle)
          {
            if (robotPathSegments.ContainsKey(agent.Id))
            {
              robotPathSegments[agent.Id].Clear();
            }
          }
          else if (path != null && path.Count >= 2 && allCloudPoints != null && allCloudPoints.Count > 0)
          {
            if (iDebugMode) RhinoApp.WriteLine("Agent " + agent.Id + " path for segments: [" +
                string.Join(", ", path) + "], count=" + path.Count);

            // rebuild segment list from current path
            var segments = new List<PathSegment>();
            for (int s = 0; s < path.Count - 1; s++)
            {
              if (path[s] < 0 || path[s] >= allCloudPoints.Count) continue;
              if (path[s + 1] < 0 || path[s + 1] >= allCloudPoints.Count) continue;
              Point3d from = allCloudPoints[path[s]];
              Point3d to = allCloudPoints[path[s + 1]];
              double brightness = (s < currentStep) ? 1.0 : 0.25; // traveled v.s. ahead
              segments.Add(new PathSegment
              {
                Line = new Line(from, to),
                Brightness = brightness
              });
            }
            robotPathSegments[agent.Id] = segments;
          }
        }

        else
        {

          RhinoApp.WriteLine("Warning: No stateKey found in Environment custom data " + agent.Id + ", using ABxM position");
        }

        try
        {
          Mesh robotMesh = BuildRobotMeshFast(agentPos, agentDir, extendArm, structuralResolution);
          // Add null check!
          if (robotMesh == null)
          {
            RhinoApp.WriteLine("ERROR: BuildRobotMesh returned NULL for Agent " + agent.Id);
            robotMesh = new Mesh();  // Use empty mesh instead
          }

          agentMeshList.Add(robotMesh);
          agentPositions.Add(agentPos);
          int agentPosIndex = -1;
          if (canEnterTheField)
          {
            agentPosIndex = ComputeCorrectPointIndex(agentPos, allCloud);
            if (allCloud[agentPosIndex].Location.DistanceTo(agentPos) > 0.01)
            {
              agentPosIndex = -1;
            }
          }

          agentPositionIndices.Add(agentPosIndex);
          agentDirections.Add(agentDir);
          agentTargets.Add(target);
        }
        catch (Exception ex)
        {

          RhinoApp.WriteLine("ERROR building mesh for Agent " + agent.Id + ": " + ex.Message);
          if (iDebugMode) RhinoApp.WriteLine("  Position: " + agentPos + ", Direction: " + agentDir);

          // Add a default/empty mesh so lists stay in sync
          agentMeshList.Add(new Mesh());
          agentPositions.Add(agentPos);
          agentDirections.Add(agentDir);
          agentTargets.Add(target);
        }
      }

      robotMeshes = agentMeshList;
      robotColors = agentColorList;
      robotStates = agentStateList;
      oRobotAgents = robotMeshes;
      oRobotPositionIndex = agentPositionIndices;
      oRobotPositions = agentPositions;
      oRobotOrientations = agentDirections;
      oRobotTargets = agentTargets;

      for (int i = 0; i < robotColors.Count; i++)
      {
        Color c = robotColors[i];
        Print("agent " + i + ", Color = " + c);
      }


      if (iDebugMode) RhinoApp.WriteLine("=== POST-PROCESSING COMPLETE ===");
    }
    catch (Exception ex)
    {

      RhinoApp.WriteLine("FATAL POST-PROCESSING: AGENT VISUALIZER ERROR: " + ex.Message);
      if (iDebugMode) RhinoApp.WriteLine("STACK: " + ex.StackTrace);
    }
# ---------- agent_visualizer: C# additional code ----------
  // ------------------------------------PERSISTENT DATA------------------------------------

  private double cachedStructuralResolution = 0.0;
  private List<Point3d> allCloudPoints = new List<Point3d>();
  private Dictionary<int, HomeBaseData> cachedHomeBases = new Dictionary<int, HomeBaseData>();
  private Dictionary<int, Color> cachedHomeColorMap = new Dictionary<int, Color>();

  private List<Mesh> robotMeshes = new List<Mesh>(); // cache memory for preview
  private List<Color> robotColors = new List<Color>();
  private List<WorkState> robotStates = new List<WorkState>(); // for state visualization
  private Dictionary<int, List<PathSegment>> robotPathSegments = new Dictionary<int, List<PathSegment>>();

  // ------------------------------------CUSTOM PREVIEW------------------------------------
  // these methods should never be run in RunScript()
  public override void DrawViewportMeshes(IGH_PreviewArgs args)
  {
    if (robotMeshes == null || robotMeshes.Count == 0) return;

    for (int i = 0; i < robotMeshes.Count; i++)
    {
      if (robotMeshes[i] == null) continue;
      WorkState state = (robotStates != null & robotStates.Count > 0) ? robotStates[i] : WorkState.Idle;
      Color agentColor = robotColors[i % robotColors.Count];
      //Color agentColor = Color.Gray;
      if (robotColors != null && i < robotColors.Count)
      {
        agentColor = robotColors[i];
      }
      //Color finalColor = TintRobotColorToWorkState(agentColor, state);
      DisplayMaterial mat = new DisplayMaterial(agentColor);
      args.Display.DrawMeshShaded(robotMeshes[i], mat);
    }
  }

  // draw home positions in labels and visualize each home's waiting line
  public override void DrawViewportWires(IGH_PreviewArgs args)
  {
    // c) agent's path trail
    if (robotPathSegments != null)
    {
      foreach (var kvp in robotPathSegments)
      {
        int agentID = kvp.Key;
        List<PathSegment> segments = kvp.Value;
        foreach (PathSegment seg in segments)
        {
          // gray from dim (brightness=0.25 → value=64) to bright (1.0 → value=220)
          int grayValue = (int)(64 + seg.Brightness * 156);
          Color segColor = Color.FromArgb(255, grayValue, grayValue, grayValue);
          int lineWeight = seg.Brightness >= 1.0 ? 2 : 1; // thicker for completed
          args.Display.DrawLine(seg.Line, segColor, lineWeight);
        }

      }

    }


  }

  private Color TintRobotColorToWorkState(Color baseColor, WorkState state)
  {
    switch (state)
    {
      case WorkState.Idle:
        return TintColor(baseColor, 0.2f, 0); // darkens
      case WorkState.Assemble:
        return TintColor(baseColor, 1.0f, 100);
      case WorkState.Disassemble:
        return TintColor(baseColor, 1.7f, 0); // lighter
      case WorkState.Remove:
        return TintColor(baseColor, 0.7f, 0);
      case WorkState.Return:
        return TintColor(baseColor, 0.5f, 0);
      default: return baseColor;
    }
  }


  private Color TintColor(Color baseColor, float factor, int extra)
  {
    // factor <1.0 darkens, factor > 1.0 lightens, clamped to 0 - 255
    int r = (int)Math.Min(255, Math.Max(0, baseColor.R * factor + extra));
    int g = (int)Math.Min(255, Math.Max(0, baseColor.G * factor + extra));
    int b = (int)Math.Min(255, Math.Max(0, baseColor.B * factor + extra));
    return Color.FromArgb(baseColor.A, r, g, b);
  }


  private Dictionary<int, Color> BuildHomeColorMap(List<Color> homeColors)
  {
    List<int> homeKeys = cachedHomeBases.Keys.OrderBy(x => x).ToList();

    Dictionary<int, Color> homeColorMap = new Dictionary<int, Color>();

    for (int i = 0; i < homeKeys.Count; i++)
    {
      homeColorMap[homeKeys[i]] = homeColors[i % homeColors.Count];
    }
    return homeColorMap;
  }


  // ------------------------------------HELPER METHODS------------------------------------

  // Build mesh fast by directly building the robot into a mesh
  private Mesh BuildRobotArmMeshFast(Point3d agentPos, Vector3d agentDir, double halfSideLength, double structureResolution)
  {
    agentDir.Unitize();
    double armLength = structureResolution - halfSideLength;
    double w = halfSideLength * 0.25; // half-width of arm section
    // build local frame perpendicular to agentDir
    // axisY and axisZ form the cross-section plane
    Vector3d axisY, axisZ;

    // Pick a reference vector not parallel to agentDir
    Vector3d reference = (Math.Abs(agentDir * Vector3d.ZAxis) < 0.99)
      ? Vector3d.ZAxis : Vector3d.XAxis;

    axisZ = Vector3d.CrossProduct(agentDir, reference);
    axisZ.Unitize();
    axisY = Vector3d.CrossProduct(agentDir, axisZ);
    axisY.Unitize();


    // arm starts at body surface, extends along agentDir
    Point3d armStart = agentPos + agentDir * halfSideLength;
    Point3d armEnd = armStart + agentDir * armLength;

    // 4 corners of start cross-section, 4 of end cross section
    Mesh armMesh = new Mesh();
    armMesh.Vertices.Add(armStart - axisY * w - axisZ * w); // 0
    armMesh.Vertices.Add(armStart + axisY * w - axisZ * w); // 1
    armMesh.Vertices.Add(armStart + axisY * w + axisZ * w); // 2
    armMesh.Vertices.Add(armStart - axisY * w + axisZ * w); // 3
    armMesh.Vertices.Add(armEnd - axisY * w - axisZ * w); // 4
    armMesh.Vertices.Add(armEnd + axisY * w - axisZ * w); // 5
    armMesh.Vertices.Add(armEnd + axisY * w + axisZ * w); // 6
    armMesh.Vertices.Add(armEnd - axisY * w + axisZ * w); // 7

    // start cap (normal faces back toward body
    armMesh.Faces.AddFace(3, 2, 1, 0);
    // end cap (normal faces away from body)
    armMesh.Faces.AddFace(4, 5, 6, 7);
    // 4 side faces
    armMesh.Faces.AddFace(0, 1, 5, 4);
    armMesh.Faces.AddFace(1, 2, 6, 5);
    armMesh.Faces.AddFace(2, 3, 7, 6);
    armMesh.Faces.AddFace(3, 0, 4, 7);

    armMesh.Normals.ComputeNormals();
    armMesh.UnifyNormals();
    return armMesh;

  }


  // Build robot mesh without using brep, which could save computation time, because calculating brep is expensive
  private Mesh BuildRobotMeshFast(Point3d agentPos, Vector3d agentDir, bool extendArm, double structureResolution)
  {
    double s = structureResolution * 0.25; // half length of the body side

    Mesh robotMesh = new Mesh();

    // a) first to build the boxy body mesh
    Mesh bodyMesh = new Mesh();

    // 8 corners of the robot body, offset from the position
    Vector3d to1 = new Vector3d(-s, -s, -s);
    Vector3d to2 = new Vector3d(s, -s, -s);
    Vector3d to3 = new Vector3d(s, s, -s);
    Vector3d to4 = new Vector3d(-s, s, -s);
    Vector3d to5 = new Vector3d(-s, -s, s);
    Vector3d to6 = new Vector3d(s, -s, s);
    Vector3d to7 = new Vector3d(s, s, s);
    Vector3d to8 = new Vector3d(-s, s, s);
    bodyMesh.Vertices.Add(agentPos + to1);
    bodyMesh.Vertices.Add(agentPos + to2);
    bodyMesh.Vertices.Add(agentPos + to3);
    bodyMesh.Vertices.Add(agentPos + to4);
    bodyMesh.Vertices.Add(agentPos + to5);
    bodyMesh.Vertices.Add(agentPos + to6);
    bodyMesh.Vertices.Add(agentPos + to7);
    bodyMesh.Vertices.Add(agentPos + to8);

    // 6 quad faces
    bodyMesh.Faces.AddFace(3, 2, 1, 0);
    bodyMesh.Faces.AddFace(4, 5, 6, 7);
    bodyMesh.Faces.AddFace(0, 4, 7, 3);
    bodyMesh.Faces.AddFace(1, 2, 6, 5);
    bodyMesh.Faces.AddFace(3, 7, 6, 2);
    bodyMesh.Faces.AddFace(0, 1, 5, 4);

    bodyMesh.Normals.ComputeNormals();
    bodyMesh.UnifyNormals();
    robotMesh.Append(bodyMesh);

    // b) then to build the arm mesh
    if (extendArm)
    {
      var armMesh = BuildRobotArmMeshFast(agentPos, agentDir, s, structureResolution);
      if (armMesh != null)
      {
        robotMesh.Append(armMesh);
      }
    }

    robotMesh.Compact();
    return robotMesh;
  }




  //--------------------------------------------------HELPER METHODS--------------------------------------------------


  // HELPERS TO LOAD / UPDATE TARGETS AND LOAD HOMEBASES
  private Dictionary<int, TargetData> LoadTargets(CartesianEnvironment env)
  {
    if (!env.CustomData.ContainsKey(EnvironmentKeys.Targets))
    {
      return new Dictionary<int, TargetData>();
    }

    object rawTargets = env.CustomData[EnvironmentKeys.Targets];
    if (rawTargets == null)
    {
      return new Dictionary<int, TargetData>();
    }

    System.Collections.IDictionary targetsDict = (System.Collections.IDictionary)rawTargets;
    Dictionary<int, TargetData> allTargets = new Dictionary<int, TargetData>();

    foreach (System.Collections.DictionaryEntry entry in targetsDict)
    {
      int key = (int)entry.Key;
      object[] data = (object[])entry.Value;

      allTargets[key] = new TargetData(
        (int)data[0],
        (int[])data[1],
        (double)data[2],
        (int[])data[3]
        );
    }

    return allTargets;
  }


  private Dictionary<int, HomeBaseData> LoadHomeBaseData(CartesianEnvironment env)
  {
    var allHomes = new Dictionary<int, HomeBaseData>();

    if (!env.CustomData.ContainsKey(EnvironmentKeys.HomeBases))
    {
      return allHomes;
    }

    object rawHomeBases = env.CustomData[EnvironmentKeys.HomeBases];
    if (rawHomeBases == null)
    {
      return allHomes;
    }

    IDictionary homeBaseDic = (IDictionary)rawHomeBases;
    foreach (DictionaryEntry entry in homeBaseDic)
    {
      int homeIndex = (int)entry.Key;
      object[] data = (object[])entry.Value;
      Point3d homePt = (Point3d)data[0];
      Point3d materialPickUpSpot = (Point3d)data[1];
      Vector3d materialPickUpDir = (Vector3d)data[2];
      Point3d firstWaitingSpot = (Point3d)data[3];
      Vector3d waitingDir = (Vector3d)data[4];


      allHomes[homeIndex] = new HomeBaseData(homePt, materialPickUpSpot, materialPickUpDir, firstWaitingSpot, waitingDir);
    }

    return allHomes;
  }

  private int ComputeCorrectPointIndex(Point3d testPt, PointCloud allCloud)
  {
    int tentativeIndex = allCloud.ClosestPoint(testPt);

    if (tentativeIndex < 0) return tentativeIndex;
    // to verify whether tentativeIndex is the correct index for the testPt
    // the reason to verify is that PointCloud.ClosestPoint() returns -1 only when the pointcloud is empty
    double tolerance = 0.1;
    Point3d pointInCloud = allCloud[tentativeIndex].Location;
    double dist = pointInCloud.DistanceTo(testPt);
    if (dist < tolerance)
    {
      return tentativeIndex;
    }
    else
    {
      return -1;
    }
  }




  //--------------------------------------------------SUPPORTING CLASS FOR AGENT --------------------------------------------------

  public enum WorkState
  {
    Idle,        // At start, deciding next task
    Assemble,    // Building a structure point
    Disassemble, // Removing a support for reuse
    Remove,      // Removing base/raft
    Return       // Returning to start position
  }

  public enum HomeStatus
  {
    Occupying,        // agent is occupying its home base
    Waiting,
    InField      // agent is in the field working
  }

  public enum CollisionType
  {
    HeadOn, // A.next == B.next  (both moving toward same node)
    Swap, // A.current == B.next  AND  B.current == A.next
    Static, // A.next == B.current  AND  B has no next step
    Trailing, // A.next == B.current  AND  B has a next step && B has not run yet this tick (B.Id > A.Id)
    Other // no collision or other collisions that I could miss
  }


  public class CollisionData
  {
    // at agent's given step, it may collide with a colldingAgent at a colldingBlock for a collisionType
    public Dictionary<int, Tuple<List<int>, CollisionType>> PerAgentCollisions;
    // collidingAgentId -> (conflictBlocks, collisionType)

    public CollisionData()
    {
      PerAgentCollisions = new Dictionary<int, Tuple<List<int>, CollisionType>>();
    }

    public void Add(int collidingAgentID, List<int> collidingBlocks, CollisionType collisionType)
    {
      PerAgentCollisions[collidingAgentID] = Tuple.Create(collidingBlocks, collisionType);
    }

    public bool HasCollisions()
    {
      return PerAgentCollisions.Count != 0;
    }

    public int CollisionCountPerStep()
    {
      int count = 0;
      foreach (var kvp in PerAgentCollisions)
      {
        int colldingAgentID = kvp.Key;
        var collision = kvp.Value;
        List<int> conflictBlocks = collision.Item1;
        if (colldingAgentID > 0 && conflictBlocks.Count > 0) count++;
      }

      return count;
    }

    private bool HasAnyWaitRequriedCollision()
    {
      foreach (var kvp in PerAgentCollisions)
      {
        CollisionType type = kvp.Value.Item2;
        if (type == CollisionType.HeadOn
          || type == CollisionType.Static
          || type == CollisionType.Trailing)
        {
          return true;
        }
      }
      return false;
    }

    private bool HasSwapCollisions()
    {
      foreach (var kvp in PerAgentCollisions)
      {
        if (kvp.Value.Item2 != CollisionType.Swap) return false;
      }
      return true;
    }
  }

  public static class AgentKeys
  {
    public static readonly string WorkState = "WorkState";
    public static readonly string Target = "target";
    public static readonly string Path = "path";
    public static readonly string CurrentStep = "currentStep";
    public static readonly string Orientation = "orientation";
    public static readonly string EntertheField = "entertheField";
    public static readonly string ExtendArm = "extendArm";
    public static readonly string PrevState = "previousWorkState";
    public static readonly string ShouldMoveForward = "shouldMoveForward";
    public static readonly string Position = "position";
    public static readonly string HasMaterial = "hasMaterial";
    public static readonly string HomeBase = "homeIndex"; // which home index is assigned to the agent
    public static readonly string CurrentHome = "currentHome"; // the temporary home the agent is current occupying or returning to or waiting at
    public static readonly string DeadLockTicks = "deadlockTicks"; // how many ticks have passed when agent is not moving. If passing a threshold, agent needs to replanning a path or task

  }



  //--------------------------------------------------SUPPORTING CLASS FOR ENVIRONMENT--------------------------------------------------

  public enum BuildState
  {
    Deployed, // Successfully built and placed
    PendingToDeploy, //  Can be built, no dependencies blocking
    NeedSupport, // Has dependencies blocking, can't build yet
    Removed  // Was deployed, now removed (for supports/base)
  }

  public enum VoxelType
  {
    Structure,
    Support,
    Base
  }

  // used for path finding with A*
  public class TargetData
  {
    public int TargetIndex;
    public int[] Path; // path from agent index to target index
    public double Cost;
    public int[] ReservedBy; // reserved by agentIds, here HashSet is better than list
    public TargetData(int targetIndex, int[] path, double cost, int[] reservedBy)
    {
      this.TargetIndex = targetIndex;
      this.Path = path;
      this.Cost = cost;
      this.ReservedBy = reservedBy;
    }
  }


  public class HomeBaseData
  {
    // static state data
    public Point3d HomeBasePt; // the list of these home base points
    public Point3d MaterialPickUpPt; // the list of the material pick up locations for each home base
    public Vector3d MaterialPickUpDir; // the list of the material pick up directions at each home base
    public Point3d FirstWaitingSpot; // the waiting line for agents who exit the field, [0] = first waiting spot, [1] = second, etc.
    public Vector3d WaitingDir;

    // dynamic state -chagnes as agents arrive/leave
    public int OccupyingAgentId; // -1 if the home base is free
    public Queue<int> WaitingQueue; // agent IDs waiting in line, in order
    public HomeBaseData(Point3d homeBasePt, Point3d materialPickUpPt, Vector3d materialPickUpDir, Point3d firstWaitingSpot, Vector3d waitingDir)
    {
      this.HomeBasePt = homeBasePt;
      this.MaterialPickUpPt = materialPickUpPt;
      this.MaterialPickUpDir = materialPickUpDir;
      this.FirstWaitingSpot = firstWaitingSpot;
      this.WaitingDir = waitingDir;
      this.OccupyingAgentId = -1;
      this.WaitingQueue = new Queue<int>();
    }

    public bool IsOccupied()
    {
      if (OccupyingAgentId != -1)
      {
        return true;
      }
      else
      {
        return false;
      }
    }

    public Point3d GetWaitingSpotFor(int agentId)
    {
      // returns which physical spot this agent should stand at
      if (WaitingQueue.Count == 0) return WaitingDir + HomeBasePt;

      int waitingLineIndex = 0;
      for (int i = 0; i < WaitingQueue.Count; i++)
      {
        int id = WaitingQueue.ElementAt(i);
        if (id == agentId)
        {
          Point3d waitingSpot = WaitingDir * (i + 1) + HomeBasePt;
          return waitingSpot;
        }
        waitingLineIndex++;
        if (waitingLineIndex >= WaitingQueue.Count) break;
      }
      // overflow to last spot
      Point3d lastAvailbleSpot = WaitingDir * (WaitingQueue.Count + 1) + HomeBasePt;
      return lastAvailbleSpot;
    }


  }

  // class to store the keys for the CustomData
  public static class EnvironmentKeys
  {
    public const string BuildState = "BuildState"; // List<BuildState>: "deployed", "needSP", "pendingToDeploy"
    public const string VoxelType = "VoxelType"; //List<VoxelType>: "Structure", "Support", "Base"
    public const string ReadyToDeploy = "ReadyToDeploy"; // List<int>: strucutre points that are a) pendingToDeploy, b) at least one neighbor is deployed
    public const string Targets = "Targets"; //Dictionary<int, TargetData>: for agent's path finding. What's in Targets come from ReadyToDeploy; Targets specifically for points to be assembled
    public const string Deployed = "Deployed"; // pointIndex in HashSet<int> according to allCloud, saved to Deployed
    public const string PToSp = "PToSp"; // dictionary<intA, intB>: structural pointA needs support pointB as support
    public const string SpToP = "SpToP"; // dictionary<intA, List<int>>: support pointA supports all this list of structural points
    public const string SpDic = "SpDic"; // dictionary<intA, list<int>>: support top pointA leads the vertical support column
    public const string BindP = "BindP"; // dictionary<intA, intB>: structural pointA needs structural pointB to be built first
    public const string BindL = "BindL"; // dictionary<intA, List<int>>: structural pointA suuports all this list of structural points
    public const string Disassembled = "Disassembled"; // List<int>
    public const string AllowDisassemble = "AllowDisassemble"; // List<int>
    public const string Basement = "Basement"; // List<int>
    public const string AllCloud = "AllCloud";  // PointCloud
    public const string AdjacencyMap = "AdjacencyMap"; // Dictionary <int, List<int>>, each point's neighbors
    public const string StructuralResolution = "StructuralResolution";
    public const string SystemReset = "SystemReset";
    public const string HomeBases = "homeBases";
    public const string ActivePath = "activePath"; // path is to track which points are being occupied by the agent, which is also used for collision detection
    public const string RaftZones = "raftZones"; // assign each raft to a zone that is closer to a home
    public const string RaftRemovers = "raftRemovers"; // track who become the active raft removers and return to which home

  }

  // Class to visualize agent's travel path progress
  private struct PathSegment
  {
    public Line Line;
    public double Brightness; // 0.0 = dim (not yet traveled), 1.0 = fully bright (completed path step)
  }
# ---------- end agent_visualizer ----------
geo_2 = Geometry()
lng = ListLength(List=debug_inspector.oPendingToDeploy)
lng_2 = ListLength(List=debug_inspector.oDeployedIndices)
lng_3 = ListLength(List=debug_inspector.oReadyToDeploy)
lng_4 = ListLength(List=debug_inspector.oOccupied)
lng_5 = ListLength(List=debug_inspector.oAllowDisassemble)
lng_6 = ListLength(List=debug_inspector.oNeedSupport)
deployed_structure = Geometry(structure_visualizer.oDeployedStructure)
deployed_support = Geometry(structure_visualizer.oDeployedSupport)
deployed_raft = Geometry(structure_visualizer.oDeployedRaft)
removed_support = Geometry(structure_visualizer.oRemovedSupport)
removed_raft = Geometry(structure_visualizer.oRemovedRaft)
homes = Geometry(structure_visualizer.oHomes)
all_points = Geometry(structure_visualizer.oAllPts)
agenttargets = Panel(agent_visualizer.oRobotTargets)
alldeployed_count = Panel(lng_2)
readytodeploy_count = Panel(lng_3)
allowdisassemble = Panel(lng_5)
needsupport_count = Panel(lng_6)
occupied_count = Panel(lng_4)
pendingtodeploy_count = Panel(lng)
robot_orientation = Panel(agent_visualizer.oRobotOrientations)
robotpositionindex = Panel(agent_visualizer.oRobotPositionIndex)
buildstates = Panel(debug_inspector.oBuildStates)
pl = ConstructPlane(Origin=deployed_structure, XAxis=Vector(1, 0, 0), YAxis=Vector(0, 1, 0))
pl_2 = ConstructPlane(Origin=deployed_support, XAxis=Vector(1, 0, 0), YAxis=Vector(0, 1, 0))
pl_3 = ConstructPlane(Origin=deployed_raft, XAxis=Vector(1, 0, 0), YAxis=Vector(0, 1, 0))
division = Division(StructuralResolution=structural_resolution_2, B=2)
pl_4 = ConstructPlane(Origin=homes, XAxis=Vector(1, 0, 0), YAxis=Vector(0, 1, 0))
box = CenterBox(Base=pl, X=division, Y=division, Z=division)
box_2 = CenterBox(Base=pl_2, X=division, Y=division, Z=division)
box_3 = CenterBox(Base=pl_3, X=division, Y=division, Z=division)
box_4 = CenterBox(Base=pl_4, X=division, Y=division, Z=division)
wires = BrepWireframe(Brep=box, Density=-1)
wires_2 = BrepWireframe(Brep=box_2, Density=-1)
wires_3 = BrepWireframe(Brep=box_4, Density=-1)
wires_4 = BrepWireframe(Brep=box_3, Density=-1)
preview = CustomPreview(Geometry=wires_4, Material=ColourSwatch(SwatchColor=RGB(222, 206, 29)))
preview_2 = CustomPreview(Geometry=wires, Material=ColourSwatch(SwatchColor=RGB(93, 217, 155)))
preview_3 = CustomPreview(Geometry=wires_2, Material=ColourSwatch(SwatchColor=RGB(151, 175, 232)))
preview_4 = CustomPreview(Geometry=wires_3, Material=ColourSwatch(SwatchColor=RGB(255, 0, 0)))
