# Grasshopper definition ABM_Robot Path Planning.gh (Grasshopper 1.0.7)
# plug-ins: ABxM.Grasshopper, Heteroptera, Pufferfish

# ---- group: support area range
number_slider = Slider(1, range=1..100)

# ---- group: overhang threashold
radians = Radians(Degrees=Slider(46, range=1..360))

# ---- group: layer height
number_slider_2 = Slider(1, range=1..100)

# ---- group: start point
construct_point = ConstructPoint(XCoordinate=0, YCoordinate=0, ZCoordinate=0)

# ---- group: start orientation
vector_xyz = VectorXYZ(XComponent=-1, YComponent=0, ZComponent=0)  # -> Vector, Length

# ---- group: robot amount
number_slider_3 = Slider(3, range=1..10)

# ----
# Control Panel
button = Button()
trigger = Trigger(Interval=-1000, TimerInterval=1000, Target=solver)

# ----
# Test Geometry
center = Center(Geometric=[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])  # -> Center, Dimension
point = Point([Point(0, 0, 0), Point(1, 0, 0), Point(2, 0, 0), Point(3, 0, 0), Point(3, 1, 0), Point(2, 1, 0)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])

center_2 = Center(Geometric=[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])  # -> Center, Dimension
center_3 = Center(Geometric=[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])  # -> Center, Dimension

# ---- group: 2d struture example
point_2 = Point(center_3.Center)

# ---- group: 3d structure example
point_3 = Point([Point(0, 0, 0), Point(1, 0, 0), Point(2, 0, 0), Point(3, 0, 0), Point(4, 0, 0), Point(5, 0, 0)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])

# ----
point_4 = Point(construct_point)
geometry = Geometry(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)
box = Box(geometry)
c_script = CSharpScript(
    switcher=Toggle(False),
    canvas_back=ColourSwatch(SwatchColor=RGB(255, 255, 255)),
    canvas_grid=ColourSwatch(SwatchColor=RGB(255, 255, 255)))  # -> out, A; inputs switcher: Boolean, canvas_back: Color, canvas_grid: Color
# ---------- c_script: C# usings ----------
using System.Drawing;
# ---------- c_script: C# ----------
    if (switcher == true)
    {
      Grasshopper.GUI.Canvas.GH_Skin.canvas_grid = canvas_grid;
      Grasshopper.GUI.Canvas.GH_Skin.canvas_back = canvas_back;
      Grasshopper.GUI.Canvas.GH_Skin.canvas_edge = Color.FromArgb(255, 0, 0, 0);
      Grasshopper.GUI.Canvas.GH_Skin.canvas_shade = Color.FromArgb(80, 0, 0, 0);
    }
    else
    {
      //DEFAULTS
      Grasshopper.GUI.Canvas.GH_Skin.canvas_grid = Color.FromArgb(30, 0, 0, 0);
      Grasshopper.GUI.Canvas.GH_Skin.canvas_back = Color.FromArgb(255, 212, 208, 200);
      Grasshopper.GUI.Canvas.GH_Skin.canvas_edge = Color.FromArgb(255, 0, 0, 0);
      Grasshopper.GUI.Canvas.GH_Skin.canvas_shade = Color.FromArgb(80, 0, 0, 0);
    }
# ---------- end c_script ----------

# ---- group: geometry on ground
ghpython_script = GhPythonScript(x=center_2.Center)  # -> out, a; inputs x: list of Point3d
# ---------- ghpython_script: Python ----------
import Rhino.Geometry as rg


for i in range(len(x)):
    x[i].Z = int(x[i].Z)
    
    
a = x
# ---------- end ghpython_script ----------

# ----
deconstruct_brep = DeconstructBrep(Brep=box)  # -> Faces, Edges, Vertices
convex_hull = ConvexHull(Points=ghpython_script.a, Plane=PlaneXY(0, 0, 0))  # -> Hull, HullZ, Indices

# ----
# Separation Behavior
number_slider_4 = Slider(1, range=0..1)
separation = GhPythonScript(
    iStartPosition=point_4,
    iRAmount=number_slider_3,
    iOrientation=vector_xyz.Vector,
    iUnitLen="1",
    W=number_slider_4,
    D=Slider(3, range=0..10))  # -> out, oBehavior; inputs iStartPosition: Point3d, iRAmount: Int32, iOrientation: Vector3d
# ---------- separation: Python ----------
import Rhino.Geometry as rg
import clr
clr.AddReference("ABxM.Core.dll")
import ABxM.Core as abm

from System.Collections.Generic import List
from collections import OrderedDict


class CartSeparationCollisionBehavior(abm.Behavior.BehaviorBase):
    def __init__(self):
        Weight = 1.0
        Distance = 3.0
        
    def getFCost(self, point, target, parentG):
        g = parentG + iUnitLen # path inherit from parent
        h = target.DistanceTo(point) # distance to target
        return g+h, g, h
    
    def Astar(self, startpos, target, cloud, deploycloud, buildstate):
        deploycloud.Add(target) # because target is not deployed yet
        # {point: [fcost, g, h, parent]}
        open = {}
        closed = {}
        fcost = self.getFCost(startpos, target, 0)
        open[startpos] = [fcost[0]-1,fcost[1]-1, fcost[2], None] # -1 because it starts from the origin point, no need to add unit len
        
        index = 0
        path = []
        while index < 99999 and len(open)>0:# for secure reson
            current = min(open, key=lambda k: (open[k][0], open[k][2])) #get point with lowest fcost & h cost in open list 
            closed[current] = open[current]
            open.pop(current)
            
            if current == target:
                index2 = 0
                tracenode = current
                # trace back to get the shortest path
                while index2<99999 and closed[tracenode][3]!=None:
                    path.append(tracenode)
                    tracenode = closed[tracenode][3]
                    index2 += 1
                break
                
            neighbors = rg.RTree.PointCloudClosestPoints(deploycloud, [current], iUnitLen)
            neighborsidx = list(neighbors)[0]
            
            for n in neighborsidx:
                neighbor = deploycloud[n].Location 
                #if (neighbor not in closed and buildstate[cloud.ClosestPoint(neighbor)]=="deployed") or neighbor == target: # ocuppied as obstacal
                if neighbor not in closed or neighbor == target: # ocuppied as obstacal
                    newFCost = self.getFCost(neighbor, target, closed[current][1]) #input parents gcost
                    if neighbor in open:# means the neighbor is another node's child
                        # if the new path is faster than the old one
                        if newFCost[0] < open[neighbor][0]:
                            open[neighbor] = [newFCost[0], newFCost[1], newFCost[2], current]
                    else:
                        open[neighbor] = [newFCost[0], newFCost[1], newFCost[2], current]
            
            index+=1
        
        deploycloud.RemoveAt(deploycloud.ClosestPoint(target)) # dont know why deploycloud is changed even isnt not returned
        return list(reversed(path))
        
    def sortTargets(self, targets): #input: {point: [path: [], intersect+pathlen: int(0), intersect points: []]}
        # get intersected paths
        for key1, value1 in targets.items():
             for key2, value2 in targets.items():
                if key1 != key2 and any(set(value1[0]).intersection(value2[0])): # if intersect with another path
                    value1[1] += 1
                    value1[2].append(key2)
                    
        # sort by sum of intersect amount + path length, then sort again by path length
        targets = OrderedDict(sorted(targets.items(), key=lambda t: (t[1][1], len(t[1][0])))) 
        
        return targets
        
    def checkCost(self, targets, dtpath):
        cost = 0
        crossp = []
        if targets == {}:
            return len(dtpath), []
        else:
            for key1, value1 in targets.items():
                if any(set(value1[0]).intersection(dtpath)):
                    cost += 1
                    crossp.append(key1)
            return cost + len(dtpath), crossp
        
    def prossPath(self, target, task, path, cloud, buildstate, available, type, deploycloud, disassemble, PToSp, SpToP, SpDic, BindP, BindL, allowdis): # free up path, and change state of modules on it
        # change state of modules on the path to `deployed` => available path
        for p in path:
            if not (task == "disassemble" and p == target):
                buildstate[cloud.ClosestPoint(p)] = "deployed"
                #if p not in deploycloud:
                if deploycloud[deploycloud.ClosestPoint(p)].Location != p: 
                    deploycloud.Add(p)
                
                # if the top support point is built, points that need this support now could be available
                if p in SpToP: # this point is a support point
                    for ns in SpToP[p]: 
                        if buildstate[cloud.ClosestPoint(ns)] == "needsp":
                            buildstate[cloud.ClosestPoint(ns)] = "undeployed"
                
                # if the point is the point that needs support, remove itself from SpToP
                if p in PToSp:
                    sp = PToSp[p] # support top point
                    if p in SpToP[sp]:
                        if len(SpToP[sp])==1: # this point is the last one that need this support
                            for s in SpDic[sp]: disassemble.append(s)
                            allowdis.append(sp)
                            del SpToP[sp]
                        else: SpToP[sp].remove(p)
                        del PToSp[p]
                        
                if p in BindL: # means it need another point to be built first
                    for b in BindL[p]:
                        buildstate[cloud.ClosestPoint(b)] = "undeployed"
                        del BindP[b]
                    del BindL[p]
               
        ####### ONLY TARGET NEED TO DO THIS!!!!!!!!!
        # add undeployed neighbors to available
        if task == "disassemble":
            tidx = cloud.ClosestPoint(target)
            buildstate[tidx] = "removed"
            belowp = rg.Point3d(cloud[tidx].Location.X, cloud[tidx].Location.Y, cloud[tidx].Location.Z-1*iUnitLen)
            if type[cloud.ClosestPoint(belowp)] == "support": # when the upper support point is removed, this point can be removed
                allowdis.append(belowp)
        else:
            neighbors = rg.RTree.PointCloudClosestPoints(cloud, [target], iUnitLen)
            neighborsIdx = list(neighbors)[0]
            for n in neighborsIdx:
                if (buildstate[n] == "undeployed") and (cloud[n].Location not in available):
                    if type[n] == "support": 
                        belowp = rg.Point3d(cloud[n].Location.X, cloud[n].Location.Y, cloud[n].Location.Z-1*iUnitLen)
                        belowpIdx = cloud.ClosestPoint(belowp)
                        if buildstate[belowpIdx] == "deployed" or buildstate[belowpIdx] == "occupied": # means there is below structure to support
                            available.Add(cloud[n].Location)
                    else:
                        available.Add(cloud[n].Location)
                            
        return  buildstate, available, deploycloud, PToSp, SpToP, SpDic, allowdis
         
    def updateTargets(self, list, deploycloud, buildstate, cloud):
        targets = {}
        for a in list:
            if buildstate[cloud.ClosestPoint(a)]!= "occupied": # because when change to removing basement, there may be another task not finished yet
                newpath = self.Astar(iStartPosition, a, cloud, deploycloud, buildstate)
                if newpath != []: # make sure no targets with empty path
                    targets[a] = [newpath, len(newpath), []]
        targets = self.sortTargets(targets)
        
        return targets
        
    def checkShortestT(self, currentp, list, cloud, deploycloud, buildstate, targets, lowestc): # check if there is any target from this point, if yes, get one with shortest path
        shortest = []
        crossp =[]
        target = None
        # get the point with the shortest path
        for i in range(len(list)):
            if buildstate[cloud.ClosestPoint(list[i])]!= "occupied":
                newpath = self.Astar(currentp, list[i], cloud, deploycloud, buildstate)
                if newpath != []:
                    cost = self.checkCost(targets, newpath) # intersect points + path length
                    if lowestc == None or cost[0] < lowestc: # the first point to check
                        lowestc = cost[0]
                        target = list[i]
                        shortest = newpath
                        crossp = cost[1]
        return target, lowestc, shortest, crossp
        
        
    def Execute(self, agent):
        #cartesianAgent = agent
        system = agent.AgentSystem
        carEnv = system.CartesianEnvironment
        
        # agent val
        target = agent.CustomData["target"]
        path = agent.CustomData["path"]
        workstate = agent.CustomData["workState"]
        currentStep = agent.CustomData["currentStep"]
        orientation = agent.CustomData["orientation"]
        extend = agent.CustomData["extend"]
        enter = agent.CustomData["enter"]
        previous = agent.CustomData["previous"]
        
        # environment val
        cloud = carEnv.CustomData["cloud"]
        buildstate = carEnv.CustomData["buildState"]
        available = carEnv.CustomData["available"]
        targets = carEnv.CustomData["targets"]
        startPos = carEnv.CustomData["startPos"]
        PToSp = carEnv.CustomData["PToSp"]
        SpToP = carEnv.CustomData["SpToP"]
        SpDic = carEnv.CustomData["SpDic"]
        type = carEnv.CustomData["type"]
        disassemble = carEnv.CustomData["disassemble"]
        allowdis = carEnv.CustomData["allowdis"]
        deploycloud = carEnv.CustomData["deploycloud"]
        basement = carEnv.CustomData["basement"]
        BindP = carEnv.CustomData["BindP"]
        BindL = carEnv.CustomData["BindL"]
        
        # enter only when there's no other robots at the startPos
        if enter == False:
            # check again if all the targets are blocked
            if targets == {}: # some targets might be temporarity blocked
                if "undeployed" in set(buildstate) or "needsp" in set(buildstate):
                    targets = self.updateTargets(available, deploycloud, buildstate, cloud)
                else:
                    targets = self.updateTargets(basement, deploycloud, buildstate, cloud)
                
            if (startPos == None or system.Agents[startPos].Position != iStartPosition) and targets!={}:
                agent.CustomData["enter"] = True
                carEnv.CustomData["startPos"] = agent.Id
        
        if enter == True:
            # check if agent has a target and a path
            if workstate == "build":
                # rotate if the orientation is not to the next step
                moveVec = path[currentStep]-agent.Position
                if moveVec != orientation:
                    agent.CustomData["orientation"] = moveVec
                else:
                    # if it is the last step
                    if currentStep == len(path)-1:
                        # check if the orientation is to the target
                        # extend arm to deploy
                        if extend == False:
                             agent.CustomData["extend"] =  True
                        
                        # assembly task finished
                        # next task: return vs. disassemble vs. stay
                        else:
                            
                            lowestc = None
                            if len(disassemble) > 0:
                                deploycloud.AddRange(path) #temporariy add points to the deploycloud for path planning
                                newtarget, lowestc, shortest, crossp = self.checkShortestT(agent.Position, allowdis, cloud, deploycloud, buildstate, targets, lowestc)
                                
                                for p in path:
                                    deploycloud.RemoveAt(deploycloud.ClosestPoint(p))
                                    
                            # next task: disassemble
                            if lowestc != None:
                                
                                # original path is free, update environment value 
                                result = self.prossPath(target, "build", path, cloud, buildstate, available, type, deploycloud, disassemble, PToSp, SpToP, SpDic, BindP, BindL, allowdis)
                                buildstate = result[0]
                                available = result[1]
                                deploycloud = result[2]
                                PToSp = result[3]
                                SpToP = result[4]
                                SpDic = result[5]
                                
                                # Note: maynot need to update target list because it is not used for now
                                # Note: may still need because later need to remove target that is currently blocked
                                # update target list, for future to choose the one that block the least paths
                                targets = self.updateTargets(available, deploycloud, buildstate, cloud)
                        
                                # change modules(on the path)' state
                                for p in shortest:
                                    buildstate[cloud.ClosestPoint(p)] = "occupied"
                                    if p == deploycloud[deploycloud.ClosestPoint(p)].Location: # make sure remove the right point
                                        deploycloud.RemoveAt(deploycloud.ClosestPoint(p))
                                
                                # check again the blocked targets, because targets is just updated
                                cost = self.checkCost(targets, shortest)
                                for c in cost[1]:
                                    if c in targets:
                                        del targets[c]
                                        
                                disassemble.remove(newtarget)
                                allowdis.remove(newtarget)
                                
                                agent.CustomData["path"] = shortest
                                agent.CustomData["workState"] =  "disassemble"
                                agent.CustomData["previous"] =  "build"
                                agent.CustomData["target"] = newtarget
                                agent.CustomData["currentStep"] = 0
                                agent.CustomData["extend"] =  False # retrieve arm
                                
                            # next task: return vs. stay
                            else:
                                if path[0].DistanceTo(iStartPosition)!=iUnitLen: # means the last task was disassemble, no path to return
                                    if previous!="stuck": # prevent from keep adding points to deploycloud if it stuck (no path to go next)
                                        # original path is free, update environment value
                                        result = self.prossPath(target, "build", path, cloud, buildstate, available, type, deploycloud, disassemble, PToSp, SpToP, SpDic, BindP, BindL, allowdis)
                                        buildstate = result[0]
                                        available = result[1]
                                        deploycloud = result[2]
                                        PToSp = result[3]
                                        SpToP = result[4]
                                        SpDic = result[5]
                                        
                                        # update target list, for future to choose the one that block the least paths
                                        targets = self.updateTargets(available, deploycloud, buildstate, cloud)
                                        # get a new path to return
                                    
                                    newpath = self.Astar(iStartPosition, agent.Position, cloud, deploycloud, buildstate)
                            
                                    if newpath!=[]:
                                        # change modules(on the path)' state
                                        for p in newpath:
                                            buildstate[cloud.ClosestPoint(p)] = "occupied"
                                            if p == deploycloud[deploycloud.ClosestPoint(p)].Location: # make sure remove the right point
                                                deploycloud.RemoveAt(deploycloud.ClosestPoint(p))
                                                
                                        cost = self.checkCost(targets, newpath)
                                        for c in cost[1]:
                                            if c in targets:
                                                del targets[c]
                                                
                                        # delete target and return to start pos
                                        agent.CustomData["workState"] =  "return"
                                        agent.CustomData["previous"] =  "build"
                                        agent.CustomData["target"] = None
                                        agent.CustomData["currentStep"] = len(newpath) -1 
                                        agent.CustomData["path"] = newpath
                                        agent.CustomData["extend"] =  False
                                    else:
                                        agent.CustomData["previous"] =  "stuck"
                                else:
                                    # delete target and return to start pos
                                    agent.CustomData["workState"] =  "return"
                                    agent.CustomData["previous"] =  "build"
                                    agent.CustomData["target"] = None
                                    agent.CustomData["currentStep"] -= 2 # because it adds additional 1 in the end, and the agent now is at the target pos, which is the last item in the path list
                                    agent.CustomData["extend"] =  False # retrieve arm
                    else:
                        # if the agent leave the startPos, set startPos to None
                        if startPos == agent.Id:
                            startPos = None
                        # take steps in the path
                        agent.Moves.Add(moveVec)
                        agent.Weights.Add(self.Weight)
                        
                        # update current step
                        agent.CustomData["currentStep"] += 1
            
            elif workstate == "disassemble":
                # rotate if the orientation is not to the next step
                moveVec = path[currentStep]-agent.Position
                if moveVec != orientation:
                    agent.CustomData["orientation"] = moveVec
                else:
                    # if it is the last step
                    if currentStep == len(path)-1:
                        # extend arm to deploy
                        if extend == False:
                            agent.CustomData["extend"] =  True
                        else:
                            if previous!="stuck": # prevent from keep adding points to deploycloud if it stuck (no path to go next)
                                # assembly task finished
                                # original path is free, update environment value 
                                result = self.prossPath(target, "disassemble", path, cloud, buildstate, available, type, deploycloud, disassemble, PToSp, SpToP, SpDic, BindP, BindL, allowdis)
                                buildstate = result[0]
                                available = result[1]
                                deploycloud = result[2]
                                PToSp = result[3]
                                SpToP = result[4]
                                SpDic = result[5]
                                
                                # update target list
                                targets = self.updateTargets(available, deploycloud, buildstate, cloud)
                            
                            # next task: return vs. build vs. stay
                            lowestc = None
                            if len(available) > 0:
                                
                                # get the available point with the shortest path
                                newtarget, lowestc, shortest, crossp = self.checkShortestT(agent.Position, available, cloud, deploycloud, buildstate, targets, lowestc)
                                
                            # next task: biuld
                            if lowestc != None:
                                
                                # change modules(on the path)' state
                                for p in shortest:
                                    buildstate[cloud.ClosestPoint(p)] = "occupied"
                                    if p == deploycloud[deploycloud.ClosestPoint(p)].Location: # make sure remove the right point
                                        deploycloud.RemoveAt(deploycloud.ClosestPoint(p))
                                
                                for c in crossp:
                                    if c in targets:
                                        del targets[c]
                                        
                                # remove point that is set as target from the available & target list
                                available.remove(newtarget)
                                if newtarget in targets:
                                    del targets[newtarget]
                                
                                agent.CustomData["path"] = shortest
                                agent.CustomData["workState"] =  "build"
                                agent.CustomData["previous"] =  "disassemble"
                                agent.CustomData["target"] = newtarget
                                agent.CustomData["currentStep"] = 0
                                agent.CustomData["extend"] =  False
                            
                            # next task: return (if there's no path to the target or no target left)
                            else:
                                # check if there is path to go back
                                # put agent.Position as target because the return path need to be reversed
                                newpath = self.Astar(iStartPosition, agent.Position, cloud, deploycloud, buildstate)
                                
                                if newpath!=[]:
                                     # change modules(on the path)' state
                                    for p in newpath:
                                        buildstate[cloud.ClosestPoint(p)] = "occupied"
                                        if p == deploycloud[deploycloud.ClosestPoint(p)].Location: # make sure remove the right point
                                            deploycloud.RemoveAt(deploycloud.ClosestPoint(p))
                                    
                                    cost = self.checkCost(targets, newpath)
                                    for c in cost[1]:
                                        if c in targets:
                                            del targets[c]
                                            
                                    # delete target and return to start pos
                                    agent.CustomData["workState"] =  "return"
                                    agent.CustomData["previous"] =  "disassemble"
                                    agent.CustomData["target"] = None
                                    agent.CustomData["currentStep"] = len(newpath) -1 
                                    agent.CustomData["path"] = newpath
                                    agent.CustomData["extend"] =  False
                                else:
                                    agent.CustomData["previous"] =  "stuck"
                                
                    else:
                        # take steps in the path
                        agent.Moves.Add(moveVec)
                        agent.Weights.Add(self.Weight)
                        # update current step
                        agent.CustomData["currentStep"] += 1
            
            elif workstate == "remove": # when the structure is done, remove basement
                # rotate if the orientation is not to the next step
                moveVec = path[currentStep]-agent.Position
                if moveVec != orientation:
                    agent.CustomData["orientation"] = moveVec
                else:
                    # if it is the last step
                    if currentStep == len(path)-1:
                        # extend arm to deploy
                        if extend == False:
                             agent.CustomData["extend"] =  True
                        else:
                            # delete target and return to start pos
                            agent.CustomData["workState"] =  "return"
                            agent.CustomData["previous"] =  "remove"
                            agent.CustomData["target"] = None
                            agent.CustomData["currentStep"] -= 2
                            agent.CustomData["extend"] =  False
                    else:
                        # if the agent leave the startPos, set startPos to None
                        if startPos == agent.Id:
                            startPos = None
                        
                        # take steps in the path
                        agent.Moves.Add(moveVec)
                        agent.Weights.Add(self.Weight)
                        # update current step
                        agent.CustomData["currentStep"] += 1
            
            elif workstate == "return":
                if currentStep < 0: # agent now is one step away form the start pos
                    # check if the orientation is to the start pos
                    finalVec = iStartPosition - agent.Position
                    if finalVec != orientation:
                        agent.CustomData["orientation"] =  finalVec
                    else:
                        if startPos == None or startPos == agent.Id: # only when there's no other robots at the startPos, it can back to the startPos
                            
                            if "undeployed" in set(buildstate) or "needsp" in set(buildstate):
                                # path is free, update environment value 
                                # `path[-1]` is the target of the previous task which has been cleaned up already
                                result = self.prossPath(path[-1], "return", path, cloud, buildstate, available, type, deploycloud, disassemble, PToSp, SpToP, SpDic, BindP, BindL, allowdis)
                                buildstate = result[0]
                                available = result[1]
                                deploycloud = result[2]
                                PToSp = result[3]
                                SpToP = result[4]
                                SpDic = result[5]
                                
                                # update target list
                                targets = self.updateTargets(available, deploycloud, buildstate, cloud)
                                
                            else: # structure is done, removing basement
                                if type[cloud.ClosestPoint(path[-1])] == "base":
                                    buildstate[cloud.ClosestPoint(path[-1])] = "removed"
                                    llen = len(path)-1
                                else: llen = len(path) # dont know why there is an issue when remove a point from the path
                                for i in range(llen):
                                    buildstate[cloud.ClosestPoint(path[i])] = "deployed"
                                    #if path[i] not in deploycloud:
                                    if deploycloud[deploycloud.ClosestPoint(path[i])].Location != path[i]: 
                                        deploycloud.Add(path[i])
                                targets = self.updateTargets(basement, deploycloud, buildstate, cloud)
                            
                            # reset agent
                            agent.Position = iStartPosition
                            agent.CustomData["path"] = None
                            agent.CustomData["workState"] = None
                            agent.CustomData["previous"] =  "return"
                            agent.CustomData["currentStep"] = 0
                            startPos = agent.Id
                        
                else:
                    # rotate if the orientation is not to the next step
                    moveVec = path[currentStep]-agent.Position
                    if moveVec != orientation:
                        agent.CustomData["orientation"] =  moveVec
                    else:
                        # take steps in the path
                        agent.Moves.Add(moveVec)
                        agent.Weights.Add(self.Weight)
                        # update current step
                        agent.CustomData["currentStep"] -= 1
                        
            elif workstate == None:
                if "undeployed" in set(buildstate) or "needsp" in set(buildstate):
                    # next task: disassemble vs. build
                    lowestc = None
                    if len(disassemble) > 0:
                        newtarget, lowestc, shortest, crossp = self.checkShortestT(agent.Position, allowdis, cloud, deploycloud, buildstate, targets, lowestc)
                        
                    # next task: disassemble
                    if lowestc != None:
                        # change modules(on the path)' state
                        for p in shortest:
                            buildstate[cloud.ClosestPoint(p)] = "occupied"
                            if p == deploycloud[deploycloud.ClosestPoint(p)].Location: # make sure remove the right point
                                deploycloud.RemoveAt(deploycloud.ClosestPoint(p))
                        
                        # check again the blocked targets, because targets is just updated
                        cost = self.checkCost(targets, shortest)
                        for c in cost[1]:
                            if c in targets:
                                del targets[c]
                                
                        disassemble.remove(newtarget)
                        allowdis.remove(newtarget)
                        
                        agent.CustomData["path"] = shortest
                        agent.CustomData["workState"] =  "disassemble"
                        agent.CustomData["target"] = newtarget
                        
                    # next task: build vs. leave
                    else:
                        # if there's really no any path, leave
                        if targets == {}:
                            agent.CustomData["target"] = None
                            agent.CustomData["enter"] = False
                            startPos = None
                        else:
                            # set a new target and the path to the closest 
                            firstTarget = next(iter(targets))
                            agent.CustomData["target"] = firstTarget
                            newpath = targets[firstTarget][0]
                            
                            # change modules(on the path)' state
                            for p in newpath:
                                buildstate[cloud.ClosestPoint(p)] = "occupied"
                                if p == deploycloud[deploycloud.ClosestPoint(p)].Location: # make sure remove the right point
                                    deploycloud.RemoveAt(deploycloud.ClosestPoint(p))
                           
                            # remove targets that are now blocked
                            for t in targets[firstTarget][2]:
                                if t in targets:
                                    del targets[t]
                            
                            agent.CustomData["orientation"] =  iOrientation # reset orientation to the supply point
                            agent.CustomData["path"] = newpath
                            agent.CustomData["workState"] = "build"
                            agent.CustomData["previous"] =  "Home"
                            
                            # remove point that is set as target from the available & target list
                            available.remove(firstTarget)
                            del targets[firstTarget]
                        
                # means all the modules are built
                else:  
                    if len(basement) > 0:
                        # get basement target list
                        if len(basement) == type.count("base"):
                            targets = self.updateTargets(basement, deploycloud, buildstate, cloud)
                        
                        # if there's really no any path
                        if targets == {}:
                            agent.CustomData["target"] = None
                            agent.CustomData["enter"] = False
                            startPos = None
                        else:
                            targetl= list(targets.items())
                            lastTarget, lastV = targetl[-1] # start removing from the furthest point
                            agent.CustomData["target"] = lastTarget
                            newpath = lastV[0]
                            
                            # change modules(on the path)' state
                            for p in newpath:
                                buildstate[cloud.ClosestPoint(p)] = "occupied"
                                if p == deploycloud[deploycloud.ClosestPoint(p)].Location: # make sure remove the right point
                                    deploycloud.RemoveAt(deploycloud.ClosestPoint(p))
                            
                            # remove targets that are now blocked
                            for t in lastV[2]:
                                if t in targets:
                                    del targets[t]
                                    
                            agent.CustomData["path"] = newpath
                            agent.CustomData["workState"] = "remove"
                            agent.CustomData["previous"] =  "Home"
                            
                            # remove point that is set as target from the target list
                            del targets[lastTarget]
                            basement.remove(lastTarget)
                        
                    else:
                        agent.CustomData["target"] = None
                        if startPos == agent.Id:
                            agent.CustomData["enter"] = False
                            startPos = None
                
            
            carEnv.CustomData["targets"] = targets
            carEnv.CustomData["buildState"] = buildstate
            carEnv.CustomData["available"] = available
            carEnv.CustomData["startPos"] = startPos
            carEnv.CustomData["disassemble"] = disassemble
            carEnv.CustomData["deploycloud"] = deploycloud
            carEnv.CustomData["basement"] = basement

behavior = CartSeparationCollisionBehavior()
behavior.Weight = W
behavior.Distance = D
oBehavior = behavior
# ---------- end separation ----------

list_item = ListItem(List=deconstruct_brep.Edges, Index=0, Wrap=True)  # -> Item1, Item, Item1_2

# ---- group: preprocess geometry
# Geometry Filter
c_script_2 = CSharpScript(
    iDesignGeo=ghpython_script.a,
    iStartPosition=point_4,
    iUnitLen="1",
    iLayerHeight=number_slider_2,
    iArea=number_slider,
    iAngle=radians,
    iHull=convex_hull.Hull)  # -> out, oDesignGeo, oPByLayer, oSupports, oBase, oPToSp, oSpToP, oSpDic, oBindP, oBindL; inputs iDesignGeo: list of Point3d, iStartPosition: Point3d, iUnitLen: Double, iLayerHeight: Double, iArea: Double, iAngle: Double, iHull: Curve
# ---------- c_script_2: C# usings ----------
using System.Linq;
# ---------- c_script_2: C# ----------
    // remove duplicated points
    var filtedPoints = RemoveDuplicatePoints(iDesignGeo);

    //group points by layer
    var groupbylayer = GroupByLayer(filtedPoints, iLayerHeight);

    //connect base
    var basement = getBase(iStartPosition, iUnitLen, groupbylayer[0].GetPoints().ToList(), iHull);

    // generate supports
    var supports = GenerateSupport(iStartPosition, filtedPoints, groupbylayer, iAngle, iLayerHeight, iArea, iUnitLen, basement);

    oDesignGeo = filtedPoints;
    oPByLayer = groupbylayer;
    oSupports = supports.Item1.GetPoints();
    oBase = basement;
    oPToSp = supports.Item2;
    oSpToP = supports.Item3;
    oSpDic = supports.Item4;
    oBindP = supports.Item5;
    oBindL = supports.Item6;
# ---------- c_script_2: C# additional code ----------
  public List<Point3d> RemoveDuplicatePoints(List<Point3d> inputPoints)
  {
    // Create a HashSet to store unique points
    HashSet<Point3d> uniquePoints = new HashSet<Point3d>();

    // Create a new list to store the filtered points
    List<Point3d> filteredPoints = new List<Point3d>();

    // Loop through the input points and add them to the HashSet
    for(var i = 0; i < inputPoints.Count; i++)
    {
      if (uniquePoints.Add(inputPoints[i]))
      {
        // If the point was added (i.e., it's unique), add it to the filtered list
        filteredPoints.Add(inputPoints[i]);
      }
    }

    return filteredPoints;
  }

  public List<PointCloud> GroupByLayer(List<Point3d> inputPoints, double layerHeight)
  {
    List<PointCloud> layerPoints = new List<PointCloud>();
    var orderedPoints = inputPoints.OrderBy(p => p.Z).ToList(); //order the points by Z
    var currentLayer = 0;
    PointCloud tempPoints = new PointCloud();
    for(var i = 0; i < orderedPoints.Count; i++)
    {
      //if changes layer, add to the main list and clear temp list
      if (Math.Floor(orderedPoints[i].Z / layerHeight) > currentLayer)
      {
        layerPoints.Add(tempPoints);
        tempPoints = new PointCloud();
        currentLayer += 1;
      }

      tempPoints.Add(orderedPoints[i]);

      // if it is the last layer, add to the main list
      if (i == orderedPoints.Count - 1){
        layerPoints.Add(tempPoints);
      }
    }

    return layerPoints;
  }

  public Tuple<PointCloud, Dictionary<Point3d, Point3d>, Dictionary<Point3d, List<Point3d>>, Dictionary<Point3d, List<Point3d>>, Dictionary<Point3d, Point3d>, Dictionary<Point3d, List<Point3d>>> GenerateSupport(Point3d startPos, List<Point3d> designGeo, List<PointCloud> clouds, double iangle, double layerHeight, double iarea, double unitLen, List<Point3d> basement)
  {
    var supports = new PointCloud();
    var sArea = new PointCloud();
    var pToSp = new Dictionary<Point3d, Point3d>();
    var spToP = new Dictionary<Point3d, List<Point3d>>();
    var spDic = new Dictionary<Point3d, List<Point3d>>();
    var hasSp = false;
    var topsp = new Point3d();

    // bind upper points to lower points (upperpoint need previous point to be built first)
    var bindP = new Dictionary<Point3d, Point3d>();
    var bindL = new Dictionary<Point3d, List<Point3d>>();

    //check though points in each layer except for the first layer
    for(var i = 1; i < clouds.Count; i++)// layerNum = i
    {
      for(var j = 0; j < clouds[i].Count; j++)
      {
        var currentp = clouds[i][j].Location;
        var closestIdx = clouds[i - 1].ClosestPoint(currentp);// get the closest point in the previous layer
        var closestp = clouds[i - 1][closestIdx].Location;
        var vec = currentp - closestp;
        var p = new Point3d(currentp.X, currentp.Y, closestp.Z);
        var hVec = p - closestp;
        var angle = 0.0;

        // calculate vector angle if not (0,0,0)
        if( hVec.IsZero == false) //true means currentp is on top of the closestp (angle == 0)
        {
          angle = Math.PI / 2 - Vector3d.VectorAngle(vec, hVec);

        }

        if (angle > iangle) // the angle is larger than the threshold
        {
          var needSp = false;
          if(sArea.Count == 0) // if no any support for this layer generated yet
          {
            needSp = true;
          }
          else
          {
            // check if any support is in this area
            // NOTE: closest p is a design structure point! not support point!
            var closestSpIdx = sArea.ClosestPoint(currentp);
            var closestSp = sArea[closestSpIdx].Location;
            if (closestSp.DistanceTo(currentp) > iarea)
            {
              needSp = true;

            }
            else
            {
              topsp = pToSp[closestSp];
              spToP[topsp].Add(currentp); // the points share the same support
              pToSp[currentp] = topsp;
            }
          }

          // if this point need support, and the support is not set yet
          if( needSp == true)
          {
            //build up the support
            for(var k = currentp.Z - 1; k >= 0; k--)
            {
              var supportp = new Point3d(currentp.X, currentp.Y, k * unitLen);
              if (designGeo.Contains(supportp) == false && basement.Contains(supportp) == false)
              {
                if(hasSp == false) //means this is the top point of this support
                {
                  pToSp[currentp] = supportp;
                  spToP[supportp] = new List<Point3d>{currentp};
                  spDic[supportp] = new List<Point3d>();
                  topsp = supportp;
                  sArea.Add(currentp); // record currentp has support
                  hasSp = true;
                }
                spDic[topsp].Add(supportp);
                supports.Add(supportp);

              }
              else // if there is already a point that can serve as support in the design structure
              {break;}
            }
          }
        }

        else // bind the point to the closest point
        {
          if(closestp != startPos)
          {
            bindP[currentp] = closestp;
            if( bindL.ContainsKey(closestp))
            {
              bindL[closestp].Add(currentp);
            }
            else
            {
              bindL[closestp] = new List<Point3d>{currentp};
            }
          }
        }


        hasSp = false; //record of support for this `point` is cleared
        topsp = new Point3d();
      }

      sArea = new PointCloud(); //record of support for this `layer` is cleared
    }
    return Tuple.Create(supports, pToSp, spToP, spDic, bindP, bindL);
  }

  public List<Point3d> getBase(Point3d startPos, double unitLen, List<Point3d> pointlist, Curve hull)
  {

    var basement = new List<Point3d>();
    var firstp = pointlist.OrderBy(p => p.X).ThenBy(p => p.Y).ToList()[0];
    var lastp = pointlist.OrderByDescending(p => p.X).ThenByDescending(p => p.Y).ToList()[0];
    for(var i = firstp.X; i <= lastp.X / unitLen; i++)
    {
      for(var j = firstp.Y; j <= lastp.Y / unitLen; j++)
      {
        var newpoint = new Point3d(i * unitLen, j * unitLen, 0);
        if(pointlist.Contains(newpoint) == false && (hull.Contains(newpoint, Plane.WorldXY, 0) == PointContainment.Coincident || hull.Contains(newpoint, Plane.WorldXY, 0) == PointContainment.Inside))
        {basement.Add(newpoint);}

      }
    }

    return basement;
  }
# ---------- end c_script_2 ----------

# ----
# PointCloud find neighbors example
ghpython_script_2 = GhPythonScript(iPoints=c_script_2.oDesignGeo)  # -> out, a; inputs iPoints: list of Point3d
# ---------- ghpython_script_2: Python ----------
import Rhino.Geometry as rg
import System

cloud = rg.PointCloud(iPoints)
tree = rg.RTree.CreatePointCloudTree(cloud)

pointarr = tree.PointCloudClosestPoints(cloud, [rg.Point3d(4,0,0)], 1.5)



idxlist = list(pointarr)[0]
pointlist = []
for i in idxlist:
    pointlist.append(cloud[i].Location)
print pointlist

yw_color = System.Drawing.Color.Yellow
testpt = cloud[0]
testpt.Color = yw_color
#cloud.SetUserString("test", "yes")
#print cloud.GetUserString("test")
print cloud[cloud.ClosestPoint(rg.Point3d(4,0,0))].Location


a = pointlist
# ---------- end ghpython_script_2 ----------

# ---- group: check layer
ghpython_script_3 = GhPythonScript(iPByLayer=c_script_2.oPByLayer, iLayer=Slider(0, range=0..100))  # -> out, a; inputs iPByLayer: list, iLayer: Int32
# ---------- ghpython_script_3: Python ----------
import Rhino.Geometry as rg

print iPByLayer[iLayer]
a = iPByLayer[iLayer].GetPoints()
# ---------- end ghpython_script_3 ----------

# ----
number = Number([list_item.Item, list_item.Item1_2, list_item.Item1])
curve = Curve(list_item.Item)
panel = Panel(c_script_2.out)
division = Division(A=number, B="1")
division_2 = Division(A=number, B=division)
point_5 = Point(c_script_2.oDesignGeo)  # disabled
point_6 = Point(c_script_2.oSupports)
point_7 = Point(c_script_2.oBase)

# ----
# Test code
ghpython_script_4 = GhPythonScript()  # -> out, a, b
# ---------- ghpython_script_4: Python ----------
import Rhino.Geometry as rg
import System

point1=rg.Point3d(0,0,0)
point2=rg.Point3d(0,1,0)
x_diff = point2.X-point1.X
y_diff = point2.Y-point1.Y
z_diff = point2.Z-point1.Z
int(x_diff/1+y_diff/1+z_diff/1)
print int(x_diff/1+y_diff/1+z_diff/1)

test =[]
test.extend([x_diff]*3)
print test

a = point1
b = point2


for i in range(10):
    for j in range(5):
        print "j = ", j, ", i = ", i
        if j == 3:
            break
    if i == 5:
        break
# ---------- end ghpython_script_4 ----------

# ---- group: set overlap amount
ghpython_script_5 = GhPythonScript()  # -> out, a, b
# ---------- ghpython_script_5: Python ----------
a = ['a', 'b', 'c']
b = ['b', 'c', 'd']
c = ['a', 'f', 'g']
d = ['b', 'f', 'e']
f = ['d', 'e']

lists = [a, b, c, d, f]
sums = []
for i in lists:
    print i
    sum = 0
    for j in lists:
        if j!=i and any(set(i).intersection(j)):
            sum += 1
    sums.append(sum)
    
    
print sums
# ---------- end ghpython_script_5 ----------

# ----
end_points = EndPoints(Curve=curve)  # -> Start, End

# ---- group: test jsonstring
ghpython_script_6 = GhPythonScript()  # -> out, a
# ---------- ghpython_script_6: Python ----------
import Rhino.Geometry as rg
import json

testdic = {}
testdic["a"] = 0
testdic["b"] = 1

jsonstring = json.dumps(testdic)
print jsonstring

a = jsonstring
# ---------- end ghpython_script_6 ----------
ghpython_script_7 = GhPythonScript(x=ghpython_script_6.a)  # -> out, a
# ---------- ghpython_script_7: Python ----------
import Rhino.Geometry as rg
import json

datastore = json.loads(x)
print datastore["a"]
# ---------- end ghpython_script_7 ----------

# ----
list_item_2 = ListItem(List=division_2, Index=0, Wrap=True)  # -> Item, Item1, Item2
list_item_3 = ListItem(List=division, Index=0, Wrap=True)  # -> Item, Item1, Item2

# ----
# CartesianEnvironment
cartesianenv = GhPythonScript(
    iReset=button,
    iUnitLen="1",
    iStartPosition=point_4,
    iDesignGeo=c_script_2.oDesignGeo,
    iSupports=c_script_2.oSupports,
    iBase=c_script_2.oBase,
    iPToSp=c_script_2.oPToSp,
    iSpToP=c_script_2.oSpToP,
    iSpDic=c_script_2.oSpDic,
    iBindP=c_script_2.oBindP,
    iBindL=c_script_2.oBindL)  # -> out, oEnvironment; inputs iStartPosition: Point3d, iDesignGeo: list of Point3d, iBoundaryCorners: list of Point3d, iSupports: list of Point3d, iBase: list of Point3d, iPToSp: list, iSpToP: list, iSpDic: list, iBindP: list, iBindL: list
# ---------- cartesianenv: Python ----------
import Rhino.Geometry as rg
import clr
clr.AddReference("ABxM.Core.dll")
import ABxM.Core as abm

from System.Collections.Generic import List

cornerPts = List[rg.Point3d] (iBoundaryCorners)
env = abm.Environments.CartesianEnvironment(cornerPts)

# for finding neighbors
cloud = rg.PointCloud(iDesignGeo)
env.CustomData.Add("cloud", cloud)

# add supports
cloud.AddRange(iBase)
cloud.AddRange(iSupports)

# Why cant Gh c# use json string :(
PToSp = {}
SpToP = {}
SpDic = {}
BindP = {}
BindL = {}
for i in range(0, len(iPToSp)):
    PToSp[iPToSp[i].Key] = iPToSp[i].Value

for i in range(0, len(iSpToP)):
    SpToP[iSpToP[i].Key] = list(iSpToP[i].Value)
    
for i in range(0, len(iSpDic)):
    SpDic[iSpDic[i].Key] = list(iSpDic[i].Value)
    
for i in range(0, len(iBindP)):
    BindP[iBindP[i].Key] = iBindP[i].Value
    
for i in range(0, len(iBindL)):
    BindL[iBindL[i].Key] = list(iBindL[i].Value)

# if the blocks are avaible for building
buildstate = []
available = []
type = []
targets = {}
deploycloud = rg.PointCloud() # to accelerate A star

# get neighbors that are attaching to the starting point
neighbors = rg.RTree.PointCloudClosestPoints(cloud, [iStartPosition], iUnitLen)
neighborlist = list(neighbors)[0]

# setup module state
for i in iDesignGeo:
    type.append("structure")
    if i== iStartPosition:
        buildstate.append("deployed")
        deploycloud.Add(i)
    elif i in PToSp or i in BindP: # means this point need support to be build first
        buildstate.append("needsp")
    else:
        if cloud.ClosestPoint(i) in neighborlist:
            available.append(i)
            targets[i] = [[i], 1, []]
        buildstate.append("undeployed")

for i in iBase:
    type.append("base")
    if cloud.ClosestPoint(i) in neighborlist:
        available.append(i)
        targets[i] = [[i], 1, []]
    buildstate.append("undeployed")

for i in iSupports:
    type.append("support")
    if cloud.ClosestPoint(i) in neighborlist:
        available.append(i)
        targets[i] = [[i], 1, []]
    buildstate.append("undeployed")

"""
for i in cloud:
    if i.Location == iStartPosition:
        buildstate.append("deployed")
    else:
        if i.Index in neighborlist:
            available.append(i.Location)
            targets[i.Location] = [[i.Location], 1, []]
            #targets.append([i.Location,[i.Location], 1, []])
        buildstate.append("undeployed")

"""

#env.CustomData.Add("buildState", buildstate)
env.CustomData.Add("available", available)
env.CustomData.Add("targets", targets)
env.CustomData.Add("buildState", buildstate) # deployed/ occupied/ undeployed / needsp
env.CustomData.Add("startPos", 0) # the agent that is now at the startPos
env.CustomData.Add("PToSp", PToSp) # record point with it's support
env.CustomData.Add("SpToP", SpToP) # record support with points that need it
env.CustomData.Add("SpDic", SpDic) # record support list
env.CustomData.Add("type", type) # structure/ support / base
env.CustomData.Add("disassemble", [])
env.CustomData.Add("allowdis", []) # only points in this list can be disassembled
env.CustomData.Add("deploycloud", deploycloud)
env.CustomData.Add("basement", iBase)
env.CustomData.Add("BindP", BindP)
env.CustomData.Add("BindL", BindL)

oEnvironment = env
# ---------- end cartesianenv ----------

# ----
# CartesianAgent(s)
cartesianagents = GhPythonScript(
    iReset=button,
    iRAmount=number_slider_3,
    iStartPosition=point_4,
    iOrientation=vector_xyz.Vector,
    iBehaviors=separation.oBehavior)  # -> out, oAgents; inputs iRAmount: Int32, iStartPosition: Point3d, iOrientation: Vector3d, iBehaviors: list
# ---------- cartesianagents: Python ----------
import Rhino.Geometry as rg
import clr
clr.AddReference("ABxM.Core.dll")
import ABxM.Core as abm

from System.Collections.Generic import List

agents = []

iBehaviors = List[abm.Behavior.BehaviorBase](iBehaviors)

for i in range(iRAmount):
    agent = abm.Agent.CartesianAgent(iStartPosition, iBehaviors)
    
    agent.Id = i
    
    if i == 0:
        agent.CustomData.Add("enter", True)
    else:
        agent.CustomData.Add("enter", False)
    
    #if module is at the desire location
    #deployed/ occupied/ undeployed
    agent.CustomData.Add("state", "undeployed")
    agent.CustomData.Add("target", None)
    agent.CustomData.Add("path", None)
    agent.CustomData.Add("workState", None) # build/return/disassemble
    agent.CustomData.Add("currentStep", 0)
    agent.CustomData.Add("orientation", iOrientation) # robot's current orientation
    agent.CustomData.Add("extend", False) # if robot arm is extended
    agent.CustomData.Add("previous", None) # record previous test
    agents.append(agent)

oAgents = agents
# ---------- end cartesianagents ----------

domain_box = DomainBox(Base=end_points.Start, X=list_item_2.Item, Y=list_item_2.Item1, Z=list_item_2.Item2)
point_8 = Point([Point(0, 0, 0), Point(1, 0, 0), Point(2, 0, 0), Point(3, 0, 0), Point(4, 0, 0), Point(4, 0, 0), Point(4, 1, 0), Point(3, 1, 0), Point(2, 1, 0), Point(1, 1, 0)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])

# ----
# Test A* algorithm
point_9 = Point(Point(0, 0, 0))
point_10 = Point(Point(5, 6, 0))
ghpython_script_8 = GhPythonScript(iPoints=point_8, iUnitLen="1", iStart=point_9, iTarget=point_10)  # -> out, oShortest; inputs iPoints: list of Point3d, iStart: Point3d, iTarget: Point3d
# ---------- ghpython_script_8: Python ----------
import Rhino.Geometry as rg

def getFCost(point, parentG):
    g = parentG + iUnitLen # path inherit from parent
    h = iTarget.DistanceTo(point) # distance to target
    return g+h, g, h
    

cloud = rg.PointCloud(iPoints)
tree = rg.RTree.CreatePointCloudTree(cloud)
    
# {point: [fcost, g, h, parent]}
open = {}
closed = {}
fcost = getFCost(iStart, 0)
open[iStart] = [fcost[0]-1,fcost[1]-1, fcost[2], None]# -1 because it starts from the origin point, no need to add unit len

index = 0
test = []
# in loop
while index < 100:# for secure reson
    current = min(open, key=lambda k: open[k][0]) #get point with lowest fcost in open list
    closed[current] = open[current]
    open.pop(current)
    if current == iTarget:
        print "reached!!!!!!"
        index2 = 0
        tracenode = current
        while index2<50 and closed[tracenode][3]!=None:
            test.append(tracenode)
            tracenode = closed[tracenode][3]
            index2 += 1
        break
        
    neighbors = tree.PointCloudClosestPoints(cloud, [current], iUnitLen)
    neighborsidx = list(neighbors)[0]
    
    for n in neighborsidx:
        neighbor = cloud[n].Location 
        if neighbor not in closed: # add ocuppied as obstacal
            newFCost = getFCost(neighbor, closed[current][1]) #input parents gcost
            flag = False
            if neighbor in open:# means the neighbor is another node's child
                # if the new path is faster than the old one
                if newFCost[0] < open[neighbor][0]:
                    flag = True
            if flag == True or (neighbor not in open):
                open[neighbor] = [newFCost[0], newFCost[1], newFCost[2], current]
    
    index+=1
    
    
oShortest = test
# ---------- end ghpython_script_8 ----------

c_script_3 = CSharpScript()  # -> out, A; disabled
# ---------- c_script_3: C# additional code ----------
  public Tuple<double, double, double> getFCost(Point3d point, Point3d target, double parentG, double unitLen)
  {
    var g = parentG + unitLen;
    var h = target.DistanceTo(point);
    return Tuple.Create(g + h, g, h);
  }

  public List<Point3d> AStar(Point3d startPos, double unitLen, Point3d target, PointCloud cloud)
  {
    var open = new Dictionary<Point3d, Tuple<double, double, double, Point3d>>();
    var closed = new Dictionary<Point3d, Tuple<double, double, double, Point3d>>();
    var fcost = getFCost(startPos, target, 0, unitLen);
    open[startPos] = Tuple.Create(fcost.Item1 - 1, fcost.Item2 - 1, fcost.Item3, startPos);


    var index = 0;
    var path = new List<Point3d>();
    while(index < 50 && open.Count > 0)
    {

      //get point with lowest fcost & h cost in open list
      var currentp = open.OrderBy(kvp => kvp.Value.Item1).ThenBy(kv => kv.Value.Item3).FirstOrDefault().Key;
      closed[currentp] = open[currentp];
      open.Remove(currentp);


      if (currentp == target)
      {
        var index2 = 0;
        var tracenode = currentp;

        //trace back to get the shortest path
        while( index2 < 50 && tracenode != startPos)
        {
          Print("get path here");
          path.Add(tracenode);
          tracenode = closed[tracenode].Item4;
          index2++;
        }
        break;
      }

      else
      {
        Print("index = " + index + ", open count= " + open.Count + ", current = " + currentp);
      }

      var neighborsidx = RTree.PointCloudClosestPoints(cloud, new List<Point3d>{currentp}, unitLen).ToList()[0];
      foreach(var n in neighborsidx)
      {
        var neighbor = cloud[n].Location;
        if(closed.ContainsKey(neighbor) == false || neighbor == target)
        {
          var newFCost = getFCost(neighbor, target, closed[currentp].Item2, unitLen);
          var flag = false;

          // means the neighbor is another node's child, and the new path is faster than the old one
          if(open.ContainsKey(neighbor))
          {
            if(newFCost.Item1 < open[neighbor].Item1)
            {flag = true;}
          }

          if(flag == true || open.ContainsKey(neighbor) == false)
          {
            open[neighbor] = Tuple.Create(newFCost.Item1, newFCost.Item2, newFCost.Item3, currentp);
          }
        }

      }
      index++;
    }

    return path;
  }
# ---------- end c_script_3 ----------
simple_mesh = SimpleMesh(Brep=domain_box)
box_array = BoxArray(Geometry=simple_mesh, Cell=domain_box, XCount=list_item_3.Item, YCount=list_item_3.Item1, ZCount=list_item_3.Item2)  # -> Geometry, Transform

# ----
# CartesianAgentSystem
cartesiansystem = GhPythonScript(iAgents=cartesianagents.oAgents, iCE=cartesianenv.oEnvironment)  # -> out, oAS; inputs iAgents: list
#   port iAgents: The Cartesian Agents
# ---------- cartesiansystem: Python ----------
import Rhino.Geometry as rg
import clr
clr.AddReference("ABxM.Core.dll")
import ABxM.Core as abm

from System.Collections.Generic import List

agents = List[abm.Agent.CartesianAgent](iAgents)
system = abm.AgentSystem.CartesianAgentSystem(agents, iCE)

oAS = system
# ---------- end cartesiansystem ----------

solver = StepByStepSolver(Reset=button, Execute=Toggle(False), AgentSystems=cartesiansystem.oAS)  # -> DisplayGeometries, AllAgentSystems, IterationCount; disabled
collision_one_many = CollisionOneMany(Collider=box_array.Geometry, Obstacles=geometry)  # -> Collision, Index
dispatch = Dispatch(List=box_array.Geometry, DispatchPattern=collision_one_many.Collision)  # -> ListA, ListB
mesh = Mesh(dispatch.ListA)
center_4 = Center(Geometric=mesh)  # -> Center, Dimension
list_item_4 = ListItem(List=center_4.Center, Index=0, Wrap=True)
move_to_point = MoveToPoint(Geometry=center_4.Center, PointA=list_item_4, PointB=construct_point)  # -> Moved, Vector, Transform
brep = Brep([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])

# ---- group: rotate robot
ghpython_script_9 = GhPythonScript(iRobot=brep, iVec=vector_xyz.Vector, iPoint=point_4)  # -> out, a; inputs iRobot: list of Brep, iVec: Vector3d, iPoint: Point3d
# ---------- ghpython_script_9: Python ----------
import Rhino.Geometry as rg

currentvec = iVec
targetvec = rg.Vector3d(0,0,1)
plane = rg.Plane(iPoint, currentvec, targetvec)
angle = rg.Vector3d.VectorAngle(currentvec, targetvec, plane)

iRobot = rg.Brep.MergeBreps(iRobot, True)
iRobot.Rotate(angle, plane.Normal, iPoint)

a = iRobot
# ---------- end ghpython_script_9 ----------

# ----
brep_2 = Brep([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])
ghpython_script_10 = GhPythonScript(x=brep)  # -> out, a; inputs x: list of Brep
# ---------- ghpython_script_10: Python ----------
import Rhino.Geometry as rg

x = rg.Brep.MergeBreps(x, True)
mesh = rg.Mesh.CreateFromBrep(x)

a = mesh
# ---------- end ghpython_script_10 ----------
mesh_join = MeshJoin(Meshes=ghpython_script_10.a)
ghpython_script_11 = GhPythonScript(x=brep_2)  # -> out, a; inputs x: list of Brep; same code as ghpython_script_10
mesh_join_2 = MeshJoin(Meshes=ghpython_script_11.a)

# ----
# Visualization
visualize = GhPythonScript(iAgentSystem=solver.AllAgentSystems)  # -> out, oAgentPositions, oDesignGeo, oAvailable, oBuildstate, oDeployed, oOccupied, oTargets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; inputs iAgentSystem: list
# ---------- visualize: Python ----------
import Rhino.Geometry as rg
import clr
clr.AddReference("ABxM.Core.dll")
import ABxM.Core as abm

from System.Collections.Generic import List
import rhinoscriptsyntax as rs
import Grasshopper.Kernel as gk

systems = List[abm.AgentSystem.CartesianAgentSystem] (iAgentSystem)
system = systems[0]
agents = system.Agents
agentPos = []
targets = []
orientations = []
extends = []
enters = []
previouss = []
workstates = []

carEnv = system.CartesianEnvironment
cloud = carEnv.CustomData["cloud"]
type = carEnv.CustomData["type"]
buildstate = carEnv.CustomData["buildState"]

for i in range(agents.Count):
    agentPos.append(agents[i].Position)
    target = agents[i].CustomData["target"]
    path = agents[i].CustomData["path"]
    orientation = agents[i].CustomData["orientation"]
    extend = agents[i].CustomData["extend"]
    enter = agents[i].CustomData["enter"]
    previous = agents[i].CustomData["previous"]
    workstate = agents[i].CustomData["workState"]
    
    extends.append(extend)
    enters.append(enter)
    targets.append(target)
    orientations.append( orientation)
    previouss.append(previous)
    workstates.append(workstate)
    
    print "id=", agents[i].Id, ", enter =", enter
    print "     target=", target
    #print path
    #print "     orientation = ", orientation
    print "     workstate=", workstate
    print "     previous=", previous
    print "     currentstep=", agents[i].CustomData["currentStep"]
    
    #print agents[i].CustomData["extend"]
    
available = carEnv.CustomData["available"]
targetlist = carEnv.CustomData["targets"]
startPos = carEnv.CustomData["startPos"]
deploycloud = carEnv.CustomData["deploycloud"]
disassemble = carEnv.CustomData["disassemble"]
SpDic = carEnv.CustomData["SpDic"]
SpToP = carEnv.CustomData["SpToP"]
PToSp = carEnv.CustomData["PToSp"]
basement = carEnv.CustomData["basement"]
BindP = carEnv.CustomData["BindP"]
BindL = carEnv.CustomData["BindL"]
type = carEnv.CustomData["type"]

print "env value: "
print "     startPos: ", startPos
#print "     disassemble: ", disassemble
print deploycloud.Count, cloud.Count

#print "     BindL: ", BindL

deployed = []
occupied = []
support = []
for i, value in enumerate(buildstate):
    if value == "deployed":
        if type[i] == "structure":
            deployed.append(cloud[i].Location)
        else:
            support.append(cloud[i].Location)
    elif value == "occupied":
        # display mode v1
        occupied.append(cloud[i].Location)
        
        # display mode v2
        """
        if cloud[i].Location not in targets:
            
            if type[i] == "structure":
                deployed.append(cloud[i].Location)
            else:
                support.append(cloud[i].Location)
        """


designGeo = cloud.GetPoints()

oAvailable = available
oAgentPositions = agentPos
oDesignGeo = designGeo
oBuildstate = buildstate
oDeployed = deployed
oOccupied = occupied
oTargets = targets
oOrientations = orientations
oExtends = extends
oEnters = enters
oSupports = support
oPrevious = previouss
oWorkstate = workstates
# ---------- end visualize ----------
point_list = PointList(Points=visualize.oDesignGeo, Size=0.2)  # disabled
point_11 = Point(visualize.oAgentPositions)
brep_3 = Brep(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)
brep_4 = Brep(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)
ghpython_script_12 = GhPythonScript(iStartPosition=point_4, iModule=brep_3, iDesignGeo=c_script_2.oDesignGeo)  # -> out, oDesignGeo; inputs iStartPosition: Point3d, iModule: Brep, iDesignGeo: list of Point3d
# ---------- ghpython_script_12: Python ----------
import Rhino.Geometry as rg

# visualize design geometry
breps = []
for i in iDesignGeo:
    brep = iModule.Duplicate()
    brep.Translate(i-iStartPosition)
    breps.append(brep)
    
oDesignGeo = breps
# ---------- end ghpython_script_12 ----------
ghpython_script_13 = GhPythonScript(
    iStartPosition=point_4,
    iModule=brep_3,
    iAvailable=visualize.oAvailable,
    iDeployed=visualize.oDeployed,
    iOccupied=visualize.oOccupied,
    iTargets=visualize.oTargets,
    iRobot=mesh_join,
    iRobotExtend=mesh_join_2,
    iAgentPos=visualize.oAgentPositions,
    iOrientations=visualize.oOrientations,
    iVec=vector_xyz.Vector,
    iExtends=visualize.oExtends,
    iEnters=visualize.oEnters,
    iSupports=visualize.oSupports,
    iPrevious=visualize.oPrevious,
    iWorkstate=visualize.oWorkstate)  # -> out, oDeployed, oOccupied, oAvailable, oTargets, oAgents, oSupports, oReplace, oPlace; inputs iStartPosition: Point3d, iModule: Brep, iAvailable: list of Point3d, iDeployed: list of Point3d, iOccupied: list of Point3d, iTargets: list of Point3d, iRobot: Mesh, iRobotExtend: Mesh, iAgentPos: list of Point3d, iOrientations: list, iVec: Vector3d, iExtends: list, iEnters: list of Boolean, iSupports: list of Point3d, iPrevious: list, iWorkstate: list
# ---------- ghpython_script_13: Python ----------
import Rhino.Geometry as rg

# visualize design geometry
deployed = []
for i in iDeployed:
    brep = iModule.Duplicate()
    brep.Translate(i-iStartPosition)
    deployed.append(brep)
    
occupied = []
for i in iOccupied:
    brep = iModule.Duplicate()
    brep.Translate(i-iStartPosition)
    occupied.append(brep)
    
available = []
for i in iAvailable:
    brep = iModule.Duplicate()
    brep.Translate(i-iStartPosition)
    available.append(brep)

supports = []
if len(iSupports)!=0:
    for i in iSupports:
        brep = iModule.Duplicate()
        brep.Translate(i-iStartPosition)
        supports.append(brep)
    
targets = []
for i in iTargets:
    if i != None:
        brep = iModule.Duplicate()
        brep.Translate(i-iStartPosition)
        targets.append(brep)
    
# orientation = [current vector, angle, plan normal]
agents = []
replace = []
place = []
for i, a in enumerate(iAgentPos):
    if a != None and iEnters[i]!= False:
        if iExtends[i] == True: # extend arm to deplooy
            brep = iRobotExtend.Duplicate()
        else:
            brep = iRobot.Duplicate()
            if iPrevious[i] == "disassemble" or iPrevious[i] == "remove":
                module = iModule.Duplicate()
                module.Translate(a-iStartPosition)
                replace.append(module)
            else:
                if iWorkstate[i] == "build":
                    module = iModule.Duplicate()
                    module.Translate(a-iStartPosition)
                    place.append(module)
        brep.Translate(a-iStartPosition)
        
        # rotate robot
        if iOrientations!=iVec:
            plane = rg.Plane(a, iVec, iOrientations[i])
            angle = rg.Vector3d.VectorAngle(iVec, iOrientations[i], plane)
            brep.Rotate(angle, plane.Normal, a)
            
        agents.append(brep)
    
oDeployed = deployed
oOccupied = occupied
oAvailable = available
oTargets = targets
oAgents = agents
oSupports = supports
oReplace = replace
oPlace = place
# ---------- end ghpython_script_13 ----------
colour_swatch = ColourSwatch(SwatchColor=RGBA(194, 255, 255, 10))  # disabled

panel_2 = Panel(visualize.oBuildstate)
ghpython_script_14 = GhPythonScript(x=brep_3)  # -> out, a; inputs x: Brep
# ---------- ghpython_script_14: Python ----------
import Rhino.Geometry as rg

mesh = rg.Mesh.CreateFromBrep(x)

a = mesh
# ---------- end ghpython_script_14 ----------
mesh_join_3 = MeshJoin(Meshes=ghpython_script_14.a)

# ---- group: design geometry
custom_preview = CustomPreview(Geometry=ghpython_script_12.oDesignGeo, Material=colour_swatch)  # disabled

# ---- group: built
custom_preview_2 = CustomPreview(
    Geometry=[ghpython_script_13.oDeployed, ghpython_script_13.oPlace],
    Material=ColourSwatch(SwatchColor=RGBA(125, 177, 255, 80)))

# ---- group: occupied
custom_preview_3 = CustomPreview(Geometry=ghpython_script_13.oOccupied, Material=ColourSwatch(SwatchColor=RGBA(38, 38, 38, 44)))

# ---- group: available for building
custom_preview_4 = CustomPreview(Geometry=ghpython_script_13.oAvailable, Material=ColourSwatch(SwatchColor=RGBA(98, 245, 44, 151)))

# ---- group: targets
custom_preview_5 = CustomPreview(Geometry=ghpython_script_13.oTargets, Material=ColourSwatch(SwatchColor=RGBA(255, 79, 138, 150)))

# ---- group: robots
custom_preview_6 = CustomPreview(Geometry=ghpython_script_13.oAgents, Material=ColourSwatch(SwatchColor=RGB(255, 0, 0)))

# ---- group: supports
custom_preview_7 = CustomPreview(
    Geometry=[ghpython_script_13.oSupports, ghpython_script_13.oReplace],
    Material=ColourSwatch(SwatchColor=RGBA(245, 231, 44, 151)))

# ---- group: Start position
curve_2 = Curve([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])
